# Dynamo graph DWG&PDF_export_RBP_messer.dyn (Dynamo 2.12.1.8246)
# packages: Genius Loci 2022.4.19, Clockwork for Dynamo 2.x 2.4.0, cata_lyst 0.0.1

# group: Filter
# note: filtering elements

# group: Error handling
# note: Treating errors as hints to user what to do to avoid the error

návod = StringInput("vyexportuje DWG a PDF súbory z aktívneho dokumentu - nastavene len pre Messer. Pripravené pre Autoexport cez RBP")  # graph input

# group: INPUT
code_block = CodeBlock { "\\\\pantograph\\Google_Drive_Home_Office\\A13 MESSER\\AutoExport"; }
sheet_list = CodeBlock { "DSP_VYKRESY"; }
dwg_export_setup = CodeBlock { "EXPORT Slepáky"; }

code_block_2 = CodeBlock(folder=code_block) { folder + "\\DWG"; }
current = Document.Current()
viewsheetset_byname = Custom[ViewSheetSet ByName](ViewSheetSetName=sheet_list, docOrRevitLinkInstance=current)  # package Genius Loci; Collect ViewSheetSet by given name in the active or given document.
views = Custom[ViewSheetSet.Views](viewsSheetSet=viewsheetset_byname)  # package Clockwork for Dynamo 2.x; Retrieves all the views/sheets in a given view/sheet set.
code_block_3 = CodeBlock { "P085-BPD-B10-E1.1-"; "_"; }
code_block_4 = CodeBlock { "Drawing type"; }
getParameterValueByName = Element.GetParameterValueByName(element=views, parameterName=code_block_4)
code_block_5 = CodeBlock { "lokalizacia"; }
getParameterValueByName_2 = Element.GetParameterValueByName(element=views, parameterName=code_block_5)
code_block_6 = CodeBlock { "Sheet Number"; }
getParameterValueByName_3 = Element.GetParameterValueByName(element=views, parameterName=code_block_6)
code_block_7 = CodeBlock { "Sheet Name"; }
getParameterValueByName_4 = Element.GetParameterValueByName(element=views, parameterName=code_block_7)

# group: remove accents
stripAccents = Custom[stripAccents](input=getParameterValueByName_4)  # package cata_lyst; strip accents from the strings

viewname_generator = CodeBlock(project_prefix=code_block_3.out0, drawingtype=getParameterValueByName, lokalizacia=getParameterValueByName_2, sheetnumber=getParameterValueByName_3, sheetname=stripAccents) { project_prefix+drawingtype+"-"+lokalizacia+"-"+sheetnumber+"-"+sheetname; }

# group: replace space for underscore
py_string_replacer = Python(IN[0]=viewname_generator)  # IronPython2
# ---------- py_string_replacer.python (17 lines) ----------
# Load the Python Standard and DesignScript Libraries
import sys
import clr
clr.AddReference('ProtoGeometry')
from Autodesk.DesignScript.Geometry import *

# The inputs to this node will be stored as a list in the IN variables.
data = IN[0]

# Place your code below this line
replaced = []
for text in data:
	replaced_text = text.replace(" ","_")
	replaced.append(replaced_text)
	
# Assign your output to the OUT variable.
OUT = replaced
# ----------------------------------------

boolean = BoolSelector(false)
boolean_2 = BoolSelector(true)
export_dwg_in_document = Custom[Export DWG in Document](DirectoryPath=code_block_2, view=views, Filename=py_string_replacer, ExportSetup=dwg_export_setup, SharedCoords=boolean, MergeViews=boolean_2, RunIt=boolean_2)  # package Genius Loci; Export views to DWG with export setup in the active or given document. Based on a script by Konrad K Sobon.

# group: OUTPUT
# note: Place output for Dynamo Player
OUTPUT = Watch(export_dwg_in_document)  # graph output

# group: opens all worksets without links
py_workset_opener = Python(IN[0]=code_block_2)  # IronPython2; frozen
# ---------- py_workset_opener.python (50 lines) ----------
# this script opens all worksets which doesn't have "link" in their name
# Load the Python Standard and DesignScript Libraries
import sys
import clr
clr.AddReference('ProtoGeometry')
from Autodesk.DesignScript.Geometry import *

clr.AddReference("RevitServices")
clr.AddReference("RevitAPI")
import RevitServices
from RevitServices.Persistence import DocumentManager
from Autodesk.Revit import DB
from Autodesk.Revit.DB.Document import GetElement

doc = DocumentManager.Instance.CurrentDBDocument
uiapp = DocumentManager.Instance.CurrentUIApplication
app = uiapp.Application
uidoc = DocumentManager.Instance.CurrentUIApplication.ActiveUIDocument

rooms = DB.FilteredElementCollector(doc).OfCategory(DB.BuiltInCategory.OST_Rooms).WhereElementIsNotElementType().ToElements()


# opening worksets with "link" not in the name
if doc.IsWorkshared:
    ws_collector = DB.FilteredWorksetCollector(doc)\
                     .OfKind(DB.WorksetKind.UserWorkset)\
                     .ToWorksets()

    for ws in ws_collector:
        if "link" not in ws.Name.lower():
            # get all elements in a workset
            filter = DB.ElementWorksetFilter(ws.Id)
            ws_elems = DB.FilteredElementCollector(doc)\
                         .WherePasses(filter)\
                         .WhereElementIsNotElementType()\
                         .ToElements()
            if ws_elems:
                # get first element in a workset
                first_elem_id = ws_elems[0].Id
                uidoc.ShowElements(doc.GetElement(first_elem_id))

# filtering out 3D view with the name which contains "Dalux"
#collector = DB.FilteredElementCollector(doc).OfClass(DB.View)
#filtered_views = []
#for view in collector:
#    if view.Name.Contains("Dalux"):
#        filtered_views.append(view)
# opening the view
#uidoc.RequestViewChange(filtered_views[0])
OUT = IN[0]
# ----------------------------------------

projectInfo = Custom[Document.ProjectInfo]()  # package Clockwork for Dynamo 2.x; Gets the project information.

# group: cut parameter
py_string_cutter = Python(IN[0]=projectInfo.BuildingName)  # IronPython2
# ---------- py_string_cutter.python (13 lines) ----------
# Load the Python Standard and DesignScript Libraries
import sys
import clr
clr.AddReference('ProtoGeometry')
from Autodesk.DesignScript.Geometry import *

# The inputs to this node will be stored as a list in the IN variables.
data = IN[0]

# Place your code below this line
splitdata = data.split("_")
# Assign your output to the OUT variable.
OUT = splitdata[0]
# ----------------------------------------

code_block_8 = CodeBlock(folder=code_block) { folder + "\\PDF"; }
current_2 = Document.Current()
viewsheetset_byname_2 = Custom[ViewSheetSet ByName](ViewSheetSetName=sheet_list, docOrRevitLinkInstance=current_2)
views_2 = Custom[ViewSheetSet.Views](viewsSheetSet=viewsheetset_byname_2)
code_block_9 = CodeBlock { "P085-BPD-B10-E1.1-"; "_"; }
code_block_10 = CodeBlock { "Drawing type"; }
getParameterValueByName_5 = Element.GetParameterValueByName(element=views_2, parameterName=code_block_10)
code_block_11 = CodeBlock { "lokalizacia"; }
getParameterValueByName_6 = Element.GetParameterValueByName(element=views_2, parameterName=code_block_11)
code_block_12 = CodeBlock { "Sheet Number"; }
getParameterValueByName_7 = Element.GetParameterValueByName(element=views_2, parameterName=code_block_12)
code_block_13 = CodeBlock { "Sheet Name"; }
getParameterValueByName_8 = Element.GetParameterValueByName(element=views_2, parameterName=code_block_13)

# group: remove accents
stripAccents_2 = Custom[stripAccents](input=getParameterValueByName_8)

viewname_generator_2 = CodeBlock(project_prefix=code_block_9.out0, drawingtype=getParameterValueByName_5, lokalizacia=getParameterValueByName_6, sheetnumber=getParameterValueByName_7, sheetname=stripAccents_2) { project_prefix+drawingtype+"-"+lokalizacia+"-"+sheetnumber+"-"+sheetname; }

# group: replace space for underscore
py_string_replacer_2 = Python(IN[0]=viewname_generator_2)  # IronPython2; same code as py_string_replacer

export_pdf = Python(IN[0]=code_block_8, IN[1]=views_2, IN[2]=py_string_replacer_2)  # IronPython2; unwired: IN[3]
# ---------- export_pdf.python (51 lines) ----------
#Inspired by Sean Page, 2022 https://forum.dynamobim.com/t/export-pdf-in-revit-2022-quick-example/62697
import clr
clr.AddReference('RevitAPI')
from Autodesk.Revit.DB import *

clr.AddReference('System')
from System.Collections.Generic import List

clr.AddReference('RevitServices')
import RevitServices
from RevitServices.Persistence import DocumentManager
doc = DocumentManager.Instance.CurrentDBDocument

Folder = IN[0]
sheets = UnwrapElement(IN[1]) if isinstance(IN[1],list) else [UnwrapElement(IN[1])]
names = IN[2] if isinstance(IN[2],list) else [IN[2]]
result = []

opts = PDFExportOptions()
opts.ExportQuality = PDFExportQualityType.DPI600
#This will use the TitleBlock size to create the sheet size
opts.PaperFormat = ExportPaperFormat.Default
#This will use a specific size for every view exported
#opts.PaperFormat = ExportPaperFormat.ARCH_E1
opts.ZoomType = ZoomType.Zoom
opts.ZoomPercentage = 100
opts.HideCropBoundaries = True
opts.HideReferencePlane = True
opts.HideScopeBoxes = True
opts.HideUnreferencedViewTags = False
opts.MaskCoincidentLines = True
opts.ViewLinksInBlue = False
opts.ColorDepth = ColorDepthType.Color
#Don't think of this as a "continue" but rather as a silent mode
opts.StopOnError = False
#Make sure to not use these settings as they don't work if 'Default' size is used above
#opts.PaperPlacement = PaperPlacementType.LowerLeft

if IN[3] == True:
	opts.Combine = True
	opts.FileName = names[0]
	sheetId = List[ElementId](x.Id for x in sheets)
	result=doc.Export(Folder,sheetId,opts)
else:
	for sheet,name in zip(sheets,names):
		opts.FileName = name
		sheetId = List[ElementId]()
		sheetId.Add(sheet.Id)
		result.append(doc.Export(Folder,sheetId,opts))
	
OUT = result
# ----------------------------------------

# group: OUTPUT
# note: Place output for Dynamo Player
OUTPUT_2 = Watch(export_pdf)  # graph output

exportPDF = Custom[ExportPDF]()  # frozen; package Genius Loci; Works only in Revit 2022 and later. Exports a selection of views in PDF format.; unwired: DirectoryPath, view, Filename
tempTest = CodeBlock { "\\\\pantograph\\Google_Drive_Home_Office\\A13 MESSER\\AutoExport\\corr"; }
