# Dynamo graph DWG_export_RBP_messer.dyn (Dynamo 2.12.1.8246)
# packages: Genius Loci 2022.4.19, Clockwork for Dynamo 2.x 2.4.0, cata_lyst 0.0.1

# group: Filter
# note: filtering elements

# group: Error handling
# note: Treating errors as hints to user what to do to avoid the error

návod = StringInput("vyexportuje DWG súbory z aktívneho dokumentu - nastavene len pre Messer")  # graph input

# group: INPUT
code_block = CodeBlock { "C:\\Users\\panto\\OneDrive\\Počítač\\workExport\\messer\\DWG"; }
sheet_list = CodeBlock { "DSP_VYKRESY"; }
dwg_export_setup = CodeBlock { "EXPORT Slepáky"; }

current = Document.Current()
viewsheetset_byname = Custom[ViewSheetSet ByName](ViewSheetSetName=sheet_list, docOrRevitLinkInstance=current)  # package Genius Loci; Collect ViewSheetSet by given name in the active or given document.
views = Custom[ViewSheetSet.Views](viewsSheetSet=viewsheetset_byname)  # package Clockwork for Dynamo 2.x; Retrieves all the views/sheets in a given view/sheet set.
code_block_2 = CodeBlock { "P085-BPD-B10-E1.1-"; "_"; }
code_block_3 = CodeBlock { "Drawing type"; }
getParameterValueByName = Element.GetParameterValueByName(element=views, parameterName=code_block_3)
code_block_4 = CodeBlock { "lokalizacia"; }
getParameterValueByName_2 = Element.GetParameterValueByName(element=views, parameterName=code_block_4)
code_block_5 = CodeBlock { "Sheet Number"; }
getParameterValueByName_3 = Element.GetParameterValueByName(element=views, parameterName=code_block_5)
code_block_6 = CodeBlock { "Sheet Name"; }
getParameterValueByName_4 = Element.GetParameterValueByName(element=views, parameterName=code_block_6)

# group: remove accents
stripAccents = Custom[stripAccents](input=getParameterValueByName_4)  # package cata_lyst; strip accents from the strings

viewname_generator = CodeBlock(project_prefix=code_block_2.out0, drawingtype=getParameterValueByName, lokalizacia=getParameterValueByName_2, sheetnumber=getParameterValueByName_3, sheetname=stripAccents) { project_prefix+drawingtype+"-"+lokalizacia+"-"+sheetnumber+"-"+sheetname; }

# group: replace space for underscore
py_string_replacer = Python(IN[0]=viewname_generator)  # IronPython2
# ---------- py_string_replacer.python (17 lines) ----------
# Load the Python Standard and DesignScript Libraries
import sys
import clr
clr.AddReference('ProtoGeometry')
from Autodesk.DesignScript.Geometry import *

# The inputs to this node will be stored as a list in the IN variables.
data = IN[0]

# Place your code below this line
replaced = []
for text in data:
	replaced_text = text.replace(" ","_")
	replaced.append(replaced_text)
	
# Assign your output to the OUT variable.
OUT = replaced
# ----------------------------------------

boolean = BoolSelector(false)
boolean_2 = BoolSelector(true)
export_dwg_in_document = Custom[Export DWG in Document](DirectoryPath=code_block, view=views, Filename=py_string_replacer, ExportSetup=dwg_export_setup, SharedCoords=boolean, MergeViews=boolean_2, RunIt=boolean_2)  # frozen; package Genius Loci; Export views to DWG with export setup in the active or given document. Based on a script by Konrad K Sobon.

# group: OUTPUT
# note: Place output for Dynamo Player
OUTPUT = Watch(export_dwg_in_document)  # graph output

# group: opens all worksets without links
py_workset_opener = Python(IN[0]=code_block)  # IronPython2; frozen
# ---------- py_workset_opener.python (50 lines) ----------
# this script opens all worksets which doesn't have "link" in their name
# Load the Python Standard and DesignScript Libraries
import sys
import clr
clr.AddReference('ProtoGeometry')
from Autodesk.DesignScript.Geometry import *

clr.AddReference("RevitServices")
clr.AddReference("RevitAPI")
import RevitServices
from RevitServices.Persistence import DocumentManager
from Autodesk.Revit import DB
from Autodesk.Revit.DB.Document import GetElement

doc = DocumentManager.Instance.CurrentDBDocument
uiapp = DocumentManager.Instance.CurrentUIApplication
app = uiapp.Application
uidoc = DocumentManager.Instance.CurrentUIApplication.ActiveUIDocument

rooms = DB.FilteredElementCollector(doc).OfCategory(DB.BuiltInCategory.OST_Rooms).WhereElementIsNotElementType().ToElements()


# opening worksets with "link" not in the name
if doc.IsWorkshared:
    ws_collector = DB.FilteredWorksetCollector(doc)\
                     .OfKind(DB.WorksetKind.UserWorkset)\
                     .ToWorksets()

    for ws in ws_collector:
        if "link" not in ws.Name.lower():
            # get all elements in a workset
            filter = DB.ElementWorksetFilter(ws.Id)
            ws_elems = DB.FilteredElementCollector(doc)\
                         .WherePasses(filter)\
                         .WhereElementIsNotElementType()\
                         .ToElements()
            if ws_elems:
                # get first element in a workset
                first_elem_id = ws_elems[0].Id
                uidoc.ShowElements(doc.GetElement(first_elem_id))

# filtering out 3D view with the name which contains "Dalux"
#collector = DB.FilteredElementCollector(doc).OfClass(DB.View)
#filtered_views = []
#for view in collector:
#    if view.Name.Contains("Dalux"):
#        filtered_views.append(view)
# opening the view
#uidoc.RequestViewChange(filtered_views[0])
OUT = IN[0]
# ----------------------------------------

projectInfo = Custom[Document.ProjectInfo]()  # package Clockwork for Dynamo 2.x; Gets the project information.

# group: cut parameter
py_string_cutter = Python(IN[0]=projectInfo.BuildingName)  # IronPython2
# ---------- py_string_cutter.python (13 lines) ----------
# Load the Python Standard and DesignScript Libraries
import sys
import clr
clr.AddReference('ProtoGeometry')
from Autodesk.DesignScript.Geometry import *

# The inputs to this node will be stored as a list in the IN variables.
data = IN[0]

# Place your code below this line
splitdata = data.split("_")
# Assign your output to the OUT variable.
OUT = splitdata[0]
# ----------------------------------------
