# Dynamo graph IFC_export_RBPv2.dyn (Dynamo 2.12.0.5650)
# packages: Genius Loci 2021.11.10

# group: Filter
# note: filtering elements

# group: Error handling
# note: Treating errors as hints to user what to do to avoid the error

návod = StringInput("""vyexportuje IFC súbor z aktívneho dokumentu

Je potrebné mať nainštalovaný Package Genius Loci""")  # graph input
code_block = CodeBlock { "C:\\Users\\davidv\\Desktop\\test\\ifc\\exportKLG"; }

# group: opens all worksets without links
py_workset_opener = Python(IN[0]=code_block)  # IronPython2
# ---------- py_workset_opener.python (50 lines) ----------
# this script opens all worksets which doesn't have "link" in their name
# Load the Python Standard and DesignScript Libraries
import sys
import clr
clr.AddReference('ProtoGeometry')
from Autodesk.DesignScript.Geometry import *

clr.AddReference("RevitServices")
clr.AddReference("RevitAPI")
import RevitServices
from RevitServices.Persistence import DocumentManager
from Autodesk.Revit import DB
from Autodesk.Revit.DB.Document import GetElement

doc = DocumentManager.Instance.CurrentDBDocument
uiapp = DocumentManager.Instance.CurrentUIApplication
app = uiapp.Application
uidoc = DocumentManager.Instance.CurrentUIApplication.ActiveUIDocument

rooms = DB.FilteredElementCollector(doc).OfCategory(DB.BuiltInCategory.OST_Rooms).WhereElementIsNotElementType().ToElements()


# opening worksets with "link" not in the name
if doc.IsWorkshared:
    ws_collector = DB.FilteredWorksetCollector(doc)\
                     .OfKind(DB.WorksetKind.UserWorkset)\
                     .ToWorksets()

    for ws in ws_collector:
        if "link" not in ws.Name.lower():
            # get all elements in a workset
            filter = DB.ElementWorksetFilter(ws.Id)
            ws_elems = DB.FilteredElementCollector(doc)\
                         .WherePasses(filter)\
                         .WhereElementIsNotElementType()\
                         .ToElements()
            if ws_elems:
                # get first element in a workset
                first_elem_id = ws_elems[0].Id
                uidoc.ShowElements(doc.GetElement(first_elem_id))

# filtering out 3D view with the name which contains "Dalux"
#collector = DB.FilteredElementCollector(doc).OfClass(DB.View)
#filtered_views = []
#for view in collector:
#    if view.Name.Contains("Dalux"):
#        filtered_views.append(view)
# opening the view
#uidoc.RequestViewChange(filtered_views[0])
OUT = IN[0]
# ----------------------------------------

py_view_finder_ifc = Python()  # IronPython2
# ---------- py_view_finder_ifc.python (26 lines) ----------
# this script opens all worksets which doesn't have "link" in their name
# Load the Python Standard and DesignScript Libraries
import sys
import clr
clr.AddReference('ProtoGeometry')
from Autodesk.DesignScript.Geometry import *

clr.AddReference("RevitServices")
clr.AddReference("RevitAPI")
import RevitServices
from RevitServices.Persistence import DocumentManager
from Autodesk.Revit import DB

doc = DocumentManager.Instance.CurrentDBDocument
uiapp = DocumentManager.Instance.CurrentUIApplication
app = uiapp.Application
uidoc = DocumentManager.Instance.CurrentUIApplication.ActiveUIDocument

collector = DB.FilteredElementCollector(doc).OfClass(DB.View)
filtered_views = []
for view in collector:
    if view.Name.Contains("IFC"):
        filtered_views.append(view)
    elif view.Name.Contains("Dalux"):
        filtered_views.append(view)
OUT = filtered_views[0]
# ----------------------------------------
py_getdocnamev2 = Python()  # IronPython2
# ---------- py_getdocnamev2.python (64 lines) ----------
# Load the Python Standard and DesignScript Libraries
import sys
import clr
clr.AddReference('ProtoGeometry')
from Autodesk.DesignScript.Geometry import *

clr.AddReference("RevitServices")
clr.AddReference("RevitAPI")
import RevitServices
from RevitServices.Persistence import DocumentManager

# The inputs to this node will be stored as a list in the IN variables.

# Place your code below this line
doc = DocumentManager.Instance.CurrentDBDocument
uiapp = DocumentManager.Instance.CurrentUIApplication
app = uiapp.Application
uidoc = DocumentManager.Instance.CurrentUIApplication.ActiveUIDocument

def userNamePurge(file_name):
    def centralPathSplitter(new_file_name):
        file_path_split = new_file_name.split("/")
        new_file_name = file_path_split[-1]
        return new_file_name + extension

    def pathSplitter(new_file_name):
        file_path_split = file_name.split("\\")
        new_file_name = file_path_split[-1]
        return new_file_name

    # userName and detached purge
    revit_user_name = "davidv"
    file_path_split_name = file_name.split("_")

    # extension extraction
    file_path_split_ext = file_name.split(".")
    extension = "."+file_path_split_ext[-1]

    if file_path_split_name[-1] == "detached.rvt" and file_path_split_name[-2] == revit_user_name:
        file_name_list = file_path_split_name[0:-2]
        new_file_name = "_".join(file_name_list)
        centralPath = centralPathSplitter(new_file_name)
    elif file_path_split_name[-1] == "detached.rvt":
        file_name_list = file_path_split_name[0:-1]
        new_file_name = "_".join(file_name_list)
        centralPath = centralPathSplitter(new_file_name)
    elif file_path_split_name[-1] == revit_user_name + ".rvt":
        file_name_list = file_path_split_name[0:-1]
        new_file_name = "_".join(file_name_list)
        centralPath = centralPathSplitter(new_file_name)
    else:
        file_name_list = file_path_split_name
        new_file_name = "_".join(file_name_list)
        centralPath = pathSplitter(new_file_name)

    return centralPath

name = doc.PathName
if not name:
    name = "Not saved file"
# workshared file
fileName = userNamePurge(name)
# Assign your output to the OUT variable.
OUT = fileName[:-4]
# ----------------------------------------
code_block_2 = CodeBlock { "0"; }
export_ifc = Custom[Export IFC](DirectoryPath=py_workset_opener, view=py_view_finder_ifc, Filename=py_getdocnamev2, ProjectOrigin=code_block_2)  # package Genius Loci; Export View to IFC file in the active document. For use with the Select Phase node. Some other IFC options are embedded inside the python script.

# group: OUTPUT
# note: Place output for Dynamo Player
OUTPUT = Watch(export_ifc)  # graph output
