# Dynamo graph NWCexport_RBP.dyn "NWCexportV2" (Dynamo 2.12.0.5650)

# group: Converting Path to string
directory_path = Directory("C:\Users\davidv\Desktop\export\NWC")
directory_from_path = DirectoryObject(path=directory_path)
string_from_object = FromObject(obj=directory_from_path)

# group: Getting a list of all Views
categories = Categories("OST_Views")  # graph input
all_elements_of_category = ElementsOfCategory(Category=categories)

# group: Search for the keyword in the view name
name = Element.Name(element=all_elements_of_category)
code_block = CodeBlock { "NWC"; }
contains = String.Contains(string=name, searchFor=code_block)

filterByBoolMask = List.FilterByBoolMask(list=all_elements_of_category, mask=contains)
py_get_name_dettached_file = Python()  # IronPython2; unwired: IN[0]
# ---------- py_get_name_dettached_file.python (33 lines) ----------
# Load the Python Standard and DesignScript Libraries
import sys
import clr
clr.AddReference('ProtoGeometry')
from Autodesk.DesignScript.Geometry import *
clr.AddReference("RevitServices")
import RevitServices
from RevitServices.Persistence import DocumentManager

from datetime import datetime

#import custom library
import sys
sys.path.append(r"U:\REVIT\Dynamo\Lib")
import ctypes
from catalyst import dyn_log_path, dyn_logger

# name of the script for log
script_name = IN[0]

doc = DocumentManager.Instance.CurrentDBDocument
app = DocumentManager.Instance.CurrentUIApplication.Application
filePath = doc.PathName

# getting file name from path
try:
	lastBackslash = filePath.rindex("\\")+1
	file_name = filePath[lastBackslash:]
except ValueError:
	file_name = filePath

# Assign your output to the OUT variable.
OUT = file_name
# ----------------------------------------

# group: Exporting NWC of views with keyword
any_3d_view_from_a_list_to_nwc = Python(IN[0]=string_from_object, IN[1]=filterByBoolMask.in, IN[2]=py_get_name_dettached_file)  # IronPython2
# ---------- any_3d_view_from_a_list_to_nwc.python (33 lines) ----------
import clr

clr.AddReference('ProtoGeometry')
from Autodesk.DesignScript.Geometry import*

clr.AddReference('RevitAPI')
from Autodesk.Revit.DB import*

clr.AddReference('RevitServices')
from RevitServices.Persistence import DocumentManager

import System
from System.Collections.Generic import *

doc = DocumentManager.Instance.CurrentDBDocument

folder = IN[0]
names = IN[1]
docname= IN[2]

collector = FilteredElementCollector(doc).OfClass(View)
options = NavisworksExportOptions()
options.ExportScope = NavisworksExportScope.View
options.ExportLinks = True

OUT = []
for i in names:
    viewstring = i.Name
    OUT.append(viewstring)
    for view in collector:
        if (view.ViewType == ViewType.ThreeD and view.Name.Contains(viewstring)):
            options.ViewId = view.Id
            doc.Export(folder, docname + "_" + view.Name + ".nwc", options)
# ----------------------------------------

návod = StringInput("vyexportuje NWC subory, ktore zo vsetkych views ktore obsahuju retazec NWC do zvoleneho priecinka")  # graph input
