# Dynamo graph pbi_project_schedules_RBP.dyn "pbi_schedules1801_RSN" (Dynamo 2.12.0.5650)
# packages: cata_lyst 0.0.1

element_types = ElementTypes("ViewSchedule")
all_elements_of_type = ElementsOfType(element_type=element_types)
code_block = CodeBlock { "U:\\1801_Klingerka II\\06_PSP\\03_Projekt\\10_PBI"; }

# group: INPUT
view_name_starts_with = StringInput("PBI skladby")  # graph input
code_block_2 = CodeBlock(path=code_block) { path+"\\skladby\\data"; }

# group: FILTER
code_block_3 = CodeBlock { "View Name"; }
getParameterValueByName = Element.GetParameterValueByName(element=all_elements_of_type, parameterName=code_block_3)
startsWith = String.StartsWith(string=getParameterValueByName, searchFor=view_name_starts_with)
filterByBoolMask = List.FilterByBoolMask(list=all_elements_of_type, mask=startsWith)

name = Element.Name(element=filterByBoolMask.in)
code_block_4 = CodeBlock(FileName=name) { FileName + ".txt"; }
python_script = Python(IN[0]=filterByBoolMask.in, IN[1]=code_block_2, IN[2]=code_block_4)  # IronPython2
# ---------- python_script.python (18 lines) ----------
import clr
clr.AddReference("RevitAPI")
from Autodesk.Revit.DB import *

schedule_list = IN[0]
path = IN[1]
filename_list = IN[2]
result_list = []

for index, sched in enumerate(schedule_list):
	schedule = UnwrapElement(sched)
	filename = filename_list[index]
	try:
		export_options = ViewScheduleExportOptions()
		schedule.Export(path, filename, export_options)
		result_list.append("Schedule Exported ")
	except: result_list.append("Failure ")
OUT = result_list
# ----------------------------------------
status = Watch(python_script)
návod = StringInput("Vyexportuje vsetky tabulky zacinajuce danym retazcom do samostatnych txt suborov do urceneho folderu.")  # graph input
element_types_2 = ElementTypes("ViewSchedule")
all_elements_of_type_2 = ElementsOfType(element_type=element_types_2)

# group: INPUT
view_name_starts_with_2 = StringInput("PBI_vykaz miestnosti")  # graph input
code_block_5 = CodeBlock(path=code_block) { path+"\\Rooms\\data"; }

# group: FILTER
code_block_6 = CodeBlock { "View Name"; }
getParameterValueByName_2 = Element.GetParameterValueByName(element=all_elements_of_type_2, parameterName=code_block_6)
startsWith_2 = String.StartsWith(string=getParameterValueByName_2, searchFor=view_name_starts_with_2)
filterByBoolMask_2 = List.FilterByBoolMask(list=all_elements_of_type_2, mask=startsWith_2)

name_2 = Element.Name(element=filterByBoolMask_2.in)
code_block_7 = CodeBlock(FileName=name_2) { FileName + ".txt"; }
python_script_2 = Python(IN[0]=filterByBoolMask_2.in, IN[1]=code_block_5, IN[2]=code_block_7)  # IronPython2; same code as python_script
status_2 = Watch(python_script_2)

# group: INPUT
path = StringInput("U:\1801_Klingerka II\06_PSP\03_Projekt\10_PBI\parking\parkovacieMiesta\data")
view_name_starts_with_3 = StringInput("PBI_Výkaz parkovacích miest")  # graph input
code_block_8 = CodeBlock(path=code_block) { path+"\\parking\\parkovacieMiesta\\data"; }

element_types_3 = ElementTypes("ViewSchedule")
all_elements_of_type_3 = ElementsOfType(element_type=element_types_3)

# group: FILTER
code_block_9 = CodeBlock { "View Name"; }
getParameterValueByName_3 = Element.GetParameterValueByName(element=all_elements_of_type_3, parameterName=code_block_9)
startsWith_3 = String.StartsWith(string=getParameterValueByName_3, searchFor=view_name_starts_with_3)
filterByBoolMask_3 = List.FilterByBoolMask(list=all_elements_of_type_3, mask=startsWith_3)

name_3 = Element.Name(element=filterByBoolMask_3.in)
code_block_10 = CodeBlock(FileName=name_3) { FileName + ".txt"; }
python_script_3 = Python(IN[0]=filterByBoolMask_3.in, IN[1]=code_block_8, IN[2]=code_block_10)  # IronPython2; same code as python_script
status_3 = Watch(python_script_3)
code_block_11 = CodeBlock { "schedulesExport1801_RSN"; }
usageLog = Custom[usageLog](scriptName=code_block_11)  # package cata_lyst; node logs every run of the script in which is used to the hardcoded server location
element_types_4 = ElementTypes("ViewSchedule")
all_elements_of_type_4 = ElementsOfType(element_type=element_types_4)

# group: INPUT
view_name_starts_with_4 = StringInput("PBI materialy")  # graph input
code_block_12 = CodeBlock(path=code_block) { path+"\\materials\\data"; }

# group: FILTER
code_block_13 = CodeBlock { "View Name"; }
getParameterValueByName_4 = Element.GetParameterValueByName(element=all_elements_of_type_4, parameterName=code_block_13)
startsWith_4 = String.StartsWith(string=getParameterValueByName_4, searchFor=view_name_starts_with_4)
filterByBoolMask_4 = List.FilterByBoolMask(list=all_elements_of_type_4, mask=startsWith_4)

name_4 = Element.Name(element=filterByBoolMask_4.in)
code_block_14 = CodeBlock(FileName=name_4) { FileName + ".txt"; }
python_script_4 = Python(IN[0]=filterByBoolMask_4.in, IN[1]=code_block_12, IN[2]=code_block_14)  # IronPython2; same code as python_script
status_4 = Watch(python_script_4)
element_types_5 = ElementTypes("ViewSchedule")
all_elements_of_type_5 = ElementsOfType(element_type=element_types_5)

# group: INPUT
view_name_starts_with_5 = StringInput("PBI_indexy zelene")  # graph input
code_block_15 = CodeBlock(path=code_block) { path+"\\indexyZelene\\data"; }

# group: FILTER
code_block_16 = CodeBlock { "View Name"; }
getParameterValueByName_5 = Element.GetParameterValueByName(element=all_elements_of_type_5, parameterName=code_block_16)
startsWith_5 = String.StartsWith(string=getParameterValueByName_5, searchFor=view_name_starts_with_5)
filterByBoolMask_5 = List.FilterByBoolMask(list=all_elements_of_type_5, mask=startsWith_5)

name_5 = Element.Name(element=filterByBoolMask_5.in)
code_block_17 = CodeBlock(FileName=name_5) { FileName + ".txt"; }
python_script_5 = Python(IN[0]=filterByBoolMask_5.in, IN[1]=code_block_15, IN[2]=code_block_17)  # IronPython2; same code as python_script
status_5 = Watch(python_script_5)
