# Dynamo graph pbi_roomData_RBP.dyn "pbi_roomData_RSN" (Dynamo 2.3.0.5885)
# packages: cata_lyst 0.0.1

# group: INPUT
# note: Place inputs for Dynamo Player

# group: Filter
# note: filtering elements

# group: Error handling
# note: Treating errors as hints to user what to do to avoid the error

návod = StringInput("""Návod, ktorý uvidí používateľ v Dynamo Playeri.

Je potrebné mať nainštalované packages...""")  # graph input

# group: OUTPUT
# note: Place output for Dynamo Player
OUTPUT = Watch()  # graph output; unwired: arg0

# note: Logovanie pre analytiku
# uprav nazov skriptu
code_block = CodeBlock { "pbi_roomData_RSN"; }
usageLog = Custom[usageLog](scriptName=code_block)  # package cata_lyst; node logs every run of the script in which is used to the hardcoded server location
py_filterelementcollector = Python()
# ---------- py_filterelementcollector.python (24 lines) ----------
# Load the Python Standard and DesignScript Libraries
import sys
import clr
clr.AddReference('ProtoGeometry')
from Autodesk.DesignScript.Geometry import *

clr.AddReference("RevitServices")
clr.AddReference("RevitAPI")
import RevitServices
from RevitServices.Persistence import DocumentManager
from Autodesk.Revit import DB

doc = DocumentManager.Instance.CurrentDBDocument
uiapp = DocumentManager.Instance.CurrentUIApplication
app = uiapp.Application

rooms = DB.FilteredElementCollector(doc).OfCategory(DB.BuiltInCategory.OST_Rooms).WhereElementIsNotElementType().ToElements()
areas = []
for room in rooms:
	area = room.LookupParameter("Area").AsDouble()
	areas.append(area*0.3048*0.3048)

# Assign your output to the OUT variable.
OUT = areas
# ----------------------------------------
code_block_2 = CodeBlock()
# ---------- code_block_2.designscript (22 lines) ----------
["Number",
"Name",
"Comments",
"Occupancy",
"Department",
"Base Finish",
"Ceiling Finish",
"Wall Finish",
"Ext_Int",
"Room Number short",
"Cislo Bytu",
"Stavebny Objekt",
"Stavebny Objekt KOD",
"Level",
"Base Offset",
"Poznamka",
"S.V. po podhlad",
"Area",
"Volume",
"Computation Height",
"Floor Finish",
"Workset"];
# ----------------------------------------
py_filterelementcollector_rooms = Python()
# ---------- py_filterelementcollector_rooms.python (21 lines) ----------
# Load the Python Standard and DesignScript Libraries
import sys
import clr
clr.AddReference('ProtoGeometry')
from Autodesk.DesignScript.Geometry import *

clr.AddReference("RevitServices")
clr.AddReference("RevitAPI")
import RevitServices
from RevitServices.Persistence import DocumentManager
from Autodesk.Revit import DB

doc = DocumentManager.Instance.CurrentDBDocument
uiapp = DocumentManager.Instance.CurrentUIApplication
app = uiapp.Application

rooms = DB.FilteredElementCollector(doc).OfCategory(DB.BuiltInCategory.OST_Rooms).WhereElementIsNotElementType().ToElements()


# Assign your output to the OUT variable.
OUT = rooms
# ----------------------------------------
getParameterValueByName = Element.GetParameterValueByName(element=py_filterelementcollector_rooms, parameterName=code_block_2@L1)
transpose = List.Transpose(lists=getParameterValueByName)
addItemToFront = List.AddItemToFront(item=code_block_2, list=transpose)
code_block_3 = CodeBlock { "C:\\batch\\testFiles\\roomDataJson\\"; }
current = Document.Current()
filePath = Document.FilePath(document=current)
code_block_4 = CodeBlock { false; }
fileName = FileSystem.FileName(path=filePath, withExtension=code_block_4)
code_block_5 = CodeBlock(folder=code_block_3, filename=fileName) { folder+filename+".json"; }
stringifyJSON = Data.StringifyJSON(values=transpose)
writeText = FileSystem.WriteText(filePath=code_block_5, text=stringifyJSON)
