# Dynamo custom node Number2integerString.dyf (Dynamo 2.12.1.8246)
# category: catalyst.dataManipulation
# Converts number to string with no decimal numbers

num = Input(num: var[])
python_script = Python(IN[0]=num)  # IronPython2
# ---------- python_script.python (24 lines) ----------
# Load the Python Standard and DesignScript Libraries
import sys
import clr
clr.AddReference('ProtoGeometry')
from Autodesk.DesignScript.Geometry import *

# The inputs to this node will be stored as a list in the IN variables.
data = IN[0]
output = []
# Place your code below this line
for i in data:
	# convert to string
	string_i = str(i)
	# if english locale with comma as decimal point
	if string_i.find(".") > -1:
		split_string = string_i.Split(".")
	# if another locale	
	else:
		split_string = string_i.Split(",")
	
	output.append(split_string[0])
		
# Assign your output to the OUT variable.
OUT = output
# ----------------------------------------
OUT = Output(python_script)
