# Dynamo custom node StringToSentenceCase.dyf (Dynamo 2.12.1.8246)
# category: catalyst.dataManipulation
# convert string to Sentence case

input = Input(input: string)
py_sentence_case = Python(IN[0]=input)  # IronPython2
# ---------- py_sentence_case.python (13 lines) ----------
# Load the Python Standard and DesignScript Libraries
import sys
import clr
clr.AddReference('ProtoGeometry')
from Autodesk.DesignScript.Geometry import *

# The inputs to this node will be stored as a list in the IN variables.
data = IN[0]

# Place your code below this line

# Assign your output to the OUT variable.
OUT = data.capitalize()
# ----------------------------------------
OUT = Output(py_sentence_case)
