# Dynamo custom node findEmptyValues.dyf (Dynamo 2.12.1.8246)
# category: catalyst.dataManipulation
# finds empty values for textual and numeric parameters

parameterValues = Input(parameterValues: var[]..[])
python_script = Python(IN[0]=parameterValues)  # IronPython2
# ---------- python_script.python (29 lines) ----------
# Load the Python Standard and DesignScript Libraries
import sys
import clr
clr.AddReference('ProtoGeometry')
from Autodesk.DesignScript.Geometry import *

# The inputs to this node will be stored as a list in the IN variables.
data = IN[0]
mask = []
# Place your code below this line

for i in data:
	if i == None:
		mask.append(True)
	elif i == "":
		mask.append(True)
	elif i == " ":
		mask.append(True)
	# just trying to find more empty values
	elif i == "\n":
		mask.append(True)
	# some numerical numbers are empty in GUI but 0 in API
	elif i == 0:
		mask.append(True)
	else:
		mask.append(False)

# Assign your output to the OUT variable.
OUT = mask
# ----------------------------------------
mask = Output(python_script)  # "mask: OUT"
