# Dynamo custom node getDocNameExt.dyf (Dynamo 2.12.0.5650)
# category: catalyst.revit
# get the name of the current document with an extension

py_get_doc_name_no_extension = Python()  # IronPython2
# ---------- py_get_doc_name_no_extension.python (32 lines) ----------
# Load the Python Standard and DesignScript Libraries
import sys
import clr
clr.AddReference('ProtoGeometry')
from Autodesk.DesignScript.Geometry import *
clr.AddReference("RevitServices")
import RevitServices
from RevitServices.Persistence import DocumentManager


#import custom library
import sys
sys.path.append(r"U:\REVIT\Dynamo\Lib")

# name of the script for log

doc = DocumentManager.Instance.CurrentDBDocument
app = DocumentManager.Instance.CurrentUIApplication.Application
filePath = doc.PathName


def doc_name(filePath):
	# get the name of the curent document
	try:
		lastBackslash = filePath.rindex("\\")+1
	except:
		lastBackslash = filePath.rindex("/")+1
	file_name = filePath[lastBackslash:]
	return file_name

# Assign your output to the OUT variable.
OUT = doc_name(filePath)
# ----------------------------------------
OUT = Output(py_get_doc_name_no_extension)
