# Dynamo custom node getMidpoint.dyf (Dynamo 2.3.0.5885)
# category: catalyst.geometry
# gets midpoint of straight curve

curve = Input(curve: Autodesk.DesignScript.Geometry.Curve)
startPoint = Curve.StartPoint(curve=curve)
X = Point.X(point=startPoint)
endPoint = Curve.EndPoint(curve=curve)
X_2 = Point.X(point=endPoint)
code_block = CodeBlock(xa=X, xb=X_2) { (xa+xb)/2; }
Y = Point.Y(point=startPoint)
Y_2 = Point.Y(point=endPoint)
code_block_2 = CodeBlock(ya=Y, yb=Y_2) { (ya+yb)/2; }
byCoordinates = Point.ByCoordinates(x=code_block, y=code_block_2)
Point = Output(byCoordinates)
