# Dynamo custom node homePath.dyf (Dynamo 2.3.0.5885)
# category: catalyst.os
# getting home file path of current user logged in

py_get_home_folder = Python()
# ---------- py_get_home_folder.python (13 lines) ----------
# Load the Python Standard and DesignScript Libraries
import sys
import clr
clr.AddReference('ProtoGeometry')
from Autodesk.DesignScript.Geometry import *

# The inputs to this node will be stored as a list in the IN variables.

# Place your code below this line
from os.path import expanduser
homepath = expanduser("~")
# Assign your output to the OUT variable.
OUT = homepath
# ----------------------------------------
Output = Output(py_get_home_folder)  # ""
