# Dynamo custom node pyIF.dyf (Dynamo 2.12.0.5650)
# category: catalyst.logic
# proper IF made in python

boolean = Input(boolean: bool)
ifTrue = Input(ifTrue: var[]..[])
ifFalse = Input(ifFalse: var[]..[])
pyIF = Python(IN[0]=boolean, IN[1]=ifTrue, IN[2]=ifFalse)  # IronPython2
# ---------- pyIF.python (20 lines) ----------
# Load the Python Standard and DesignScript Libraries
import sys
import clr
clr.AddReference('ProtoGeometry')
from Autodesk.DesignScript.Geometry import *

# The inputs to this node will be stored as a list in the IN variables.
boolean = IN[0]
true = IN[1]
false = IN[2]

# Place your code below this line
if boolean == 1:
	result = true
elif boolean == 0:
	result = false
else:
	result = null
# Assign your output to the OUT variable.
OUT = result
# ----------------------------------------
OUT = Output(pyIF)
