# Dynamo custom node removeNulls.dyf (Dynamo 2.3.0.5885)
# category: catalyst.dataManipulation
# removes null values from the list

obj = Input(obj: var[]..[])

# group: removing nulls
code_block = CodeBlock { 0; }
string_from_object = FromObject(obj=obj)
code_block_2 = CodeBlock { "null"; }
allIndicesOf = List.AllIndicesOf(list=string_from_object, item=code_block_2)
firstItem = List.FirstItem(list=allIndicesOf)
slice = List.Slice(list=obj, start=code_block, end=firstItem)

items = Output(slice)
