# Dynamo custom node removeNullsV2.dyf "RemoveNullsV2" (Dynamo 2.3.0.5885)
# category: catalyst.dataManipulation
# remove nulls from list

obj = Input(obj: var[]..[])
python_script = Python(IN[0]=obj)
# ---------- python_script.python (16 lines) ----------
# Load the Python Standard and DesignScript Libraries
import sys
import clr
clr.AddReference('ProtoGeometry')
from Autodesk.DesignScript.Geometry import *

# The inputs to this node will be stored as a list in the IN variables.
data = IN[0]

# Place your code below this line
result = []
for d in data:
	if d is not None:
		result.append(d)
# Assign your output to the OUT variable.
OUT = result
# ----------------------------------------
items = Output(python_script)
