# Dynamo custom node removeNullsWithMask.dyf (Dynamo 2.12.1.8246)
# category: catalyst.dataManipulation
# removes null values from list and provides mask for filtering out elements from another lists

obj = Input(obj: var[]..[])
py_remove_nulls_with_mask = Python(IN[0]=obj)  # IronPython2
# ---------- py_remove_nulls_with_mask.python (20 lines) ----------
# Load the Python Standard and DesignScript Libraries
import sys
import clr
clr.AddReference('ProtoGeometry')
from Autodesk.DesignScript.Geometry import *

# The inputs to this node will be stored as a list in the IN variables.
data = IN[0]

# Place your code below this line
result = []
mask = []
for d in data:
	if d is not None:
		result.append(d)
		mask.append(True)
	else:
		mask.append(False)
# Assign your output to the OUT variable.
OUT = result, mask
# ----------------------------------------
code_block = CodeBlock(a=py_remove_nulls_with_mask) { a[0]; a[1]; }
list_without_nulls = Output(code_block.out0)
mask = Output(code_block.out1)
