# Dynamo custom node revitUserName.dyf (Dynamo 2.3.0.5885)
# category: catalyst.revit.application
# gets revit user name

revit_username = Python()
# ---------- revit_username.python (9 lines) ----------
# Load the Python Standard and DesignScript Libraries
import clr

clr.AddReference('RevitServices')
from RevitServices.Persistence import DocumentManager
app = DocumentManager.Instance.CurrentUIApplication.Application

# Assign your output to the OUT variable.
OUT = app.Username
# ----------------------------------------
OUT = Output(revit_username)
