# Dynamo custom node simpleExcelExport.dyf (Dynamo 2.3.0.5885)
# category: catalyst.dataExtraction
# export to excel without too much setting needed
# sheet name = Sheet 1
# start = A0
# overwrite = false

filePath = Input(filePath: string)
code_block = CodeBlock { "Sheet 1"; 0; true; }
data = Input(data: var[]..[])
exportExcel = Data.ExportExcel(filePath=filePath, sheetName=code_block.out0, startRow=code_block.out1, startCol=code_block.out1, data=data, overWrite=code_block.out2)
data_2 = Output(exportExcel)  # "data"
