# Dynamo custom node stripAccents.dyf (Dynamo 2.12.1.8246)
# category: catalyst.dataManipulation
# strip accents from the strings

input = Input(input: string)
py_strip_accents = Python(IN[0]=input)  # IronPython2
# ---------- py_strip_accents.python (22 lines) ----------
# Load the Python Standard and DesignScript Libraries
import sys
import clr
clr.AddReference('ProtoGeometry')
from Autodesk.DesignScript.Geometry import *

# The inputs to this node will be stored as a list in the IN variables.
data = IN[0]

# Place your code below this line
def strip_accents(s):
    # removing accents from strings
    import unicodedata
    return ''.join(c for c in unicodedata.normalize('NFD', s)
                  if unicodedata.category(c) != 'Mn')
no_acc_strings = []
for i in data:
	no_acc_str = strip_accents(i)
	no_acc_strings.append(no_acc_str)
	
# Assign your output to the OUT variable.
OUT = strip_accents(data)
# ----------------------------------------
OUT = Output(py_strip_accents)
