# Dynamo custom node trailingZeros.dyf (Dynamo 2.3.0.5885)
# category: catalyst.dataManipulation
# adds trailing zeros to numbers, e.g. for enumeration of elements

start = Input(start: int)
end = Input(end: int)
python_script = Python(IN[0]=start, IN[1]=end)
# ---------- python_script.python (22 lines) ----------
# Load the Python Standard and DesignScript Libraries
import sys
import clr
clr.AddReference('ProtoGeometry')
from Autodesk.DesignScript.Geometry import *

# The inputs to this node will be stored as a list in the IN variables.
start = IN[0]
end = IN[1]

# Place your code below this line
zeros_list = []
end_digit_count = len(str(end))
for i in range(start,end):
	str_num = str(i)
	digit_count = len(str_num)
	zeros_count = end_digit_count-digit_count
	zeros_string = zeros_count*"0" + str_num
	zeros_list.append(zeros_string)

# Assign your output to the OUT variable.
OUT = zeros_list
# ----------------------------------------
Output = Output(python_script)  # ""
