# Dynamo custom node trailingZerosManual.dyf (Dynamo 2.12.1.8246)
# category: catalyst.dataManipulation
# adds specific number of trailing zeros to sequence of numbers, e. g. for numbering elements

start = Input(start: int)
end = Input(end: int)
numberOfDecimalPlaces = Input(numberOfDecimalPlaces: int)
python_script = Python(IN[0]=start, IN[1]=end, IN[2]=numberOfDecimalPlaces)  # IronPython2
# ---------- python_script.python (23 lines) ----------
# Load the Python Standard and DesignScript Libraries
import sys
import clr
clr.AddReference('ProtoGeometry')
from Autodesk.DesignScript.Geometry import *

# The inputs to this node will be stored as a list in the IN variables.
start = IN[0]
end = IN[1]
decPlaces = IN[2]

# Place your code below this line
zeros_list = []
end_digit_count = len(str(end))
for i in range(start,end):
	str_num = str(i)
	digit_count = len(str_num)
	zeros_count = decPlaces-digit_count
	zeros_string = zeros_count*"0" + str_num
	zeros_list.append(zeros_string)

# Assign your output to the OUT variable.
OUT = zeros_list
# ----------------------------------------
OUT = Output(python_script)
