# Dynamo custom node trippleIF.dyf (Dynamo 2.3.0.5885)
# category: catalyst.logic
# IF which sorts list values into 3 groups. Lower or Greater than 2 threshold values.

mark = Input(mark: double)
firstThreshold = Input(firstThreshold: double)
secondThreshold = Input(secondThreshold: double)
ifLowerThanFirst = Input(ifLowerThanFirst: var[]..[])
ifLowerThanSecond = Input(ifLowerThanSecond: var[]..[])
ifGreaterThanSecond = Input(ifGreaterThanSecond: var[]..[])
pyIF = Python(IN[0]=mark, IN[1]=firstThreshold, IN[2]=secondThreshold, IN[3]=ifLowerThanFirst, IN[4]=ifLowerThanSecond, IN[5]=ifGreaterThanSecond)
# ---------- pyIF.python (23 lines) ----------
# Load the Python Standard and DesignScript Libraries
import sys
import clr
clr.AddReference('ProtoGeometry')
from Autodesk.DesignScript.Geometry import *

# The inputs to this node will be stored as a list in the IN variables.
mark = IN[0]
treshold1 = IN[1]
treshold2 = IN[2]
first = IN[3]
second = IN[4]
third = IN[5]

# Place your code below this line
if mark < treshold1:
	result = first
elif mark < treshold2:
	result = second
else:
	result = third
# Assign your output to the OUT variable.
OUT = result
# ----------------------------------------
OUT = Output(pyIF)
