# Dynamo graph 3DbyWorkset_po.dyn "3DbyWorkset_p" (Dynamo 2.12.0.5650)
# packages: cata_lyst 0.0.1

boolean = BoolSelector(true)
prefix = CodeBlock { "ws_"; }
py_3dview_for_each_workset = Python(IN[0]=boolean, IN[1]=prefix)  # IronPython2
# ---------- py_3dview_for_each_workset.python (61 lines) ----------
# This node has been made by Modelical
# www.modelical.com
import clr
clr.AddReference('ProtoGeometry')
from Autodesk.DesignScript.Geometry import *

# Import DocumentManager and TransactionManager
clr.AddReference("RevitServices")
import RevitServices
from RevitServices.Persistence import DocumentManager
from RevitServices.Transactions import TransactionManager

# Import RevitAPI
clr.AddReference("RevitAPI")
import Autodesk
from Autodesk.Revit.DB import *

doc = DocumentManager.Instance.CurrentDBDocument

bool = IN[0]
prefix = IN[1]
output = "Set boolean to TRUE to create new 3D views"

#Get IsmetricViewType Id

for viewType in FilteredElementCollector(doc).OfClass(ViewFamilyType).WhereElementIsElementType().ToElements():
	if viewType.ViewFamily == ViewFamily.ThreeDimensional:
		isometricViewId= viewType.Id
		
#Get Workset Id		
worksets = FilteredWorksetCollector(doc).OfKind(WorksetKind.UserWorkset).ToWorksets()

if bool == True:
	wsNames = []

	collector = FilteredWorksetCollector(doc)
	wsList = collector.OfKind(WorksetKind.UserWorkset)
	
	for w in wsList:
		wsNames.append(w.Name)

TransactionManager.Instance.EnsureInTransaction(doc)

viewsList=[]		
for name in wsNames:
	try:
		v=View3D.CreateIsometric(doc,isometricViewId)
		v.Name = prefix + name
		v.Unlock()
		for wk in worksets:
			if wk.Name == name:
				v.SetWorksetVisibility(wk.Id, WorksetVisibility.Visible)
			else:
				v.SetWorksetVisibility(wk.Id, WorksetVisibility.Hidden)
				
		viewsList.append(v)
	except:
		viewsList.append("Error with "+name+ " view")
TransactionManager.Instance.TransactionTaskDone()

OUT = viewsList
# ----------------------------------------

# group: INPUT
code_block = CodeBlock { "Delenie"; "00_NASTAVENIA"; }
code_block_2 = CodeBlock { "Delenie 2"; "WORKSETS"; }

setParameterByName = Element.SetParameterByName(element=py_3dview_for_each_workset, parameterName=code_block.out0, value=code_block.out1)
setParameterByName_2 = Element.SetParameterByName(element=py_3dview_for_each_workset, parameterName=code_block_2.out0, value=code_block_2.out1)
code_block_3 = CodeBlock { "3DbyWorkset"; }
usageLog = Custom[usageLog](scriptName=code_block_3)  # package cata_lyst; node logs every run of the script in which is used to the hardcoded server location
návod = StringInput("Vytvorí 3D View pre každý Workset v projekte a zaradí ho správne do Project Browseru")  # graph input
