# Dynamo graph 3DtextRoomData_p.dyn (Dynamo 2.12.1.8246)
# packages: Clockwork for Dynamo 2.x 2.4.0, archi-lab.net 2023.213.1523, cata_lyst 0.0.1

# group: get room locations
code_block = CodeBlock { "Rooms"; }
byName = Category.ByName(name=code_block)
all_elements_of_category = ElementsOfCategory(Category=byName)
getLocation = Element.GetLocation(element=all_elements_of_category)

# group: filter only placed rooms
removeNullsWithMask = Custom[removeNullsWithMask](obj=getLocation)  # package cata_lyst; removes null values from list and provides mask for filtering out elements from another lists
filterByBoolMask = List.FilterByBoolMask(list=all_elements_of_category, mask=removeNullsWithMask.mask)

level = Custom[Element.Level](element=filterByBoolMask.in)  # frozen; package Clockwork for Dynamo 2.x; Gets an element's level
byPointAndLevel = FamilyInstance.ByPointAndLevel(level=level)  # unwired: familyType, point

# group: INPUT
n3d_text_family_3droomtag_rfa = FamilyTypes("3DroomTag:300/120mm")  # "3D Text Family (3DroomTag.rfa)"; graph input
workset_pre_3d_text = WorksetUi("3DtextRoomData")  # "Workset pre 3D Text (3DtextRoomData)"; graph input

byPoint = FamilyInstance.ByPoint(familyType=n3d_text_family_3droomtag_rfa, point=removeNullsWithMask.list_without_nulls)
written_parameters = CodeBlock()
# ---------- written_parameters.designscript (9 lines) ----------
[
"Number",
"Name",
"Area",
"Floor Finish",
"Wall Finish",
"Ceiling Finish",
"Base Finish"
];
# ----------------------------------------
code_block_2 = CodeBlock(param=written_parameters) { "Room "+param; }
getParameterValueByName = Element.GetParameterValueByName(element=filterByBoolMask.in, parameterName=written_parameters@L2, lacing=Longest)
setParameterByName = Element.SetParameterByName(element=byPoint, parameterName=code_block_2@L2, value=getParameterValueByName, lacing=Longest)

# group: changing the workset
code_block_3 = CodeBlock { "Workset"; }
id = archilab.Revit.Elements.Workset.Id(workset=workset_pre_3d_text)
setParameterByName_2 = Element.SetParameterByName(element=setParameterByName, parameterName=code_block_3, value=id)

návod = StringInput("""V každej Room vytvorí 3D text s uvedením Room Name a Room Number. Do parametrov 3D text sú zapísané vybrané parametre z Rooms pre jednoduchšiu identifikáciu v 3D pohľadoch alebo mimo Revitu.

Skript funguje s pripravenou family 3DroomTag.rfa s pridanými parametrami.

Pred spustením vymaž všetky pôvodné 3D room Tagy.""")  # graph input
code_block_4 = CodeBlock { "3DtextRoomData"; }
usageLog = Custom[usageLog](scriptName=code_block_4)  # package cata_lyst; node logs every run of the script in which is used to the hardcoded server location
count = List.Count(list=byPoint)
code_block_5 = CodeBlock(count=count) { "Bolo vytvorených " + count + " elementov"; }

# group: OUTPUT
vytvorené_3d_room_tagy = Watch(code_block_5)  # graph output
