# Dynamo graph @Help a popis skriptov.dyn "_Help" (Dynamo 2.2.1.5175)

string = StringInput("\"http://dynamohelp.atwebpages.com/index.php\"")
python_script = Python(IN[0]=string)
# ---------- python_script.python (14 lines) ----------
# Load the Python Standard and DesignScript Libraries
import sys
import clr
clr.AddReference('ProtoGeometry')
from Autodesk.DesignScript.Geometry import *

# The inputs to this node will be stored as a list in the IN variables.
url = IN[0]

# Place your code below this line
import webbrowser
webbrowser.open(url)
# Assign your output to the OUT variable.
OUT = "check your browser"
# ----------------------------------------
watch = Watch(python_script)  # graph output
návod = StringInput("Klikni na Play pre zobrazenie Helpu.")  # graph input
