# Dynamo graph AllRoomAreasToTitleBlocks_rasto.dyn (Dynamo 2.3.0.5885)

code_block = CodeBlock { "Sheets"; }
byName = Category.ByName(name=code_block)
all_elements_of_category = ElementsOfCategory(Category=byName)

# group: INPUT
extarea_parameter = StringInput("Byty_Plocha uzitkova")  # graph input
sheet_parameter_s_označením_bytu = StringInput("Sheet Name")  # graph input
room_parameter_s_označením_bytu = StringInput("Alternativne cislo")  # graph input
označenie_exteriérových = StringInput("PLOCHA BALKÓNOV")  # "Označenie exteriérových miestností (Department)"; graph input
počet_desatinných_miest = DoubleInput(1)  # graph input
intarea_parameter = StringInput("Byty_Plocha exterier")  # graph input

code_block_2 = CodeBlock { "Rooms"; }
byName_2 = Category.ByName(name=code_block_2)
all_elements_of_category_2 = ElementsOfCategory(Category=byName_2)
getParameterValueByName = Element.GetParameterValueByName(element=all_elements_of_category, parameterName=sheet_parameter_s_označením_bytu)
getParameterValueByName_2 = Element.GetParameterValueByName(element=all_elements_of_category_2, parameterName=room_parameter_s_označením_bytu)
eq = getParameterValueByName == getParameterValueByName_2  # lacing=CrossProduct
filterByBoolMask = List.FilterByBoolMask(list=all_elements_of_category_2, mask=eq@L2)

# group: splitting interior and exterior rooms
code_block_3 = CodeBlock { "Department"; }
getParameterValueByName_3 = Element.GetParameterValueByName(element=filterByBoolMask.in, parameterName=code_block_3)
eq_2 = getParameterValueByName_3 == označenie_exteriérových
filterByBoolMask_2 = List.FilterByBoolMask(list=filterByBoolMask.in, mask=eq_2)

# group: interior room areas
code_block_4 = CodeBlock { "Area"; }
getParameterValueByName_4 = Element.GetParameterValueByName(element=filterByBoolMask_2.out, parameterName=code_block_4)
round = Math.Round(number=getParameterValueByName_4, digits=počet_desatinných_miest)
sum = Math.Sum(values=round)

string_from_object = FromObject(obj=sum)
py_string_round = Python(IN[0]=string_from_object, IN[1]=počet_desatinných_miest)
# ---------- py_string_round.python (21 lines) ----------
# Load the Python Standard and DesignScript Libraries
import sys
import clr
clr.AddReference('ProtoGeometry')
from Autodesk.DesignScript.Geometry import *

# The inputs to this node will be stored as a list in the IN variables.
input = IN[0]
decimal_places = IN[1]

# Place your code below this line
output = []
for sublist in input:
	#test.append(sublist)
    comma_index = sublist.index(",")
    short_num = sublist[:comma_index+decimal_places+1]
    short_num_no_comma = short_num.replace(",",".")
    #dot instead of comma and round string
    output.append(short_num_no_comma)
# Assign your output to the OUT variable.
OUT = output
# ----------------------------------------
setParameterByName = Element.SetParameterByName(element=all_elements_of_category, parameterName=extarea_parameter, value=py_string_round)

# group: exterior room areas
code_block_5 = CodeBlock { "Area"; }
getParameterValueByName_5 = Element.GetParameterValueByName(element=filterByBoolMask_2.in, parameterName=code_block_5)
round_2 = Math.Round(number=getParameterValueByName_5, digits=počet_desatinných_miest)
sum_2 = Math.Sum(values=round_2)

string_from_object_2 = FromObject(obj=sum_2)
py_string_round_2 = Python(IN[0]=string_from_object_2, IN[1]=počet_desatinných_miest)  # same code as py_string_round
setParameterByName_2 = Element.SetParameterByName(element=all_elements_of_category, parameterName=intarea_parameter, value=py_string_round_2)
watch = Watch(filterByBoolMask.in)
py_log = Python()  # unwired: IN[0]
# ---------- py_log.python (37 lines) ----------
# Load the Python Standard and DesignScript Libraries
import sys
import clr
clr.AddReference('ProtoGeometry')
from Autodesk.DesignScript.Geometry import *
clr.AddReference("RevitServices")
import RevitServices
from RevitServices.Persistence import DocumentManager

from datetime import datetime
import getpass

# name of the script for log
log_string = "AllRoomAreasToTitleBlocks"

doc = DocumentManager.Instance.CurrentDBDocument
filePath = doc.PathName

# getting file name from path
lastBackslash = filePath.rindex("\\")+1
file_name = filePath[lastBackslash:]
user_name = getpass.getuser()
datestamp = str(datetime.now())
# tabulator between data to easy import to excel schedule
separator = "\t"
line = datestamp + separator + log_string + separator + user_name + "\n"

try:
	f = open("L:\\customToolslogs\\dynLogs\\" + file_name +".log", "a")
	f.write(line)
	f.close()
	status = "log has been written"
except:
	status = "something went wrong"

# Assign your output to the OUT variable.
OUT = status
# ----------------------------------------
návod = StringInput("""zapíše aritmeticky správny súčet zaokrúhlených plôch miestností každého bytu do parametru Sheetu. Sheet musí mať v parametri vyplnený názov bytu rovnako ako miestnosti.

Hodnoty sumárnych plôch sa zobrazla v Title Blocku každého bytu""")  # graph input
code_block_6 = CodeBlock(name=getParameterValueByName, a=py_string_round, b=py_string_round_2) { name + "; IntArea = "+ a + "; ExtArea = "+ b; }

# group: OUTPUT
sum_output = Watch(code_block_6)  # graph output
