# Dynamo graph Area2Parameter.dyn (Dynamo 2.3.0.5885)

# group: INPUT
vyber_element = DSModelElementSelection()  # 1 picked in the model; graph input
parameter_to_write = StringInput("Comments")  # graph input
zaohkrúlenie_počet_desatinných = IntegerSlider(2, range=-3..4 step 1)  # "zaohkrúlenie (počet desatinných miest)"; graph input
add_units = BoolSelector(false)  # graph input

code_block = CodeBlock { "Area"; }
getParameterValueByName = Element.GetParameterValueByName(element=vyber_element, parameterName=code_block)
py_round2string = Python(IN[0]=zaohkrúlenie_počet_desatinných, IN[1]=getParameterValueByName, IN[2]=add_units)
# ---------- py_round2string.python (28 lines) ----------
# Load the Python Standard and DesignScript Libraries
import sys
import clr
clr.AddReference('ProtoGeometry')
from Autodesk.DesignScript.Geometry import *

#decimal places
n = IN[0]
#number to round
num = IN[1]
add_units = IN[2]

multiplier = 10**n
rounded_num = round(num*multiplier)/multiplier
rounded_str = str(rounded_num)
#removing ending 0.0 if not float
if n<0:
	rounded_str = rounded_str.split(".")[0]
units = " m²"

if add_units:
	result = rounded_str + units
else:
	result = rounded_str


# Assign your output to the OUT variable.
OUT = result
# ----------------------------------------
setParameterByName = Element.SetParameterByName(element=vyber_element, parameterName=parameter_to_write, value=py_round2string)
návod = StringInput("Zapíše zaokrúhlenú hodnotu plochy do zvoleného parametru. Vhodné napríklad na vyjazovanie plôch Filled Regionov cez Detail Tagy")  # graph input
py_log = Python()  # unwired: IN[0]
# ---------- py_log.python (37 lines) ----------
# Load the Python Standard and DesignScript Libraries
import sys
import clr
clr.AddReference('ProtoGeometry')
from Autodesk.DesignScript.Geometry import *
clr.AddReference("RevitServices")
import RevitServices
from RevitServices.Persistence import DocumentManager

from datetime import datetime
import getpass

# name of the script for log
log_string = "Area2Parameter"

doc = DocumentManager.Instance.CurrentDBDocument
filePath = doc.PathName

# getting file name from path
lastBackslash = filePath.rindex("\\")+1
file_name = filePath[lastBackslash:]
user_name = getpass.getuser()
datestamp = str(datetime.now())
# tabulator between data to easy import to excel schedule
separator = "\t"
line = datestamp + separator + log_string + separator + user_name + "\n"

try:
	f = open("L:\\customToolslogs\\dynLogs\\" + file_name +".log", "a")
	f.write(line)
	f.close()
	status = "log has been written"
except:
	status = "something went wrong"

# Assign your output to the OUT variable.
OUT = status
# ----------------------------------------
