# Dynamo graph CW spline_p.dyn (Dynamo 1.3.1.1736)

# group: INPUT
select_model_line = DSModelElementSelection()  # 1 picked in the model
segment_length = DoubleSlider(3000, range=800..10000 step 50)
wall_height = CodeBlock { 5000; }
levels = Levels("Level 1")
wall_type = WallTypes("Wall 1")

curve = CurveElement.Curve(select_model_line)
pointsAtChordLengthFromPoint = Curve.PointsAtChordLengthFromPoint(curve, arg2=segment_length)
splitByPoints = Curve.SplitByPoints(curve=curve, points=pointsAtChordLengthFromPoint)
startPoint = Curve.StartPoint(splitByPoints)
endPoint = Curve.EndPoint(splitByPoints)
byStartPointEndPoint = Line.ByStartPointEndPoint(startPoint=startPoint, endPoint=endPoint)
byCurveAndHeight = Wall.ByCurveAndHeight(curve=byStartPointEndPoint, height=wall_height, level=levels, wallType=wall_type)
návod = StringInput("vytvorí nasegmentované steny alebo Curtain Walls podľa krivky s voliteľnou dĺžkou segmentu")
