# Dynamo graph CWimgPanelType.dyn (Dynamo 2.3.0.5885)
# packages: cata_lyst 0.0.1

# group: INPUT
select_model_elements = DSModelElementsSelection()  # 1 picked in the model
image_path = Filename("img\uniformGradient.png")
počet_segmentov_fasady = IntegerSlider(35, range=0..100 step 1)
cw_panel_type_1 = FamilyTypes("System Panel:Solid")
cw_panel_type_2 = FamilyTypes("System Panel:Glazed")

byElement = CurtainPanel.ByElement(hostingElement=select_model_elements)
code_block = CodeBlock { "Type"; }
file_from_path = FileObject(path=image_path)
readFromFile = Image.ReadFromFile(file=file_from_path)
code_block_2 = CodeBlock(x=počet_segmentov_fasady) { x+1; }
pixels = Image.Pixels(image=readFromFile, xSamples=code_block_2, ySamples=code_block_2)

# group: niekedy netreba, zavisi od img type
reverse = List.Reverse(list=pixels)

brightness = Color.Brightness(c=reverse)
code_block_3 = CodeBlock { 1; }
round = Math.Round(number=brightness, digits=code_block_3)
flatten = List.Flatten(list=round)
code_block_4 = CodeBlock { 0.5; }
lt = flatten < code_block_4
pyIF = Custom[pyIF](boolean=lt, ifFalse=cw_panel_type_1, ifTrue=cw_panel_type_2)  # package cata_lyst; proper IF made in python
setParameterByName = Element.SetParameterByName(element=byElement@L2, parameterName=code_block, value=pyIF)
návod = StringInput("Zmení druh panelov v Curtain Wall podľa bitmapy")
py_log = Python()  # unwired: IN[0]
# ---------- py_log.python (40 lines) ----------
# Load the Python Standard and DesignScript Libraries
import sys
import clr
clr.AddReference('ProtoGeometry')
from Autodesk.DesignScript.Geometry import *
clr.AddReference("RevitServices")
import RevitServices
from RevitServices.Persistence import DocumentManager

from datetime import datetime
import getpass

# name of the script for log
log_string = "CWimgPanelType"

doc = DocumentManager.Instance.CurrentDBDocument
filePath = doc.PathName

# getting file name from path
try:
	lastBackslash = filePath.rindex("\\")+1
except:
	lastBackslash = filePath.rindex("/")+1
file_name = filePath[lastBackslash:]
user_name = getpass.getuser()
datestamp = str(datetime.now())
# tabulator between data to easy import to excel schedule
separator = "\t"
line = datestamp + separator + log_string + separator + user_name + "\n"

try:
	f = open("L:\\customToolslogs\\dynLogs\\" + file_name +".log", "a")
	f.write(line)
	f.close()
	status = "log has been written"
except:
	status = "something went wrong"

# Assign your output to the OUT variable.
OUT = status
# ----------------------------------------
