# Dynamo graph CWimgVoidPanels.dyn (Dynamo 2.3.0.5885)
# packages: cata_lyst 0.0.1

# group: INPUT
select_curtainwall = DSModelElementSelection()  # 1 picked in the model
largest_allowed_void_radius = IntegerSlider(80, range=50..200 step 10)
invert = BoolSelector(false)
image_path = Filename("img\GFIbw.png")
cw_segments_count = IntegerSlider(19, range=0..100 step 1)
smallest_allowed_void_radius = IntegerSlider(12, range=10..200 step 10)
cw_panel_under_threshold = FamilyTypes("System Panel:Solid")
default_cw_panel = FamilyTypes("voidPanel:voidPanel")

byElement = CurtainPanel.ByElement(hostingElement=select_curtainwall)
code_block = CodeBlock { "Type"; }
code_block_2 = CodeBlock(max=largest_allowed_void_radius) { 0; 1; 10; max; }
file_from_path = FileObject(path=image_path)
readFromFile = Image.ReadFromFile(file=file_from_path)
code_block_3 = CodeBlock(x=cw_segments_count) { x+1; }
pixels = Image.Pixels(image=readFromFile, xSamples=code_block_3, ySamples=code_block_3)

# group: netreba vzdy, zavisi od img type
reverse = List.Reverse(list=pixels)

brightness = Color.Brightness(c=reverse)
code_block_4 = CodeBlock { 1; }
round = Math.Round(number=brightness, digits=code_block_4)
flatten = List.Flatten(list=round)

# group: inverting the img
code_block_5 = CodeBlock(a=flatten) { 1-a; }
pyIF = Custom[pyIF](boolean=invert, ifFalse=code_block_5, ifTrue=flatten)  # package cata_lyst; proper IF made in python

mapTo = Math.MapTo(rangeMin=code_block_2.out0, rangeMax=code_block_2.out1, inputValue=pyIF, targetRangeMin=code_block_2.out2, targetRangeMax=code_block_2.max)
lt = mapTo < smallest_allowed_void_radius
pyIF_2 = Custom[pyIF](boolean=lt, ifFalse=cw_panel_under_threshold, ifTrue=default_cw_panel)
setParameterByName = Element.SetParameterByName(element=byElement, parameterName=code_block, value=pyIF_2)

# group: seting the void radius
filterByBoolMask = List.FilterByBoolMask(list=setParameterByName, mask=lt)
code_block_6 = CodeBlock { "void radius"; }
filterByBoolMask_2 = List.FilterByBoolMask(list=mapTo, mask=lt)
setParameterByName_2 = Element.SetParameterByName(element=filterByBoolMask.out, parameterName=code_block_6, value=filterByBoolMask_2.out)

# group: Sum area
filterByBoolMask_3 = List.FilterByBoolMask(list=mapTo, mask=lt)
code_block_7 = CodeBlock(r=filterByBoolMask_3.out) { r*r*3.14/1000000; }
sum = Math.Sum(values=code_block_7)
code_block_8 = CodeBlock(area=sum) { area + " m2"; }

watch_image = WatchImageCore(image=readFromFile)
návod = StringInput("Zmení typ panelov podľa bitmapy a podľa jej jasu upraví parameter panelu - velkost otvoru v paneli - \"void radius\"")
py_log = Python()  # unwired: IN[0]
# ---------- py_log.python (40 lines) ----------
# Load the Python Standard and DesignScript Libraries
import sys
import clr
clr.AddReference('ProtoGeometry')
from Autodesk.DesignScript.Geometry import *
clr.AddReference("RevitServices")
import RevitServices
from RevitServices.Persistence import DocumentManager

from datetime import datetime
import getpass

# name of the script for log
log_string = "CWimgVoidPanels"

doc = DocumentManager.Instance.CurrentDBDocument
filePath = doc.PathName

# getting file name from path
try:
	lastBackslash = filePath.rindex("\\")+1
except:
	lastBackslash = filePath.rindex("/")+1
file_name = filePath[lastBackslash:]
user_name = getpass.getuser()
datestamp = str(datetime.now())
# tabulator between data to easy import to excel schedule
separator = "\t"
line = datestamp + separator + log_string + separator + user_name + "\n"

try:
	f = open("L:\\customToolslogs\\dynLogs\\" + file_name +".log", "a")
	f.write(line)
	f.close()
	status = "log has been written"
except:
	status = "something went wrong"

# Assign your output to the OUT variable.
OUT = status
# ----------------------------------------
