# Dynamo graph CWpatternsGrids.dyn (Dynamo 2.3.0.5885)
# packages: spring nodes 204.1.0

# group: INPUT
select_curtainwall = DSModelElementSelection()  # 1 picked in the model
cw_segments = IntegerSlider(11, range=0..50 step 1)
dlzka_vzoru = IntegerSlider(3, range=1..6 step 1)
prva_cast = IntegerSlider(2, range=1..5 step 1)
cw_panel_type_1 = FamilyTypes("System Panel:Solid")
cw_panel_type_2 = FamilyTypes("System Panel:Glazed")

byElement = CurtainPanel.ByElement(hostingElement=select_curtainwall)
code_block = CodeBlock(count=cw_segments) { count+1; }
chop = List.Chop(list=byElement, lengths=code_block)
indexOf = List.IndexOf(list=chop@L2, element=chop@L2)
mod = indexOf % dlzka_vzoru@L2
flatten = List.Flatten(list=mod)
ofRepeatedItem = List.OfRepeatedItem(item=flatten@L1, amount=code_block)
lt = ofRepeatedItem < prva_cast
flatten_2 = List.Flatten(list=lt)
filterByBoolMask = List.FilterByBoolMask(list=byElement, mask=flatten_2)
code_block_2 = CodeBlock { "Type"; }
setParameterByName = Element.SetParameterByName(element=filterByBoolMask.in, parameterName=code_block_2, value=cw_panel_type_1)
ꟿ_list_getevenodd = Custom[ꟿ List.GetEvenOdd](list=filterByBoolMask.out@L2)  # package spring nodes; Gets the even and odd indices from the list.
setParameterByName_2 = Element.SetParameterByName(element=ꟿ_list_getevenodd.even, parameterName=code_block_2, value=cw_panel_type_1)
setParameterByName_3 = Element.SetParameterByName(element=ꟿ_list_getevenodd.odd, parameterName=code_block_2, value=cw_panel_type_2)
návod = StringInput("Zmení vzor rozmiestnenia Curtain Panelov podľa vzorca vytvárajúceho mriežku")
py_log = Python()  # unwired: IN[0]
# ---------- py_log.python (40 lines) ----------
# Load the Python Standard and DesignScript Libraries
import sys
import clr
clr.AddReference('ProtoGeometry')
from Autodesk.DesignScript.Geometry import *
clr.AddReference("RevitServices")
import RevitServices
from RevitServices.Persistence import DocumentManager

from datetime import datetime
import getpass

# name of the script for log
log_string = "CWpatternsGrids"

doc = DocumentManager.Instance.CurrentDBDocument
filePath = doc.PathName

# getting file name from path
try:
	lastBackslash = filePath.rindex("\\")+1
except:
	lastBackslash = filePath.rindex("/")+1
file_name = filePath[lastBackslash:]
user_name = getpass.getuser()
datestamp = str(datetime.now())
# tabulator between data to easy import to excel schedule
separator = "\t"
line = datestamp + separator + log_string + separator + user_name + "\n"

try:
	f = open("L:\\customToolslogs\\dynLogs\\" + file_name +".log", "a")
	f.write(line)
	f.close()
	status = "log has been written"
except:
	status = "something went wrong"

# Assign your output to the OUT variable.
OUT = status
# ----------------------------------------
