# Dynamo graph CWpatternsSimple.dyn (Dynamo 2.3.0.5885)
# packages: cata_lyst 0.0.1

# group: INPUT
select_curtainwall = DSModelElementSelection()  # 1 picked in the model
cw_segments = IntegerSlider(12, range=0..20 step 1)
dlzka_vzoru = IntegerSlider(2, range=1..10 step 1)
prva_cast = IntegerSlider(1, range=1..10 step 1)
cw_panel_type_1 = FamilyTypes("System Panel:Solid")
cw_panel_type_2 = FamilyTypes("System Panel:Glazed")

byElement = CurtainPanel.ByElement(hostingElement=select_curtainwall)
code_block = CodeBlock { "Type"; }
code_block_2 = CodeBlock(count=cw_segments) { count+1; }
chop = List.Chop(list=byElement, lengths=code_block_2)
indexOf = List.IndexOf(list=chop@L2, element=chop@L2)
mod = indexOf % dlzka_vzoru
lt = mod < prva_cast
flatten = List.Flatten(list=lt)
pyIF = Custom[pyIF](boolean=flatten, ifFalse=cw_panel_type_1, ifTrue=cw_panel_type_2)  # package cata_lyst; proper IF made in python
setParameterByName = Element.SetParameterByName(element=byElement, parameterName=code_block, value=pyIF)
návod = StringInput("Zmení vzor rozmiestnenia Curtain Panelov podľa jednoduchého vzorca ")
py_log = Python()  # unwired: IN[0]
# ---------- py_log.python (40 lines) ----------
# Load the Python Standard and DesignScript Libraries
import sys
import clr
clr.AddReference('ProtoGeometry')
from Autodesk.DesignScript.Geometry import *
clr.AddReference("RevitServices")
import RevitServices
from RevitServices.Persistence import DocumentManager

from datetime import datetime
import getpass

# name of the script for log
log_string = "CWpatternsSimple"

doc = DocumentManager.Instance.CurrentDBDocument
filePath = doc.PathName

# getting file name from path
try:
	lastBackslash = filePath.rindex("\\")+1
except:
	lastBackslash = filePath.rindex("/")+1
file_name = filePath[lastBackslash:]
user_name = getpass.getuser()
datestamp = str(datetime.now())
# tabulator between data to easy import to excel schedule
separator = "\t"
line = datestamp + separator + log_string + separator + user_name + "\n"

try:
	f = open("L:\\customToolslogs\\dynLogs\\" + file_name +".log", "a")
	f.write(line)
	f.close()
	status = "log has been written"
except:
	status = "something went wrong"

# Assign your output to the OUT variable.
OUT = status
# ----------------------------------------
