# Dynamo graph CWrandomPanels.dyn (Dynamo 2.3.0.5885)
# packages: cata_lyst 0.0.1

# group: INPUT
select_curtainwall = DSModelElementSelection()  # 1 picked in the model
n1st_threshold = DoubleSlider(0.3, range=0..1 step 0.1)  # "1st threshold"
n2nd_threshold = DoubleSlider(0.7, range=0..1 step 0.1)  # "2nd threshold"
cw_panel_type_1 = FamilyTypes("System Panel:Solid")
cw_panel_type_2 = FamilyTypes("System Panel:Glazed")
cw_panel_type_3 = FamilyTypes("System Panel:Solid 2")

byElement = CurtainPanel.ByElement(hostingElement=select_curtainwall)
code_block = CodeBlock { "Type"; }
count = List.Count(list=byElement)
randomList = Math.RandomList(amount=count)
trippleIF = Custom[trippleIF](mark=randomList, firstThreshold=n1st_threshold, secondThreshold=n2nd_threshold, ifLowerThanFirst=cw_panel_type_1, ifLowerThanSecond=cw_panel_type_2, ifGreaterThanSecond=cw_panel_type_3)  # package cata_lyst; IF which sorts list values into 3 groups. Lower or Greater than 2 threshold values.
setParameterByName = Element.SetParameterByName(element=byElement, parameterName=code_block, value=trippleIF)
návod = StringInput("""Generátor náhodne umiestnených panelov v Curtainwall pre 2 alebo 3 typy panelov.

pre 2 typy nastavne 2nd threshold =1""")
py_log = Python()  # unwired: IN[0]
# ---------- py_log.python (40 lines) ----------
# Load the Python Standard and DesignScript Libraries
import sys
import clr
clr.AddReference('ProtoGeometry')
from Autodesk.DesignScript.Geometry import *
clr.AddReference("RevitServices")
import RevitServices
from RevitServices.Persistence import DocumentManager

from datetime import datetime
import getpass

# name of the script for log
log_string = "CWrandomPanels"

doc = DocumentManager.Instance.CurrentDBDocument
filePath = doc.PathName

# getting file name from path
try:
	lastBackslash = filePath.rindex("\\")+1
except:
	lastBackslash = filePath.rindex("/")+1
file_name = filePath[lastBackslash:]
user_name = getpass.getuser()
datestamp = str(datetime.now())
# tabulator between data to easy import to excel schedule
separator = "\t"
line = datestamp + separator + log_string + separator + user_name + "\n"

try:
	f = open("L:\\customToolslogs\\dynLogs\\" + file_name +".log", "a")
	f.write(line)
	f.close()
	status = "log has been written"
except:
	status = "something went wrong"

# Assign your output to the OUT variable.
OUT = status
# ----------------------------------------
