# Dynamo graph Change Type parameters_p.dyn (Dynamo 2.3.0.5885)
# packages: Clockwork for Dynamo 2.x 2.1.2

# group: INPUT
categories = Categories("OST_Doors")  # graph input
search_for = StringInput("jednokrídlové")  # graph input
type_parameter = StringInput("Description")  # graph input
replace = StringInput("jednokrídl.")  # graph input

all_elements_of_category = ElementsOfCategory(Category=categories)
type = Custom[Element.Type](element=all_elements_of_category)  # package Clockwork for Dynamo 2.x; Gets the family type of a given element (if applicable). Unlike the OOTB node, it also works for elements in linked models.
uniqueItems = List.UniqueItems(list=type)
string_from_object = FromObject(obj=uniqueItems)
contains = String.Contains(str=string_from_object, searchFor=search_for)
filterByBoolMask = List.FilterByBoolMask(list=uniqueItems, mask=contains)
getParameterValueByName = Element.GetParameterValueByName(element=filterByBoolMask.in, parameterName=type_parameter)
watch = Watch(getParameterValueByName)
replace_2 = String.Replace(str=getParameterValueByName, searchFor=search_for, replaceWith=replace)
setParameterByName = Element.SetParameterByName(element=filterByBoolMask.in, parameterName=type_parameter, value=replace_2)
návod = StringInput("Nahradí textový reťazec v parametri celej vybranej kategórie")  # graph input
py_log = Python()  # unwired: IN[0]
# ---------- py_log.python (40 lines) ----------
# Load the Python Standard and DesignScript Libraries
import sys
import clr
clr.AddReference('ProtoGeometry')
from Autodesk.DesignScript.Geometry import *
clr.AddReference("RevitServices")
import RevitServices
from RevitServices.Persistence import DocumentManager

from datetime import datetime
import getpass

# name of the script for log
log_string = "Change Type parameters"

doc = DocumentManager.Instance.CurrentDBDocument
filePath = doc.PathName

# getting file name from path
try:
	lastBackslash = filePath.rindex("\\")+1
except:
	lastBackslash = filePath.rindex("/")+1
file_name = filePath[lastBackslash:]
user_name = getpass.getuser()
datestamp = str(datetime.now())
# tabulator between data to easy import to excel schedule
separator = "\t"
line = datestamp + separator + log_string + separator + user_name + "\n"

try:
	f = open("L:\\customToolslogs\\dynLogs\\" + file_name +".log", "a")
	f.write(line)
	f.close()
	status = "log has been written"
except:
	status = "something went wrong"

# Assign your output to the OUT variable.
OUT = status
# ----------------------------------------
