# Dynamo graph CoordinateScheduleToParametresCulRParking.dyn (Dynamo 2.0.1.5055)

# group: INPUT
file_path = Filename(".\coordinates.xlsx")  # graph input
categories = Categories(index=351)  # graph input
filter_by_type_comments = StringInput("1")  # graph input

code_block = CodeBlock { "Sheet1"; 0; }
all_elements_of_category = ElementsOfCategory(Category=categories)
elementType = Element.ElementType(element=all_elements_of_category)

# group: Filter
code_block_2 = CodeBlock { "Type Comments"; }
getParameterValueByName = Element.GetParameterValueByName(element=elementType, parameterName=code_block_2)
eq = getParameterValueByName == filter_by_type_comments
filterByBoolMask = List.FilterByBoolMask(list=all_elements_of_category, mask=eq)

# group: setting mark values
code_block_3 = CodeBlock { "Mark"; }
count = List.Count(list=filterByBoolMask.in)
code_block_4 = CodeBlock(a=count) { 1..a; }
string_from_object = FromObject(obj=code_block_4)
setParameterByName = Element.SetParameterByName(element=filterByBoolMask.in, parameterName=code_block_3, value=string_from_object)
getParameterValueByName_2 = Element.GetParameterValueByName(element=setParameterByName, parameterName=code_block_3)

location = FamilyInstance.Location(familyInstance=filterByBoolMask.in)
surveyPoint = Coordinates.SurveyPoint()
byOrigin = CoordinateSystem.ByOrigin(origin=surveyPoint)

# group: This is the location of revits origin 0,0,0
identity = CoordinateSystem.Identity()

# group: Transforms gemoerty from one coordinate system to another, in this case it moves the location of the second element on the a new coordinate system that has been created at the location of the 1st element
transform = Geometry.Transform(geometry=location, fromCoordinateSystem=byOrigin, contextCoordinateSystem=identity)
watch = Watch(transform)

X = Point.X(point=watch)
Y = Point.Y(point=watch)
Z = Point.Z(point=watch)

# group: Custom Shift
code_block_5 = CodeBlock(x=X) { x-303316855; }
code_block_6 = CodeBlock(y=Y) { y+433951277; }
code_block_7 = CodeBlock(z=Z) { z+37; }

round = Math.Round(number=code_block_5)
round_2 = Math.Round(number=code_block_6)
round_3 = Math.Round(number=code_block_7)
list_create = List.Create(item0=getParameterValueByName_2, item1=round, item2=round_2, item3=round_3)
transpose = List.Transpose(lists=list_create)

# group: Schedule header
code_block_8 = CodeBlock { "Označenie"; "X"; "Y"; "Z"; }
list_create_2 = List.Create(item0=code_block_8.out0, item1=code_block_8.out1, item2=code_block_8.out2, item3=code_block_8.out3)
code_block_9 = CodeBlock { 0; }
insert = List.Insert(list=transpose, element=list_create_2, index=code_block_9)

boolean = BoolSelector(true)
exportExcel = Data.ExportExcel(filePath=file_path, sheetName=code_block.out0, startRow=code_block.out1, startCol=code_block.out1, data=insert, overWrite=boolean)
output_parameter_name = StringInput("Comments")  # graph input
string = StringInput("; ")
list_create_3 = List.Create(item0=round, item1=round_2, item2=round_3)
transpose_2 = List.Transpose(lists=list_create_3)
string_from_object_2 = FromObject(obj=transpose_2)

# group: removing zeros
code_block_10 = CodeBlock { 0; }
string_2 = StringInput(",")
indexOf = String.IndexOf(str=string_from_object_2@L2, searchFor=string_2)
substring = String.Substring(str=string_from_object_2, startIndex=code_block_10, length=indexOf)

join = String.Join(separator=string@L1, string0=substring)
flatten = List.Flatten(list=join)
setParameterByName_2 = Element.SetParameterByName(element=filterByBoolMask.in, parameterName=output_parameter_name, value=flatten)
návod = StringInput("""Zapíše súradnice všetkých prvkov danej kategórie vyhovujúcich filtru podľa Type Comments do zvoleného textového parametru.

Výstup sa vyexportuje aj do excelovskej tabuľky.

Je možné nastavit posun 0 projektu ak bol posunutý Project Base Point aj Survey point.""")  # graph input
