# Dynamo graph Copy instance parameter with category filter.dyn (Dynamo 1.3.0.875)

# group: INPUT
# note: Skopiruje hodnotu parametra z jedneho elementu na druhy. Dovoli vybrat len jednu vybranu Category.
select_model_element = DSModelElementSelection()  # 1 picked in the model
categories = Categories("Doors")
instance_parameter = CodeBlock { "Comments"; }
parameter_value = CodeBlock { "PO"; }

isOfCategory = Custom[Element.IsOfCategory](element_s=select_model_element, Category=categories)  # Checks whether an element is of a specified category
filterByBoolMask = List.FilterByBoolMask(list=select_model_element, mask=isOfCategory)
setParameterByName = Element.SetParameterByName(element=filterByBoolMask.in, parameterName=instance_parameter, value=parameter_value)
