# Dynamo graph Copy instance parameter with category filter_p.dyn (Dynamo 2.3.0.5885)

# group: INPUT
návod = StringInput("Skopiruje hodnotu parametra z jedneho elementu na druhy. Dovoli vybrat len jednu vybranu Category.")  # graph input
select_model_element = DSModelElementSelection()  # nothing selected; graph input
categories = Categories("OST_Doors")  # graph input
instance_parameter = StringInput("Comments")  # graph input
parameter_value = StringInput("PO")  # graph input

# group: element is of category
getCategory = Element.GetCategory(element=select_model_element)
string_from_object = FromObject(obj=getCategory)
string_from_object_2 = FromObject(obj=categories)
eq = string_from_object == string_from_object_2

filterByBoolMask = List.FilterByBoolMask(list=select_model_element, mask=eq)
setParameterByName = Element.SetParameterByName(element=filterByBoolMask.in, parameterName=instance_parameter, value=parameter_value)

# group: OUTPUT
spracované_elementy = Watch(setParameterByName)  # graph output

py_log = Python()  # unwired: IN[0]
# ---------- py_log.python (37 lines) ----------
# Load the Python Standard and DesignScript Libraries
import sys
import clr
clr.AddReference('ProtoGeometry')
from Autodesk.DesignScript.Geometry import *
clr.AddReference("RevitServices")
import RevitServices
from RevitServices.Persistence import DocumentManager

from datetime import datetime
import getpass

# name of the script for log
log_string = "Copy instance parameter with category filter"

doc = DocumentManager.Instance.CurrentDBDocument
filePath = doc.PathName

# getting file name from path
lastBackslash = filePath.rindex("\\")+1
file_name = filePath[lastBackslash:]
user_name = getpass.getuser()
datestamp = str(datetime.now())
# tabulator between data to easy import to excel schedule
separator = "\t"
line = datestamp + separator + log_string + separator + user_name + "\n"

try:
	f = open("L:\\customToolslogs\\dynLogs\\" + file_name +".log", "a")
	f.write(line)
	f.close()
	status = "log has been written"
except:
	status = "something went wrong"

# Assign your output to the OUT variable.
OUT = status
# ----------------------------------------
