# Dynamo graph CopyAllParameterValues_p.dyn (Dynamo 2.3.0.5885)

# group: INPUT
categories = Categories()  # nothing selected; graph input
original_parameter_name = StringInput("")  # graph input
návod = StringInput("""Skopiruje hodnoty jedneho parametra vsetkych elementov danej kategorie do zvoleneho noveho parametru.

Vhodné napr. pri zmene Project parametru na Shared parameter, pricom do novovytvoreneho paremetra potrebujeme nakopirovat spravne hodnoty povodneho parametra.

Novy parameter uz musi byt vytvoreny.
""")  # graph input
new_parameter_name = StringInput("")  # graph input

all_elements_of_category = ElementsOfCategory(Category=categories)
getParameterValueByName = Element.GetParameterValueByName(element=all_elements_of_category, parameterName=original_parameter_name)
watch = Watch(getParameterValueByName)
setParameterByName = Element.SetParameterByName(element=all_elements_of_category, parameterName=new_parameter_name, value=getParameterValueByName)
count = List.Count(list=setParameterByName)

# group: OUTPUT
počet_prekopírovaných_hodnôt = Watch(count)

py_log = Python()  # unwired: IN[0]
# ---------- py_log.python (37 lines) ----------
# Load the Python Standard and DesignScript Libraries
import sys
import clr
clr.AddReference('ProtoGeometry')
from Autodesk.DesignScript.Geometry import *
clr.AddReference("RevitServices")
import RevitServices
from RevitServices.Persistence import DocumentManager

from datetime import datetime
import getpass

# name of the script for log
log_string = "CopyAllParameterValues"

doc = DocumentManager.Instance.CurrentDBDocument
filePath = doc.PathName

# getting file name from path
lastBackslash = filePath.rindex("\\")+1
file_name = filePath[lastBackslash:]
user_name = getpass.getuser()
datestamp = str(datetime.now())
# tabulator between data to easy import to excel schedule
separator = "\t"
line = datestamp + separator + log_string + separator + user_name + "\n"

try:
	f = open("L:\\customToolslogs\\dynLogs\\" + file_name +".log", "a")
	f.write(line)
	f.close()
	status = "log has been written"
except:
	status = "something went wrong"

# Assign your output to the OUT variable.
OUT = status
# ----------------------------------------
