# Dynamo graph CopySheetParameters_active_view_p.dyn (Dynamo 2.3.0.5885)

# group: get active view
code_block = CodeBlock { refresh:bool = true; }
python_script = Python(IN[0]=code_block)
# ---------- python_script.python (14 lines) ----------
#Copyright(c) 2016, Dimitar Venkov
# @5devene, dimitar.ven@gmail.com

import clr

clr.AddReference("RevitServices")
import RevitServices
from RevitServices.Persistence import DocumentManager
doc = DocumentManager.Instance.CurrentDBDocument
clr.AddReference("RevitNodes")
import Revit
clr.ImportExtensions(Revit.Elements)

OUT = doc.ActiveView.ToDSType(True)
# ----------------------------------------

parameter_names = CodeBlock()
# ---------- parameter_names.designscript (9 lines) ----------
"Mierka vpisana";
"Stavebny objekt KOD";
"Cast Projektu";
"etapa";
"Approved By";
"Designed By";
"Sheet Name";
"Delenie I";
"Delenie II";
# ----------------------------------------

# group: sheet number reading
element_types = ElementTypes("ViewSheet")
all_elements_of_type = ElementsOfType(element_type=element_types)
code_block_2 = CodeBlock { "Sheet Number"; }
getParameterValueByName = Element.GetParameterValueByName(element=all_elements_of_type, parameterName=code_block_2)

# group: INPUT - POUŽI DYNAMO PLAYER
copy_from_sheet_no = StringInput("005b")  # graph input

# group: filter by sheet number
eq = getParameterValueByName == copy_from_sheet_no
filterByBoolMask = List.FilterByBoolMask(list=all_elements_of_type, mask=eq)

# group: getters
getParameterValueByName_2 = Element.GetParameterValueByName(element=filterByBoolMask.in, parameterName=parameter_names.out0)
getParameterValueByName_3 = Element.GetParameterValueByName(element=filterByBoolMask.in, parameterName=parameter_names.out1)
getParameterValueByName_4 = Element.GetParameterValueByName(element=filterByBoolMask.in, parameterName=parameter_names.out2)
getParameterValueByName_5 = Element.GetParameterValueByName(element=filterByBoolMask.in, parameterName=parameter_names.out6)
getParameterValueByName_6 = Element.GetParameterValueByName(element=filterByBoolMask.in, parameterName=parameter_names.out4)
getParameterValueByName_7 = Element.GetParameterValueByName(element=filterByBoolMask.in, parameterName=parameter_names.out5)
getParameterValueByName_8 = Element.GetParameterValueByName(element=filterByBoolMask.in, parameterName=parameter_names.out3)
getParameterValueByName_9 = Element.GetParameterValueByName(element=filterByBoolMask.in, parameterName=parameter_names.out7)
getParameterValueByName_10 = Element.GetParameterValueByName(element=filterByBoolMask.in, parameterName=parameter_names.out8)

# group: Setters
setParameterByName = Element.SetParameterByName(element=python_script, parameterName=parameter_names.out0, value=getParameterValueByName_2)
setParameterByName_2 = Element.SetParameterByName(element=python_script, parameterName=parameter_names.out1, value=getParameterValueByName_3)
setParameterByName_3 = Element.SetParameterByName(element=python_script, parameterName=parameter_names.out2, value=getParameterValueByName_4)
setParameterByName_4 = Element.SetParameterByName(element=python_script, parameterName=parameter_names.out6, value=getParameterValueByName_5)
setParameterByName_5 = Element.SetParameterByName(element=python_script, parameterName=parameter_names.out4, value=getParameterValueByName_6)
setParameterByName_6 = Element.SetParameterByName(element=python_script, parameterName=parameter_names.out5, value=getParameterValueByName_7)
setParameterByName_7 = Element.SetParameterByName(element=python_script, parameterName=parameter_names.out3, value=getParameterValueByName_8)
setParameterByName_8 = Element.SetParameterByName(element=python_script, parameterName=parameter_names.out7, value=getParameterValueByName_9)
setParameterByName_9 = Element.SetParameterByName(element=python_script, parameterName=parameter_names.out8, value=getParameterValueByName_10)

návod = StringInput("""Vypíše rozpisku podľa vzorového výkresu. Je potrebné zvoliť Sheet Number vzorového výkresu, z ktorého sa skopíruju dole vypísané parametre do Sheetu, ktorý je aktívny.

Kopírované parametre:
Mierka vpisana; Stavebny objekt KOD; Cast Projektu; etapa; Approved By; Designed By; Sheet Name, Delenie I a Delenie II.

Opakovane funguje len Dynamo playeri.""")  # graph input
py_log = Python()  # unwired: IN[0]
# ---------- py_log.python (37 lines) ----------
# Load the Python Standard and DesignScript Libraries
import sys
import clr
clr.AddReference('ProtoGeometry')
from Autodesk.DesignScript.Geometry import *
clr.AddReference("RevitServices")
import RevitServices
from RevitServices.Persistence import DocumentManager

from datetime import datetime
import getpass

# name of the script for log
log_string = "CopySheetParameters_activeView"

doc = DocumentManager.Instance.CurrentDBDocument
filePath = doc.PathName

# getting file name from path
lastBackslash = filePath.rindex("\\")+1
file_name = filePath[lastBackslash:]
user_name = getpass.getuser()
datestamp = str(datetime.now())
# tabulator between data to easy import to excel schedule
separator = "\t"
line = datestamp + separator + log_string + separator + user_name + "\n"

try:
	f = open("L:\\customToolslogs\\dynLogs\\" + file_name +".log", "a")
	f.write(line)
	f.close()
	status = "log has been written"
except:
	status = "something went wrong"

# Assign your output to the OUT variable.
OUT = status
# ----------------------------------------
