# Dynamo graph DeleteFilters_p.dyn (Dynamo 2.0.1.5055)

element_types = ElementTypes(index=127)  # graph input
all_elements_of_type = ElementsOfType(element_type=element_types)
name = Element.Name(element=all_elements_of_type)
všetky_filtre = Watch(name)

# group: INPUT
vymazať_filtre_obsahujúce = StringInput("load")  # "Vymazať filtre obsahujúce reťazec:"; graph input

ignore_case = BoolSelector(true)  # graph input
contains = String.Contains(str=name, searchFor=vymazať_filtre_obsahujúce, ignoreCase=ignore_case)
filterByBoolMask = List.FilterByBoolMask(list=name, mask=contains)
vymazané_filtre = Watch(filterByBoolMask.in)
návod = StringInput("""Vymaže všetky filtre z dokumentu, ktorých názov obsahuje zvolený reťazec

Je potrbné doinštalovať package Archi-lab""")  # graph input
filterByBoolMask_2 = List.FilterByBoolMask(list=all_elements_of_type, mask=contains)
delete = archilab.Revit.Elements.Elements.Delete(element=filterByBoolMask_2.in)
