# Dynamo graph DeleteRevisions_p.dyn (Dynamo 2.0.1.5055)

element_types = ElementTypes(index=262)
all_elements_of_type = ElementsOfType(element_type=element_types)
name = Element.Name(element=all_elements_of_type)
všetky_revizie = Watch(name)

# group: INPUT
vymazať_vsetky_revizie = StringInput("základná verzia")  # "Vymazať vsetky revizie neobsahujúce reťazec:"; graph input

ignore_case = BoolSelector(true)  # graph input
contains = String.Contains(str=name, searchFor=vymazať_vsetky_revizie, ignoreCase=ignore_case)
filterByBoolMask = List.FilterByBoolMask(list=name, mask=contains)
vymazané_revizie = Watch(filterByBoolMask.out)
návod = StringInput("Vymaže všetky revízie z dokumentu, ktorých názov obsahuje zvolený reťazec")  # graph input
filterByBoolMask_2 = List.FilterByBoolMask(list=all_elements_of_type, mask=contains)
delete = archilab.Revit.Elements.Elements.Delete(element=filterByBoolMask_2.out)
