# Dynamo graph Duplicate views_p.dyn (Dynamo 2.3.0.5885)
# packages: Clockwork for Dynamo 2.x 2.1.2

# group: INPUT
new_floor_plan_parameter_name = StringInput("Delenie I")  # graph input
new_floor_plan_parameter_value = StringInput("nove podorysy")  # graph input
parameter_value = StringInput("1")  # graph input
parameter_name = StringInput("Title on Sheet")  # graph input
copied_view_name_suffix = StringInput("floor")  # graph input

návod = StringInput("""Skopiruje Views (ktore maju priradeny  parameter s nazvom "Parameter Name" s hodnotou "Parameter Value") ako "Duplicate with detailing" a prida nazvu View priponu "Copied View Name Suffix"

Treba doinstalovat Package Clockwork.""")  # graph input
code_block = CodeBlock { "Views"; }
byName = Category.ByName(name=code_block)
all_elements_of_category = ElementsOfCategory(Category=byName)
getParameterValueByName = Element.GetParameterValueByName(element=all_elements_of_category, parameterName=parameter_name)
eq = parameter_value == getParameterValueByName
filterByBoolMask = List.FilterByBoolMask(list=all_elements_of_category, mask=eq)
code_block_2 = CodeBlock { "View Name"; }
getParameterValueByName_2 = Element.GetParameterValueByName(element=filterByBoolMask.in, parameterName=code_block_2)
code_block_3 = CodeBlock(name=getParameterValueByName_2, suffix=copied_view_name_suffix) { name + suffix; }
duplicateWithDetailing = Custom[View.DuplicateWithDetailing](view=filterByBoolMask.in, name=code_block_3)  # package Clockwork for Dynamo 2.x; Duplicates a given view with detailing
vytvorené_views = Watch(duplicateWithDetailing)  # graph output
py_log = Python()  # unwired: IN[0]
# ---------- py_log.python (37 lines) ----------
# Load the Python Standard and DesignScript Libraries
import sys
import clr
clr.AddReference('ProtoGeometry')
from Autodesk.DesignScript.Geometry import *
clr.AddReference("RevitServices")
import RevitServices
from RevitServices.Persistence import DocumentManager

from datetime import datetime
import getpass

# name of the script for log
log_string = "Duplicate Views"

doc = DocumentManager.Instance.CurrentDBDocument
filePath = doc.PathName

# getting file name from path
lastBackslash = filePath.rindex("\\")+1
file_name = filePath[lastBackslash:]
user_name = getpass.getuser()
datestamp = str(datetime.now())
# tabulator between data to easy import to excel schedule
separator = "\t"
line = datestamp + separator + log_string + separator + user_name + "\n"

try:
	f = open("L:\\customToolslogs\\dynLogs\\" + file_name +".log", "a")
	f.write(line)
	f.close()
	status = "log has been written"
except:
	status = "something went wrong"

# Assign your output to the OUT variable.
OUT = status
# ----------------------------------------
