# Dynamo graph DuplicateScheduleByLevel_p.dyn "DuplicateScheduleByLevel_po" (Dynamo 2.12.1.8246)
# packages: cata_lyst 0.0.1

# group: INPUT
views = Views("Room Schedule All")  # graph input

code_block = CodeBlock { "Levels"; }
byName = Category.ByName(name=code_block)
all_elements_of_category = ElementsOfCategory(Category=byName)
name = Level.Name(level=all_elements_of_category)
code_block_2 = CodeBlock(suffix=name) { " - "+suffix; }
duplicateView = View.DuplicateView(view=views, suffix=code_block_2)
clearAllFilters = ScheduleView.ClearAllFilters(scheduleView=duplicateView)
fields = ScheduleView.Fields(scheduleView=views)
string_from_object = FromObject(object=fields)
code_block_3 = CodeBlock { "Level"; }
indexOf = List.IndexOf(list=string_from_object, element=code_block_3)
code_block_4 = CodeBlock(a=fields, b=indexOf) { a[b]; }
schedule_filter_type = ScheduleFilterType("Equal")
byFieldTypeAndValue = Revit.Schedules.ScheduleFilter.ByFieldTypeAndValue(field=code_block_4, filterType=schedule_filter_type, value=all_elements_of_category)
python_script = Python(IN[0]=byFieldTypeAndValue)  # IronPython2
# ---------- python_script.python (15 lines) ----------
# Load the Python Standard and DesignScript Libraries
import sys
import clr
clr.AddReference('ProtoGeometry')
from Autodesk.DesignScript.Geometry import *

# The inputs to this node will be stored as a list in the IN variables.
dataEnteringNode = IN[0]

# Place your code below this line
output = []
for a in dataEnteringNode:
	output.append([a])
# Assign your output to the OUT variable.
OUT = output
# ----------------------------------------
addFilters = ScheduleView.AddFilters(scheduleView=clearAllFilters, scheduleFilters=python_script)
list_create = List.Create(item0=byFieldTypeAndValue)
návod = StringInput("Skopíruje vypranú tabuľku s filtrami podľa poschodí")  # graph input
code_block_5 = CodeBlock { "DuplicateScheduleByLevel"; }
usageLog = Custom[usageLog](scriptName=code_block_5)  # package cata_lyst; node logs every run of the script in which is used to the hardcoded server location
