# Dynamo graph FamilyIsInPlace_po.dyn "FamilyIsInPlace" (Dynamo 2.0.1.5055)

návod = StringInput("Zobrazí koľko Families je vytvorených ako In Place Family.")  # graph input
element_types = ElementTypes(index=119)
all_elements_of_type = ElementsOfType(element_type=element_types)
name = Family.Name(family=all_elements_of_type)
isInPlace = Custom[Family.IsInPlace](family=all_elements_of_type)  # Determines if a family is an in-place family
filterByBoolMask = List.FilterByBoolMask(list=name, mask=isInPlace)
count = List.Count(list=filterByBoolMask.in)
count_2 = List.Count(list=all_elements_of_type)
code_block = CodeBlock(a=count, b=count_2) { a/b*100+" % Families je InPlace"; }
percentage_of_inplace_families = Watch(code_block)  # graph output
name_of_inplace_families = Watch(filterByBoolMask.in)  # graph output
