# Dynamo graph FamilySplasher_p.dyn "FamilySplasher" (Dynamo 2.12.1.8246)
# packages: archi-lab.net 2023.213.1523

# group: Error handling
# note: Treating errors as hints to user what to do to avoid the error

# group: Filter
# note: filtering elements

návod = StringInput("Pre každú family nastaví inú farbu Override Graphics in View v aktívnom View")  # graph input

# group: OUTPUT
# note: Place output for Dynamo Player
OUTPUT = Watch()  # graph output; unwired: arg0

# note: python FilterElementCollector
py_filterelementcollector = Python()  # IronPython2
# ---------- py_filterelementcollector.python (24 lines) ----------
# Load the Python Standard and DesignScript Libraries
import sys
import clr
clr.AddReference('ProtoGeometry')
from Autodesk.DesignScript.Geometry import *

clr.AddReference("RevitServices")
clr.AddReference("RevitAPI")
import RevitServices
from RevitServices.Persistence import DocumentManager
from Autodesk.Revit import DB

doc = DocumentManager.Instance.CurrentDBDocument
uiapp = DocumentManager.Instance.CurrentUIApplication
app = uiapp.Application

rooms = DB.FilteredElementCollector(doc).OfCategory(DB.BuiltInCategory.OST_Rooms).WhereElementIsNotElementType().ToElements()
areas = []
for room in rooms:
	area = room.LookupParameter("Area").AsDouble()
	areas.append(area*0.3048*0.3048)

# Assign your output to the OUT variable.
OUT = areas
# ----------------------------------------

# group: INPUT
categories = Categories("OST_Doors")  # graph input
seed = DoubleSlider(185, range=0..255 step 5)  # graph input

all_elements_of_category = ElementsOfCategory(Category=categories)
current = Document.Current()
activeView = Document.ActiveView(document=current)

# group: treating just elements visible in view
isVisibleInView = archilab.Revit.Elements.Elements.IsVisibleInView(element=all_elements_of_category, view=activeView)
filterByBoolMask = List.FilterByBoolMask(list=all_elements_of_category, mask=isVisibleInView)

getFamily = FamilyInstance.GetFamily(familyInstance=filterByBoolMask.in)
name = FamilyType.Name(familyType=getFamily)
uniqueItems = List.UniqueItems(list=name)

# group: spliting list based on Family
eq = name@L2 == uniqueItems  # lacing=Longest
filterByBoolMask_2 = List.FilterByBoolMask(list=filterByBoolMask.in, mask=eq@L2)

# group: randomize values
code_block = CodeBlock { 0; 255; }
random = Math.Random(value1=code_block.out0, value2=code_block.out1, seed=seed)
floor = Math.Floor(number=random)
random_2 = Math.Random(value1=code_block.out0, value2=code_block.out1, seed=floor)
floor_2 = Math.Floor(number=random_2)
code_block_2 = CodeBlock(a=seed, b=floor, c=floor_2) { a; b; c; }

# group: generating RGB values
count = List.Count(list=uniqueItems)
code_block_3 = CodeBlock { 0; 255; }
randomList = Math.RandomList(amount=count, value1=code_block_3.out0, value2=code_block_3.out1, seed=code_block_2.a)
floor_3 = Math.Floor(number=randomList)
randomList_2 = Math.RandomList(amount=count, value1=code_block_3.out0, value2=code_block_3.out1, seed=code_block_2.b)
floor_4 = Math.Floor(number=randomList_2)
randomList_3 = Math.RandomList(amount=count, value1=code_block_3.out0, value2=code_block_3.out1, seed=code_block_2.c)
floor_5 = Math.Floor(number=randomList_3)

# group: generating colors
list_create = List.Create(item0=floor_3, item1=floor_4, item2=floor_5)
transpose = List.Transpose(lists=list_create)
code_block_4 = CodeBlock { 0; 1; 2; }
getItemAtIndex = List.GetItemAtIndex(list=transpose@L2, index=code_block_4.out0)
getItemAtIndex_2 = List.GetItemAtIndex(list=transpose@L2, index=code_block_4.out1)
getItemAtIndex_3 = List.GetItemAtIndex(list=transpose@L2, index=code_block_4.out2)
byARGB = Color.ByARGB(red=getItemAtIndex, green=getItemAtIndex_2, blue=getItemAtIndex_3)

overrideColorInView = Element.OverrideColorInView(element=filterByBoolMask_2.in@L2, color=byARGB@L1)
