# Dynamo graph IFC_export_p.dyn (Dynamo 2.6.1.8786)
# packages: Genius Loci 2021.11.10, cata_lyst 0.0.1

# group: Filter
# note: filtering elements

# group: Error handling
# note: Treating errors as hints to user what to do to avoid the error

návod = StringInput("""vyexportuje IFC súbor z aktívneho dokumentu

Je potrebné mať nainštalovaný Package Genius Loci""")  # graph input
code_block = CodeBlock { "IFC_export"; }
usageLog = Custom[usageLog](scriptName=code_block)  # package cata_lyst; node logs every run of the script in which is used to the hardcoded server location

# group: INPUT
directory_path = Directory("No file selected.")  # graph input
coodinates_sharedcoordinates_0 = DoubleSlider(3, range=0..3 step 1)  # "Coodinates SharedCoordinates = 0, SiteSurveyPoint = 1, ProjectBasePoint = 2, InternalCoordinates = 3"; graph input

current = Document.Current()
activeView = Document.ActiveView(document=current)
getDocName = Custom[getDocName]()  # package cata_lyst; get the name of the current document without an extension
code_block_2 = CodeBlock(a=getDocName) { a+"_2"; }
export_ifc = Custom[Export IFC](DirectoryPath=directory_path, view=activeView, Filename=code_block_2, ProjectOrigin=coodinates_sharedcoordinates_0)  # package Genius Loci; Export View to IFC file in the active document. For use with the Select Phase node. Some other IFC options are embedded inside the python script.

# group: OUTPUT
# note: Place output for Dynamo Player
OUTPUT = Watch(export_ifc)  # graph output
