# Dynamo graph LegendPlacer.dyn (Dynamo 2.3.0.5885)

# group: INPUT
name_of_legend = StringInput("Legend 1")  # graph input
parameter_value = StringInput("1")  # graph input
filter_by_parameter_name = StringInput("Approved By")  # graph input
placement_x_axis = DoubleSlider(-2.279, range=-3..3 step 0.001)  # graph input
placement_y_axis = DoubleSlider(3.326, range=0..5 step 0.001)  # graph input

get_view_by_name_py = Python(IN[0]=name_of_legend)
# ---------- get_view_by_name_py.python (30 lines) ----------
import clr
# import Document Manager
clr.AddReference("RevitServices")
import RevitServices 
from RevitServices.Persistence import DocumentManager
from RevitServices.Transactions import TransactionManager
doc = DocumentManager.Instance.CurrentDBDocument
uidoc = DocumentManager.Instance.CurrentUIDocument
clr.AddReference("RevitNodes")
import Revit
clr.ImportExtensions(Revit.Elements)
clr.ImportExtensions(Revit.GeometryConversion)
clr.AddReference("RevitAPI")
from Autodesk.Revit.DB import *

dataEnteringNode = IN
vName = IN[0]
foundView = None

coll = FilteredElementCollector(doc)
views = coll.OfClass(View)

for v in views:
	view = UnwrapElement(v)
	if v.Name == vName:
		foundView = v
	
OUT = foundView
	
#For more information refer to RBG Wiki or email me (ctrl + click link): daniel.woodcock@robertbird.com
# ----------------------------------------
get_all_sheets_in_project_py = Python()
# ---------- get_all_sheets_in_project_py.python (33 lines) ----------
import clr
# import Document Manager
clr.AddReference("RevitServices")
import RevitServices 
from RevitServices.Persistence import DocumentManager
from RevitServices.Transactions import TransactionManager
doc = DocumentManager.Instance.CurrentDBDocument
uidoc = DocumentManager.Instance.CurrentUIDocument
clr.AddReference("RevitNodes")
import Revit
clr.ImportExtensions(Revit.Elements)
clr.ImportExtensions(Revit.GeometryConversion)
clr.AddReference("RevitAPI")
from Autodesk.Revit.DB import *

dataEnteringNode = IN

sheets = []
sheetNum = []
sheetName = []

coll = FilteredElementCollector(doc)
vSheets = coll.OfClass(ViewSheet)

for vs in vSheets:
	sht = UnwrapElement(vs)
	sheetNum.Add(sht.SheetNumber)
	sheetName.Add(sht.Name)
	sheets.Add(sht)

OUT = [sheets,sheetNum,sheetName]
	
#For more information refer to RBG Wiki or email me (ctrl + click link): daniel.woodcock@robertbird.com
# ----------------------------------------
code_block = CodeBlock(a=get_all_sheets_in_project_py) { a[0]; }

# group: Sheet filter
getParameterValueByName = Element.GetParameterValueByName(element=code_block, parameterName=filter_by_parameter_name)
eq = parameter_value == getParameterValueByName
filterByBoolMask = List.FilterByBoolMask(list=code_block, mask=eq)

byCoordinates = Point.ByCoordinates(x=placement_x_axis, y=placement_y_axis)
place_legend_on_sheets_py = Python(IN[0]=get_view_by_name_py, IN[1]=filterByBoolMask.in, IN[2]=byCoordinates)
# ---------- place_legend_on_sheets_py.python (40 lines) ----------
import clr
# import Document Manager
clr.AddReference("RevitServices")
import RevitServices 
from RevitServices.Persistence import DocumentManager
from RevitServices.Transactions import TransactionManager
doc = DocumentManager.Instance.CurrentDBDocument
uidoc = DocumentManager.Instance.CurrentUIDocument
clr.AddReference("RevitNodes")
import Revit
clr.ImportExtensions(Revit.Elements)
clr.ImportExtensions(Revit.GeometryConversion)
clr.AddReference("RevitAPI")
from Autodesk.Revit.DB import *

dataEnteringNode = IN

legend = UnwrapElement(IN[0])
sheets = IN[1]
loc = XYZ(IN[2].X, IN[2].Y, IN[2].Z)
viewports = []
failed = []

for vs in sheets:
	sheet = UnwrapElement(vs)
	canAddToSht = Viewport.CanAddViewToSheet(doc, sheet.Id, legend.Id)
	if canAddToSht:
		try:		
			TransactionManager.Instance.EnsureInTransaction(doc)	
			viewport = Viewport.Create(doc, sheet.Id, legend.Id, loc)	
			TransactionManager.Instance.TransactionTaskDone()
			viewports.Add([viewport,sheet])
		except:
			failed.Add(["Failed",sheet])
	else:
		failed.Add(["Failed",sheet])
		
OUT = [viewports, failed]
	
#For more information refer to RBG Wiki or email me (ctrl + click link): daniel.woodcock@robertbird.com
# ----------------------------------------
succeded = CodeBlock(a=place_legend_on_sheets_py) { a[0]; }
failed = CodeBlock(a=place_legend_on_sheets_py) { a[1]; }
návod = StringInput("""Automaticky umiestni legendu na viacero Sheetov. Je možné zvoliť súradnice umiestnenia legendy. 

Najlepšie je keď sa Titleblocky umiestnené automaticky a neposúvajú sa manuálne ľubovolným smerom.

Po každom spostení treba reštartovať Dynamo.""")  # graph input
py_log = Python()  # unwired: IN[0]
# ---------- py_log.python (37 lines) ----------
# Load the Python Standard and DesignScript Libraries
import sys
import clr
clr.AddReference('ProtoGeometry')
from Autodesk.DesignScript.Geometry import *
clr.AddReference("RevitServices")
import RevitServices
from RevitServices.Persistence import DocumentManager

from datetime import datetime
import getpass

# name of the script for log
log_string = "LegendPlacer"

doc = DocumentManager.Instance.CurrentDBDocument
filePath = doc.PathName

# getting file name from path
lastBackslash = filePath.rindex("\\")+1
file_name = filePath[lastBackslash:]
user_name = getpass.getuser()
datestamp = str(datetime.now())
# tabulator between data to easy import to excel schedule
separator = "\t"
line = datestamp + separator + log_string + separator + user_name + "\n"

try:
	f = open("L:\\customToolslogs\\dynLogs\\" + file_name +".log", "a")
	f.write(line)
	f.close()
	status = "log has been written"
except:
	status = "something went wrong"

# Assign your output to the OUT variable.
OUT = status
# ----------------------------------------
