# Dynamo graph Level rename.dyn (Dynamo 2.3.0.5885)

code_block = CodeBlock { "Levels"; }
byName = Category.ByName(name=code_block)
all_elements_of_category = ElementsOfCategory(Category=byName)
uniqueItems = List.UniqueItems(list=all_elements_of_category)
watch = Watch(uniqueItems)
code_block_2 = CodeBlock { "Name"; }
getParameterValueByName = Element.GetParameterValueByName(element=all_elements_of_category, parameterName=code_block_2)
uniqueItems_2 = List.UniqueItems(list=getParameterValueByName)
code_block_3 = CodeBlock { "1.NP"; }
boolean = BoolSelector(true)
startsWith = String.StartsWith(str=uniqueItems_2, searchFor=code_block_3, ignoreCase=boolean)
filterByBoolMask = List.FilterByBoolMask(list=uniqueItems, mask=startsWith)
filterByBoolMask_2 = List.FilterByBoolMask(list=uniqueItems_2, mask=startsWith)

# group: nadzemne poschodia
code_block_4 = CodeBlock { "NP"; }
boolean_2 = BoolSelector(true)
contains = String.Contains(str=filterByBoolMask_2.out, searchFor=code_block_4, ignoreCase=boolean_2)
filterByBoolMask_3 = List.FilterByBoolMask(list=filterByBoolMask.out, mask=contains)
code_block_5 = CodeBlock { 1..33; }
filterByBoolMask_4 = List.FilterByBoolMask(list=filterByBoolMask_2.out, mask=contains)
name_v_tvare_1_poschodie_2_np = CodeBlock(a=code_block_5, b=filterByBoolMask_4.in) { a+".poschodie ("+b+")"; }
setParameterByName = Element.SetParameterByName(element=filterByBoolMask_3.in, parameterName=code_block_2, value=name_v_tvare_1_poschodie_2_np)

# group: Sutereny
code_block_6 = CodeBlock { "PP"; }
boolean_3 = BoolSelector(true)
contains_2 = String.Contains(str=filterByBoolMask_2.out, searchFor=code_block_6, ignoreCase=boolean_3)
filterByBoolMask_5 = List.FilterByBoolMask(list=filterByBoolMask.out, mask=contains_2)
sort = List.Sort(list=filterByBoolMask_5.in)
code_block_7 = CodeBlock { 1..33; }
filterByBoolMask_6 = List.FilterByBoolMask(list=filterByBoolMask_2.out, mask=contains_2)
sort_2 = List.Sort(list=filterByBoolMask_6.in)
name_v_tvare_1_suterén_1_pp = CodeBlock(a=code_block_7, b=sort_2) { a+".suterén ("+b+")"; }
setParameterByName_2 = Element.SetParameterByName(element=sort, parameterName=code_block_2, value=name_v_tvare_1_suterén_1_pp)

filterByBoolMask_7 = List.FilterByBoolMask(list=all_elements_of_category, mask=startsWith)

# group: prizemie
code_block_8 = CodeBlock { "prízemie"; }
setParameterByName_3 = Element.SetParameterByName(element=filterByBoolMask_7.in, parameterName=code_block_2, value=code_block_8)
