# Dynamo graph OverrideGraphicsInViewCut_p.dyn (Dynamo 2.3.0.5885)

# group: INPUT
select_model_element = DSModelElementSelection()  # 1 picked in the model; graph input
red = DoubleSlider(0, range=0..255 step 1)  # graph input
green = DoubleSlider(129, range=0..255 step 1)  # graph input
blue = DoubleSlider(69, range=0..255 step 1)  # graph input
fill_patterns = FillPatterns()  # nothing selected; graph input

code_block = CodeBlock { 1; }
byARGB = Color.ByARGB(a=code_block, r=red, g=green, b=blue)
byProperties = Revit.Filter.OverrideGraphicSettings.ByProperties(cutFillColor=byARGB, cutFillPattern=fill_patterns)
overrideInView = Element.OverrideInView(element=select_model_element, overrides=byProperties)
návod = StringInput("nastaví Override Graphics in View vybraným elementom")  # graph input
py_log = Python()  # unwired: IN[0]
# ---------- py_log.python (37 lines) ----------
# Load the Python Standard and DesignScript Libraries
import sys
import clr
clr.AddReference('ProtoGeometry')
from Autodesk.DesignScript.Geometry import *
clr.AddReference("RevitServices")
import RevitServices
from RevitServices.Persistence import DocumentManager

from datetime import datetime
import getpass

# name of the script for log
log_string = "OverrideGraphicsInViewCut"

doc = DocumentManager.Instance.CurrentDBDocument
filePath = doc.PathName

# getting file name from path
lastBackslash = filePath.rindex("\\")+1
file_name = filePath[lastBackslash:]
user_name = getpass.getuser()
datestamp = str(datetime.now())
# tabulator between data to easy import to excel schedule
separator = "\t"
line = datestamp + separator + log_string + separator + user_name + "\n"

try:
	f = open("L:\\customToolslogs\\dynLogs\\" + file_name +".log", "a")
	f.write(line)
	f.close()
	status = "log has been written"
except:
	status = "something went wrong"

# Assign your output to the OUT variable.
OUT = status
# ----------------------------------------
