# Dynamo graph OverrideGraphicsInViewProjection_p.dyn (Dynamo 1.3.2.2480)

# group: INPUT
select_model_element = DSModelElementSelection()  # 1 picked in the model
red = DoubleSlider(0, range=0..255 step 1)
green = DoubleSlider(129, range=0..255 step 1)
blue = DoubleSlider(69, range=0..255 step 1)
fill_patterns = FillPatterns("Solid fill")

code_block = CodeBlock { 1; }
byARGB = Color.ByARGB(a=code_block, r=red, g=green, b=blue)
byProperties = Revit.Filter.OverrideGraphicSettings.ByProperties(arg1=byARGB, arg5=fill_patterns)
overrideInView = Element.OverrideInView(element=select_model_element, overrides=byProperties)
návod = StringInput("nastaví Override Graphics in View vybraným elementom")
