# Dynamo graph Parameter Replace_p.dyn (Dynamo 2.3.0.5885)

návod = StringInput("""vyhlada textovy retazec v parametri zvolenej category a nahradi ho za zvoleny text.
napriklad premenuje vsetky rezy""")  # graph input

# group: INPUT
element_types = ElementTypes("ViewSection")  # graph input
parameter_name_always_case = StringInput("View Name")  # "Parameter name (always Case Sensitive)"; graph input
search = StringInput("Section")  # graph input
ignore_case = BoolSelector(true)  # graph input
replace_for = StringInput("Rez")  # graph input

all_elements_of_type = ElementsOfType(element_type=element_types)
getParameterValueByName = Element.GetParameterValueByName(element=all_elements_of_type, parameterName=parameter_name_always_case)
contains = String.Contains(str=getParameterValueByName, searchFor=search, ignoreCase=ignore_case)
filterByBoolMask = List.FilterByBoolMask(list=all_elements_of_type, mask=contains)
watch = Watch(filterByBoolMask.in)
filterByBoolMask_2 = List.FilterByBoolMask(list=getParameterValueByName, mask=contains)
replace = String.Replace(str=filterByBoolMask_2.in, searchFor=search, replaceWith=replace_for)
setParameterByName = Element.SetParameterByName(element=watch, parameterName=parameter_name_always_case, value=replace)
status = Watch(setParameterByName)
py_log = Python()  # unwired: IN[0]
# ---------- py_log.python (40 lines) ----------
# Load the Python Standard and DesignScript Libraries
import sys
import clr
clr.AddReference('ProtoGeometry')
from Autodesk.DesignScript.Geometry import *
clr.AddReference("RevitServices")
import RevitServices
from RevitServices.Persistence import DocumentManager

from datetime import datetime
import getpass

# name of the script for log
log_string = "Parameter Replace"

doc = DocumentManager.Instance.CurrentDBDocument
filePath = doc.PathName

# getting file name from path
try:
	lastBackslash = filePath.rindex("\\")+1
except:
	lastBackslash = filePath.rindex("/")+1
file_name = filePath[lastBackslash:]
user_name = getpass.getuser()
datestamp = str(datetime.now())
# tabulator between data to easy import to excel schedule
separator = "\t"
line = datestamp + separator + log_string + separator + user_name + "\n"

try:
	f = open("L:\\customToolslogs\\dynLogs\\" + file_name +".log", "a")
	f.write(line)
	f.close()
	status = "log has been written"
except:
	status = "something went wrong"

# Assign your output to the OUT variable.
OUT = status
# ----------------------------------------
