# Dynamo graph PoschodieSetterLevels_po.dyn (Dynamo 2.12.1.8246)
# packages: cata_lyst 0.0.1

code_block = CodeBlock { "Levels"; }
byName = Category.ByName(name=code_block)
all_elements_of_category = ElementsOfCategory(Category=byName)
code_block_2 = CodeBlock { "Poschodie"; }
name = Level.Name(level=all_elements_of_category)
py_dot_chopper = Python(IN[0]=name)  # IronPython2
# ---------- py_dot_chopper.python (16 lines) ----------
# Load the Python Standard and DesignScript Libraries
import sys
import clr
clr.AddReference('ProtoGeometry')
from Autodesk.DesignScript.Geometry import *

# The inputs to this node will be stored as a list in the IN variables.
strings = IN[0]

# Place your code below this line
split_strings = []
for s in strings:
	split_s = s.split(".")
	split_strings.append(split_s[0])
# Assign your output to the OUT variable.
OUT = split_strings
# ----------------------------------------
setParameterByName = Element.SetParameterByName(element=all_elements_of_category, parameterName=code_block_2, value=py_dot_chopper)
code_block_3 = CodeBlock { "PoschodieSetterLevels"; }
usageLog = Custom[usageLog](scriptName=code_block_3)  # package cata_lyst; node logs every run of the script in which is used to the hardcoded server location
návod = StringInput("Zapíše do Shared Prametru \"Poschodie\" všetko, čo je v názve daného Levelu pred prvou bodkou.\n\nPre \"12.NP\" zapíše \"12\"")  # graph input
