# Dynamo graph Rename Type Name_p.dyn (Dynamo 2.0.1.5055)

# group: INPUT
categories = Categories(index=589)  # graph input
search_for = StringInput("")  # graph input
replace = StringInput("")  # graph input

all_elements_of_category = ElementsOfCategory(Category=categories)
type = Custom[Element.Type](element=all_elements_of_category)  # Gets the family type of a given element (if applicable).
uniqueItems = List.UniqueItems(list=type)
string_from_object = FromObject(obj=uniqueItems)
contains = String.Contains(str=string_from_object, searchFor=search_for)
filterByBoolMask = List.FilterByBoolMask(list=uniqueItems, mask=contains)
watch = Watch(filterByBoolMask.in)
code_block = CodeBlock { "Type Name"; }
getParameterValueByName = Element.GetParameterValueByName(element=filterByBoolMask.in, parameterName=code_block)
replace_2 = String.Replace(str=getParameterValueByName, searchFor=search_for, replaceWith=replace)
setName = Custom[Element.SetName](element=filterByBoolMask.in, name=replace_2)  # Gets the name of a given Revit element
návod = StringInput("""nahradi textovy retazec v nazve vsetkych Families v ramci danej Category

Je potrebne mat nainstalovany Package Clockwork""")  # graph input
