# Dynamo graph RevisionOnSheetCopy_p.dyn (Dynamo 2.3.0.5885)
# packages: archi-lab.net 2020.23.2

návod = StringInput("""Skopíruje Revisions on Sheet z vybraného Sheetu určeného Sheet Number.

Je potrbné mať nainštalovaný package archi-lab""")  # graph input
springs_doc_activeview_py = Python()  # unwired: IN[0]
# ---------- springs_doc_activeview_py.python (14 lines) ----------
#Copyright(c) 2016, Dimitar Venkov
# @5devene, dimitar.ven@gmail.com

import clr

clr.AddReference("RevitServices")
import RevitServices
from RevitServices.Persistence import DocumentManager
doc = DocumentManager.Instance.CurrentDBDocument
clr.AddReference("RevitNodes")
import Revit
clr.ImportExtensions(Revit.Elements)

OUT = doc.ActiveView.ToDSType(True)
# ----------------------------------------
element_types = ElementTypes("ViewSheet")
all_elements_of_type = ElementsOfType(element_type=element_types)
code_block = CodeBlock { "Sheet Number"; }
getParameterValueByName = Element.GetParameterValueByName(element=all_elements_of_type, parameterName=code_block)
sheet_number_copy_from = StringInput("005b")  # graph input
eq = getParameterValueByName == sheet_number_copy_from
filterByBoolMask = List.FilterByBoolMask(list=all_elements_of_type, mask=eq)
revisions = archilab.Revit.Views.Sheets.Revisions(sheet=filterByBoolMask.in)
flatten = List.Flatten(list=revisions)
boolean = BoolSelector(true)
add_revisions_to_sheet_py = Python(IN[0]=springs_doc_activeview_py, IN[1]=flatten, IN[2]=boolean)
# ---------- add_revisions_to_sheet_py.python (76 lines) ----------
# Copyright(c) 2015, Konrad K Sobon
# @arch_laboratory, http://archi-lab.net

import clr
# Import Element wrapper extension methods
clr.AddReference("RevitNodes")
import Revit
clr.ImportExtensions(Revit.Elements)

# Import DocumentManager and TransactionManager
clr.AddReference("RevitServices")
import RevitServices
from RevitServices.Persistence import DocumentManager
from RevitServices.Transactions import TransactionManager
doc = DocumentManager.Instance.CurrentDBDocument

# Import RevitAPI
clr.AddReference("RevitAPI")
import Autodesk
from Autodesk.Revit.DB import *

import sys
pyt_path = r'C:\Program Files (x86)\IronPython 2.7\Lib'
sys.path.append(pyt_path)

import System
from System import Array
from System.Collections.Generic import *

#The inputs to this node will be stored as a list in the IN variable.
dataEnteringNode = IN

if isinstance(IN[0], list):
	sheets = []
	for i in IN[0]:
		sheets.append(UnwrapElement(i))
else:
	sheets = [UnwrapElement(IN[0])]

if isinstance(IN[1], list):
	revs = []
	for i in IN[1]:
		revs.append(UnwrapElement(i))
else:
	revs = [UnwrapElement(IN[1])]
	
RunIt = IN[2]

if RunIt:
	try:
		errorReport = None
		for i in sheets:
			revisionsOnSheet = i.GetAdditionalRevisionIds()
			for r in revs:
				print(r)
				if r.Id not in revisionsOnSheet:
					revisionsOnSheet.Add(r.Id)
				else:
					continue
			TransactionManager.Instance.EnsureInTransaction(doc)
			i.SetAdditionalRevisionIds(revisionsOnSheet)
			TransactionManager.Instance.TransactionTaskDone()
			
	except:
		# if error accurs anywhere in the process catch it
		import traceback
		errorReport = traceback.format_exc()
else:
	errorReport = "Set RunIt to True."


#Assign your output to the OUT variable
if errorReport == None:
	OUT = IN[0]
else:
	OUT = errorReport
# ----------------------------------------
py_log = Python()  # unwired: IN[0]
# ---------- py_log.python (40 lines) ----------
# Load the Python Standard and DesignScript Libraries
import sys
import clr
clr.AddReference('ProtoGeometry')
from Autodesk.DesignScript.Geometry import *
clr.AddReference("RevitServices")
import RevitServices
from RevitServices.Persistence import DocumentManager

from datetime import datetime
import getpass

# name of the script for log
log_string = "RevisionOnSheetCopy"

doc = DocumentManager.Instance.CurrentDBDocument
filePath = doc.PathName

# getting file name from path
try:
	lastBackslash = filePath.rindex("\\")+1
except:
	lastBackslash = filePath.rindex("/")+1
file_name = filePath[lastBackslash:]
user_name = getpass.getuser()
datestamp = str(datetime.now())
# tabulator between data to easy import to excel schedule
separator = "\t"
line = datestamp + separator + log_string + separator + user_name + "\n"

try:
	f = open("L:\\customToolslogs\\dynLogs\\" + file_name +".log", "a")
	f.write(line)
	f.close()
	status = "log has been written"
except:
	status = "something went wrong"

# Assign your output to the OUT variable.
OUT = status
# ----------------------------------------
