# Dynamo graph Room renumbering - filter and prefix_p.dyn (Dynamo 2.3.0.5885)

code_block = CodeBlock { "Rooms"; }
byName = Category.ByName(name=code_block)
all_elements_of_category = ElementsOfCategory(Category=byName)
code_block_2 = CodeBlock { "Name"; }
getParameterValueByName = Element.GetParameterValueByName(element=all_elements_of_category, parameterName=code_block_2)

# group: INPUT
room_name_starts_with = StringInput("Kobka")  # graph input
prefix = StringInput("k.")  # graph input

startsWith = String.StartsWith(str=getParameterValueByName, searchFor=room_name_starts_with)
filterByBoolMask = List.FilterByBoolMask(list=all_elements_of_category, mask=startsWith)
string = StringInput("Number")
count = List.Count(list=filterByBoolMask.in)
code_block_3 = CodeBlock(x=count) { 1..x; }

# group: 0 nvyse pri jednocifernych cislach
number = DoubleInput(10)
lt = code_block_3 < number
code_block_4 = CodeBlock { "0"; }
code_block_5 = CodeBlock { ""; }
if_ = If(test=lt, true=code_block_4, false=code_block_5)

code_block_6 = CodeBlock(a=prefix, b=if_, c=code_block_3) { a+b+c; }
string_from_object = FromObject(obj=code_block_6)
setParameterByName = Element.SetParameterByName(element=filterByBoolMask.in, parameterName=string, value=string_from_object)
count_2 = List.Count(list=setParameterByName)
počet_prečíslovaných_miestností = Watch(count_2)
návod = StringInput("ocisluje vsetky miestnosti, ktorych nazov zacina tak ako hodnota v \"Room name search\" a prida predponu (prefix)")  # graph input
py_log = Python()  # unwired: IN[0]
# ---------- py_log.python (37 lines) ----------
# Load the Python Standard and DesignScript Libraries
import sys
import clr
clr.AddReference('ProtoGeometry')
from Autodesk.DesignScript.Geometry import *
clr.AddReference("RevitServices")
import RevitServices
from RevitServices.Persistence import DocumentManager

from datetime import datetime
import getpass

# name of the script for log
log_string = "Room renumbering - filter and prefix"

doc = DocumentManager.Instance.CurrentDBDocument
filePath = doc.PathName

# getting file name from path
lastBackslash = filePath.rindex("\\")+1
file_name = filePath[lastBackslash:]
user_name = getpass.getuser()
datestamp = str(datetime.now())
# tabulator between data to easy import to excel schedule
separator = "\t"
line = datestamp + separator + log_string + separator + user_name + "\n"

try:
	f = open("L:\\customToolslogs\\dynLogs\\" + file_name +".log", "a")
	f.write(line)
	f.close()
	status = "log has been written"
except:
	status = "something went wrong"

# Assign your output to the OUT variable.
OUT = status
# ----------------------------------------
