# Dynamo graph Room renumbering prefix_p.dyn (Dynamo 2.3.0.5885)

code_block = CodeBlock { "Rooms"; }
byName = Category.ByName(name=code_block)
all_elements_of_category = ElementsOfCategory(Category=byName)
code_block_2 = CodeBlock { "Number"; }
getParameterValueByName = Element.GetParameterValueByName(element=all_elements_of_category, parameterName=code_block_2)
sortByKey = List.SortByKey(list=all_elements_of_category, keys=getParameterValueByName)
watch = Watch(sortByKey.sorted_keys)
string_from_object = FromObject(obj=watch)

# group: INPUT
search = StringInput("1")  # graph input
replace = StringInput("")  # graph input

startsWith = String.StartsWith(str=string_from_object, searchFor=search)
filterByBoolMask = List.FilterByBoolMask(list=sortByKey.sorted_list, mask=startsWith)
watch_2 = Watch(filterByBoolMask.in)
string = StringInput("Number")
number = DoubleInput(1)
count = List.Count(list=all_elements_of_category)
number_2 = DoubleInput(1)
sequence = Sequence(start=number, amount=count, step=number_2, lacing=Longest)

# group: 0 nvyse pri jednocifernych cislach
number_3 = DoubleInput(10)
lt = sequence < number_3
code_block_3 = CodeBlock { "0"; }
code_block_4 = CodeBlock { ""; }
if_ = If(test=lt, true=code_block_3, false=code_block_4)

code_block_5 = CodeBlock(a=replace, b=if_, c=sequence) { a+"."+b+c; }
string_from_object_2 = FromObject(obj=code_block_5)
setParameterByName = Element.SetParameterByName(element=watch_2, parameterName=string, value=string_from_object_2)
count_2 = List.Count(list=setParameterByName)
počet_prečíslovaných_miestností = Watch(count_2)
návod = StringInput("zmení prefix v číslach miestností, poradie ponechá pôvodné. Skript je použiteľný aj na rýchle prečíslovanie po vymazaní niektorých miestností")  # graph input
py_log = Python()  # unwired: IN[0]
# ---------- py_log.python (37 lines) ----------
# Load the Python Standard and DesignScript Libraries
import sys
import clr
clr.AddReference('ProtoGeometry')
from Autodesk.DesignScript.Geometry import *
clr.AddReference("RevitServices")
import RevitServices
from RevitServices.Persistence import DocumentManager

from datetime import datetime
import getpass

# name of the script for log
log_string = "Room renumbering prefix"

doc = DocumentManager.Instance.CurrentDBDocument
filePath = doc.PathName

# getting file name from path
lastBackslash = filePath.rindex("\\")+1
file_name = filePath[lastBackslash:]
user_name = getpass.getuser()
datestamp = str(datetime.now())
# tabulator between data to easy import to excel schedule
separator = "\t"
line = datestamp + separator + log_string + separator + user_name + "\n"

try:
	f = open("L:\\customToolslogs\\dynLogs\\" + file_name +".log", "a")
	f.write(line)
	f.close()
	status = "log has been written"
except:
	status = "something went wrong"

# Assign your output to the OUT variable.
OUT = status
# ----------------------------------------
