# Dynamo graph Room renumbering spline-byty_p.dyn (Dynamo 2.3.0.5885)
# packages: Clockwork for Dynamo 2.x 2.1.2

code_block = CodeBlock { "Rooms"; }
byName = Category.ByName(name=code_block)
all_elements_of_category = ElementsOfCategory(Category=byName)

# group: INPUT
levels = Levels("3.NP")
select_model_line = DSModelElementSelection()  # 1 picked in the model; graph input
code_block_2 = CodeBlock { 1000; }
prefix = StringInput("A")  # graph input
number_of_level = DoubleInput(2)  # graph input
cislo_bytu = DoubleInput(6)  # graph input
start_number = DoubleInput(1)  # graph input

# group: level filter
level = Custom[Element.Level](element=all_elements_of_category)  # package Clockwork for Dynamo 2.x; Gets an element's level
name = Level.Name(level=level)
name_2 = Level.Name(level=levels)
eq = name == name_2
filterByBoolMask = List.FilterByBoolMask(list=all_elements_of_category, mask=eq)

filterByBoolMask_2 = List.FilterByBoolMask(list=filterByBoolMask.in)  # unwired: mask
watch = Watch(filterByBoolMask_2.in)
# note: chyba v tomto node, znamena ze ciara nie je nakreslena ako MODEL LINE
curve = CurveElement.Curve(curveElement=select_model_line)
# note: chyba v tomto node znamena ze ciara je prilis dlha
pointsAtChordLengthFromPoint = Curve.PointsAtChordLengthFromPoint(curve=curve, chordLength=code_block_2)
splitByPoints = Curve.SplitByPoints(curve=curve, points=pointsAtChordLengthFromPoint)
endPoint = Curve.EndPoint(curve=splitByPoints)
geometry = Element.Geometry(element=filterByBoolMask.in)
boundingBox = Geometry.BoundingBox(geometry=geometry)
flatten = List.Flatten(list=boundingBox)
contains = BoundingBox.Contains(boundingBox=flatten)  # unwired: point
map = List.Map(list=endPoint, f_x=contains)
map_2 = List.Map(list=map, f_x=filterByBoolMask_2.in)
flatten_2 = List.Flatten(list=map_2)
uniqueItems = List.UniqueItems(list=flatten_2)
watch_2 = Watch(uniqueItems)
string = StringInput("Number")
code_block_3 = CodeBlock { "."; }

# group: 0 navyse pri jednocifernych cislach
number = DoubleInput(10)
lt = cislo_bytu < number
number_2 = DoubleInput(0)
code_block_4 = CodeBlock { ""; }
if_ = If(test=lt, true=number_2, false=code_block_4)

count = List.Count(list=watch_2)
number_3 = DoubleInput(1)
sequence = Sequence(start=start_number, amount=count, step=number_3, lacing=Longest)
string_from_object = FromObject(obj=sequence)
toNumber = String.ToNumber(str=string_from_object)

# group: 0 navyse pri jednocifernych cislach
number_4 = DoubleInput(10)
lt_2 = toNumber < number_4
number_5 = DoubleInput(0)
code_block_5 = CodeBlock { ""; }
if_2 = If(test=lt_2, true=number_5, false=code_block_5)

code_block_6 = CodeBlock(pref=prefix, lev=number_of_level, dot=code_block_3, zer1=if_, flat=cislo_bytu, zer2=if_2, room=string_from_object) { pref+lev+dot+zer1+flat+zer2+room; }
setParameterByName = Element.SetParameterByName(element=watch_2, parameterName=string, value=code_block_6)
count_2 = List.Count(list=setParameterByName)
počet_prečísovaných_miestností = Watch(count_2)
návod = StringInput("""Format precislovania = pl.bbmm
p=prefix, l=level, b=cislo bytu, m=cislo miestnosti
napr. = A12.0105

Precisluje miestnosti podla nakreslenej ciary.
	Najprv je potrebne nakreslit ciaru (najlepsie spline), ktora pretina miestnosti ktore chceme precislovat. Ciary je dobre robit v samostatnej Subcategory napr. "Renumbering rooms" aby sa dali lahko vsetky naraz vypnut/zapnut pre nasledne opatovne precislovanie. Ciara musi byt kreslena ako Model Line alebo convertovana z Detail Line.
	Model Line musi byt nakreslena vo Workplane, ktora pretina precislovane miestnost, cize typicky v rovine podlahy. Pri velmi dlhej ciare sa moze vyskytnut chyba, vtedy rozdelte ciaru na viacere elementy.
	Prikaz moze pracovat dlhsie, nepustajte ho v automatickom mode, ale len v manualnom.""")  # graph input
py_log = Python()  # unwired: IN[0]
# ---------- py_log.python (37 lines) ----------
# Load the Python Standard and DesignScript Libraries
import sys
import clr
clr.AddReference('ProtoGeometry')
from Autodesk.DesignScript.Geometry import *
clr.AddReference("RevitServices")
import RevitServices
from RevitServices.Persistence import DocumentManager

from datetime import datetime
import getpass

# name of the script for log
log_string = "Room renumbering spline-byty"

doc = DocumentManager.Instance.CurrentDBDocument
filePath = doc.PathName

# getting file name from path
lastBackslash = filePath.rindex("\\")+1
file_name = filePath[lastBackslash:]
user_name = getpass.getuser()
datestamp = str(datetime.now())
# tabulator between data to easy import to excel schedule
separator = "\t"
line = datestamp + separator + log_string + separator + user_name + "\n"

try:
	f = open("L:\\customToolslogs\\dynLogs\\" + file_name +".log", "a")
	f.write(line)
	f.close()
	status = "log has been written"
except:
	status = "something went wrong"

# Assign your output to the OUT variable.
OUT = status
# ----------------------------------------
