# Dynamo graph Room renumbering spline_p.dyn (Dynamo 2.3.0.5885)
# packages: archi-lab.net 2020.23.2

code_block = CodeBlock { "Rooms"; }
byName = Category.ByName(name=code_block)
all_elements_of_category = ElementsOfCategory(Category=byName)
watch = Watch(all_elements_of_category)
filterByBoolMask = List.FilterByBoolMask(list=all_elements_of_category)  # unwired: mask
watch_2 = Watch(filterByBoolMask.in)

# group: INPUT
select_model_line = DSModelElementSelection()  # 1 picked in the model; graph input
code_block_2 = CodeBlock { 1000; }
prefix = StringInput("")  # graph input
number_of_level = DoubleInput(5)  # graph input
start_number = DoubleInput(1)  # graph input

# note: chyba v tomto node, znamena ze ciara nie je nakreslena ako MODEL LINE
curve = CurveElement.Curve(curveElement=select_model_line)
# note: chyba v tomto node znamena ze ciara je prilis dlha
pointsAtChordLengthFromPoint = Curve.PointsAtChordLengthFromPoint(curve=curve, chordLength=code_block_2)
splitByPoints = Curve.SplitByPoints(curve=curve, points=pointsAtChordLengthFromPoint)
endPoint = Curve.EndPoint(curve=splitByPoints)
geometry = Element.Geometry(element=all_elements_of_category)
boundingBox = Geometry.BoundingBox(geometry=geometry)
flatten = List.Flatten(list=boundingBox)
contains = BoundingBox.Contains(boundingBox=flatten)  # unwired: point
map = List.Map(list=endPoint, f_x=contains)
map_2 = List.Map(list=map, f_x=filterByBoolMask.in)
flatten_2 = List.Flatten(list=map_2)
uniqueItems = List.UniqueItems(list=flatten_2)
watch_3 = Watch(uniqueItems)
string = StringInput("Number")
code_block_3 = CodeBlock { "."; }
count = List.Count(list=watch_3)
number = DoubleInput(1)
sequence = Sequence(start=start_number, amount=count, step=number, lacing=Longest)

# group: 0 navyse pri dvojcifernych cislach
code_block_4 = CodeBlock { 100.000; }
lt = sequence < code_block_4
number_2 = DoubleInput(0)
code_block_5 = CodeBlock { ""; }
if_ = If(test=lt, true=number_2, false=code_block_5)

# group: 0 navyse pri jednocifernych cislach
number_3 = DoubleInput(10)
lt_2 = sequence < number_3
number_4 = DoubleInput(0)
code_block_6 = CodeBlock { ""; }
if_2 = If(test=lt_2, true=number_4, false=code_block_6)

string_from_object = FromObject(obj=sequence)
code_block_7 = CodeBlock(x=prefix, a=number_of_level, b=code_block_3, ba=if_, c=if_2, d=string_from_object) { x+a+b+ba+c+d; }
setParameterByName = Element.SetParameterByName(element=watch_3, parameterName=string, value=code_block_7)
count_2 = List.Count(list=setParameterByName)
počet_prečíslovaných_miestností = Watch(count_2)
návod = StringInput("""Format precislovania = pl.mmm
p=prefix, l=level, m=cislo miestnosti
napr. = A12.156

Precisluje miestnosti podla nakreslenej ciary.
	Najprv je potrebne nakreslit ciaru (najlepsie spline), ktora pretina miestnosti ktore chceme precislovat. Ciary je dobre robit v samostatnej Subcategory napr. "Renumbering rooms" aby sa dali lahko vsetky naraz vypnut/zapnut pre nasledne opatovne precislovanie. Ciara musi byt kreslena ako Model Line alebo konvertovana z Detail Line.
	Model Line musi byt nakreslena vo Workplane, ktora pretina precislovane miestnosti, cize typicky v rovine podlahy. Pri velmi dlhej ciare sa moze vyskytnut chyba, vtedy rozdelte ciaru na viacere elementy.
	Prikaz moze pracovat dlhsie, nepustajte ho v automatickom mode, ale len v manualnom.""")  # graph input
clear_list = Custom[Clear List]()  # package archi-lab.net; This node will remove all Null and Empty Lists from any list.; unwired: input
py_log = Python()  # unwired: IN[0]
# ---------- py_log.python (37 lines) ----------
# Load the Python Standard and DesignScript Libraries
import sys
import clr
clr.AddReference('ProtoGeometry')
from Autodesk.DesignScript.Geometry import *
clr.AddReference("RevitServices")
import RevitServices
from RevitServices.Persistence import DocumentManager

from datetime import datetime
import getpass

# name of the script for log
log_string = "Room renumbering spline"

doc = DocumentManager.Instance.CurrentDBDocument
filePath = doc.PathName

# getting file name from path
lastBackslash = filePath.rindex("\\")+1
file_name = filePath[lastBackslash:]
user_name = getpass.getuser()
datestamp = str(datetime.now())
# tabulator between data to easy import to excel schedule
separator = "\t"
line = datestamp + separator + log_string + separator + user_name + "\n"

try:
	f = open("L:\\customToolslogs\\dynLogs\\" + file_name +".log", "a")
	f.write(line)
	f.close()
	status = "log has been written"
except:
	status = "something went wrong"

# Assign your output to the OUT variable.
OUT = status
# ----------------------------------------
