# Dynamo graph RoomParamCopyNEW_po.dyn (Dynamo 2.12.1.8246)

code_block = CodeBlock()
# ---------- code_block.designscript (9 lines) ----------
["Cislo_Bytu/Priestoru",
"Ext_Int",
"Izbovost",
"Kod_Profesie",
"Room Number short",
"Stavebny Objekt",
"Svetla vyska",
"Typ_bytu",
"vybavenie miestnosti"];
# ----------------------------------------
code_block_2 = CodeBlock { "Rooms"; }
byName = Category.ByName(name=code_block_2)
all_elements_of_category = ElementsOfCategory(Category=byName)
original_room_parameters = CodeBlock()
# ---------- original_room_parameters.designscript (4 lines) ----------
["Stavebny Objekt",
"Poschodie",
"Typ_bytu",
"Room Number short"];
# ----------------------------------------
getParameterValueByName = Element.GetParameterValueByName(element=all_elements_of_category@L1, parameterName=original_room_parameters)
code_block_3 = CodeBlock { 0; 1; 2; 3; }
getItemAtIndex = List.GetItemAtIndex(list=getParameterValueByName@L2, index=code_block_3.out0)
code_block_4 = CodeBlock { "."; }
getItemAtIndex_2 = List.GetItemAtIndex(list=getParameterValueByName@L2, index=code_block_3.out1)
getItemAtIndex_3 = List.GetItemAtIndex(list=getParameterValueByName@L2, index=code_block_3.out2)
getItemAtIndex_4 = List.GetItemAtIndex(list=getParameterValueByName@L2, index=code_block_3.out3)

# group: Room Number Concat
code_block_5 = CodeBlock { "Number"; }
room_number = CodeBlock(objekt=getItemAtIndex, dot=code_block_4, poschodie=getItemAtIndex_2, byt=getItemAtIndex_3, number=getItemAtIndex_4) { objekt+dot+poschodie+dot+byt+dot+number; }
setParameterByName = Element.SetParameterByName(element=all_elements_of_category, parameterName=code_block_5, value=room_number)

# group: CisloBytu/Priestoru
code_block_6 = CodeBlock { "Cislo_Bytu/Priestoru"; }
cislo_bytu_priestoru = CodeBlock(objekt=getItemAtIndex, dot=code_block_4, poschodie=getItemAtIndex_2, byt=getItemAtIndex_3) { objekt+dot+poschodie+dot+byt; }
setParameterByName_2 = Element.SetParameterByName(element=all_elements_of_category, parameterName=code_block_6, value=cislo_bytu_priestoru)

# group: Interier/exterier
rooms = CodeBlock(RoomInstances=all_elements_of_category) { RoomInstances; }
code_block_7 = CodeBlock { "Name"; }
getParameterValueByName_2 = Element.GetParameterValueByName(element=all_elements_of_category, parameterName=code_block_7)
code_block_8 = CodeBlock()
# ---------- code_block_8.designscript (4 lines) ----------
["terasa",
"balkón",
"loggia",
"lodžia"];
# ----------------------------------------
code_block_9 = CodeBlock { true; }
contains = String.Contains(string=getParameterValueByName_2, searchFor=code_block_8, ignoreCase=code_block_9, lacing=CrossProduct)
transpose = List.Transpose(lists=contains)
filterByBoolMask = List.FilterByBoolMask(list=rooms, mask=transpose@L2)
flatten = List.Flatten(list=filterByBoolMask.in)
code_block_10 = CodeBlock { "Ext_Int"; "Exteriér"; "Interiér"; }
setParameterByName_3 = Element.SetParameterByName(element=flatten, parameterName=code_block_10.out0, value=code_block_10.out1)
flatten_2 = List.Flatten(list=filterByBoolMask.out)
setParameterByName_4 = Element.SetParameterByName(element=flatten_2, parameterName=code_block_10.out0, value=code_block_10.out2)
