# Dynamo graph SUM of selected element Length_p.dyn (Dynamo 2.3.0.5885)

# group: INPUT
# note: Spocita dlzku jednotlivych elementov.
# Elementy je potrebne vybrat cez Crossing Window. Podporovane su vsetky elementy, ktore maju parameter Length (Railings, Walls, Lines...)
vyberte_elementy_oknom = DSModelElementsSelection()  # nothing selected; graph input

count = List.Count(list=vyberte_elementy_oknom)
počet_elementov = Watch(count)
code_block = CodeBlock { "Length"; }
getParameterValueByName = Element.GetParameterValueByName(element=vyberte_elementy_oknom, parameterName=code_block)
sum = Math.Sum(values=getParameterValueByName)
code_block_2 = CodeBlock { 2; }
round = Math.Round(number=sum, digits=code_block_2)
dlzka_v_mm = Watch(round)
code_block_3 = CodeBlock(a=dlzka_v_mm) { a/1000; }
dlzka_v_m = Watch(code_block_3)  # graph output
návod = StringInput("""Spocita dlzku jednotlivych elementov.
Elementy je potrebne vybrat cez Crossing Window. Podporovane su vsetky elementy, ktore maju parameter Length (Railings, Walls, Lines...)""")  # graph input
py_log = Python()  # unwired: IN[0]
# ---------- py_log.python (40 lines) ----------
# Load the Python Standard and DesignScript Libraries
import sys
import clr
clr.AddReference('ProtoGeometry')
from Autodesk.DesignScript.Geometry import *
clr.AddReference("RevitServices")
import RevitServices
from RevitServices.Persistence import DocumentManager

from datetime import datetime
import getpass

# name of the script for log
log_string = "SUM of selected element Length"

doc = DocumentManager.Instance.CurrentDBDocument
filePath = doc.PathName

# getting file name from path
try:
	lastBackslash = filePath.rindex("\\")+1
except:
	lastBackslash = filePath.rindex("/")+1
file_name = filePath[lastBackslash:]
user_name = getpass.getuser()
datestamp = str(datetime.now())
# tabulator between data to easy import to excel schedule
separator = "\t"
line = datestamp + separator + log_string + separator + user_name + "\n"

try:
	f = open("L:\\customToolslogs\\dynLogs\\" + file_name +".log", "a")
	f.write(line)
	f.close()
	status = "log has been written"
except:
	status = "something went wrong"

# Assign your output to the OUT variable.
OUT = status
# ----------------------------------------
