# Dynamo graph SUM of selected element Volume_p.dyn (Dynamo 2.3.0.5885)

# group: INPUT
# note: Spocita objem jednotlivych elementov.
# Elementy je potrebne vybrat cez Crossing Window. Podporovane su vsetky elementy, ktore maju parameter Volume (Walls, Floors, Columns, Slab Edges...)
vyberte_elementy_oknom = DSModelElementsSelection()  # nothing selected; graph input

count = List.Count(list=vyberte_elementy_oknom)
počet_elementov = Watch(count)
code_block = CodeBlock { "Volume"; }
getParameterValueByName = Element.GetParameterValueByName(element=vyberte_elementy_oknom, parameterName=code_block)
sum = Math.Sum(values=getParameterValueByName)
code_block_2 = CodeBlock { 3; }
round = Math.Round(number=sum, digits=code_block_2)
objem_v_m3 = Watch(round)
code_block_3 = CodeBlock(a=sum) { a*1000; }
round_2 = Math.Round(number=code_block_3, digits=code_block_2)
objem_v_litroch = Watch(round_2)
návod = StringInput("""Spocita objem jednotlivych elementov.
Elementy je potrebne vybrat cez Crossing Window. Podporovane su vsetky elementy, ktore maju parameter Volume (Walls, Floors, Columns, Slab Edges...)""")  # graph input
py_log = Python()  # unwired: IN[0]
# ---------- py_log.python (37 lines) ----------
# Load the Python Standard and DesignScript Libraries
import sys
import clr
clr.AddReference('ProtoGeometry')
from Autodesk.DesignScript.Geometry import *
clr.AddReference("RevitServices")
import RevitServices
from RevitServices.Persistence import DocumentManager

from datetime import datetime
import getpass

# name of the script for log
log_string = "SUM of selected element Volume"

doc = DocumentManager.Instance.CurrentDBDocument
filePath = doc.PathName

# getting file name from path
lastBackslash = filePath.rindex("\\")+1
file_name = filePath[lastBackslash:]
user_name = getpass.getuser()
datestamp = str(datetime.now())
# tabulator between data to easy import to excel schedule
separator = "\t"
line = datestamp + separator + log_string + separator + user_name + "\n"

try:
	f = open("L:\\customToolslogs\\dynLogs\\" + file_name +".log", "a")
	f.write(line)
	f.close()
	status = "log has been written"
except:
	status = "something went wrong"

# Assign your output to the OUT variable.
OUT = status
# ----------------------------------------
