# Dynamo graph ScheduleChecker.dyn (Dynamo 2.3.0.5885)

code_block = CodeBlock { "Schedules"; }
byName = Category.ByName(name=code_block)
all_elements_of_category = ElementsOfCategory(Category=byName)
name = Element.Name(element=all_elements_of_category)
scheduleFilters = ScheduleView.ScheduleFilters(scheduleView=all_elements_of_category)

# group: sublist to string
code_block_2 = CodeBlock { ","; }
string_from_object = FromObject(obj=scheduleFilters)
join = String.Join(separator=code_block_2, string0=string_from_object)
flatten = List.Flatten(list=join)

list_create = List.Create(item0=name, item1=flatten)
transpose = List.Transpose(lists=list_create)

# group: OUTPUT
# note: Place output for Dynamo Player
schedule_group_list = Watch(transpose)  # graph output

# group: INPUT
file_path = Filename("C:\Users\davidv\Desktop\schedules.xls")  # graph input
overwrite_schedule = BoolSelector(true)  # graph input

file_from_path = FileObject(path=file_path)
string_from_object_2 = FromObject(obj=file_from_path)
code_block_3 = CodeBlock { "Schedules"; 1; 0; }
exportExcel = Data.ExportExcel(filePath=string_from_object_2, sheetName=code_block_3.out0, startRow=code_block_3.out1, startCol=code_block_3.out2, data=transpose, overWrite=overwrite_schedule)
návod = StringInput("Vytvorí excelovskú tabuľku Schedules so Schedule Name a s uvedením nastavených filtrov. Napr. na skontrolvanie filtra vytvorených tabuliek nastaveného na správny byt pri vytváraní knihy bytov.")  # graph input
py_log = Python()  # unwired: IN[0]
# ---------- py_log.python (40 lines) ----------
# Load the Python Standard and DesignScript Libraries
import sys
import clr
clr.AddReference('ProtoGeometry')
from Autodesk.DesignScript.Geometry import *
clr.AddReference("RevitServices")
import RevitServices
from RevitServices.Persistence import DocumentManager

from datetime import datetime
import getpass

# name of the script for log
log_string = "ScheduleChecker"

doc = DocumentManager.Instance.CurrentDBDocument
filePath = doc.PathName

# getting file name from path
try:
	lastBackslash = filePath.rindex("\\")+1
except:
	lastBackslash = filePath.rindex("/")+1
file_name = filePath[lastBackslash:]
user_name = getpass.getuser()
datestamp = str(datetime.now())
# tabulator between data to easy import to excel schedule
separator = "\t"
line = datestamp + separator + log_string + separator + user_name + "\n"

try:
	f = open("L:\\customToolslogs\\dynLogs\\" + file_name +".log", "a")
	f.write(line)
	f.close()
	status = "log has been written"
except:
	status = "something went wrong"

# Assign your output to the OUT variable.
OUT = status
# ----------------------------------------
