# Dynamo graph SchodyPodchodnaVyska_p.dyn (Dynamo 2.3.0.5885)

návod = StringInput("Vypočíta podchodnú a priechodnú výšku vybraného schodiska podľa STN 73 4130 ")  # graph input

# group: INPUT
select_stairs = DSModelElementSelection()  # 1 picked in the model; graph input

code_block = CodeBlock { "Actual Riser Height"; }
getParameterValueByName = Element.GetParameterValueByName(element=select_stairs, parameterName=code_block)
code_block_2 = CodeBlock { "Actual Tread Depth"; }
getParameterValueByName_2 = Element.GetParameterValueByName(element=select_stairs, parameterName=code_block_2)
angle_of_staircase_run = CodeBlock(height=getParameterValueByName, depth=getParameterValueByName_2) { Math.Atan(height/depth); }
code_block_3 = CodeBlock { 1; }
round = Math.Round(number=angle_of_staircase_run, digits=code_block_3)
code_block_4 = CodeBlock(angle=angle_of_staircase_run) { 750+1500*Math.Cos(angle); }
round_2 = Math.Round(number=code_block_4)
code_block_5 = CodeBlock(angle=angle_of_staircase_run) { 1500+(750/Math.Cos(angle)); }
round_3 = Math.Round(number=code_block_5)

# group: claims
code_block_6 = CodeBlock(a=round) { "príliš strmé schodisko "+a+" - nevyhovuje ako hlavné schodisko - z.532 §27 bod 4"; }
code_block_7 = CodeBlock(a=round_2) { a+" - nevyhovuje bodu 23 STN 73 4130"; }
code_block_8 = CodeBlock(b=round_3, a=getParameterValueByName) { b+" - príliš veľká výška stupňa "+a+" - nevyhovuje"; }

code_block_9 = CodeBlock(x=round, y=code_block_6, z=round) { (x>35)?y:z; }
sklon_schodiskového_ramena = Watch(code_block_9)  # graph output
code_block_10 = CodeBlock(x=round_2, y=code_block_7, z=round_2) { (x<1900)?y:z; }
najmenšia_priechodná_výška_v_mm = Watch(code_block_10)  # graph output
code_block_11 = CodeBlock(x=getParameterValueByName, y=code_block_8, z=round_3) { (x>180)?y:z; }
najmenšia_podchodná_výška_mm = Watch(code_block_11)  # graph output
py_log = Python()  # unwired: IN[0]
# ---------- py_log.python (40 lines) ----------
# Load the Python Standard and DesignScript Libraries
import sys
import clr
clr.AddReference('ProtoGeometry')
from Autodesk.DesignScript.Geometry import *
clr.AddReference("RevitServices")
import RevitServices
from RevitServices.Persistence import DocumentManager

from datetime import datetime
import getpass

# name of the script for log
log_string = "schodyPodchodnaVyska"

doc = DocumentManager.Instance.CurrentDBDocument
filePath = doc.PathName

# getting file name from path
try:
	lastBackslash = filePath.rindex("\\")+1
except:
	lastBackslash = filePath.rindex("/")+1
file_name = filePath[lastBackslash:]
user_name = getpass.getuser()
datestamp = str(datetime.now())
# tabulator between data to easy import to excel schedule
separator = "\t"
line = datestamp + separator + log_string + separator + user_name + "\n"

try:
	f = open("L:\\customToolslogs\\dynLogs\\" + file_name +".log", "a")
	f.write(line)
	f.close()
	status = "log has been written"
except:
	status = "something went wrong"

# Assign your output to the OUT variable.
OUT = status
# ----------------------------------------
