# Dynamo graph UniqueIDsGet_p.dyn "UniqueIDsGet" (Dynamo 2.0.1.5055)

# group: Get UID INPUT
select_model_elements = DSModelElementsSelection()  # 1 picked in the model; graph input

uniqueId = Element.UniqueId(element=select_model_elements)
unique_ids = Watch(uniqueId)  # graph output
count = List.Count(list=uniqueId)
py_list_generator = Python(IN[0]=uniqueId, IN[1]=count)
# ---------- py_list_generator.python (29 lines) ----------
# Enable Python support and load DesignScript library
import clr
clr.AddReference('ProtoGeometry')
from Autodesk.DesignScript.Geometry import *

# The inputs to this node will be stored as a list in the IN variables.
#sourcelist=[]
sourcelist = IN[0]
count = IN[1]
x=""

def quote(a):
    b='"'+a+'"'
    return a

if count<2: c=sourcelist
else:
	for i in range(0,count-1):
		x=x+sourcelist[i]+", "
	x=x+sourcelist[count-1]
	c="ID označených elementov: "+x

#print sourcelist[newlist]
#for i in range

# Place your code below this line

# Assign your output to the OUT variable.
OUT = c
# ----------------------------------------
unique_ids_list_for_dynamo = Watch(py_list_generator)
py_clipboard = Python(IN[0]=py_list_generator)
# ---------- py_clipboard.python (24 lines) ----------
import clr
clr.AddReference('ProtoGeometry')
from Autodesk.DesignScript.Geometry import *

clr.AddReference('System.Windows.Forms')
from System.Windows.Forms import Clipboard

import sys
pyt_path = r'C:\Program Files (x86)\IronPython 2.7\Lib'
sys.path.append(pyt_path)

#The inputs to this node will be stored as a list in the IN variables.
#leaved commented text from original WRITE TO TEXT FILE node
A = IN[0]
#path = IN[1]

#anewline = "\n".join(A.split(", "))

try:
	Clipboard.SetText(A)
	OUT = "Výstup bol nakopírovaný do schránky"
#	OUT = IN[0]
except:
	OUT = 'Data could not be copied to clipboard'
# ----------------------------------------
clipboard_status = Watch(py_clipboard)  # graph output
návod = StringInput("""Vygeneruje Unique IDs (UIDs) vybraných elementov a vloží ho do Clipboardu. Zoznam sa pošle druhej strane.

Druhá strana si Zoznam vloží v do Select By Unique ID v skripte UniqueIDsSelect.dyn. Skript označí Elementy s príslušným UIDs. Skript spúšťajte s aktívnym 3D view.""")  # graph input
