# Dynamo graph UniqueIDsSelect_p.dyn "UniqueIDsSelect" (Dynamo 2.0.1.5055)

# group: Input pre Dynamo player
select_by_unique_id = StringInput("")  # graph input

# group: One UID
python_script = Python(IN[0]=select_by_unique_id)
# ---------- python_script.python (27 lines) ----------
import clr
clr.AddReference("RevitAPI")
import Autodesk
from Autodesk.Revit.DB import ElementId
clr.AddReference("RevitServices")
import RevitServices
from RevitServices.Persistence import DocumentManager
clr.AddReference("System")
from System.Collections.Generic import List

doc = DocumentManager.Instance.CurrentDBDocument

guids = IN[0]

if not isinstance(guids, list):
	guids = [guids]
	
elems = []

for g in guids:
	hexid = g[37:]
	id = int(hexid, 16)
	elem = doc.GetElement(ElementId(id));
	elems.append(elem)


OUT = elems
# ----------------------------------------
id = Element.Id(element=python_script)
python_script_2 = Python(IN[0]=id)
# ---------- python_script_2.python (29 lines) ----------
import clr
clr.AddReference("RevitAPI")
import Autodesk
from Autodesk.Revit.DB import ElementId
clr.AddReference("RevitServices")
import RevitServices
from RevitServices.Persistence import DocumentManager
clr.AddReference("System")
from System.Collections.Generic import List

uiapp = DocumentManager.Instance.CurrentUIApplication

ids = IN[0]

# if it's not a list, make it a list
if not isinstance(ids, list):
	ids = [ids]

# convert to element ids
elemIds = []
for id in ids:
    elemIds.append(ElementId(id))
    

# cast to icollection and select
uiapp.ActiveUIDocument.Selection.SetElementIds(List[ElementId](elemIds));

#Assign your output to the OUT variable.
OUT = 0
# ----------------------------------------

návod = StringInput("""Druhá strana vygeneruje Unique IDs (UIDs) vybraných elementov pomocou skriptu UniqueIDsGet.dyn a pošle ho nám.

Zoznam je potrebné vložiť do Select By Unique ID. Skript označí Elementy s príslušným UIDs. Skript spúšťajte s aktívnym 3D view.""")  # graph input
