# Dynamo graph Views - Control Internal Origin_po.dyn (Dynamo 2.3.0.5885)

python_script_get_views_without = Python()  # "Python Script - Get Views without Templates and View Templates"
# ---------- python_script_get_views_without.python (45 lines) ----------
#Copyright(c) 2019, Aaron Rumple, AIA
#David Vadkerti - added Detail Views treating

import clr
clr.AddReference('ProtoGeometry')
from Autodesk.DesignScript.Geometry import *

# Import ToDSType(bool) extension method
clr.AddReference("RevitNodes")
import Revit
clr.ImportExtensions(Revit.Elements)

# Import DocumentManager and TransactionManager
clr.AddReference("RevitServices")
import RevitServices
from RevitServices.Persistence import DocumentManager
from RevitServices.Transactions import TransactionManager

from System.Collections.Generic import *

# Import RevitAPI
clr.AddReference("RevitAPI")
import Autodesk
from Autodesk.Revit.DB import *

myDoc = DocumentManager.Instance.CurrentDBDocument
uiapp = DocumentManager.Instance.CurrentUIApplication
app = uiapp.Application

myViews = FilteredElementCollector(myDoc).OfCategory(BuiltInCategory.OST_Views).WhereElementIsNotElementType().ToElements()
myRules = []
myCollectedViews = []
for myView in myViews:
	if myView.ViewType == ViewType.FloorPlan or myView.ViewType == ViewType.CeilingPlan	or myView.ViewType == ViewType.Elevation \
	   or myView.ViewType == ViewType.Section or myView.ViewType == ViewType.ThreeD or myView.ViewType == ViewType.Detail:
		if myView.IsTemplate == False and myView.ViewTemplateId.IntegerValue == -1:
				myCollectedViews.append(myView)
		else:
			pass
			
viewTemplates = [t for t in FilteredElementCollector(myDoc).OfClass(View).ToElements() if t.ViewType != ViewType.ThreeD and t.IsTemplate == True and t.ViewType != ViewType.Schedule]

myCollectedViews.extend(viewTemplates)

OUT = myCollectedViews
# ----------------------------------------

# group: Site Sub Categories
string = StringInput("Site - Internal Origin")
byName = Category.ByName(name=string)
string_2 = StringInput("Site - Project Base Point")
byName_2 = Category.ByName(name=string_2)
string_3 = StringInput("Site - Survey Point")
byName_3 = Category.ByName(name=string_3)

byProperties = Revit.Filter.OverrideGraphicSettings.ByProperties()

# group: Visibility Toggles
hide_internal_origin = BoolSelector(true)  # graph input
setCategoryOverrides = View.SetCategoryOverrides(view=python_script_get_views_without, category=byName, overrides=byProperties, hide=hide_internal_origin, lacing=CrossProduct)
hide_project_base_point = BoolSelector(true)  # graph input
setCategoryOverrides_2 = View.SetCategoryOverrides(view=python_script_get_views_without, category=byName_2, overrides=byProperties, hide=hide_project_base_point)
hide_survey_point = BoolSelector(true)  # graph input
setCategoryOverrides_3 = View.SetCategoryOverrides(view=python_script_get_views_without, category=byName_3, overrides=byProperties, hide=hide_survey_point)

návod = StringInput("""Vypne Internal origin, Survey Point a Project Base Point vo všetkých FloorPlan, CeilingPlan, Elevation, Section, 3D Views a Detail Views

Skryť tieto body vie len vtedy ak je zobrazenie linku nastavené na "By Host View"

Ak je nastavený na „By Linked View”, musi byt skript spustený v danom linku.
""")  # graph input
py_log = Python()  # unwired: IN[0]
# ---------- py_log.python (40 lines) ----------
# Load the Python Standard and DesignScript Libraries
import sys
import clr
clr.AddReference('ProtoGeometry')
from Autodesk.DesignScript.Geometry import *
clr.AddReference("RevitServices")
import RevitServices
from RevitServices.Persistence import DocumentManager

from datetime import datetime
import getpass

# name of the script for log
log_string = "Views - Control Internal Origin"

doc = DocumentManager.Instance.CurrentDBDocument
filePath = doc.PathName

# getting file name from path
try:
	lastBackslash = filePath.rindex("\\")+1
except:
	lastBackslash = filePath.rindex("/")+1
file_name = filePath[lastBackslash:]
user_name = getpass.getuser()
datestamp = str(datetime.now())
# tabulator between data to easy import to excel schedule
separator = "\t"
line = datestamp + separator + log_string + separator + user_name + "\n"

try:
	f = open("L:\\customToolslogs\\dynLogs\\" + file_name +".log", "a")
	f.write(line)
	f.close()
	status = "log has been written"
except:
	status = "something went wrong"

# Assign your output to the OUT variable.
OUT = status
# ----------------------------------------
