# Dynamo graph Wall location line copy_p.dyn (Dynamo 1.3.1.1736)

# group: input
copy_to_crossing_window = DSModelElementsSelection()
copy_from = DSModelElementSelection()

code_block = CodeBlock { "Location Line"; }
getParameterValueByName = Element.GetParameterValueByName(element=copy_from, parameterName=code_block)
watch = Watch(getParameterValueByName)
setParameterByName = Element.SetParameterByName(element=copy_to_crossing_window, parameterName=code_block, value=watch)
code_block_2 = CodeBlock()
# ---------- code_block_2.designscript (2 lines) ----------
{"Wall Centerline (default)", "Core Centerline", "Finish Face: Exterior", "Finish Face: Interior", "Core Face: Exterior",
 "Core Face: Interior"};
# ----------------------------------------
getItemAtIndex = List.GetItemAtIndex(list=code_block_2, index=watch)

# group (continued): input
# note: Skopiruje Location line z jednej steny na ine.
settings_copying = Watch(getItemAtIndex)

návod = StringInput("Skopiruje Location line z jednej steny na ine. ")
