# Dynamo graph WarningColorSelect_po.dyn (Dynamo 2.3.0.5885)
# packages: archi-lab.net 2020.23.2

# group: from archilab package
getWarnings = archilab.Revit.Elements.Warning.GetWarnings()
elements = archilab.Revit.Elements.Warning.Elements(warning=getWarnings)

flatten = List.Flatten(list=elements)

# group: from archilab package
clear_list = Custom[Clear List](input=flatten)  # package archi-lab.net; This node will remove all Null and Empty Lists from any list.
id = archilab.Revit.Elements.WarningElement.Id(warningElement=clear_list)

flatten_2 = List.Flatten(list=id)
py_select_elements = Python(IN[0]=flatten_2)
# ---------- py_select_elements.python (29 lines) ----------
import clr
clr.AddReference("RevitAPI")
import Autodesk
from Autodesk.Revit.DB import ElementId
clr.AddReference("RevitServices")
import RevitServices
from RevitServices.Persistence import DocumentManager
clr.AddReference("System")
from System.Collections.Generic import List

uiapp = DocumentManager.Instance.CurrentUIApplication

ids = IN[0]

# if it's not a list, make it a list
if not isinstance(ids, list):
	ids = [ids]

# convert to element ids
elemIds = []
for id in ids:
    elemIds.append(ElementId(id))
    

# cast to icollection and select
uiapp.ActiveUIDocument.Selection.SetElementIds(List[ElementId](elemIds));

#Assign your output to the OUT variable.
OUT = 0
# ----------------------------------------
byElementId = archilab.Revit.Selection.Select.ByElementId(id=flatten_2)

# group: INPUT
color_palette = ColorPalette({R: 255, G: 20, B: 147, A: 255})

overrideColorInView = Element.OverrideColorInView(element=byElementId, color=color_palette)
py_log = Python()  # unwired: IN[0]
# ---------- py_log.python (40 lines) ----------
# Load the Python Standard and DesignScript Libraries
import sys
import clr
clr.AddReference('ProtoGeometry')
from Autodesk.DesignScript.Geometry import *
clr.AddReference("RevitServices")
import RevitServices
from RevitServices.Persistence import DocumentManager

from datetime import datetime
import getpass

# name of the script for log
log_string = "WarningColorSelect"

doc = DocumentManager.Instance.CurrentDBDocument
filePath = doc.PathName

# getting file name from path
try:
	lastBackslash = filePath.rindex("\\")+1
except:
	lastBackslash = filePath.rindex("/")+1
file_name = filePath[lastBackslash:]
user_name = getpass.getuser()
datestamp = str(datetime.now())
# tabulator between data to easy import to excel schedule
separator = "\t"
line = datestamp + separator + log_string + separator + user_name + "\n"

try:
	f = open("L:\\customToolslogs\\dynLogs\\" + file_name +".log", "a")
	f.write(line)
	f.close()
	status = "log has been written"
except:
	status = "something went wrong"

# Assign your output to the OUT variable.
OUT = status
# ----------------------------------------
