# Dynamo graph arcZigZagLines_p.dyn (Dynamo 2.0.1.5055)

# group: LEFT CURVE
select_model_element = DSModelElementSelection()  # 1 picked in the model; graph input
curve = CurveElement.Curve(curveElement=select_model_element)

startPoint = Curve.StartPoint(curve=curve)
number_slider = DoubleSlider(950, range=0..5000 step 50)  # graph input

# group: RIGHT CURVE
select_model_element_2 = DSModelElementSelection()  # 1 picked in the model
curve_2 = CurveElement.Curve(curveElement=select_model_element_2)

# group: iteration right
byCenterPointRadius = Circle.ByCenterPointRadius(centerPoint=startPoint, radius=number_slider)
intersect = Geometry.Intersect(geometry=byCenterPointRadius, other=curve_2)

# group: iteration left
byCenterPointRadius_2 = Circle.ByCenterPointRadius(centerPoint=intersect, radius=number_slider)
intersect_2 = Geometry.Intersect(geometry=byCenterPointRadius_2, other=curve)

# group: iteration right
byCenterPointRadius_3 = Circle.ByCenterPointRadius(centerPoint=intersect_2, radius=number_slider)
intersect_3 = Geometry.Intersect(geometry=byCenterPointRadius_3, other=curve_2)
flatten = List.Flatten(list=intersect_3)
pruneDuplicates = Point.PruneDuplicates(points=flatten)

# group: iteration left
byCenterPointRadius_4 = Circle.ByCenterPointRadius(centerPoint=pruneDuplicates, radius=number_slider)
intersect_4 = Geometry.Intersect(geometry=byCenterPointRadius_4, other=curve)

# group: iteration right
byCenterPointRadius_5 = Circle.ByCenterPointRadius(centerPoint=intersect_4, radius=number_slider)
intersect_5 = Geometry.Intersect(geometry=byCenterPointRadius_5, other=curve_2)
flatten_2 = List.Flatten(list=intersect_5)
pruneDuplicates_2 = Point.PruneDuplicates(points=flatten_2)

# group: iteration left
byCenterPointRadius_6 = Circle.ByCenterPointRadius(centerPoint=pruneDuplicates_2, radius=number_slider)
intersect_6 = Geometry.Intersect(geometry=byCenterPointRadius_6, other=curve)

# group: iteration right
byCenterPointRadius_7 = Circle.ByCenterPointRadius(centerPoint=intersect_6, radius=number_slider)
intersect_7 = Geometry.Intersect(geometry=byCenterPointRadius_7, other=curve_2)
flatten_3 = List.Flatten(list=intersect_7)
pruneDuplicates_3 = Point.PruneDuplicates(points=flatten_3)

# group: iteration left
byCenterPointRadius_8 = Circle.ByCenterPointRadius(centerPoint=pruneDuplicates_3, radius=number_slider)
intersect_8 = Geometry.Intersect(geometry=byCenterPointRadius_8, other=curve)

# group: iteration right
byCenterPointRadius_9 = Circle.ByCenterPointRadius(centerPoint=intersect_8, radius=number_slider)
intersect_9 = Geometry.Intersect(geometry=byCenterPointRadius_9, other=curve_2)
flatten_4 = List.Flatten(list=intersect_9)
pruneDuplicates_4 = Point.PruneDuplicates(points=flatten_4)

# group: iteration left
byCenterPointRadius_10 = Circle.ByCenterPointRadius(centerPoint=pruneDuplicates_4, radius=number_slider)
intersect_10 = Geometry.Intersect(geometry=byCenterPointRadius_10, other=curve)

# group: iteration right
byCenterPointRadius_11 = Circle.ByCenterPointRadius(centerPoint=intersect_10, radius=number_slider)
intersect_11 = Geometry.Intersect(geometry=byCenterPointRadius_11, other=curve_2)
flatten_5 = List.Flatten(list=intersect_11)
pruneDuplicates_5 = Point.PruneDuplicates(points=flatten_5)

list_create = List.Create(item0=startPoint, item1=intersect, item2=intersect_2, item3=intersect_3, item4=intersect_4, item5=intersect_5, item6=intersect_6, item7=pruneDuplicates_3, item8=intersect_8, item9=pruneDuplicates_4, item10=intersect_10, item11=pruneDuplicates_5)
flatten_6 = List.Flatten(list=list_create)
pruneDuplicates_6 = Point.PruneDuplicates(points=flatten_6)
py_except_last_item = Python(IN[0]=pruneDuplicates_6)
# ---------- py_except_last_item.python (12 lines) ----------
# Enable Python support and load DesignScript library
import clr
clr.AddReference('ProtoGeometry')
from Autodesk.DesignScript.Geometry import *

# The inputs to this node will be stored as a list in the IN variables.
a = IN

# Place your code below this line
result = [item[:-1] for item in a]
# Assign your output to the OUT variable.
OUT = result
# ----------------------------------------
py_except_first_item = Python(IN[0]=pruneDuplicates_6)
# ---------- py_except_first_item.python (12 lines) ----------
# Enable Python support and load DesignScript library
import clr
clr.AddReference('ProtoGeometry')
from Autodesk.DesignScript.Geometry import *

# The inputs to this node will be stored as a list in the IN variables.
a = IN

# Place your code below this line
result = [item[1:] for item in a]
# Assign your output to the OUT variable.
OUT = result
# ----------------------------------------
byStartPointEndPoint = Line.ByStartPointEndPoint(startPoint=py_except_last_item, endPoint=py_except_first_item)
byCurve = ModelCurve.ByCurve(curve=byStartPointEndPoint)
návod = StringInput("Vytvorí sériu rovnako dlhých čiar medzi dvoma vodiacimi krivkami (napr. tiahla priehradového nosníku).")  # graph input
