# Dynamo graph arcZigZag_p.dyn (Dynamo 2.0.1.5055)

family_types = FamilyTypes(index=207)  # graph input

# group: LEFT CURVE
select_left_or_lower_curve = DSModelElementSelection()  # 1 picked in the model; graph input
curve = CurveElement.Curve(curveElement=select_left_or_lower_curve)

startPoint = Curve.StartPoint(curve=curve)
dlzka_lichobezniku = DoubleSlider(700, range=200..1000 step 50)  # graph input

# group: RIGHT CURVE
select_right_or_upper_curve = DSModelElementSelection()  # 1 picked in the model; graph input
curve_2 = CurveElement.Curve(curveElement=select_right_or_upper_curve)

# group: iteration right
byCenterPointRadius = Circle.ByCenterPointRadius(centerPoint=startPoint, radius=dlzka_lichobezniku)
intersect = Geometry.Intersect(geometry=byCenterPointRadius, other=curve_2)

# group: iteration left
byCenterPointRadius_2 = Circle.ByCenterPointRadius(centerPoint=intersect, radius=dlzka_lichobezniku)
intersect_2 = Geometry.Intersect(geometry=byCenterPointRadius_2, other=curve)

# group: iteration right
byCenterPointRadius_3 = Circle.ByCenterPointRadius(centerPoint=intersect_2, radius=dlzka_lichobezniku)
intersect_3 = Geometry.Intersect(geometry=byCenterPointRadius_3, other=curve_2)
flatten = List.Flatten(list=intersect_3)
pruneDuplicates = Point.PruneDuplicates(points=flatten)

# group: iteration left
byCenterPointRadius_4 = Circle.ByCenterPointRadius(centerPoint=pruneDuplicates, radius=dlzka_lichobezniku)
intersect_4 = Geometry.Intersect(geometry=byCenterPointRadius_4, other=curve)

# group: iteration right
byCenterPointRadius_5 = Circle.ByCenterPointRadius(centerPoint=intersect_4, radius=dlzka_lichobezniku)
intersect_5 = Geometry.Intersect(geometry=byCenterPointRadius_5, other=curve_2)
flatten_2 = List.Flatten(list=intersect_5)
pruneDuplicates_2 = Point.PruneDuplicates(points=flatten_2)

# group: iteration left
byCenterPointRadius_6 = Circle.ByCenterPointRadius(centerPoint=pruneDuplicates_2, radius=dlzka_lichobezniku)
intersect_6 = Geometry.Intersect(geometry=byCenterPointRadius_6, other=curve)

# group: iteration right
byCenterPointRadius_7 = Circle.ByCenterPointRadius(centerPoint=intersect_6, radius=dlzka_lichobezniku)
intersect_7 = Geometry.Intersect(geometry=byCenterPointRadius_7, other=curve_2)
flatten_3 = List.Flatten(list=intersect_7)
pruneDuplicates_3 = Point.PruneDuplicates(points=flatten_3)

# group: iteration left
byCenterPointRadius_8 = Circle.ByCenterPointRadius(centerPoint=pruneDuplicates_3, radius=dlzka_lichobezniku)
intersect_8 = Geometry.Intersect(geometry=byCenterPointRadius_8, other=curve)

# group: iteration right
byCenterPointRadius_9 = Circle.ByCenterPointRadius(centerPoint=intersect_8, radius=dlzka_lichobezniku)
intersect_9 = Geometry.Intersect(geometry=byCenterPointRadius_9, other=curve_2)
flatten_4 = List.Flatten(list=intersect_9)
pruneDuplicates_4 = Point.PruneDuplicates(points=flatten_4)

# group: iteration left
byCenterPointRadius_10 = Circle.ByCenterPointRadius(centerPoint=pruneDuplicates_4, radius=dlzka_lichobezniku)
intersect_10 = Geometry.Intersect(geometry=byCenterPointRadius_10, other=curve)

# group: iteration right
byCenterPointRadius_11 = Circle.ByCenterPointRadius(centerPoint=intersect_10, radius=dlzka_lichobezniku)
intersect_11 = Geometry.Intersect(geometry=byCenterPointRadius_11, other=curve_2)
flatten_5 = List.Flatten(list=intersect_11)
pruneDuplicates_5 = Point.PruneDuplicates(points=flatten_5)

# group: iteration left
byCenterPointRadius_12 = Circle.ByCenterPointRadius(centerPoint=pruneDuplicates_5, radius=dlzka_lichobezniku)
intersect_12 = Geometry.Intersect(geometry=byCenterPointRadius_12, other=curve)

# group: iteration right
byCenterPointRadius_13 = Circle.ByCenterPointRadius(centerPoint=intersect_12, radius=dlzka_lichobezniku)
intersect_13 = Geometry.Intersect(geometry=byCenterPointRadius_13, other=curve_2)
flatten_6 = List.Flatten(list=intersect_13)
pruneDuplicates_6 = Point.PruneDuplicates(points=flatten_6)

# group: iteration left
byCenterPointRadius_14 = Circle.ByCenterPointRadius(centerPoint=pruneDuplicates_6, radius=dlzka_lichobezniku)
intersect_14 = Geometry.Intersect(geometry=byCenterPointRadius_14, other=curve)

# group: iteration right
byCenterPointRadius_15 = Circle.ByCenterPointRadius(centerPoint=intersect_14, radius=dlzka_lichobezniku)
intersect_15 = Geometry.Intersect(geometry=byCenterPointRadius_15, other=curve_2)
flatten_7 = List.Flatten(list=intersect_15)
pruneDuplicates_7 = Point.PruneDuplicates(points=flatten_7)

# group: iteration left
byCenterPointRadius_16 = Circle.ByCenterPointRadius(centerPoint=pruneDuplicates_7, radius=dlzka_lichobezniku)
intersect_16 = Geometry.Intersect(geometry=byCenterPointRadius_16, other=curve)

# group: iteration right
byCenterPointRadius_17 = Circle.ByCenterPointRadius(centerPoint=intersect_16, radius=dlzka_lichobezniku)
intersect_17 = Geometry.Intersect(geometry=byCenterPointRadius_17, other=curve_2)
flatten_8 = List.Flatten(list=intersect_17)
pruneDuplicates_8 = Point.PruneDuplicates(points=flatten_8)

# group: iteration left
byCenterPointRadius_18 = Circle.ByCenterPointRadius(centerPoint=pruneDuplicates_8, radius=dlzka_lichobezniku)
intersect_18 = Geometry.Intersect(geometry=byCenterPointRadius_18, other=curve)

list_create = List.Create(item0=startPoint, item1=intersect, item2=intersect_2, item3=intersect_3, item4=intersect_4, item5=intersect_5, item6=intersect_6, item7=pruneDuplicates_3, item8=intersect_8, item9=pruneDuplicates_4, item10=intersect_10, item11=pruneDuplicates_5, item12=intersect_12, item13=pruneDuplicates_6, item14=intersect_14, item15=pruneDuplicates_7, item16=intersect_16, item17=pruneDuplicates_8, item18=intersect_18)
flatten_9 = List.Flatten(list=list_create)
pruneDuplicates_9 = Point.PruneDuplicates(points=flatten_9)
py_every_even_item_2x = Python(IN[0]=pruneDuplicates_9)
# ---------- py_every_even_item_2x.python (15 lines) ----------
# Enable Python support and load DesignScript library
import clr
clr.AddReference('ProtoGeometry')
from Autodesk.DesignScript.Geometry import *

# The inputs to this node will be stored as a list in the IN variables.
a = IN

# Place your code below this line
b = [item[::2] for item in a]
c = [item[1:] for item in b]
#result=zip(b,c)
result=b+c
# Assign your output to the OUT variable.
OUT = result
# ----------------------------------------
py_every_even_item_2x_2 = Python(IN[0]=pruneDuplicates_9)
# ---------- py_every_even_item_2x_2.python (14 lines) ----------
# Enable Python support and load DesignScript library
import clr
clr.AddReference('ProtoGeometry')
from Autodesk.DesignScript.Geometry import *

# The inputs to this node will be stored as a list in the IN variables.
a = IN

# Place your code below this line
b = [item[1::2] for item in a]
c = [item[1:-1:2] for item in a]
result=b+c
# Assign your output to the OUT variable.
OUT = result
# ----------------------------------------

# group: place instance and rotate by two points vector
byPoint = FamilyInstance.ByPoint(familyType=family_types, point=py_every_even_item_2x)
byTwoPoints = Vector.ByTwoPoints(start=py_every_even_item_2x, end=py_every_even_item_2x_2)
YAxis = Vector.YAxis()
ZAxis = Vector.ZAxis()
angleAboutAxis = Vector.AngleAboutAxis(vector=byTwoPoints, otherVector=YAxis, rotationAxis=ZAxis)

code_block = CodeBlock(a=angleAboutAxis) { a+180; }

# group (continued): place instance and rotate by two points vector
setRotation = FamilyInstance.SetRotation(familyInstance=byPoint, degree=code_block)

py_except_last_item = Python(IN[0]=pruneDuplicates_9)
# ---------- py_except_last_item.python (12 lines) ----------
# Enable Python support and load DesignScript library
import clr
clr.AddReference('ProtoGeometry')
from Autodesk.DesignScript.Geometry import *

# The inputs to this node will be stored as a list in the IN variables.
a = IN

# Place your code below this line
result = [item[:-1] for item in a]
# Assign your output to the OUT variable.
OUT = result
# ----------------------------------------
py_except_first_item = Python(IN[0]=pruneDuplicates_9)
# ---------- py_except_first_item.python (12 lines) ----------
# Enable Python support and load DesignScript library
import clr
clr.AddReference('ProtoGeometry')
from Autodesk.DesignScript.Geometry import *

# The inputs to this node will be stored as a list in the IN variables.
a = IN

# Place your code below this line
result = [item[1:] for item in a]
# Assign your output to the OUT variable.
OUT = result
# ----------------------------------------
byStartPointEndPoint = Line.ByStartPointEndPoint(startPoint=py_except_last_item, endPoint=py_except_first_item)
byCurve = ModelCurve.ByCurve()  # unwired: curve
byTwoPoints_2 = Vector.ByTwoPoints(start=py_every_even_item_2x, end=py_every_even_item_2x_2)
flatten_10 = List.Flatten(list=byTwoPoints_2)
restOfItems = List.RestOfItems(list=flatten_10)
ZAxis_2 = Vector.ZAxis()
angleAboutAxis_2 = Vector.AngleAboutAxis(vector=restOfItems, otherVector=flatten_10, rotationAxis=ZAxis_2)
návod = StringInput("Vytvorí sériu rovnako dlhých čiar medzi dvoma vodiacimi krivkami (napr. tiahla priehradového nosníku). Na tieto čiary umiestni ľubovoľnú family.")  # graph input
