# Dynamo graph architectural floor from room perimeter.dyn (Dynamo 1.3.1.1736)

categories = Categories("Rooms")
all_elements_of_category = ElementsOfCategory(categories)
watch = Watch(all_elements_of_category)
code_block = CodeBlock { "Floor Finish"; }
getParameterValueByName = Element.GetParameterValueByName(element=all_elements_of_category, parameterName=code_block)
byName = FloorType.ByName(getParameterValueByName)
geometry = Element.Geometry(all_elements_of_category)
flatten = Flatten(geometry)
XY = Plane.XY()

# group: INPUT
# note: vytvori architectural floor podla Floor Finish prislusnej Room
# je potrebne vytvorit Floor types s nazvom zhodnym s Floor Finish
levels = Levels("1.NP")

elevation = Level.Elevation(levels)
code_block_2 = CodeBlock(a=elevation) { a+100; }
offset = Plane.Offset(XY, code_block_2)
intersect = Geometry.Intersect(geometry=flatten, other=offset)
flatten_2 = Flatten(intersect)
perimeterCurves = Surface.PerimeterCurves(flatten_2)
floor_types = FloorTypes("carpet")
byOutlineTypeAndLevel = Floor.ByOutlineTypeAndLevel(outlineCurves=perimeterCurves, floorType=floor_types, level=levels)
count_of_created_floors = Count(byOutlineTypeAndLevel)
watch_2 = Watch(count_of_created_floors)
watch_3 = Watch(getParameterValueByName)
firstItem = List.FirstItem(flatten)
