# Dynamo graph architectural floor from room perimeter_p.dyn (Dynamo 2.12.0.5650)
# packages: archi-lab.net 2020.23.2

# group: INPUT
# note: Place inputs for Dynamo Player

# group: Filter
# note: filtering elements

# group: Error handling
# note: Treating errors as hints to user what to do to avoid the error

# group: OUTPUT
# note: Place output for Dynamo Player

# group: INPUT
vyber_elementy_oknom = DSModelElementsSelection()  # 1839 picked in the model; graph input
vytvoriť_floortype_podľa_base = BoolSelector(true)  # "Vytvoriť FloorType podľa Base Finish v miestnostiach?"; graph input
placeholder_floor_type_len_ak_sa = FloorTypes()  # "Placeholder Floor Type (Len ak sa nepoužívajú dáta z miestností)"; nothing selected; graph input
návod = StringInput("""Vytvori architectural floor podľa Base Finish danej miestnosti. Je potrebné vytvoriť Floor types s príslušnými Base Finishes. Floor sa vytvorí v rovine Levelu, na ktorom je miestnosť umiestnená.

Ak nemáte vytvorené Floor types je možné nastaviť aj vytváranie placeholder dosiek.

Známe bugy:
nevytvorí floors miestnostiam, ktorých obvod tvorí viac ako jeden uzavretý reťazec

Pri takýchto elementoch pomôže vypnutie a zapnutie Room Bounding""")  # graph input

# group: Filtering Rooms By Level
code_block = CodeBlock { "Rooms"; }
byName = Category.ByName(name=code_block)
string_from_object = FromObject(obj=byName)
getCategory = Element.GetCategory(element=vyber_elementy_oknom)
string_from_object_2 = FromObject(obj=getCategory)
eq = string_from_object == string_from_object_2

filterByBoolMask = List.FilterByBoolMask(list=vyber_elementy_oknom, mask=eq)
watch = Watch(filterByBoolMask.in)
geometry = Element.Geometry(element=filterByBoolMask.in)
flatten = List.Flatten(list=geometry)
XY = Plane.XY()
code_block_2 = CodeBlock { "Level"; }
getParameterValueByName = Element.GetParameterValueByName(element=filterByBoolMask.in, parameterName=code_block_2)
getLevelByName = archilab.Revit.Selection.Select.GetLevelByName(name=getParameterValueByName)
elevation = Level.Elevation(level=getLevelByName)
save_offset = CodeBlock { 1000; }
code_block_3 = CodeBlock(a=elevation, save_offset=save_offset) { a+save_offset; }
offset = Plane.Offset(plane=XY, dist=code_block_3)
intersect = Geometry.Intersect(geometry=flatten, other=offset)
flatten_2 = List.Flatten(list=intersect)
perimeterCurves = Surface.PerimeterCurves(surface=flatten_2)

# group: Get Floor Types (clockwork)
code_block_4 = CodeBlock { "Floors"; }
byName_2 = Category.ByName(name=code_block_4)
py_all_family_types_of_category = Python(IN[0]=byName_2)  # IronPython2; unwired: IN[1], IN[2]
# ---------- py_all_family_types_of_category.python (22 lines) ----------
import System
import clr
clr.AddReference('RevitAPI')
from Autodesk.Revit.DB import *

clr.AddReference("RevitServices")
import RevitServices
from RevitServices.Persistence import DocumentManager

def ElementTypesByCategory(cat, doc):
	bic = System.Enum.ToObject(BuiltInCategory, cat.Id)
	collector = FilteredElementCollector(doc).OfCategory(bic).WhereElementIsElementType()
	return collector.ToElements()

inputdoc = UnwrapElement(IN[2])
if not inputdoc: doc = DocumentManager.Instance.CurrentDBDocument
elif inputdoc.GetType().ToString() == "Autodesk.Revit.DB.RevitLinkInstance": doc = inputdoc.GetLinkDocument()
elif inputdoc.GetType().ToString() == "Autodesk.Revit.DB.Document": doc = inputdoc
else: doc = DocumentManager.Instance.CurrentDBDocument

if isinstance(IN[0], list): OUT = [ElementTypesByCategory(x, doc) for x in IN[0]]
else: OUT = ElementTypesByCategory(IN[0], doc)
# ----------------------------------------

# group: Floor by Room's Floor Finish
code_block_5 = CodeBlock { "Base Finish"; }
getParameterValueByName_2 = Element.GetParameterValueByName(element=filterByBoolMask.in, parameterName=code_block_5)

code_block_6 = CodeBlock { "Type Mark"; }
getParameterValueByName_3 = Element.GetParameterValueByName(element=py_all_family_types_of_category, parameterName=code_block_6)
py_index = Python(IN[0]=getParameterValueByName_2, IN[1]=getParameterValueByName_3)  # IronPython2
# ---------- py_index.python (20 lines) ----------
# Load the Python Standard and DesignScript Libraries
import sys
import clr
clr.AddReference('ProtoGeometry')
from Autodesk.DesignScript.Geometry import *

# The inputs to this node will be stored as a list in the IN variables.
finishes = IN[0]
typemarks = IN[1]

# Place your code below this line
output = []
for i in finishes:
	try:
		a=typemarks.index(i)
		output.append(a)
	except:
		pass
# Assign your output to the OUT variable.
OUT = output
# ----------------------------------------
getItemAtIndex = List.GetItemAtIndex(list=py_all_family_types_of_category, index=py_index)
pyIF = Python(IN[0]=vytvoriť_floortype_podľa_base, IN[1]=getItemAtIndex, IN[2]=placeholder_floor_type_len_ak_sa)  # IronPython2
# ---------- pyIF.python (20 lines) ----------
# Load the Python Standard and DesignScript Libraries
import sys
import clr
clr.AddReference('ProtoGeometry')
from Autodesk.DesignScript.Geometry import *

# The inputs to this node will be stored as a list in the IN variables.
boolean = IN[0]
true = IN[1]
false = IN[2]

# Place your code below this line
if boolean == 1:
	result = true
elif boolean == 0:
	result = false
else:
	result = null
# Assign your output to the OUT variable.
OUT = result
# ----------------------------------------
byOutlineTypeAndLevel = Floor.ByOutlineTypeAndLevel(outlineCurves=perimeterCurves, floorType=pyIF, level=getLevelByName)
count = List.Count(list=byOutlineTypeAndLevel)

# group: OUTPUT
počet_vytvorených_floors = Watch(count)  # graph output

py_log = Python()  # IronPython2; unwired: IN[0]
# ---------- py_log.python (40 lines) ----------
# Load the Python Standard and DesignScript Libraries
import sys
import clr
clr.AddReference('ProtoGeometry')
from Autodesk.DesignScript.Geometry import *
clr.AddReference("RevitServices")
import RevitServices
from RevitServices.Persistence import DocumentManager

from datetime import datetime
import getpass

# name of the script for log
log_string = "architectural floor from room perimeter_p.dyn"

doc = DocumentManager.Instance.CurrentDBDocument
filePath = doc.PathName

# getting file name from path
try:
	lastBackslash = filePath.rindex("\\")+1
except:
	lastBackslash = filePath.rindex("/")+1
file_name = filePath[lastBackslash:]
user_name = getpass.getuser()
datestamp = str(datetime.now())
# tabulator between data to easy import to excel schedule
separator = "\t"
line = datestamp + separator + log_string + separator + user_name + "\n"

try:
	f = open("L:\\customToolslogs\\dynLogs\\" + file_name +".log", "a")
	f.write(line)
	f.close()
	status = "log has been written"
except:
	status = "something went wrong"

# Assign your output to the OUT variable.
OUT = status
# ----------------------------------------

# group: move floors back down
code_block_7 = CodeBlock(offset=save_offset) { 0; -offset; }
byCoordinates = Vector.ByCoordinates(x=code_block_7.out0, y=code_block_7.out0, z=code_block_7.out1)
moveByVector = Element.MoveByVector(element=byOutlineTypeAndLevel, vector=byCoordinates)
