# Dynamo graph automaticke preklady_p.dyn (Dynamo 2.3.0.5885)
# packages: Clockwork for Dynamo 2.x 2.1.2

# group: INPUT
návod = StringInput("""Vsetkym dveram v projekte v nenosnych stenach prida preklady. Je mozne nastavit vynimku. Funguje len s dverami, v ktorych visibility prekladu ovlada parameter "nosný preklad"
	Ak su dvere v stene, ktora ma parameter rovny nastavenej hodnote, nastaví parameter dverí "nosný preklad" na YES a naopak
	napr. IF Type Comments == "murovane steny" => "nosný preklad"=YES""")  # graph input
nedávať_preklad_na_dvere_s_type = StringInput("xxx")  # "Nedávať preklad na dvere s Type Mark:"; graph input
parameter_name = StringInput("Type Comments")  # graph input
parameter_value = StringInput("murované steny")  # graph input

code_block = CodeBlock { "Doors"; }
byName = Category.ByName(name=code_block)
all_elements_of_category = ElementsOfCategory(Category=byName)
type = Custom[Element.Type](element=all_elements_of_category)  # package Clockwork for Dynamo 2.x; Gets the family type of a given element (if applicable). Unlike the OOTB node, it also works for elements in linked models.
code_block_2 = CodeBlock { "Type Mark"; }
parameterByName = Parameter.ParameterByName(element=type, name=code_block_2)
string_from_object = FromObject(obj=parameterByName)
contains = String.Contains(str=string_from_object, searchFor=nedávať_preklad_na_dvere_s_type)
filterByBoolMask = List.FilterByBoolMask(list=all_elements_of_category, mask=contains)
host = Custom[Element.Host](element=filterByBoolMask.out)  # package Clockwork for Dynamo 2.x; Gets an element's host. Unlike the OOTB node FamilyInstance.GetHost it not only works for family instances but also for elements like wall sweeps, foundations, railings, builing pads and topo subregions.
type_2 = Custom[Element.Type](element=host)
parameterByName_2 = Parameter.ParameterByName(element=type_2, name=parameter_name)
string_from_object_2 = FromObject(obj=parameterByName_2)
contains_2 = String.Contains(str=string_from_object_2, searchFor=parameter_value)
filterByBoolMask_2 = List.FilterByBoolMask(list=filterByBoolMask.out, mask=contains_2)
code_block_3 = CodeBlock { "nosny preklad"; }
boolean = BoolSelector(true)
setParameterByName = Element.SetParameterByName(element=filterByBoolMask_2.in, parameterName=code_block_3, value=boolean)
count = List.Count(list=setParameterByName)
boolean_2 = BoolSelector(false)
setParameterByName_2 = Element.SetParameterByName(element=filterByBoolMask_2.out, parameterName=code_block_3, value=boolean_2)
count_2 = List.Count(list=setParameterByName_2)

# group: OUTPUT
počet_dverí_ktorým_skript = Watch(count)  # "Počet dverí, ktorým skript nastavil preklad"; graph output
počet_dverí_ktorým_skript_2 = Watch(count_2)  # "Počet dverí, ktorým skript nastavil, že nemajú preklad"; graph output

py_log = Python()  # unwired: IN[0]
# ---------- py_log.python (40 lines) ----------
# Load the Python Standard and DesignScript Libraries
import sys
import clr
clr.AddReference('ProtoGeometry')
from Autodesk.DesignScript.Geometry import *
clr.AddReference("RevitServices")
import RevitServices
from RevitServices.Persistence import DocumentManager

from datetime import datetime
import getpass

# name of the script for log
log_string = "automaticke preklady"

doc = DocumentManager.Instance.CurrentDBDocument
filePath = doc.PathName

# getting file name from path
try:
	lastBackslash = filePath.rindex("\\")+1
except:
	lastBackslash = filePath.rindex("/")+1
file_name = filePath[lastBackslash:]
user_name = getpass.getuser()
datestamp = str(datetime.now())
# tabulator between data to easy import to excel schedule
separator = "\t"
line = datestamp + separator + log_string + separator + user_name + "\n"

try:
	f = open("L:\\customToolslogs\\dynLogs\\" + file_name +".log", "a")
	f.write(line)
	f.close()
	status = "log has been written"
except:
	status = "something went wrong"

# Assign your output to the OUT variable.
OUT = status
# ----------------------------------------
