# Dynamo graph beamsFromGridsIntersects.dyn (Dynamo 2.12.1.8246)
# packages: cata_lyst 0.0.1

# group: INPUT
select_face = DSFaceSelection()  # 1 picked in the model
select_grids = DSModelElementsSelection()  # 15 picked in the model
levels = Levels("2.NP")
structural_framing_types = StructuralFramingTypes("Family1")

curve = Grid.Curve(grid=select_grids)
code_block = CodeBlock { 50000; }
byCoordinates = Vector.ByCoordinates(z=code_block)
extrude = Curve.Extrude(curve=curve, direction=byCoordinates)
intersect = Geometry.Intersect(geometry=select_face, other=extrude, lacing=Longest)
flatten = List.Flatten(list=intersect)
beamByCurve = StructuralFraming.BeamByCurve(curve=flatten, level=levels, structuralFramingType=structural_framing_types)
code_block_2 = CodeBlock { "Cross-Section Rotation"; 0; }
setParameterByName = Element.SetParameterByName(element=beamByCurve, parameterName=code_block_2.out0, value=code_block_2.out1)
návod = StringInput("Vyrvorí Beams v mieste priesečníku vybraných Grids a vybraného Faceu. Napr. Face komplikovanej krivkovej strechy.")  # graph input
code_block_3 = CodeBlock { "beamsFromGridsIntersects"; }
usageLog = Custom[usageLog](scriptName=code_block_3)  # package cata_lyst; node logs every run of the script in which is used to the hardcoded server location
