# Dynamo graph checkUnhostedElements_p.dyn (Dynamo 2.3.0.5885)

select_model_elements = DSModelElementsSelection()  # nothing selected; graph input
string = StringInput("Host")
getParameterValueByName = Element.GetParameterValueByName(element=select_model_elements, parameterName=string)
uniqueItems = List.UniqueItems(list=getParameterValueByName)
názvy_elementov_ktoré_sú_ako = Watch(uniqueItems)  # "Názvy elementov, ktoré sú ako host"; graph output
návod = StringInput("""Vypíše elementy, ku ktorým sú hostované označené elementy.

Vhodné napr. na kontrolu či sú všetky stromy hostované k Topography atd.""")  # graph input
py_log = Python()  # unwired: IN[0]
# ---------- py_log.python (37 lines) ----------
# Load the Python Standard and DesignScript Libraries
import sys
import clr
clr.AddReference('ProtoGeometry')
from Autodesk.DesignScript.Geometry import *
clr.AddReference("RevitServices")
import RevitServices
from RevitServices.Persistence import DocumentManager

from datetime import datetime
import getpass

# name of the script for log
log_string = "checkUnhostedElements"

doc = DocumentManager.Instance.CurrentDBDocument
filePath = doc.PathName

# getting file name from path
lastBackslash = filePath.rindex("\\")+1
file_name = filePath[lastBackslash:]
user_name = getpass.getuser()
datestamp = str(datetime.now())
# tabulator between data to easy import to excel schedule
separator = "\t"
line = datestamp + separator + log_string + separator + user_name + "\n"

try:
	f = open("L:\\customToolslogs\\dynLogs\\" + file_name +".log", "a")
	f.write(line)
	f.close()
	status = "log has been written"
except:
	status = "something went wrong"

# Assign your output to the OUT variable.
OUT = status
# ----------------------------------------
