# Dynamo graph coarse2blackSolid_po.dyn "Coarse2blackSolid_po" (Dynamo 2.12.1.8246)
# packages: cata_lyst 0.0.1

# group: INPUT
# note: Place inputs for Dynamo Player

návod = StringInput("""Všetkým Wall, Floor a Roof Types nastaví:
Coarse Scale Fill Pattern = <Solid fill>
Coarse Scale Fill Color = Black (0,0,0)""")  # graph input
code_block = CodeBlock { "Coarse2blackSolid"; }
usageLog = Custom[usageLog](scriptName=code_block)  # package cata_lyst; node logs every run of the script in which is used to the hardcoded server location
py_walltypecollector = Python()  # IronPython2
# ---------- py_walltypecollector.python (20 lines) ----------
# Load the Python Standard and DesignScript Libraries
import sys
import clr
clr.AddReference('ProtoGeometry')
from Autodesk.DesignScript.Geometry import *

clr.AddReference("RevitServices")
clr.AddReference("RevitAPI")
import RevitServices
from RevitServices.Persistence import DocumentManager
from Autodesk.Revit import DB

doc = DocumentManager.Instance.CurrentDBDocument
uiapp = DocumentManager.Instance.CurrentUIApplication
app = uiapp.Application

wall_types = DB.FilteredElementCollector(doc).OfCategory(DB.BuiltInCategory.OST_Walls).WhereElementIsElementType().ToElements()

# Assign your output to the OUT variable.
OUT = wall_types
# ----------------------------------------
py_floortypecollector = Python()  # IronPython2
# ---------- py_floortypecollector.python (20 lines) ----------
# Load the Python Standard and DesignScript Libraries
import sys
import clr
clr.AddReference('ProtoGeometry')
from Autodesk.DesignScript.Geometry import *

clr.AddReference("RevitServices")
clr.AddReference("RevitAPI")
import RevitServices
from RevitServices.Persistence import DocumentManager
from Autodesk.Revit import DB

doc = DocumentManager.Instance.CurrentDBDocument
uiapp = DocumentManager.Instance.CurrentUIApplication
app = uiapp.Application

floor_types = DB.FilteredElementCollector(doc).OfCategory(DB.BuiltInCategory.OST_Floors).WhereElementIsElementType().ToElements()

# Assign your output to the OUT variable.
OUT = floor_types
# ----------------------------------------
py_floortypecollector_2 = Python()  # IronPython2
# ---------- py_floortypecollector_2.python (20 lines) ----------
# Load the Python Standard and DesignScript Libraries
import sys
import clr
clr.AddReference('ProtoGeometry')
from Autodesk.DesignScript.Geometry import *

clr.AddReference("RevitServices")
clr.AddReference("RevitAPI")
import RevitServices
from RevitServices.Persistence import DocumentManager
from Autodesk.Revit import DB

doc = DocumentManager.Instance.CurrentDBDocument
uiapp = DocumentManager.Instance.CurrentUIApplication
app = uiapp.Application

roof_types = DB.FilteredElementCollector(doc).OfCategory(DB.BuiltInCategory.OST_Roofs).WhereElementIsElementType().ToElements()

# Assign your output to the OUT variable.
OUT = roof_types
# ----------------------------------------
list_create = List.Create(item0=py_walltypecollector, item1=py_floortypecollector, item2=py_floortypecollector_2)

# group: color
code_block_2 = CodeBlock { "Coarse Scale Fill Color"; }
code_block_3 = CodeBlock { 0; }
setParameterByName = Element.SetParameterByName(element=list_create@L2, parameterName=code_block_2, value=code_block_3)

# group: pattern
code_block_4 = CodeBlock { "Coarse Scale Fill Pattern"; }
code_block_5 = CodeBlock { "<Solid fill>"; }
getByName = FillPatternElement.GetByName(name=code_block_5)
setParameterByName_2 = Element.SetParameterByName(element=list_create@L2, parameterName=code_block_4, value=getByName)
