# Dynamo graph concatParameters.dyn (Dynamo 2.3.0.5885)

code_block = CodeBlock { "Rooms"; }
byName = Category.ByName(name=code_block)
all_elements_of_category = ElementsOfCategory(Category=byName)

# group: INPUT
parameter_1 = StringInput("Cislo Bytu")  # graph input
parameter_2 = StringInput("Room Number short")  # graph input
delimiter = StringInput(".")  # graph input
new_parameter_name = StringInput("Number")  # graph input

getParameterValueByName = Element.GetParameterValueByName(element=all_elements_of_category, parameterName=parameter_1)
getParameterValueByName_2 = Element.GetParameterValueByName(element=all_elements_of_category, parameterName=parameter_2)
py_concatenate_just_filled = Python(IN[0]=getParameterValueByName, IN[1]=getParameterValueByName_2, IN[2]=delimiter)  # "PY concatenate just filled params"
# ---------- py_concatenate_just_filled.python (24 lines) ----------
# Load the Python Standard and DesignScript Libraries
import sys
import clr
clr.AddReference('ProtoGeometry')
from Autodesk.DesignScript.Geometry import *

# The inputs to this node will be stored as a list in the IN variables.
param_values1 = IN[0]
param_values2 = IN[1]
delimiter = IN[2]
filled_param_list = []

count = 0
for param_value2 in param_values2:	
	if param_value2:
		param_value1 = param_values1[count]
		new_param_value = param_value1 + delimiter + param_value2
		filled_param_list.append(new_param_value)
	else:
		filled_param_list.append("")
	count += 1

# Assign your output to the OUT variable.
OUT = filled_param_list
# ----------------------------------------

# group: filtering just filled parameters
code_block_2 = CodeBlock { ""; }
ne = code_block_2 != py_concatenate_just_filled
filterByBoolMask = List.FilterByBoolMask(list=all_elements_of_category, mask=ne)
filterByBoolMask_2 = List.FilterByBoolMask(list=py_concatenate_just_filled, mask=ne)

setParameterByName = Element.SetParameterByName(element=filterByBoolMask.in, parameterName=new_parameter_name, value=filterByBoolMask_2.in)
návod = StringInput("""Spojí Parameter1 a Parameter2 do nového poarametru vo formáte:
New parameter = Parameter1 + delimiter + Parameter2

Ak má element ako Parameter2 prázdnu hodnotu, tento element bude preskočený (napr. aby sa prepísali len tie Room Numbers, ktoré chceme)""")  # graph input
py_log = Python()  # unwired: IN[0]
# ---------- py_log.python (37 lines) ----------
# Load the Python Standard and DesignScript Libraries
import sys
import clr
clr.AddReference('ProtoGeometry')
from Autodesk.DesignScript.Geometry import *
clr.AddReference("RevitServices")
import RevitServices
from RevitServices.Persistence import DocumentManager

from datetime import datetime
import getpass

# name of the script for log
log_string = "concatParameters"

doc = DocumentManager.Instance.CurrentDBDocument
filePath = doc.PathName

# getting file name from path
lastBackslash = filePath.rindex("\\")+1
file_name = filePath[lastBackslash:]
user_name = getpass.getuser()
datestamp = str(datetime.now())
# tabulator between data to easy import to excel schedule
separator = "\t"
line = datestamp + separator + log_string + separator + user_name + "\n"

try:
	f = open("L:\\customToolslogs\\dynLogs\\" + file_name +".log", "a")
	f.write(line)
	f.close()
	status = "log has been written"
except:
	status = "something went wrong"

# Assign your output to the OUT variable.
OUT = status
# ----------------------------------------
