# Dynamo graph countElementTypes_p.dyn "modelGroupAudit" (Dynamo 2.6.1.8786)
# packages: Clockwork for Dynamo 2.x 2.1.2

návod = StringInput("Zobrazí vsetky opakovatelnost typov elementov, napr model groups")  # graph input

# group: INPUT
categories = Categories("OST_IOSModelGroups")  # graph input

all_elements_of_category = ElementsOfCategory(Category=categories)
elementType = Element.ElementType(element=all_elements_of_category)
code_block = CodeBlock { "Type Name"; }
getParameterValueByName = Element.GetParameterValueByName(element=elementType, parameterName=code_block)
countOccurences = Custom[List.CountOccurences](seq=getParameterValueByName)  # package Clockwork for Dynamo 2.x; Counts the number of occurences of each unique element in a given list
sortByKey = List.SortByKey(list=countOccurences.uniqueElements, keys=countOccurences.count)
code_block_2 = CodeBlock(a=sortByKey.sorted_list, b=sortByKey.sorted_keys) { a+" - "+b+"x"; }
reverse = List.Reverse(list=code_block_2)
parameter_values_with_occurences = Watch(reverse)  # graph output
