# Dynamo graph customSchedule_p.dyn (Dynamo 2.0.1.5055)

# group: INPUT
vytvorit_tabulku_v_category = Categories(index=363)  # graph input
názov_tabuľky_v_revite = StringInput("custom xls schedule2")  # graph input
file_path = Filename("alpha_versions\customSchedule\customSchedule1.xlsx")  # graph input

schedule_type = ScheduleTypes(index=0)
createSchedule = ScheduleView.CreateSchedule(category=vytvorit_tabulku_v_category, name=názov_tabuľky_v_revite, scheduleType=schedule_type)
schedulableFields = ScheduleView.SchedulableFields(scheduleView=createSchedule)
file_from_path = FileObject(path=file_path)
názov_hárku_v_exceli = StringInput("1")  # graph input
boolean = BoolSelector(true)
boolean_2 = BoolSelector(false)
importExcel = Data.ImportExcel(file=file_from_path, sheetName=názov_hárku_v_exceli, readAsStrings=boolean, showExcel=boolean_2)

# group: getting number of columns - parameters
count = List.Count(list=importExcel, lacing=CrossProduct)
firstItem = List.FirstItem(list=count)

chop = List.Chop(list=schedulableFields, lengths=firstItem)
firstItem_2 = List.FirstItem(list=chop)
addFields = ScheduleView.AddFields(scheduleView=createSchedule, fields=firstItem_2)
key_schedule = Custom[Key Schedule](ViewSchedule=addFields, Data=importExcel, Parameter_Names=firstItem_2)  # This node will take a key schedule, data and a list of parameters and populate it with infomation from data parameter. Visit www.archi-lab.net for more information on how to prep this node for take off.
watch = Watch(key_schedule)
návod = StringInput("vloží tabuľku z excelu do revitu")  # graph input
