# Dynamo graph 3DtextGenerator.dyn (Dynamo 2.12.1.8246)
# packages: Clockwork for Dynamo 2.x 2.4.0

# group: INPUT
family_types = FamilyTypes("3DtextTag:3DtextTag")
select_model_elements = DSModelElementsSelection()  # 20 picked in the model

location = Custom[Element.Location+](element=select_model_elements)  # package Clockwork for Dynamo 2.x; Returns the location of an element as point, curve or curve loop, along with some booleans to help filtering the results. Unlike the OOTB Element.GetLocation node, it also retunrs sketch lines of sketch-based elements like floor slabs as well as the element's rotation property.
byPoint = FamilyInstance.ByPoint(familyType=family_types, point=location.points)
code_block = CodeBlock { "Text"; }
text = TextNote.Text(textNote=select_model_elements)
setParameterByName = Element.SetParameterByName(element=byPoint, parameterName=code_block, value=text)
