# Dynamo graph prierazyPipes_p.dyn (Dynamo 2.3.0.5885)
# packages: Clockwork for Dynamo 2.x 2.1.2, spring nodes 203.1.0

# group: Opening Family Type
family_prierazu = FamilyTypes()  # nothing selected
code_block = CodeBlock { "Prieraz_KRUH_stena"; }
byName = FamilyType.ByName(name=code_block)

návod = StringInput("""Vo vybranej stene vytvorí automaticky prierazy pre vybrané potrubia v kategórii Pipes kruhového prierezu. V projekte musí byť naloadovaná family s názvom "Prieraz_KRUH_stena" a pridaný Shared Parameter "Profesia".

Trasy profesií je potrebné dočasne nakopírovať priamo do projektu. Nestačí mať naloadovaný link.

Je potrebné mať nainštalované packages Clockwork a Springs""")  # graph input

# group: INPUT
select_wall = DSModelElementSelection()  # 1 picked in the model; graph input
select_pipes_window_selection = DSModelElementsSelection()  # 1 picked in the model; graph input
o_koľko_má_byť_väčší_otvor_na = DoubleSlider(50, range=0..200 step 10)  # "o koľko má byť väčší otvor na každú stranu"; graph input
rozmer_otvorov_zaokrúliť_na = DoubleSlider(10, range=0..100 step 10)  # graph input
parameter_pre_kód_profesie = StringInput("Poznámka")  # graph input
kód_profesie = StringInput("ZT")  # graph input
označenie_poschodia = StringInput("01")  # graph input
rozsah_dole = DoubleSlider(3000, range=0..8000 step 100)  # graph input

geometry = Element.Geometry(element=select_wall)

# group: category filter
getCategory = Element.GetCategory(element=select_pipes_window_selection)
name = Category.Name(category=getCategory)
code_block_2 = CodeBlock { "Pipes"; }
eq = name == code_block_2
filterByBoolMask = List.FilterByBoolMask(list=select_pipes_window_selection, mask=eq)

location = Custom[Element.Location+](element=filterByBoolMask.in)  # package Clockwork for Dynamo 2.x; Returns the location of an element as point, curve or curve loop, along with some booleans to help filtering the results. Unlike the OOTB Element.GetLocation node, it also retunrs sketch lines of sketch-based elements like floor slabs as well as the element's rotation property.
intersect = Geometry.Intersect(geometry=geometry, other=location.curves, lacing=CrossProduct)
flatten = List.Flatten(list=intersect)
endPoint = Curve.EndPoint(curve=flatten)
byPoints = Custom[Springs.HostedInstance.ByPoints](host=select_wall, type=byName, point=endPoint)  # package spring nodes; Creates hosted family instances(doors/windows) at the specified points. You can feed either a single family type or a unique type for each instance.
code_block_3 = CodeBlock(a=o_koľko_má_byť_väčší_otvor_na) { a*2; }

# group: Calculates opening size
code_block_4 = CodeBlock { "Diameter"; }
getParameterValueByName = Element.GetParameterValueByName(element=filterByBoolMask.in, parameterName=code_block_4)
code_block_5 = CodeBlock { "Insulation Thickness"; }
getParameterValueByName_2 = Element.GetParameterValueByName(element=filterByBoolMask.in, parameterName=code_block_5)
code_block_6 = CodeBlock(diameter=getParameterValueByName, offset=code_block_3, insulation=getParameterValueByName_2) { diameter + offset + 2*insulation; }
ceiling = Custom[Rounding.Ceiling+](dbl=code_block_6, precision=rozmer_otvorov_zaokrúliť_na)  # package Clockwork for Dynamo 2.x; Rounds a number *up* to a specified precision

# group: set opening size
code_block_7 = CodeBlock { "Priemer"; }
setParameterByName = Element.SetParameterByName(element=byPoints, parameterName=code_block_7, value=ceiling)

# group: setter - profesia
setParameterByName_2 = Element.SetParameterByName(element=setParameterByName, parameterName=parameter_pre_kód_profesie, value=kód_profesie)

py_log = Python()  # unwired: IN[0]
# ---------- py_log.python (37 lines) ----------
# Load the Python Standard and DesignScript Libraries
import sys
import clr
clr.AddReference('ProtoGeometry')
from Autodesk.DesignScript.Geometry import *
clr.AddReference("RevitServices")
import RevitServices
from RevitServices.Persistence import DocumentManager

from datetime import datetime
import getpass

# name of the script for log
log_string = "prierazyPipesE2"

doc = DocumentManager.Instance.CurrentDBDocument
filePath = doc.PathName

# getting file name from path
lastBackslash = filePath.rindex("\\")+1
file_name = filePath[lastBackslash:]
user_name = getpass.getuser()
datestamp = str(datetime.now())
# tabulator between data to easy import to excel schedule
separator = "\t"
line = datestamp + separator + log_string + separator + user_name + "\n"

try:
	f = open("L:\\customToolslogs\\dynLogs\\" + file_name +".log", "a")
	f.write(line)
	f.close()
	status = "log has been written"
except:
	status = "something went wrong"

# Assign your output to the OUT variable.
OUT = status
# ----------------------------------------
parameter_name = StringInput("hrubka Poziarnej upchavky")

# group: setter - upchavka
setParameterByName_3 = Element.SetParameterByName(element=setParameterByName, parameterName=parameter_name, value=o_koľko_má_byť_väčší_otvor_na)

parameter_name_2 = StringInput("Blizsie zatriedenie")
elementType = Element.ElementType(element=select_wall)
code_block_8 = CodeBlock { "Keynote"; }
getParameterValueByName_3 = Element.GetParameterValueByName(element=elementType, parameterName=code_block_8)

# group: setter - typ steny
setParameterByName_4 = Element.SetParameterByName(element=setParameterByName, parameterName=parameter_name_2, value=getParameterValueByName_3)

code_block_9 = CodeBlock { "Outside Diameter"; }
parameter_name_3 = StringInput("Stavba KOD")
getParameterValueByName_4 = Element.GetParameterValueByName(element=select_wall, parameterName=parameter_name_3)

# group: setter - stavba kod
setParameterByName_5 = Element.SetParameterByName(element=setParameterByName, parameterName=parameter_name_3, value=getParameterValueByName_4)

parameter_name_4 = StringInput("Poschodie")

# group: setter - poschodie
setParameterByName_6 = Element.SetParameterByName(element=setParameterByName, parameterName=parameter_name_4, value=označenie_poschodia)

# group: logging IDs to log file
id = Element.Id(element=byPoints)
py_log_id_elementu = Python(IN[0]=id)
# ---------- py_log_id_elementu.python (45 lines) ----------
# Load the Python Standard and DesignScript Libraries
import sys
import clr
clr.AddReference('ProtoGeometry')
from Autodesk.DesignScript.Geometry import *
clr.AddReference("RevitServices")
import RevitServices
from RevitServices.Persistence import DocumentManager

from datetime import datetime
import getpass

# name of the script for log
id_list = IN[0]

doc = DocumentManager.Instance.CurrentDBDocument
filePath = doc.PathName

# getting file name from path
lastBackslash = filePath.rindex("\\")+1
file_name = filePath[lastBackslash:]
user_name = getpass.getuser()
datestamp = str(datetime.now())
# tabulator between data to easy import to excel schedule
separator = "\t"

record = ""
for id_int in id_list:
    line = datestamp + separator + str(id_int) + separator + user_name + "\n"

    # try:
    # f = open("U:\\1603_Eurovea 2\\04_RP\\01 PROJEKT\\LOG\\prierazy" + file_name +".log", "a")
    # f.write(line)
    # f.close()
    record += line
    # status = "log has been written"
    # except:
    #     pass
        # status = "something went wrong"
f = open("T:\\1603_Eurovea 2\\04_RP\\_Global\\01_PROJEKT\\10_LOG\\prierazy\\" + file_name +".log", "a")
f.write(record)
f.close()

# Assign your output to the OUT variable.
OUT = record
# ----------------------------------------
watch = Watch(py_log_id_elementu)

parameter_name_5 = StringInput("Rozsah Dole")

# group: setter - Rozsah Dole
setParameterByName_7 = Element.SetParameterByName(element=byPoints, parameterName=parameter_name_5, value=rozsah_dole)
