# Dynamo graph prierazyV2.dyn (Dynamo 2.3.0.5885)
# packages: spring nodes 203.1.0, Clockwork for Dynamo 2.x 2.1.2

návod = StringInput("""Vo vybranej stene vytvorí automaticky prierazy obdĺžnikového prierezu - Duct alebo káblové žľaby - Cable Trays. V projekte musí byť naloadovaná family s názvom "Prieraz_RECT_stena" a pridaný Shared Parameter "Profesia".

Trasy profesií je potrebné dočasne nakopírovať priamo do projektu. Nestačí mať naloadovaný link.

Je potrebné mať nainštalované packages Clockwork a Springs""")  # graph input
py_log = Python()  # unwired: IN[0]
# ---------- py_log.python (37 lines) ----------
# Load the Python Standard and DesignScript Libraries
import sys
import clr
clr.AddReference('ProtoGeometry')
from Autodesk.DesignScript.Geometry import *
clr.AddReference("RevitServices")
import RevitServices
from RevitServices.Persistence import DocumentManager

from datetime import datetime
import getpass

# name of the script for log
log_string = "prierazyV2_E2"

doc = DocumentManager.Instance.CurrentDBDocument
filePath = doc.PathName

# getting file name from path
lastBackslash = filePath.rindex("\\")+1
file_name = filePath[lastBackslash:]
user_name = getpass.getuser()
datestamp = str(datetime.now())
# tabulator between data to easy import to excel schedule
separator = "\t"
line = datestamp + separator + log_string + separator + user_name + "\n"

try:
	f = open("L:\\customToolslogs\\dynLogs\\" + file_name +".log", "a")
	f.write(line)
	f.close()
	status = "log has been written"
except:
	status = "something went wrong"

# Assign your output to the OUT variable.
OUT = status
# ----------------------------------------

# group: INPUT
select_mep_elements_window = DSModelElementsSelection()  # "Select MEP elements (Window selection)"; 1 picked in the model; graph input
uhol_potrubia_zadať_len_ak_ide = DoubleSlider(0, range=0..90 step 0.1)  # "uhol potrubia (zadať len ak ide šikmo)"; graph input
select_wall = DSModelElementSelection()  # 1 picked in the model; graph input
rozmer_otvorov_zaokrúliť_na = DoubleSlider(10, range=0..100 step 10)  # graph input
o_koľko_má_byť_väčší_otvor_na = DoubleSlider(50, range=0..200 step 10)  # "o koľko má byť väčší otvor na každú stranu"; graph input
parameter_pre_kód_profesie = StringInput("Poznámka")  # graph input
kód_profesie = StringInput("VZ")  # graph input
označenie_poschodia = StringInput("01")  # graph input
rozsah_dole = DoubleSlider(4000, range=0..8000 step 100)  # graph input

# group: category filter
getCategory = Element.GetCategory(element=select_mep_elements_window)
name = Category.Name(category=getCategory)
py_allowed_categories = Python(IN[0]=name)
# ---------- py_allowed_categories.python (22 lines) ----------
# Load the Python Standard and DesignScript Libraries
import sys
import clr
clr.AddReference('ProtoGeometry')
from Autodesk.DesignScript.Geometry import *

# The inputs to this node will be stored as a list in the IN variables.
categories = IN[0]

# Place your code below this line
allowed_categories = ["Cable Trays", "Ducts", "Pipes", "Cable Tray Fittings","Duct Accessories","Duct Fittings","Duct Fitting Lining","Duct Insulations","Duct Linings","Duct Terminals","Pipe Accessories","Pipe Connections","Pipe Fittings","Pipe Insulations"]
output = []
#if not list make list from string
if type(categories) == str:
	categories = [categories]
for category in categories:
	if category in allowed_categories:
		output.append(True)
	else:
		output.append(False)
# Assign your output to the OUT variable.
OUT = output
# ----------------------------------------
filterByBoolMask = List.FilterByBoolMask(list=select_mep_elements_window, mask=py_allowed_categories)

geometry = Element.Geometry(element=filterByBoolMask.in)
code_block = CodeBlock { 0; }
byCoordinates = Point.ByCoordinates(x=code_block, y=code_block, z=code_block)
ZAxis = Vector.ZAxis()
code_block_2 = CodeBlock(x=uhol_potrubia_zadať_len_ak_ide) { x*-1; }
rotate = Geometry.Rotate(geometry=geometry, origin=byCoordinates, axis=ZAxis, degrees=code_block_2)
byGeometry = BoundingBox.ByGeometry(geom=rotate)
toCuboid = BoundingBox.ToCuboid(boundingBox=byGeometry)
rotate_2 = Geometry.Rotate(geometry=toCuboid, origin=byCoordinates, axis=ZAxis, degrees=uhol_potrubia_zadať_len_ak_ide)
byGeometry_2 = BoundingBox.ByGeometry(geom=rotate_2)
toCuboid_2 = BoundingBox.ToCuboid(boundingBox=byGeometry_2)
byUnion = Solid.ByUnion(solids=rotate_2)
geometry_2 = Element.Geometry(element=select_wall)
intersect = Geometry.Intersect(geometry=byUnion, other=geometry_2)
byGeometry_3 = BoundingBox.ByGeometry(geom=intersect)
toCuboid_3 = BoundingBox.ToCuboid(boundingBox=byGeometry_3)
circular = BoolSelector(false)

# group: Opening Family Type
code_block_3 = CodeBlock { "Prieraz_KRUH_stena"; }
byName = FamilyType.ByName(name=code_block_3)
code_block_4 = CodeBlock { "Prieraz_RECT_stena"; }
byName_2 = FamilyType.ByName(name=code_block_4)

if_ = If(test=circular, true=byName, false=byName_2)
centroid = Solid.Centroid(solid=intersect)
flatten = List.Flatten(list=centroid)
ZAxis_2 = Vector.ZAxis()
getLocation = Element.GetLocation(element=select_wall)

# group: getting angle of the wall
startPoint = Curve.StartPoint(curve=getLocation)
XAxis = Vector.XAxis()
code_block_5 = CodeBlock { 1000; }
translate = Geometry.Translate(geometry=startPoint, direction=XAxis, distance=code_block_5)
byTwoPoints = Vector.ByTwoPoints(start=startPoint, end=translate)
endPoint = Curve.EndPoint(curve=getLocation)
byTwoPoints_2 = Vector.ByTwoPoints(start=endPoint, end=startPoint)
ZAxis_3 = Vector.ZAxis()
angleAboutAxis = Vector.AngleAboutAxis(vector=byTwoPoints, otherVector=byTwoPoints_2, rotationAxis=ZAxis_3)
code_block_6 = CodeBlock(x=angleAboutAxis) { x*-1; }

rotate_3 = Geometry.Rotate(geometry=intersect, origin=flatten, axis=ZAxis_2, degrees=code_block_6)
byGeometry_4 = BoundingBox.ByGeometry(geom=rotate_3)
toCuboid_4 = BoundingBox.ToCuboid(boundingBox=byGeometry_4)
width = Cuboid.Width(cuboid=toCuboid_4)
ceiling = Custom[Rounding.Ceiling+](dbl=width, precision=rozmer_otvorov_zaokrúliť_na)  # package Clockwork for Dynamo 2.x; Rounds a number *up* to a specified precision
height = Cuboid.Height(cuboid=toCuboid_4)
ceiling_2 = Custom[Rounding.Ceiling+](dbl=height, precision=rozmer_otvorov_zaokrúliť_na)
code_block_7 = CodeBlock(width=ceiling, offset=o_koľko_má_byť_väčší_otvor_na, height=ceiling_2) { width+offset; height+offset; }

# group: lowering basepoint because of origin on bottom edge
X = Point.X(point=flatten)
Y = Point.Y(point=flatten)
Z = Point.Z(point=flatten)
code_block_8 = CodeBlock(z=Z, height=code_block_7.out1) { z-height/2; }
byCoordinates_2 = Point.ByCoordinates(x=X, y=Y, z=code_block_8)

ꟿ_familyinstance_byhostandpoint = Custom[ꟿ FamilyInstance.ByHostAndPoint](host=select_wall, type=if_, point=byCoordinates_2)  # package spring nodes; Creates hosted family instances(doors/windows) at the specified points. You can feed either a single family type or a unique type for each instance.
code_block_9 = CodeBlock { "Width"; "Height"; }

# group: set opening width
setParameterByName = Element.SetParameterByName(element=ꟿ_familyinstance_byhostandpoint, parameterName=code_block_9.out0, value=code_block_7.out0)

# group: set opening heigth
setParameterByName_2 = Element.SetParameterByName(element=ꟿ_familyinstance_byhostandpoint, parameterName=code_block_9.out1, value=code_block_7.out1)

# group: setter - profesia
setParameterByName_3 = Element.SetParameterByName(element=ꟿ_familyinstance_byhostandpoint, parameterName=parameter_pre_kód_profesie, value=kód_profesie)

parameter_name = StringInput("Blizsie zatriedenie")
elementType = Element.ElementType(element=select_wall)
code_block_10 = CodeBlock { "Keynote"; }
getParameterValueByName = Element.GetParameterValueByName(element=elementType, parameterName=code_block_10)

# group: setter - typ steny
setParameterByName_4 = Element.SetParameterByName(element=ꟿ_familyinstance_byhostandpoint, parameterName=parameter_name, value=getParameterValueByName)

parameter_name_2 = StringInput("Stavba KOD")
getParameterValueByName_2 = Element.GetParameterValueByName(element=select_wall, parameterName=parameter_name_2)

# group: setter - stavba kod
setParameterByName_5 = Element.SetParameterByName(element=ꟿ_familyinstance_byhostandpoint, parameterName=parameter_name_2, value=getParameterValueByName_2)

parameter_name_3 = StringInput("Poschodie")

# group: setter - poschodie
setParameterByName_6 = Element.SetParameterByName(element=ꟿ_familyinstance_byhostandpoint, parameterName=parameter_name_3, value=označenie_poschodia)

parameter_name_4 = StringInput("Rozsah Dole")

# group: setter - Rozsah Dole
setParameterByName_7 = Element.SetParameterByName(parameterName=parameter_name_4, value=rozsah_dole)  # unwired: element

# group: logging IDs to log file
id = Element.Id(element=ꟿ_familyinstance_byhostandpoint)
py_log_id_elementu = Python(IN[0]=id)
# ---------- py_log_id_elementu.python (45 lines) ----------
# Load the Python Standard and DesignScript Libraries
import sys
import clr
clr.AddReference('ProtoGeometry')
from Autodesk.DesignScript.Geometry import *
clr.AddReference("RevitServices")
import RevitServices
from RevitServices.Persistence import DocumentManager

from datetime import datetime
import getpass

# name of the script for log
id_list = IN[0]

doc = DocumentManager.Instance.CurrentDBDocument
filePath = doc.PathName

# getting file name from path
lastBackslash = filePath.rindex("\\")+1
file_name = filePath[lastBackslash:]
user_name = getpass.getuser()
datestamp = str(datetime.now())
# tabulator between data to easy import to excel schedule
separator = "\t"

record = ""
for id_int in id_list:
    line = datestamp + separator + str(id_int) + separator + user_name + "\n"

    # try:
    # f = open("U:\\1603_Eurovea 2\\04_RP\\01 PROJEKT\\LOG\\prierazy" + file_name +".log", "a")
    # f.write(line)
    # f.close()
    record += line
    # status = "log has been written"
    # except:
    #     pass
        # status = "something went wrong"
f = open("T:\\1603_Eurovea 2\\04_RP\\_Global\\01_PROJEKT\\10_LOG\\prierazy\\" + file_name +".log", "a")
f.write(record)
f.close()

# Assign your output to the OUT variable.
OUT = record
# ----------------------------------------
watch = Watch(py_log_id_elementu)
