# Dynamo graph apartmentCrop.dyn (Dynamo 2.3.0.5885)
# packages: Rhythm 2019.12.4, spring nodes 203.1.0

categories = Categories("OST_Views")
all_elements_of_category = ElementsOfCategory(Category=categories)

# group: Filter - just selected View Category
type = Object.Type(obj=all_elements_of_category)
code_block = CodeBlock { "Revit.Elements.Views.FloorPlanView"; }
eq = type == code_block
filterByBoolMask = List.FilterByBoolMask(list=all_elements_of_category, mask=eq)

code_block_2 = CodeBlock { "View Name"; }
getParameterValueByName = Element.GetParameterValueByName(element=filterByBoolMask.in, parameterName=code_block_2)
code_block_3 = CodeBlock { 15; }
py_generate_apartment_numbers = Python(IN[0]=code_block_3)
# ---------- py_generate_apartment_numbers.python (18 lines) ----------
# Load the Python Standard and DesignScript Libraries
import sys
import clr
clr.AddReference('ProtoGeometry')
from Autodesk.DesignScript.Geometry import *

# The inputs to this node will be stored as a list in the IN variables.
x = IN[0]

# Place your code below this line
n = []
for i in range(1,x+1):
	if i<10:
		n.append("KP.D.1.0"+str(i))
	else:
		n.append("KP.D.1."+str(i))
# Assign your output to the OUT variable.
OUT = n
# ----------------------------------------
allIndicesOf = List.AllIndicesOf(list=getParameterValueByName, item=py_generate_apartment_numbers)
flatten = List.Flatten(list=allIndicesOf)
getItemAtIndex = List.GetItemAtIndex(list=filterByBoolMask.in, index=flatten)
categories_2 = Categories("OST_Rooms")
all_elements_of_category_2 = ElementsOfCategory(Category=categories_2)

# group: level filter - TEMPORARY
code_block_4 = CodeBlock { "2.NP"; }
code_block_5 = CodeBlock { "Level"; }
getParameterValueByName_2 = Element.GetParameterValueByName(element=all_elements_of_category_2, parameterName=code_block_5)
eq_2 = code_block_4 == getParameterValueByName_2
filterByBoolMask_2 = List.FilterByBoolMask(list=all_elements_of_category_2, mask=eq_2)

# group: filter empty values
code_block_6 = CodeBlock { "Alternativne cislo"; }
getParameterValueByName_3 = Element.GetParameterValueByName(element=filterByBoolMask_2.in, parameterName=code_block_6)
sort = List.Sort(list=getParameterValueByName_3)
code_block_7 = CodeBlock { "D."; }
startsWith = String.StartsWith(str=sort, searchFor=code_block_7)

filterByBoolMask_3 = List.FilterByBoolMask(list=filterByBoolMask_2.in, mask=startsWith)
geometry = Element.Geometry(element=filterByBoolMask_3.in)
flatten_2 = List.Flatten(list=geometry)
filterByBoolMask_4 = List.FilterByBoolMask(list=sort, mask=startsWith)
sortByKey = List.SortByKey(list=flatten_2, keys=filterByBoolMask_4.in)
py_list_of_unique = Python(IN[0]=sortByKey.sorted_keys, IN[1]=flatten_2)
# ---------- py_list_of_unique.python (29 lines) ----------
# Load the Python Standard and DesignScript Libraries
import sys
import clr
clr.AddReference('ProtoGeometry')
from Autodesk.DesignScript.Geometry import *

# The inputs to this node will be stored as a list in the IN variables.
parameters = IN[0]
elements = IN[1]

# Place your code below this line
unique = []
sortedElements = []
counter = 0
for parameter in parameters:
    try:
        element = elements[counter]
        if parameter not in unique:
            unique.append(parameter)
            sortedElements.append([element])
        else:
            index = unique.index(parameter)
            sortedElements[index].append(element)
    except:
        pass
    counter += 1

# Assign your output to the OUT variable.
OUT = sortedElements
# ----------------------------------------
byUnion = Solid.ByUnion(solids=py_list_of_unique)
byGeometry = BoundingBox.ByGeometry(geom=byUnion, lacing=Longest)
code_block_8 = CodeBlock { 1.2; }
ꟿ_boundingbox_scale = Custom[ꟿ BoundingBox.Scale](boundingBox=byGeometry, xAmmount=code_block_8, yAmmount=code_block_8, zAmmount=code_block_8)  # package spring nodes; Scales the bounding box in three dimensions according to it's center.
ʳʰʸᵗʰᵐ_view_setcropregion = Rhythm.Revit.Views.View.SetCropRegion(view=getItemAtIndex, bBox=ꟿ_boundingbox_scale)
code_block_9 = CodeBlock { ["KP.D.1.01", "KP.D.1.02", "KP.D.1.03", "KP.D.1.04", "KP.D.1.05", "KP.D.1.06"]; }
code_block_10 = CodeBlock { ["KP.D.1.01"]; }
návod = StringInput("zduplikuje pôdorys a oreže podľa jednotlivých bytov")  # graph input
