# Dynamo graph apartmentCropPoJednom.dyn (Dynamo 2.3.0.5885)
# packages: Rhythm 2019.12.4, spring nodes 203.1.0

categories = Categories("OST_Views")
all_elements_of_category = ElementsOfCategory(Category=categories)

# group: Filter - just selected View Category
type = Object.Type(obj=all_elements_of_category)
code_block = CodeBlock { "Revit.Elements.Views.FloorPlanView"; }
eq = type == code_block
filterByBoolMask = List.FilterByBoolMask(list=all_elements_of_category, mask=eq)

code_block_2 = CodeBlock { "View Name"; }
getParameterValueByName = Element.GetParameterValueByName(element=filterByBoolMask.in, parameterName=code_block_2)

# group: INPUT
select_model_element = DSModelElementSelection()  # 1 picked in the model; graph input

code_block_3 = CodeBlock { "Alternativne cislo"; }
getParameterValueByName_2 = Element.GetParameterValueByName(element=select_model_element, parameterName=code_block_3)
code_block_4 = CodeBlock(a=getParameterValueByName_2) { "KP."+a; }
allIndicesOf = List.AllIndicesOf(list=getParameterValueByName, item=code_block_4)
flatten = List.Flatten(list=allIndicesOf)
getItemAtIndex = List.GetItemAtIndex(list=filterByBoolMask.in, index=flatten)
categories_2 = Categories("OST_Rooms")
all_elements_of_category_2 = ElementsOfCategory(Category=categories_2)

# group: level filter - TEMPORARY
code_block_5 = CodeBlock { "2.NP"; }
code_block_6 = CodeBlock { "Level"; }
getParameterValueByName_3 = Element.GetParameterValueByName(element=all_elements_of_category_2, parameterName=code_block_6)
eq_2 = code_block_5 == getParameterValueByName_3
filterByBoolMask_2 = List.FilterByBoolMask(list=all_elements_of_category_2, mask=eq_2)

code_block_7 = CodeBlock { "Alternativne cislo"; }
getParameterValueByName_4 = Element.GetParameterValueByName(element=filterByBoolMask_2.in, parameterName=code_block_7)

# group: temp filter apartment number
eq_3 = getParameterValueByName_2 == getParameterValueByName_4
filterByBoolMask_3 = List.FilterByBoolMask(list=getParameterValueByName_4, mask=eq_3)
filterByBoolMask_4 = List.FilterByBoolMask(list=filterByBoolMask_2.in, mask=eq_3)

geometry = Element.Geometry(element=filterByBoolMask_4.in)
flatten_2 = List.Flatten(list=geometry)
py_list_of_unique = Python(IN[0]=filterByBoolMask_3.in, IN[1]=flatten_2)
# ---------- py_list_of_unique.python (29 lines) ----------
# Load the Python Standard and DesignScript Libraries
import sys
import clr
clr.AddReference('ProtoGeometry')
from Autodesk.DesignScript.Geometry import *

# The inputs to this node will be stored as a list in the IN variables.
parameters = IN[0]
elements = IN[1]

# Place your code below this line
unique = []
sortedElements = []
counter = 0
for parameter in parameters:
    try:
        element = elements[counter]
        if parameter not in unique:
            unique.append(parameter)
            sortedElements.append([element])
        else:
            index = unique.index(parameter)
            sortedElements[index].append(element)
    except:
        pass
    counter += 1

# Assign your output to the OUT variable.
OUT = sortedElements
# ----------------------------------------
byUnion = Solid.ByUnion(solids=py_list_of_unique)
byGeometry = BoundingBox.ByGeometry(geom=byUnion, lacing=Longest)
code_block_8 = CodeBlock { 1.2; }
ꟿ_boundingbox_scale = Custom[ꟿ BoundingBox.Scale](boundingBox=byGeometry, xAmmount=code_block_8, yAmmount=code_block_8, zAmmount=code_block_8)  # package spring nodes; Scales the bounding box in three dimensions according to it's center.
ʳʰʸᵗʰᵐ_view_setcropregion = Rhythm.Revit.Views.View.SetCropRegion(view=getItemAtIndex, bBox=ꟿ_boundingbox_scale)
code_block_9 = CodeBlock { ["KP.D.1.01", "KP.D.1.02", "KP.D.1.03", "KP.D.1.04", "KP.D.1.05", "KP.D.1.06"]; }
toPolySurface = BoundingBox.ToPolySurface()  # unwired: boundingBox
