# Dynamo graph developerAreaV3messer.dyn (Dynamo 2.12.1.8246)
# packages: Clockwork for Dynamo 2.x 2.4.0, Genius Loci 2022.4.19

categories = Categories("OST_Doors")
all_elements_of_category = ElementsOfCategory(Category=categories)
rooms = Custom[Door.Rooms](door=all_elements_of_category)  # package Clockwork for Dynamo 2.x; Gets the rooms that are connected by a given door

# group: reseting values for "fromRoom"s
categories_2 = Categories("OST_Rooms")
all_elements_of_category_2 = ElementsOfCategory(Category=categories_2)
code_block = CodeBlock { "Plocha korekcia"; 0; }
setParameterByName = Element.SetParameterByName(element=all_elements_of_category_2, parameterName=code_block.out0, value=code_block.out1)

passthrough = Custom[Passthrough](passThrough=rooms.fromRoom, waitFor=setParameterByName)  # package Clockwork for Dynamo 2.x; Forces a sequential order of execution. The node wired into the output of the Passthrough node will be executed *after* the node wired into the waitFor input (e.g. important for some Revit operations). The value of the passThrough input will be passed on to the node wired into the output port of the Passthrough node.

# group: filter only placed rooms
location = Custom[Element.Location+](element=passthrough)  # package Clockwork for Dynamo 2.x; Returns the location of an element as point, curve or curve loop, along with some booleans to help filtering the results. Unlike the OOTB Element.GetLocation node, it also retunrs sketch lines of sketch-based elements like floor slabs as well as the element's rotation property.
filterByBoolMask = List.FilterByBoolMask(list=passthrough, mask=location.hasLocation)

# group: getting area correction values from doors
filterByBoolMask_2 = List.FilterByBoolMask(list=all_elements_of_category, mask=location.hasLocation)
elementType = Element.ElementType(element=filterByBoolMask_2.in)
code_block_2 = CodeBlock { "Krídlo_šírka"; }
getParameterValueByName = Element.GetParameterValueByName(element=elementType, parameterName=code_block_2)
code_block_3 = CodeBlock(a=getParameterValueByName) { a/1000; }
element_host = Custom[Element Host](element=filterByBoolMask_2.in)  # package Genius Loci; Gets the host of the element. Unlike the OOTB node FamilyInstance.GetHost, it also works for elements hosted by a linked document, wall sweeps, foundations, railings and builing pads. Based on a Clockwork's node
elementType_2 = Element.ElementType(element=element_host)
code_block_4 = CodeBlock { "Width"; }
getParameterValueByName_2 = Element.GetParameterValueByName(element=elementType_2, parameterName=code_block_4)
code_block_5 = CodeBlock(a=getParameterValueByName_2) { a/1000; }
code_block_6 = CodeBlock(a=code_block_3, b=code_block_5) { a*b; }

categories_3 = Categories("OST_Windows")
all_elements_of_category_3 = ElementsOfCategory(Category=categories_3)
passthrough_2 = Custom[Passthrough](passThrough=all_elements_of_category_3, waitFor=setParameterByName)

# group: filtering out windows with zero Sill Height
code_block_7 = CodeBlock { "Sill Height"; }
getParameterValueByName_3 = Element.GetParameterValueByName(element=all_elements_of_category_3, parameterName=code_block_7)
code_block_8 = CodeBlock { 0; }
eq = getParameterValueByName_3 == code_block_8
filterByBoolMask_3 = List.FilterByBoolMask(list=passthrough_2, mask=eq)

rooms_2 = Custom[Window.Rooms](window=filterByBoolMask_3.in)  # package Clockwork for Dynamo 2.x; Gets the rooms that are connected by a given window

# group: filter only placed rooms
location_2 = Custom[Element.Location+](element=rooms_2.fromRoom)
filterByBoolMask_4 = List.FilterByBoolMask(list=rooms_2.fromRoom, mask=location_2.hasLocation)

# group: getting area correction values from windows
filterByBoolMask_5 = List.FilterByBoolMask(list=filterByBoolMask_3.in, mask=location_2.hasLocation)
elementType_3 = Element.ElementType(element=filterByBoolMask_5.in)
code_block_9 = CodeBlock { "Width"; }
getParameterValueByName_4 = Element.GetParameterValueByName(element=elementType_3, parameterName=code_block_9)
code_block_10 = CodeBlock { "OT_zvacsenie_prava"; }
getParameterValueByName_5 = Element.GetParameterValueByName(element=elementType_3, parameterName=code_block_10)
code_block_11 = CodeBlock { "OT_zvacsenie_lava"; }
getParameterValueByName_6 = Element.GetParameterValueByName(element=elementType_3, parameterName=code_block_11)
code_block_12 = CodeBlock(a=getParameterValueByName_4, b=getParameterValueByName_5, c=getParameterValueByName_6) { a+b+c; }
code_block_13 = CodeBlock(a=code_block_12) { a/1000; }
code_block_14 = CodeBlock { "Int. parapet_širka"; }
getParameterValueByName_7 = Element.GetParameterValueByName(element=elementType_3, parameterName=code_block_14)
code_block_15 = CodeBlock(a=getParameterValueByName_7) { a/1000; }
code_block_16 = CodeBlock(a=code_block_13, b=code_block_15) { a*b; }

join = List.Join(list0=code_block_6, list1=code_block_16)
join_2 = List.Join(list0=filterByBoolMask.in, list1=filterByBoolMask_4.in)
py_sum_correction_by_room = Python(IN[0]=join, IN[1]=join_2)  # IronPython2
# ---------- py_sum_correction_by_room.python (46 lines) ----------
# Load the Python Standard and DesignScript Libraries
import sys
import clr
clr.AddReference('ProtoGeometry')
from Autodesk.DesignScript.Geometry import *

clr.AddReference("RevitServices")
clr.AddReference("RevitAPI")
import RevitServices
from RevitServices.Persistence import DocumentManager
from Autodesk.Revit import DB

doc = DocumentManager.Instance.CurrentDBDocument
uiapp = DocumentManager.Instance.CurrentUIApplication
app = uiapp.Application


# The inputs to this node will be stored as a list in the IN variables.
area_corr = IN[0]
rooms = IN[1]

# Place your code below this line
unique_rooms = []
area_corrections = []
count = 0
for room in rooms:
	#try:
		if room not in unique_rooms:
			unique_rooms.append(room)
			area_corrections.append(area_corr[count])
		else:
			index = unique_rooms.index(room)
			# last_area_corr = area_corrections[index]
			# if some records have no value
			try:
				area_corrections[index] += area_corr[count]
			except:
				pass
		count += 1
	#except:
		#pass


# Assign your output to the OUT variable.
OUT = zip(unique_rooms, area_corrections)
#OUT = area_corrections
# ----------------------------------------
transpose = List.Transpose(lists=py_sum_correction_by_room)
code_block_17 = CodeBlock(a=transpose) { a[0]; a[1]; }
code_block_18 = CodeBlock { "Plocha korekcia"; }
setParameterByName_2 = Element.SetParameterByName(element=code_block_17.out0, parameterName=code_block_18, value=code_block_17.out1)
py_sum_correction_by_room_2 = Python(IN[0]=code_block_16, IN[1]=filterByBoolMask_4.in)  # IronPython2; frozen
# ---------- py_sum_correction_by_room_2.python (39 lines) ----------
# Load the Python Standard and DesignScript Libraries
import sys
import clr
clr.AddReference('ProtoGeometry')
from Autodesk.DesignScript.Geometry import *

clr.AddReference("RevitServices")
clr.AddReference("RevitAPI")
import RevitServices
from RevitServices.Persistence import DocumentManager
from Autodesk.Revit import DB

doc = DocumentManager.Instance.CurrentDBDocument
uiapp = DocumentManager.Instance.CurrentUIApplication
app = uiapp.Application


# The inputs to this node will be stored as a list in the IN variables.
area_corr = IN[0]
rooms = IN[1]

# Place your code below this line
unique_rooms = []
area_corrections = []
count = 0
for room in rooms:
	if room not in unique_rooms:
		unique_rooms.append(room)
		area_corrections.append(area_corr[count])
	else:
		index = unique_rooms.index(room)
		#last_area_corr = area_corrections[index]
		area_corrections[index] += area_corr[count]
	count += 1


# Assign your output to the OUT variable.
OUT = zip(unique_rooms, area_corrections)
#OUT = area_corrections
# ----------------------------------------
transpose_2 = List.Transpose(lists=py_sum_correction_by_room_2)
code_block_19 = CodeBlock(a=transpose_2) { a[0]; a[1]; }
code_block_20 = CodeBlock { "Plocha korekcia"; }
setParameterByName_3 = Element.SetParameterByName(element=code_block_19.out0, parameterName=code_block_20, value=code_block_19.out1)
code_block_21 = CodeBlock { "Rozširovací profil_pravý"; }
getParameterValueByName_8 = Element.GetParameterValueByName(element=elementType_3, parameterName=code_block_21)
id = Element.Id(element=join_2)
