# Dynamo graph DuplicateSchemeByAppartments_pV2.dyn (Dynamo 2.12.1.8246)
# packages: cata_lyst 0.0.1, Clockwork for Dynamo 2.x 2.4.0, Genius Loci 2022.4.19, archi-lab.net 2023.213.1523, Modelical 2022.5.12

návod = StringInput("""Vytvori seriu Floorplanov pre kazdy Level na ktorom je umiestneny byt. Pre kazdy byt spravi Dependent View tohto floorplanu, ktoreho nazov zmeni podla nazvu bytu v parametri occupancy - hodnota v parametri zacinajuca BYT xxx
vsetkym novovytvorenym floorplanom aplikuje template a nakoniec ich oreze podla boundingboxu vsetkych miestnosti s offsetom""")  # graph input
code_block = CodeBlock { "DuplicateSchemeByAppartment"; }
usageLog = Custom[usageLog](scriptName=code_block)  # package cata_lyst; node logs every run of the script in which is used to the hardcoded server location
code_block_2 = CodeBlock { "Rooms"; }
byName = Category.ByName(name=code_block_2)
all_elements_of_category = ElementsOfCategory(Category=byName)

# group: INPUT
appartment_parameter_name = StringInput("Occupancy")

# group: filtering out just rooms from appartments
getParameterValueByName = Element.GetParameterValueByName(element=all_elements_of_category, parameterName=appartment_parameter_name)
level = Custom[Element.Level](element=all_elements_of_category)  # package Clockwork for Dynamo 2.x; Gets an element's level
py_find_and_cut_bytxxxx = Python(IN[0]=getParameterValueByName, IN[1]=level, IN[2]=all_elements_of_category)  # IronPython2
# ---------- py_find_and_cut_bytxxxx.python (31 lines) ----------
# Load the Python Standard and DesignScript Libraries
import sys
import clr
clr.AddReference('ProtoGeometry')
from Autodesk.DesignScript.Geometry import *

# The inputs to this node will be stored as a list in the IN variables.
occ_vals = IN[0] # occupancy values
levels = IN[1]
rooms = IN[2]
index = 3 # for cutting occupancy values
filt_rooms = [] # all rooms in an appartment
filt_occ_vals = [] #occupancy values of first room in an appartment - unique values
filt_levels = [] # just levels with rooms belonging to an appartment
app_occ_vals = [] # occypancy values of rooms in appartments

# Place your code below this line
count = 0
for value in occ_vals:
	#if value[:3] == "BYT":
	#if value[:3] == "BYT" or value[:8] == "PRENAJÍM" or value[:6] == "APARTM":
	if value:
		#cut_value = value[index:]
		if value not in filt_occ_vals:
			filt_occ_vals.append(value)
			filt_levels.append(levels[count])
		filt_rooms.append(rooms[count]) # all rooms in appartments
		app_occ_vals.append(value) # occupancy values of all rooms in appartments
	count += 1
# Assign your output to the OUT variable.
OUT = [filt_occ_vals, filt_levels, filt_rooms, app_occ_vals]
# ----------------------------------------
code_block_3 = CodeBlock(a=py_find_and_cut_bytxxxx)
# ---------- code_block_3.designscript (8 lines) ----------
//occupancy values;
a[0];
//levels
a[1];
//rooms in apparmtents;
a[2];
//occupancy vals of rooms in apparmtents;
a[3];
# ----------------------------------------

# group: group appartment number by Level
groupByKey = List.GroupByKey(list=code_block_3.out0, keys=code_block_3.out1)

# group: cannot sortByKey by Level - bug
string_from_object = FromObject(object=groupByKey.uniqueKeys)
list_sortbykey_levels = List.SortByKey(list=groupByKey.uniqueKeys, keys=string_from_object)
list_sortbykey_appartments = List.SortByKey(list=groupByKey.groups, keys=string_from_object)

code_block_4 = CodeBlock { "Views"; }
byName_2 = Category.ByName(name=code_block_4)
all_elements_of_category_2 = ElementsOfCategory(Category=byName_2)
code_block_5 = CodeBlock { "View Name"; }
getParameterValueByName_2 = Element.GetParameterValueByName(element=all_elements_of_category_2, parameterName=code_block_5)
code_block_6 = CodeBlock { "Delenie I"; }
getParameterValueByName_3 = Element.GetParameterValueByName(element=all_elements_of_category_2, parameterName=code_block_6)
code_block_7 = CodeBlock { "MARKETING poschodia"; }
eq = getParameterValueByName_3 == code_block_7
filterByBoolMask = List.FilterByBoolMask(list=getParameterValueByName_2, mask=eq)
sort = List.Sort(list=filterByBoolMask.in)
view_byname = Custom[View ByName](ViewName=sort)  # package Genius Loci; Collect views by given name in the active or given document. Based on a Christian Gartland's script.
code_block_8 = CodeBlock { "Duplicate"; }
space_before_suffix = CodeBlock(a=list_sortbykey_appartments.sortedList) { " "+a; }

# group: creating depending views for each appartment
duplicateView = View.DuplicateView(view=view_byname@L2, viewDuplicateOption=code_block_8, suffix=space_before_suffix)

flatten = List.Flatten(list=duplicateView)
code_block_9 = CodeBlock { "MAR_Podorys podlazia"; }
applyViewTemplate = Custom[View.ApplyViewTemplate](views=flatten, tempName=code_block_9)  # package Modelical; This node applies a view template (selected by name) to the selected view.
code_block_10 = CodeBlock { false; }
cropBoxVisible = archilab.Revit.Views.Views.CropBoxVisible(view=applyViewTemplate.views, visible=code_block_10)
flatten_2 = List.Flatten(list=cropBoxVisible)
code_block_11 = CodeBlock { "Rooms"; }
byName_3 = Category.ByName(name=code_block_11)
code_block_12 = CodeBlock { "View Name"; }
getParameterValueByName_4 = Element.GetParameterValueByName(element=applyViewTemplate.views, parameterName=code_block_12)
code_block_13 = CodeBlock { 1; }
flatten_3 = List.Flatten(list=getParameterValueByName_4, amount=code_block_13)

# group: for other models
py_get_cislo_bytu = Python(IN[0]=flatten_3)  # IronPython2
# ---------- py_get_cislo_bytu.python (18 lines) ----------
# Load the Python Standard and DesignScript Libraries
import sys
import clr
clr.AddReference('ProtoGeometry')
from Autodesk.DesignScript.Geometry import *

# The inputs to this node will be stored as a list in the IN variables.
names = IN[0]
split_names = []

# Place your code below this line
#for name_list in names:
	#for i in name_list:
for i in names:
		split_name = i.split(".")
		split_names.append(split_name[-1])
# Assign your output to the OUT variable.
OUT = split_names
# ----------------------------------------
code_block_14 = CodeBlock(num=py_get_cislo_bytu) { "passporty_byt"+num; }

set_colorfill_scheme_properties = Custom[Set ColorFill Scheme Properties](colorFillScheme=code_block_14@L1)  # package Genius Loci; Works only in Revit 2022 and later. Sets the name, values, colors and fill patterns of the given Color Scheme. (All inputs are optional)
view_set_colorfill_scheme = Custom[View Set ColorFill Scheme](view=flatten_2@L1, category=byName_3, colorFillScheme=set_colorfill_scheme_properties@L1)  # package Genius Loci; Works only in Revit 2022 and later. Applies color fill scheme to the given view.
code_block_15 = CodeBlock { "AsDependent"; }

# group: group rooms by appartment
groupByKey_2 = List.GroupByKey(list=code_block_3.out2, keys=code_block_3.out3)

sortByKey = List.SortByKey(list=groupByKey_2.groups, keys=groupByKey_2.uniqueKeys)

# group: for B1 model only
py_get_cislo_sekcie_len_objekt = Python(IN[0]=flatten_3)  # "PY get Cislo sekcie - len objekt B1"; IronPython2
# ---------- py_get_cislo_sekcie_len_objekt.python (28 lines) ----------
# Load the Python Standard and DesignScript Libraries
import sys
import clr
clr.AddReference('ProtoGeometry')
from Autodesk.DesignScript.Geometry import *

# The inputs to this node will be stored as a list in the IN variables.
names = IN[0]
split_names = []

# Place your code below this line
#for name_list in names:
	#for i in name_list:
for i in names:
		split_name = i.split(".")
		try:
			# if Cislo sekcie is third from the end
			# other units, not appartments
			split_n = int(split_name[-3])
			split_names.append(split_name[-2])
		except:
			# if Cislo sekcie is second from the end
			# appartments
			split_names.append(split_name[-3])
		
		
# Assign your output to the OUT variable.
OUT = split_names
# ----------------------------------------
code_block_16 = CodeBlock(a=py_get_cislo_sekcie_len_objekt, b=py_get_cislo_bytu) { a+b; }
code_block_17 = CodeBlock(num=code_block_16) { "passporty_byt"+num; }
py_get_cislo_bytu_len_objekt_b1 = Python(IN[0]=flatten_3)  # IronPython2
# ---------- py_get_cislo_bytu_len_objekt_b1.python (28 lines) ----------
# Load the Python Standard and DesignScript Libraries
import sys
import clr
clr.AddReference('ProtoGeometry')
from Autodesk.DesignScript.Geometry import *

# The inputs to this node will be stored as a list in the IN variables.
names = IN[0]
split_names = []

# Place your code below this line
#for name_list in names:
	#for i in name_list:
for i in names:
		split_name = i.split(".")
		try:
			# if Cislo sekcie is third from the end
			# other units, not appartments
			split_n = int(split_name[-3])
			split_names.append(split_name[-1])
		except:
			# if Cislo sekcie is second from the end
			# appartments
			split_names.append(split_name[-2])
		
		
# Assign your output to the OUT variable.
OUT = split_names
# ----------------------------------------
