# Dynamo graph sheetCreateAllinOne1dyn.dyn (Dynamo 2.12.1.8246)
# packages: Clockwork for Dynamo 2.x 2.4.0, Modelical 2022.5.12, Genius Loci 2022.4.19, archi-lab.net 2023.213.1523

# group: INPUT
crop_box_offset = IntegerSlider(200, range=0..3000 step 50)  # graph input
appartment_parameter_name = StringInput("Occupancy")
view_template_name = StringInput("passportyMarketing")  # graph input

code_block = CodeBlock { "Rooms"; }
byName = Category.ByName(name=code_block)
all_elements_of_category = ElementsOfCategory(Category=byName)

# group: INPUT
views = Views("BYT")  # graph input
appartment_parameter_name_2 = StringInput("Occupancy")

code_block_2 = CodeBlock { "Rooms"; }
byName_2 = Category.ByName(name=code_block_2)
all_elements_of_category_2 = ElementsOfCategory(Category=byName_2)
getParameterValueByName = Element.GetParameterValueByName(element=all_elements_of_category_2, parameterName=appartment_parameter_name_2)
uniqueItems = List.UniqueItems(list=getParameterValueByName)
py_find_bytxxxx = Python(IN[0]=uniqueItems)  # IronPython2
# ---------- py_find_bytxxxx.python (18 lines) ----------
# Load the Python Standard and DesignScript Libraries
import sys
import clr
clr.AddReference('ProtoGeometry')
from Autodesk.DesignScript.Geometry import *

# The inputs to this node will be stored as a list in the IN variables.
strings = IN[0]
index = 3
filt_cut_strings = []

# Place your code below this line
for s in strings:
	if s:
	#if s[:index] == "BYT" or s[:index] == "APA" or s[:6] == "PRENAJ" :
		filt_cut_strings.append(s)
# Assign your output to the OUT variable.
OUT = filt_cut_strings
# ----------------------------------------
duplicateView = View.DuplicateView(view=views, suffix=py_find_bytxxxx)
code_block_3 = CodeBlock { "View Name"; }
setParameterByName = Element.SetParameterByName(element=duplicateView, parameterName=code_block_3, value=py_find_bytxxxx)
clearAllFilters = ScheduleView.ClearAllFilters(scheduleView=setParameterByName)
fields = ScheduleView.Fields(scheduleView=views)
string_from_object = FromObject(object=fields)
code_block_4 = CodeBlock { "Occupancy"; }
indexOf = List.IndexOf(list=string_from_object, element=code_block_4)
code_block_5 = CodeBlock(a=fields, b=indexOf) { a[b]; }
schedule_filter_type = ScheduleFilterType("Equal")
byFieldTypeAndValue = Revit.Schedules.ScheduleFilter.ByFieldTypeAndValue(field=code_block_5, filterType=schedule_filter_type, value=py_find_bytxxxx)
python_script = Python(IN[0]=byFieldTypeAndValue)  # IronPython2
# ---------- python_script.python (15 lines) ----------
# Load the Python Standard and DesignScript Libraries
import sys
import clr
clr.AddReference('ProtoGeometry')
from Autodesk.DesignScript.Geometry import *

# The inputs to this node will be stored as a list in the IN variables.
dataEnteringNode = IN[0]

# Place your code below this line
output = []
for a in dataEnteringNode:
	output.append([a])
# Assign your output to the OUT variable.
OUT = output
# ----------------------------------------
addFilters = ScheduleView.AddFilters(scheduleView=clearAllFilters, scheduleFilters=python_script)
passthrough = Custom[Passthrough](passThrough=appartment_parameter_name, waitFor=addFilters)  # package Clockwork for Dynamo 2.x; Forces a sequential order of execution. The node wired into the output of the Passthrough node will be executed *after* the node wired into the waitFor input (e.g. important for some Revit operations). The value of the passThrough input will be passed on to the node wired into the output port of the Passthrough node.

# group: filtering out just rooms from appartments
getParameterValueByName_2 = Element.GetParameterValueByName(element=all_elements_of_category, parameterName=passthrough)
level = Custom[Element.Level](element=all_elements_of_category)  # package Clockwork for Dynamo 2.x; Gets an element's level
py_find_and_cut_bytxxxx = Python(IN[0]=getParameterValueByName_2, IN[1]=level, IN[2]=all_elements_of_category)  # IronPython2
# ---------- py_find_and_cut_bytxxxx.python (31 lines) ----------
# Load the Python Standard and DesignScript Libraries
import sys
import clr
clr.AddReference('ProtoGeometry')
from Autodesk.DesignScript.Geometry import *

# The inputs to this node will be stored as a list in the IN variables.
occ_vals = IN[0] # occupancy values
levels = IN[1]
rooms = IN[2]
index = 3 # for cutting occupancy values
filt_rooms = [] # all rooms in an appartment
filt_occ_vals = [] #occupancy values of first room in an appartment - unique values
filt_levels = [] # just levels with rooms belonging to an appartment
app_occ_vals = [] # occypancy values of rooms in appartments

# Place your code below this line
count = 0
for value in occ_vals:
	#if value[:3] == "BYT":
	if value:
	#if value[:3] == "BYT" or value[:8] == "PRENAJÍM" or value[:6] == "APARTM":
		#cut_value = value[index:]
		if value not in filt_occ_vals:
			filt_occ_vals.append(value)
			filt_levels.append(levels[count])
		filt_rooms.append(rooms[count]) # all rooms in appartments
		app_occ_vals.append(value) # occupancy values of all rooms in appartments
	count += 1
# Assign your output to the OUT variable.
OUT = [filt_occ_vals, filt_levels, filt_rooms, app_occ_vals]
# ----------------------------------------
code_block_6 = CodeBlock(a=py_find_and_cut_bytxxxx)
# ---------- code_block_6.designscript (8 lines) ----------
//occupancy values;
a[0];
//levels
a[1];
//rooms in apparmtents;
a[2];
//occupancy vals of rooms in apparmtents;
a[3];
# ----------------------------------------

# group: group appartment number by Level
groupByKey = List.GroupByKey(list=code_block_6.out0, keys=code_block_6.out1)

# group: cannot sortByKey by Level - bug
string_from_object_2 = FromObject(object=groupByKey.uniqueKeys)
list_sortbykey_levels = List.SortByKey(list=groupByKey.uniqueKeys, keys=string_from_object_2)
list_sortbykey_appartments = List.SortByKey(list=groupByKey.groups, keys=string_from_object_2)

# group: creating and renaming Floorplans for each Level
byLevel = FloorPlanView.ByLevel(level=list_sortbykey_levels.sortedList)
code_block_7 = CodeBlock { "View Name"; }
name = Level.Name(level=list_sortbykey_levels.sortedList)
code_block_8 = CodeBlock(a=name) { a+ " MAR"; }
setParameterByName_2 = Element.SetParameterByName(element=byLevel, parameterName=code_block_7, value=code_block_8)

applyViewTemplate = Custom[View.ApplyViewTemplate](views=setParameterByName_2, tempName=view_template_name)  # package Modelical; This node applies a view template (selected by name) to the selected view.
code_block_9 = CodeBlock { "AsDependent"; }
space_before_suffix = CodeBlock(a=list_sortbykey_appartments.sortedList) { " "+a; }

# group: creating depending views for each appartment
duplicateView_2 = View.DuplicateView(view=applyViewTemplate.views@L2, viewDuplicateOption=code_block_9, suffix=space_before_suffix)

flatten = List.Flatten(list=duplicateView_2)

# group: group rooms by appartment
groupByKey_2 = List.GroupByKey(list=code_block_6.out2, keys=code_block_6.out3)

sortByKey = List.SortByKey(list=groupByKey_2.groups, keys=groupByKey_2.uniqueKeys)
indexOf_2 = List.IndexOf(list=sortByKey.sortedKeys, element=list_sortbykey_appartments.sortedList)
getItemAtIndex = List.GetItemAtIndex(list=sortByKey.sortedList, index=indexOf_2@L1)
boundingbox_byunion = Custom[BoundingBox ByUnion](element=getItemAtIndex@L2)  # package Genius Loci; Creates a single bounding box for one or more elements and returns a solid. The optional input Rotation allows to be not aligned with the axis. By Vsevolod Chugreev
byGeometry = BoundingBox.ByGeometry(geom=boundingbox_byunion@L1)

# group: setting crop box
setCropBox = archilab.Revit.Views.Views.SetCropBox(view=flatten, boundingBox=byGeometry)
resizeCropBox = Custom[View.ResizeCropBox](amt=crop_box_offset, view=setCropBox)  # package Clockwork for Dynamo 2.x; Resizes the bounding box of a given Revit element by the specified amount in X, Y and Z direction. May need to be used in conjunction with a Transaction node.
code_block_10 = CodeBlock { false; }
cropBoxVisible = archilab.Revit.Views.Views.CropBoxVisible(view=resizeCropBox.view, visible=code_block_10)  # frozen
