# Dynamo graph sheetCreateAllinOne2dyn.dyn (Dynamo 2.12.1.8246)
# packages: cata_lyst 0.0.1, Clockwork for Dynamo 2.x 2.4.0, Rhythm 2022.4.3

categories = Categories("OST_Rooms")
all_elements_of_category = ElementsOfCategory(Category=categories)

# group: INPUT
file_path_for_excel_schedule = Filename("sheetcreate\sheetlist_Project1.txt")  # graph input
select_title_block = FamilyTypes("format_passportyBytovSample:B1")  # graph input
select_view_type_of_1st_view_1 = DoubleSlider(1, range=1..7 step 1)  # "Select View Type of 1st View 1 - FloorPlanView 2 - SectionView 3 - CeilingPlanView 4 - Legend 5 - AxonometricView 6 - AreaPlanView 7 - DraftingView"; graph input
select_view_type_of_3nd_view = DoubleSlider(1, range=1..8 step 1)  # "Select View Type of 3nd View (optional)"; graph input
select_view_type_of_2nd_view = DoubleSlider(8, range=1..8 step 1)  # "Select View Type of 2nd View (optional)"; graph input

fromPath = FileObject(path=file_path_for_excel_schedule)  # "File.FromPath"
readText = FileSystem.ReadText(file=fromPath)

# group: FIX it here
python_script = Python(IN[0]=readText)  # IronPython2
# ---------- python_script.python (16 lines) ----------
# Load the Python Standard and DesignScript Libraries
import sys
import clr
clr.AddReference('ProtoGeometry')
from Autodesk.DesignScript.Geometry import *

# The inputs to this node will be stored as a list in the IN variables.
text = IN[0]
structured = []
# Place your code below this line
t = text.split("\n")
for i in t:
	line = i.split("	")
	structured.append(line)
# Assign your output to the OUT variable.
OUT = structured
# ----------------------------------------

transpose = List.Transpose(lists=python_script)
number = DoubleInput(1)
getItemAtIndex = List.GetItemAtIndex(list=transpose, index=number)
number_2 = DoubleInput(0)
getItemAtIndex_2 = List.GetItemAtIndex(list=transpose, index=number_2)
categories_2 = Categories("OST_Views")
all_elements_of_category_2 = ElementsOfCategory(Category=categories_2)

# group: list of View Categories
code_block = CodeBlock()
# ---------- code_block.designscript (8 lines) ----------
["Revit.Elements.Views.FloorPlanView",
"Revit.Elements.Views.SectionView",
"Revit.Elements.Views.CeilingPlanView",
"Revit.Elements.Views.Legend",
"Revit.Elements.Views.AxonometricView",
"Revit.Elements.Views.AreaPlanView",
"Revit.Elements.Views.DraftingView",
"Revit.Elements.Views.ScheduleView"];
# ----------------------------------------

# group: Filter - just selected View Category
type = Object.Type(object=all_elements_of_category_2)
code_block_2 = CodeBlock(list=code_block, x=select_view_type_of_1st_view_1) { list[x-1]; }
eq = type == code_block_2
filterByBoolMask = List.FilterByBoolMask(list=all_elements_of_category_2, mask=eq)

code_block_3 = CodeBlock { "View Name"; }
getParameterValueByName = Element.GetParameterValueByName(element=filterByBoolMask.in, parameterName=code_block_3)
number_3 = DoubleInput(2)
getItemAtIndex_3 = List.GetItemAtIndex(list=transpose, index=number_3)
allIndicesOf = List.AllIndicesOf(list=getParameterValueByName, item=getItemAtIndex_3)
flatten = List.Flatten(list=allIndicesOf)
getItemAtIndex_4 = List.GetItemAtIndex(list=filterByBoolMask.in, index=flatten)
categories_3 = Categories("OST_Views")
all_elements_of_category_3 = ElementsOfCategory(Category=categories_3)

# group: Filter - just selected View Category
type_2 = Object.Type(object=all_elements_of_category_3)
code_block_4 = CodeBlock(list=code_block, x=select_view_type_of_3nd_view) { list[x-1]; }
eq_2 = type_2 == code_block_4
filterByBoolMask_2 = List.FilterByBoolMask(list=all_elements_of_category_3, mask=eq_2)

code_block_5 = CodeBlock { "View Name"; }
getParameterValueByName_2 = Element.GetParameterValueByName(element=filterByBoolMask_2.in, parameterName=code_block_5)
number_4 = DoubleInput(5)
getItemAtIndex_5 = List.GetItemAtIndex(list=transpose, index=number_4)
allIndicesOf_2 = List.AllIndicesOf(list=getParameterValueByName_2, item=getItemAtIndex_5)
flatten_2 = List.Flatten(list=allIndicesOf_2)
getItemAtIndex_6 = List.GetItemAtIndex(list=filterByBoolMask_2.in, index=flatten_2)

# group: possible list create with 2nd views
list_create = List.Create(item0=getItemAtIndex_4, item1=getItemAtIndex_6)

transpose_2 = List.Transpose(lists=list_create)
C3 = CodeBlock()
# ---------- C3.designscript (4 lines) ----------
[
Point.ByCoordinates(2072,776,0),
Point.ByCoordinates(2170,830,0)
];
# ----------------------------------------
byNameNumberTitleBlockViewsAndLocations = Sheet.ByNameNumberTitleBlockViewsAndLocations(sheetName=getItemAtIndex, sheetNumber=getItemAtIndex_2, titleBlockFamilyType=select_title_block, views=transpose_2, locations=C3)
code_block_6 = CodeBlock { "Occupancy"; }

# group: INPUT
code_block_7 = CodeBlock { "."; }

code_block_8 = CodeBlock { "Occupancy"; }
schedule_origin_y_coord = CodeBlock { 169.102; }
schedule_row_height = CodeBlock { 4.4588; }
number_5 = DoubleInput(6)
getItemAtIndex_7 = List.GetItemAtIndex(list=transpose, index=number_5)
watch = Watch(getItemAtIndex_7)

# group: FIX THIS
adhoc_return_remover = Python(IN[0]=watch)  # IronPython2
# ---------- adhoc_return_remover.python (17 lines) ----------
# Load the Python Standard and DesignScript Libraries
import sys
import clr
clr.AddReference('ProtoGeometry')
from Autodesk.DesignScript.Geometry import *

# The inputs to this node will be stored as a list in the IN variables.
data = IN[0]
output = []
# Place your code below this line
for i in data:
	try:
		output.append(i[:-1])
	except:
		pass
# Assign your output to the OUT variable.
OUT = output
# ----------------------------------------

number_6 = DoubleInput(4)
getItemAtIndex_8 = List.GetItemAtIndex(list=transpose, index=number_6)
watch_2 = Watch(getItemAtIndex_8)

# group: Sheet parameters setter
code_block_9 = CodeBlock { "Poschodie"; }
py_poschodie_getter = Python(IN[0]=getItemAtIndex)  # IronPython2
# ---------- py_poschodie_getter.python (15 lines) ----------
# Load the Python Standard and DesignScript Libraries
import sys
import clr
clr.AddReference('ProtoGeometry')
from Autodesk.DesignScript.Geometry import *

# The inputs to this node will be stored as a list in the IN variables.
data = IN[0]
split_strings = []
# Place your code below this line
for i in data:
	split_string = i.split(".")
	split_strings.append(split_string[-2])
# Assign your output to the OUT variable.
OUT = split_strings
# ----------------------------------------
setParameterByName = Element.SetParameterByName(element=byNameNumberTitleBlockViewsAndLocations, parameterName=code_block_9, value=py_poschodie_getter)
code_block_10 = CodeBlock { "Delenie I"; "MAR sheet script"; }
setParameterByName_2 = Element.SetParameterByName(element=byNameNumberTitleBlockViewsAndLocations, parameterName=code_block_10.out0, value=code_block_10.out1)
code_block_11 = CodeBlock { "Druh_priestoru"; }
setParameterByName_3 = Element.SetParameterByName(element=byNameNumberTitleBlockViewsAndLocations, parameterName=code_block_11, value=adhoc_return_remover)
code_block_12 = CodeBlock { "Izbovost"; }
setParameterByName_4 = Element.SetParameterByName(element=byNameNumberTitleBlockViewsAndLocations, parameterName=code_block_12, value=watch_2)

passthrough = Custom[Passthrough](passThrough=all_elements_of_category, waitFor=setParameterByName)  # package Clockwork for Dynamo 2.x; Forces a sequential order of execution. The node wired into the output of the Passthrough node will be executed *after* the node wired into the waitFor input (e.g. important for some Revit operations). The value of the passThrough input will be passed on to the node wired into the output port of the Passthrough node.
getParameterValueByName_3 = Element.GetParameterValueByName(element=passthrough, parameterName=code_block_6)
contains = String.Contains(string=getParameterValueByName_3, searchFor=code_block_7)
filterByBoolMask_3 = List.FilterByBoolMask(list=passthrough, mask=contains)
filterByBoolMask_4 = List.FilterByBoolMask(list=getParameterValueByName_3, mask=contains)
groupByKey = List.GroupByKey(list=filterByBoolMask_3.in, keys=filterByBoolMask_4.in)

# group: get this to catalyst
py_get_sheet_by_name = Python(IN[0]=groupByKey.uniqueKeys)  # IronPython2
# ---------- py_get_sheet_by_name.python (23 lines) ----------
import clr
clr.AddReference('RevitServices')
import RevitServices
from RevitServices.Persistence import DocumentManager
clr.AddReference('RevitAPI')
import Autodesk
from Autodesk.Revit.DB import Document, RevitLinkInstance, FilteredElementCollector, ViewSheet

sh_names = IN[0]

doc = DocumentManager.Instance.CurrentDBDocument

collector = FilteredElementCollector(doc).OfClass(Autodesk.Revit.DB.ViewSheet)

# sheets=[s for s in collector for namnum in namnums if namnum in s.SheetNumber or namnum in s.Name]
sheets = []
for sh_name in sh_names:
	for sheet in collector:
		if sheet.Name == sh_name:
			sheets.append(sheet)

if len(sheets)>1 : OUT = sheets
else: OUT = sheets[0]
# ----------------------------------------

titleBlock = Sheet.TitleBlock(sheet=py_get_sheet_by_name)

# group: Interier/Exterier
code_block_13 = CodeBlock { "Department"; }
getParameterValueByName_4 = Element.GetParameterValueByName(element=passthrough, parameterName=code_block_13)
code_block_14 = CodeBlock { "Interior"; }
eq_3 = getParameterValueByName_4 == code_block_14
filterByBoolMask_5 = List.FilterByBoolMask(list=passthrough, mask=eq_3)

getParameterValueByName_5 = Element.GetParameterValueByName(element=filterByBoolMask_5.in, parameterName=code_block_8)
contains_2 = String.Contains(string=getParameterValueByName_5, searchFor=code_block_7)
filterByBoolMask_6 = List.FilterByBoolMask(list=filterByBoolMask_5.in, mask=contains_2)
filterByBoolMask_7 = List.FilterByBoolMask(list=getParameterValueByName_5, mask=contains_2)
groupByKey_2 = List.GroupByKey(list=filterByBoolMask_6.in, keys=filterByBoolMask_7.in)

# group: calculating the parameter value
count = List.Count(list=groupByKey_2.groups@L2)
height_of_the_schedule = CodeBlock(schedRowHeight=schedule_row_height, countOfRows=count) { schedRowHeight*(countOfRows+1); }
parameter_value = CodeBlock(origin=schedule_origin_y_coord, height=height_of_the_schedule) { origin - height; }

# group: calculating the parameter value
count_2 = List.Count(list=groupByKey.groups@L2)
height_of_the_schedule_2 = CodeBlock(schedRowHeight=schedule_row_height, countOfRows=count_2) { schedRowHeight*(countOfRows+2); }
parameter_value_2 = CodeBlock(origin=schedule_origin_y_coord, height=height_of_the_schedule_2) { origin - height; }

# group: If no exterior Room
eq_4 = count == count_2
pyIF = Custom[pyIF](boolean=eq_4, ifTrue=parameter_value, ifFalse=parameter_value_2)  # package cata_lyst; proper IF made in python

# group: 2nd frame setter -exterior
flatten_3 = List.Flatten(list=titleBlock)
code_block_15 = CodeBlock { "totalsFrame2"; }
setParameterByName_5 = Element.SetParameterByName(element=flatten_3, parameterName=code_block_15, value=pyIF)

# group: get this to catalyst
py_get_sheet_by_name_2 = Python(IN[0]=groupByKey_2.uniqueKeys)  # IronPython2; same code as py_get_sheet_by_name

titleBlock_2 = Sheet.TitleBlock(sheet=py_get_sheet_by_name_2)

# group: 1st frame setter - interior
flatten_4 = List.Flatten(list=titleBlock_2)
code_block_16 = CodeBlock { "totalsFrame1"; }
setParameterByName_6 = Element.SetParameterByName(element=flatten_4, parameterName=code_block_16, value=parameter_value)

categories_4 = Categories("OST_Views")
all_elements_of_category_4 = ElementsOfCategory(Category=categories_4)
categories_5 = Categories("OST_Schedules")
all_elements_of_category_5 = ElementsOfCategory(Category=categories_5)
join = List.Join(list0=all_elements_of_category_4, list1=all_elements_of_category_5)

# group: Filter - just selected View Category
type_3 = Object.Type(object=join)
code_block_17 = CodeBlock(list=code_block, x=select_view_type_of_2nd_view) { list[x-1]; }
eq_5 = type_3 == code_block_17
filterByBoolMask_8 = List.FilterByBoolMask(list=join, mask=eq_5)

code_block_18 = CodeBlock { "View Name"; }
getParameterValueByName_6 = Element.GetParameterValueByName(element=filterByBoolMask_8.in, parameterName=code_block_18)
number_7 = DoubleInput(3)
getItemAtIndex_9 = List.GetItemAtIndex(list=transpose, index=number_7)
allIndicesOf_3 = List.AllIndicesOf(list=getParameterValueByName_6, item=getItemAtIndex_9)
flatten_5 = List.Flatten(list=allIndicesOf_3)
getItemAtIndex_10 = List.GetItemAtIndex(list=filterByBoolMask_8.in, index=flatten_5)
schedule_location_on_sheet = CodeBlock { Point.ByCoordinates(2193.85,845,0); }
ʳʰʸᵗʰᵐ_viewport_create = Rhythm.Revit.Elements.Viewport.Create(sheet=byNameNumberTitleBlockViewsAndLocations, view=getItemAtIndex_10, location=schedule_location_on_sheet)
manual = StringInput("""1 - FloorPlanView
2 - SectionView
3 - CeilingPlanView
4 - Legend
5 - AxonometricView
6 - AreaPlanView
7 - DraftingView""")
