# Dynamo graph sheetCreateAllinOneV5.dyn (Dynamo 2.12.1.8246)
# packages: Rhythm 2022.4.3, Clockwork for Dynamo 2.x 2.4.0, Modelical 2022.5.12, Genius Loci 2022.4.19, archi-lab.net 2023.213.1523, cata_lyst 0.0.1

manual = StringInput("""Vytvorí Sheety s číslami a názvami výkresov podľa excelovskej tabuľky.
Na každý Sheet pridá Floor Plan s názvom podľa 3. stĺpca.

V projekte nemôžu byť 2 rovnako nazvané Floor Plany ak jeden z nich chceme automaticky umiestňovať na Sheet.

Formát XLS súboru:
1. stĺpec - Sheet Number
2. stĺpec - Sheet Name
3. Stĺpec - View Name 1
4. Stĺpec - Legenda miestností 
5. Stĺpec - Izbovosť bytu
6. Stĺpec - schema poschodia
7. Stĺpec - Druh_priestoru
(nepovinné)""")  # graph input

# group: INPUT
file_path_for_excel_schedule = Filename("sheetcreate\sheetlist_Project1.txt")  # graph input
select_title_block = FamilyTypes("format_passportyBytovSample:B1")  # graph input
select_view_type_of_1st_view_1 = DoubleSlider(1, range=1..7 step 1)  # "Select View Type of 1st View 1 - FloorPlanView 2 - SectionView 3 - CeilingPlanView 4 - Legend 5 - AxonometricView 6 - AreaPlanView 7 - DraftingView"; graph input
select_view_type_of_3nd_view = DoubleSlider(1, range=1..8 step 1)  # "Select View Type of 3nd View (optional)"; graph input
select_view_type_of_2nd_view = DoubleSlider(8, range=1..8 step 1)  # "Select View Type of 2nd View (optional)"; graph input

fromPath = FileObject(path=file_path_for_excel_schedule)  # "File.FromPath"
readText = FileSystem.ReadText(file=fromPath)

# group: FIX it here
python_script = Python(IN[0]=readText)  # IronPython2
# ---------- python_script.python (16 lines) ----------
# Load the Python Standard and DesignScript Libraries
import sys
import clr
clr.AddReference('ProtoGeometry')
from Autodesk.DesignScript.Geometry import *

# The inputs to this node will be stored as a list in the IN variables.
text = IN[0]
structured = []
# Place your code below this line
t = text.split("\n")
for i in t:
	line = i.split("	")
	structured.append(line)
# Assign your output to the OUT variable.
OUT = structured
# ----------------------------------------

transpose = List.Transpose(lists=python_script)
number = DoubleInput(1)
getItemAtIndex = List.GetItemAtIndex(list=transpose, index=number)
watch = Watch(getItemAtIndex)
number_2 = DoubleInput(0)
getItemAtIndex_2 = List.GetItemAtIndex(list=transpose, index=number_2)
watch_2 = Watch(getItemAtIndex_2)

# group: INPUT
crop_box_offset = IntegerSlider(200, range=0..3000 step 50)  # graph input
appartment_parameter_name = StringInput("Occupancy")
view_template_name = StringInput("passportyMarketing")  # graph input

code_block = CodeBlock { "Rooms"; }
byName = Category.ByName(name=code_block)
all_elements_of_category = ElementsOfCategory(Category=byName)

# group: INPUT
views = Views("BYT")  # graph input
appartment_parameter_name_2 = StringInput("Occupancy")

code_block_2 = CodeBlock { "Rooms"; }
byName_2 = Category.ByName(name=code_block_2)
all_elements_of_category_2 = ElementsOfCategory(Category=byName_2)
getParameterValueByName = Element.GetParameterValueByName(element=all_elements_of_category_2, parameterName=appartment_parameter_name_2)
uniqueItems = List.UniqueItems(list=getParameterValueByName)
py_find_bytxxxx = Python(IN[0]=uniqueItems)  # IronPython2
# ---------- py_find_bytxxxx.python (18 lines) ----------
# Load the Python Standard and DesignScript Libraries
import sys
import clr
clr.AddReference('ProtoGeometry')
from Autodesk.DesignScript.Geometry import *

# The inputs to this node will be stored as a list in the IN variables.
strings = IN[0]
index = 3
filt_cut_strings = []

# Place your code below this line
for s in strings:
	if s:
	#if s[:index] == "BYT" or s[:index] == "APA" or s[:6] == "PRENAJ" :
		filt_cut_strings.append(s)
# Assign your output to the OUT variable.
OUT = filt_cut_strings
# ----------------------------------------
duplicateView = View.DuplicateView(view=views, suffix=py_find_bytxxxx)
code_block_3 = CodeBlock { "View Name"; }
setParameterByName = Element.SetParameterByName(element=duplicateView, parameterName=code_block_3, value=py_find_bytxxxx)
clearAllFilters = ScheduleView.ClearAllFilters(scheduleView=setParameterByName)
fields = ScheduleView.Fields(scheduleView=views)
string_from_object = FromObject(object=fields)
code_block_4 = CodeBlock { "Occupancy"; }
indexOf = List.IndexOf(list=string_from_object, element=code_block_4)
code_block_5 = CodeBlock(a=fields, b=indexOf) { a[b]; }
schedule_filter_type = ScheduleFilterType("Equal")
byFieldTypeAndValue = Revit.Schedules.ScheduleFilter.ByFieldTypeAndValue(field=code_block_5, filterType=schedule_filter_type, value=py_find_bytxxxx)
python_script_2 = Python(IN[0]=byFieldTypeAndValue)  # IronPython2
# ---------- python_script_2.python (15 lines) ----------
# Load the Python Standard and DesignScript Libraries
import sys
import clr
clr.AddReference('ProtoGeometry')
from Autodesk.DesignScript.Geometry import *

# The inputs to this node will be stored as a list in the IN variables.
dataEnteringNode = IN[0]

# Place your code below this line
output = []
for a in dataEnteringNode:
	output.append([a])
# Assign your output to the OUT variable.
OUT = output
# ----------------------------------------
addFilters = ScheduleView.AddFilters(scheduleView=clearAllFilters, scheduleFilters=python_script_2)
passthrough = Custom[Passthrough](passThrough=appartment_parameter_name, waitFor=addFilters)  # package Clockwork for Dynamo 2.x; Forces a sequential order of execution. The node wired into the output of the Passthrough node will be executed *after* the node wired into the waitFor input (e.g. important for some Revit operations). The value of the passThrough input will be passed on to the node wired into the output port of the Passthrough node.

# group: filtering out just rooms from appartments
getParameterValueByName_2 = Element.GetParameterValueByName(element=all_elements_of_category, parameterName=passthrough)
level = Custom[Element.Level](element=all_elements_of_category)  # package Clockwork for Dynamo 2.x; Gets an element's level
py_find_and_cut_bytxxxx = Python(IN[0]=getParameterValueByName_2, IN[1]=level, IN[2]=all_elements_of_category)  # IronPython2
# ---------- py_find_and_cut_bytxxxx.python (31 lines) ----------
# Load the Python Standard and DesignScript Libraries
import sys
import clr
clr.AddReference('ProtoGeometry')
from Autodesk.DesignScript.Geometry import *

# The inputs to this node will be stored as a list in the IN variables.
occ_vals = IN[0] # occupancy values
levels = IN[1]
rooms = IN[2]
index = 3 # for cutting occupancy values
filt_rooms = [] # all rooms in an appartment
filt_occ_vals = [] #occupancy values of first room in an appartment - unique values
filt_levels = [] # just levels with rooms belonging to an appartment
app_occ_vals = [] # occypancy values of rooms in appartments

# Place your code below this line
count = 0
for value in occ_vals:
	#if value[:3] == "BYT":
	if value:
	#if value[:3] == "BYT" or value[:8] == "PRENAJÍM" or value[:6] == "APARTM":
		#cut_value = value[index:]
		if value not in filt_occ_vals:
			filt_occ_vals.append(value)
			filt_levels.append(levels[count])
		filt_rooms.append(rooms[count]) # all rooms in appartments
		app_occ_vals.append(value) # occupancy values of all rooms in appartments
	count += 1
# Assign your output to the OUT variable.
OUT = [filt_occ_vals, filt_levels, filt_rooms, app_occ_vals]
# ----------------------------------------
code_block_6 = CodeBlock(a=py_find_and_cut_bytxxxx)
# ---------- code_block_6.designscript (8 lines) ----------
//occupancy values;
a[0];
//levels
a[1];
//rooms in apparmtents;
a[2];
//occupancy vals of rooms in apparmtents;
a[3];
# ----------------------------------------

# group: group appartment number by Level
groupByKey = List.GroupByKey(list=code_block_6.out0, keys=code_block_6.out1)

# group: cannot sortByKey by Level - bug
string_from_object_2 = FromObject(object=groupByKey.uniqueKeys)
list_sortbykey_levels = List.SortByKey(list=groupByKey.uniqueKeys, keys=string_from_object_2)
list_sortbykey_appartments = List.SortByKey(list=groupByKey.groups, keys=string_from_object_2)

# group: creating and renaming Floorplans for each Level
byLevel = FloorPlanView.ByLevel(level=list_sortbykey_levels.sortedList)
code_block_7 = CodeBlock { "View Name"; }
name = Level.Name(level=list_sortbykey_levels.sortedList)
code_block_8 = CodeBlock(a=name) { a+ " MAR"; }
setParameterByName_2 = Element.SetParameterByName(element=byLevel, parameterName=code_block_7, value=code_block_8)

applyViewTemplate = Custom[View.ApplyViewTemplate](views=setParameterByName_2, tempName=view_template_name)  # package Modelical; This node applies a view template (selected by name) to the selected view.
code_block_9 = CodeBlock { "AsDependent"; }
space_before_suffix = CodeBlock(a=list_sortbykey_appartments.sortedList) { " "+a; }

# group: creating depending views for each appartment
duplicateView_2 = View.DuplicateView(view=applyViewTemplate.views@L2, viewDuplicateOption=code_block_9, suffix=space_before_suffix)

flatten = List.Flatten(list=duplicateView_2)

# group: group rooms by appartment
groupByKey_2 = List.GroupByKey(list=code_block_6.out2, keys=code_block_6.out3)

sortByKey = List.SortByKey(list=groupByKey_2.groups, keys=groupByKey_2.uniqueKeys)
indexOf_2 = List.IndexOf(list=sortByKey.sortedKeys, element=list_sortbykey_appartments.sortedList)
getItemAtIndex_3 = List.GetItemAtIndex(list=sortByKey.sortedList, index=indexOf_2@L1)
boundingbox_byunion = Custom[BoundingBox ByUnion](element=getItemAtIndex_3@L2)  # package Genius Loci; Creates a single bounding box for one or more elements and returns a solid. The optional input Rotation allows to be not aligned with the axis. By Vsevolod Chugreev
byGeometry = BoundingBox.ByGeometry(geom=boundingbox_byunion@L1)

# group: setting crop box
setCropBox = archilab.Revit.Views.Views.SetCropBox(view=flatten, boundingBox=byGeometry)
resizeCropBox = Custom[View.ResizeCropBox](amt=crop_box_offset, view=setCropBox)  # package Clockwork for Dynamo 2.x; Resizes the bounding box of a given Revit element by the specified amount in X, Y and Z direction. May need to be used in conjunction with a Transaction node.
code_block_10 = CodeBlock { false; }
cropBoxVisible = archilab.Revit.Views.Views.CropBoxVisible(view=resizeCropBox.view, visible=code_block_10)  # frozen

passthrough_2 = Custom[Passthrough](passThrough=select_title_block, waitFor=resizeCropBox.view)
categories = Categories("OST_Views")
all_elements_of_category_3 = ElementsOfCategory(Category=categories)

# group: list of View Categories
code_block_11 = CodeBlock()
# ---------- code_block_11.designscript (8 lines) ----------
["Revit.Elements.Views.FloorPlanView",
"Revit.Elements.Views.SectionView",
"Revit.Elements.Views.CeilingPlanView",
"Revit.Elements.Views.Legend",
"Revit.Elements.Views.AxonometricView",
"Revit.Elements.Views.AreaPlanView",
"Revit.Elements.Views.DraftingView",
"Revit.Elements.Views.ScheduleView"];
# ----------------------------------------

# group: Filter - just selected View Category
type = Object.Type(object=all_elements_of_category_3)
code_block_12 = CodeBlock(list=code_block_11, x=select_view_type_of_1st_view_1) { list[x-1]; }
eq = type == code_block_12
filterByBoolMask = List.FilterByBoolMask(list=all_elements_of_category_3, mask=eq)

code_block_13 = CodeBlock { "View Name"; }
getParameterValueByName_3 = Element.GetParameterValueByName(element=filterByBoolMask.in, parameterName=code_block_13)
number_3 = DoubleInput(2)
getItemAtIndex_4 = List.GetItemAtIndex(list=transpose, index=number_3)
watch_3 = Watch(getItemAtIndex_4)

# group: removing nulls
code_block_14 = CodeBlock { 0; }
string_from_object_3 = FromObject(obj=watch_3)
code_block_15 = CodeBlock { "null"; }
allIndicesOf = List.AllIndicesOf(list=string_from_object_3, item=code_block_15)
firstItem = List.FirstItem(list=allIndicesOf)
slice = List.Slice(list=watch_3, start=code_block_14, end=firstItem)

allIndicesOf_2 = List.AllIndicesOf(list=getParameterValueByName_3, item=slice)
flatten_2 = List.Flatten(list=allIndicesOf_2)
getItemAtIndex_5 = List.GetItemAtIndex(list=filterByBoolMask.in, index=flatten_2)
categories_2 = Categories("OST_Views")
all_elements_of_category_4 = ElementsOfCategory(Category=categories_2)

# group: Filter - just selected View Category
type_2 = Object.Type(object=all_elements_of_category_4)
code_block_16 = CodeBlock(list=code_block_11, x=select_view_type_of_3nd_view) { list[x-1]; }
eq_2 = type_2 == code_block_16
filterByBoolMask_2 = List.FilterByBoolMask(list=all_elements_of_category_4, mask=eq_2)

code_block_17 = CodeBlock { "View Name"; }
getParameterValueByName_4 = Element.GetParameterValueByName(element=filterByBoolMask_2.in, parameterName=code_block_17)
number_4 = DoubleInput(5)
getItemAtIndex_6 = List.GetItemAtIndex(list=transpose, index=number_4)
watch_4 = Watch(getItemAtIndex_6)

# group: removing nulls
code_block_18 = CodeBlock { 0; }
string_from_object_4 = FromObject(object=watch_4)
code_block_19 = CodeBlock { "null"; }
allIndicesOf_3 = List.AllIndicesOf(list=string_from_object_4, item=code_block_19)
firstItem_2 = List.FirstItem(list=allIndicesOf_3)
slice_2 = List.Slice(list=watch_4, start=code_block_18, end=firstItem_2)

allIndicesOf_4 = List.AllIndicesOf(list=getParameterValueByName_4, item=slice_2)
flatten_3 = List.Flatten(list=allIndicesOf_4)
getItemAtIndex_7 = List.GetItemAtIndex(list=filterByBoolMask_2.in, index=flatten_3)

# group: possible list create with 2nd views
list_create = List.Create(item0=getItemAtIndex_5, item1=getItemAtIndex_7)

transpose_2 = List.Transpose(lists=list_create)
C3 = CodeBlock()
# ---------- C3.designscript (4 lines) ----------
[
Point.ByCoordinates(2072,776,0),
Point.ByCoordinates(2170,830,0)
];
# ----------------------------------------
byNameNumberTitleBlockViewsAndLocations = Sheet.ByNameNumberTitleBlockViewsAndLocations(sheetName=watch, sheetNumber=watch_2, titleBlockFamilyType=passthrough_2, views=transpose_2, locations=C3)
count = List.Count(list=byNameNumberTitleBlockViewsAndLocations)
code_block_20 = CodeBlock(count=count) { "Bolo vytvorenych " + count + " Sheetov."; }
status = Watch(code_block_20)  # graph output
manual_2 = StringInput("""1 - FloorPlanView
2 - SectionView
3 - CeilingPlanView
4 - Legend
5 - AxonometricView
6 - AreaPlanView
7 - DraftingView""")
number_5 = DoubleInput(3)
getItemAtIndex_8 = List.GetItemAtIndex(list=transpose, index=number_5)
watch_5 = Watch(getItemAtIndex_8)

# group: FIX THIS
adhoc_return_remover = Python(IN[0]=watch_5)  # IronPython2
# ---------- adhoc_return_remover.python (17 lines) ----------
# Load the Python Standard and DesignScript Libraries
import sys
import clr
clr.AddReference('ProtoGeometry')
from Autodesk.DesignScript.Geometry import *

# The inputs to this node will be stored as a list in the IN variables.
data = IN[0]
output = []
# Place your code below this line
for i in data:
	try:
		output.append(i[:-1])
	except:
		pass
# Assign your output to the OUT variable.
OUT = output
# ----------------------------------------

categories_3 = Categories("OST_Views")
all_elements_of_category_5 = ElementsOfCategory(Category=categories_3)
categories_4 = Categories("OST_Schedules")
all_elements_of_category_6 = ElementsOfCategory(Category=categories_4)
join = List.Join(list0=all_elements_of_category_5, list1=all_elements_of_category_6)

# group: Filter - just selected View Category
type_3 = Object.Type(object=join)
code_block_21 = CodeBlock(list=code_block_11, x=select_view_type_of_2nd_view) { list[x-1]; }
eq_3 = type_3 == code_block_21
filterByBoolMask_3 = List.FilterByBoolMask(list=join, mask=eq_3)

code_block_22 = CodeBlock { "View Name"; }
getParameterValueByName_5 = Element.GetParameterValueByName(element=filterByBoolMask_3.in, parameterName=code_block_22)

# group: removing nulls
code_block_23 = CodeBlock { 0; }
string_from_object_5 = FromObject(obj=watch_5)
code_block_24 = CodeBlock { "null"; }
allIndicesOf_5 = List.AllIndicesOf(list=string_from_object_5, item=code_block_24)
firstItem_3 = List.FirstItem(list=allIndicesOf_5)
slice_3 = List.Slice(list=watch_5, start=code_block_23, end=firstItem_3)

allIndicesOf_6 = List.AllIndicesOf(list=getParameterValueByName_5, item=slice_3)
flatten_4 = List.Flatten(list=allIndicesOf_6)
getItemAtIndex_9 = List.GetItemAtIndex(list=filterByBoolMask_3.in, index=flatten_4)
schedule_location_on_sheet = CodeBlock { Point.ByCoordinates(2193.85,845,0); }
ʳʰʸᵗʰᵐ_viewport_create = Rhythm.Revit.Elements.Viewport.Create(sheet=byNameNumberTitleBlockViewsAndLocations, view=getItemAtIndex_9, location=schedule_location_on_sheet)
adhoc_return_remover_2 = Python(IN[0]=watch_3)  # IronPython2; same code as adhoc_return_remover
number_6 = DoubleInput(4)
getItemAtIndex_10 = List.GetItemAtIndex(list=transpose, index=number_6)
watch_6 = Watch(getItemAtIndex_10)

# group: FIX THIS
adhoc_return_remover_3 = Python(IN[0]=watch_6)  # IronPython2; same code as adhoc_return_remover

sheets = Watch(byNameNumberTitleBlockViewsAndLocations)  # graph output

# group: FIX THIS
adhoc_return_remover_4 = Python(IN[0]=watch_4)  # IronPython2; same code as adhoc_return_remover

number_7 = DoubleInput(6)
getItemAtIndex_11 = List.GetItemAtIndex(list=transpose, index=number_7)
watch_7 = Watch(getItemAtIndex_11)

# group: FIX THIS
adhoc_return_remover_5 = Python(IN[0]=watch_7)  # IronPython2; same code as adhoc_return_remover

# group: Sheet parameters setter
code_block_25 = CodeBlock { "Izbovost"; }
setParameterByName_3 = Element.SetParameterByName(element=sheets, parameterName=code_block_25, value=watch_6)
code_block_26 = CodeBlock { "Druh_priestoru"; }
setParameterByName_4 = Element.SetParameterByName(element=sheets, parameterName=code_block_26, value=adhoc_return_remover_5)
code_block_27 = CodeBlock { "Delenie I"; "MAR sheet script"; }
setParameterByName_5 = Element.SetParameterByName(element=sheets, parameterName=code_block_27.out0, value=code_block_27.out1)
code_block_28 = CodeBlock { "Poschodie"; }
py_poschodie_getter = Python(IN[0]=getItemAtIndex)  # IronPython2
# ---------- py_poschodie_getter.python (15 lines) ----------
# Load the Python Standard and DesignScript Libraries
import sys
import clr
clr.AddReference('ProtoGeometry')
from Autodesk.DesignScript.Geometry import *

# The inputs to this node will be stored as a list in the IN variables.
data = IN[0]
split_strings = []
# Place your code below this line
for i in data:
	split_string = i.split(".")
	split_strings.append(split_string[-2])
# Assign your output to the OUT variable.
OUT = split_strings
# ----------------------------------------
setParameterByName_6 = Element.SetParameterByName(element=sheets, parameterName=code_block_28, value=py_poschodie_getter)

C3_2 = CodeBlock()
# ---------- C3_2.designscript (4 lines) ----------
[
Point.ByCoordinates(2084,776,0),
Point.ByCoordinates(2170,856,0)
];
# ----------------------------------------
code_block_29 = CodeBlock { "APARTMÁN "; }
code_block_30 = CodeBlock { "PRENAJ"; }
categories_5 = Categories("OST_Rooms")
all_elements_of_category_7 = ElementsOfCategory(Category=categories_5)
passthrough_3 = Custom[Passthrough](passThrough=all_elements_of_category_7, waitFor=setParameterByName_6)

# group: Interier/Exterier
code_block_31 = CodeBlock { "Department"; }
getParameterValueByName_6 = Element.GetParameterValueByName(element=passthrough_3, parameterName=code_block_31)
code_block_32 = CodeBlock { "Interior"; }
eq_4 = getParameterValueByName_6 == code_block_32
filterByBoolMask_4 = List.FilterByBoolMask(list=passthrough_3, mask=eq_4)

code_block_33 = CodeBlock { "Occupancy"; }
getParameterValueByName_7 = Element.GetParameterValueByName(element=filterByBoolMask_4.in, parameterName=code_block_33)

# group: INPUT
code_block_34 = CodeBlock { "."; }

startsWith = String.StartsWith(string=getParameterValueByName_7, searchFor=code_block_34)  # frozen
code_block_35 = CodeBlock { "Occupancy"; }
getParameterValueByName_8 = Element.GetParameterValueByName(element=passthrough_3, parameterName=code_block_35)
startsWith_2 = String.StartsWith(string=getParameterValueByName_8)  # frozen; unwired: searchFor
contains = String.Contains(string=getParameterValueByName_8, searchFor=code_block_34)
filterByBoolMask_5 = List.FilterByBoolMask(list=passthrough_3, mask=contains)
filterByBoolMask_6 = List.FilterByBoolMask(list=getParameterValueByName_8, mask=contains)
groupByKey_3 = List.GroupByKey(list=filterByBoolMask_5.in, keys=filterByBoolMask_6.in)

# group: get this to catalyst
py_get_sheet_by_name = Python(IN[0]=groupByKey_3.uniqueKeys)  # IronPython2
# ---------- py_get_sheet_by_name.python (23 lines) ----------
import clr
clr.AddReference('RevitServices')
import RevitServices
from RevitServices.Persistence import DocumentManager
clr.AddReference('RevitAPI')
import Autodesk
from Autodesk.Revit.DB import Document, RevitLinkInstance, FilteredElementCollector, ViewSheet

sh_names = IN[0]

doc = DocumentManager.Instance.CurrentDBDocument

collector = FilteredElementCollector(doc).OfClass(Autodesk.Revit.DB.ViewSheet)

# sheets=[s for s in collector for namnum in namnums if namnum in s.SheetNumber or namnum in s.Name]
sheets = []
for sh_name in sh_names:
	for sheet in collector:
		if sheet.Name == sh_name:
			sheets.append(sheet)

if len(sheets)>1 : OUT = sheets
else: OUT = sheets[0]
# ----------------------------------------

titleBlock = Sheet.TitleBlock(sheet=py_get_sheet_by_name)
contains_2 = String.Contains(string=getParameterValueByName_7, searchFor=code_block_34)
filterByBoolMask_7 = List.FilterByBoolMask(list=filterByBoolMask_4.in, mask=contains_2)
filterByBoolMask_8 = List.FilterByBoolMask(list=getParameterValueByName_7, mask=contains_2)
groupByKey_4 = List.GroupByKey(list=filterByBoolMask_7.in, keys=filterByBoolMask_8.in)
schedule_origin_y_coord = CodeBlock { 169.102; }
schedule_row_height = CodeBlock { 4.4588; }

# group: calculating the parameter value
count_2 = List.Count(list=groupByKey_4.groups@L2)
height_of_the_schedule = CodeBlock(schedRowHeight=schedule_row_height, countOfRows=count_2) { schedRowHeight*(countOfRows+1); }
parameter_value = CodeBlock(origin=schedule_origin_y_coord, height=height_of_the_schedule) { origin - height; }

# group: calculating the parameter value
count_3 = List.Count(list=groupByKey_3.groups@L2)
height_of_the_schedule_2 = CodeBlock(schedRowHeight=schedule_row_height, countOfRows=count_3) { schedRowHeight*(countOfRows+2); }
parameter_value_2 = CodeBlock(origin=schedule_origin_y_coord, height=height_of_the_schedule_2) { origin - height; }

# group: If no exterior Room
eq_5 = count_2 == count_3
pyIF = Custom[pyIF](boolean=eq_5, ifTrue=parameter_value, ifFalse=parameter_value_2)  # package cata_lyst; proper IF made in python

# group: 2nd frame setter -exterior
flatten_5 = List.Flatten(list=titleBlock)
code_block_36 = CodeBlock { "totalsFrame2"; }
setParameterByName_7 = Element.SetParameterByName(element=flatten_5, parameterName=code_block_36, value=pyIF)

# group: get this to catalyst
py_get_sheet_by_name_2 = Python(IN[0]=groupByKey_4.uniqueKeys)  # IronPython2; same code as py_get_sheet_by_name

titleBlock_2 = Sheet.TitleBlock(sheet=py_get_sheet_by_name_2)

# group: 1st frame setter - interior
flatten_6 = List.Flatten(list=titleBlock_2)
code_block_37 = CodeBlock { "totalsFrame1"; }
setParameterByName_8 = Element.SetParameterByName(element=flatten_6, parameterName=code_block_37, value=parameter_value)

návod = StringInput("Skopíruje vzorovú tabuľku s filtrami podľa bytov - hodnota v paremtri zacinajuca BYT xxx")  # graph input
list_create_2 = List.Create(item0=byFieldTypeAndValue)
návod_2 = StringInput("""Vytvori seriu Floorplanov pre kazdy Level na ktorom je umiestneny byt. Pre kazdy byt spravi Dependent View tohto floorplanu, ktoreho nazov zmeni podla nazvu bytu v parametri occupancy - hodnota v parametri zacinajuca BYT xxx
vsetkym novovytvorenym floorplanom aplikuje template a nakoniec ich oreze podla boundingboxu vsetkych miestnosti s offsetom""")  # graph input
