# Dynamo graph SheetFrameSetter.dyn (Dynamo 2.12.1.8246)

categories = Categories("OST_Rooms")
all_elements_of_category = ElementsOfCategory(Category=categories)

# group: Interier/Exterier
code_block = CodeBlock { "Department"; }
getParameterValueByName = Element.GetParameterValueByName(element=all_elements_of_category, parameterName=code_block)
code_block_2 = CodeBlock { "Interior"; }
eq = getParameterValueByName == code_block_2
filterByBoolMask = List.FilterByBoolMask(list=all_elements_of_category, mask=eq)

code_block_3 = CodeBlock { "Occupancy"; }
getParameterValueByName_2 = Element.GetParameterValueByName(element=filterByBoolMask.in, parameterName=code_block_3)

# group: INPUT
code_block_4 = CodeBlock { "."; }

startsWith = String.StartsWith(string=getParameterValueByName_2, searchFor=code_block_4)  # frozen
code_block_5 = CodeBlock { "Occupancy"; }
getParameterValueByName_3 = Element.GetParameterValueByName(element=all_elements_of_category, parameterName=code_block_5)
startsWith_2 = String.StartsWith(string=getParameterValueByName_3)  # frozen; unwired: searchFor
contains = String.Contains(string=getParameterValueByName_2, searchFor=code_block_4)
filterByBoolMask_2 = List.FilterByBoolMask(list=filterByBoolMask.in, mask=contains)
filterByBoolMask_3 = List.FilterByBoolMask(list=getParameterValueByName_2, mask=contains)
groupByKey = List.GroupByKey(list=filterByBoolMask_2.in, keys=filterByBoolMask_3.in)

# group: get this to catalyst
py_get_sheet_by_name = Python(IN[0]=groupByKey.uniqueKeys)  # IronPython2
# ---------- py_get_sheet_by_name.python (23 lines) ----------
import clr
clr.AddReference('RevitServices')
import RevitServices
from RevitServices.Persistence import DocumentManager
clr.AddReference('RevitAPI')
import Autodesk
from Autodesk.Revit.DB import Document, RevitLinkInstance, FilteredElementCollector, ViewSheet

sh_names = IN[0]

doc = DocumentManager.Instance.CurrentDBDocument

collector = FilteredElementCollector(doc).OfClass(Autodesk.Revit.DB.ViewSheet)

# sheets=[s for s in collector for namnum in namnums if namnum in s.SheetNumber or namnum in s.Name]
sheets = []
for sh_name in sh_names:
	for sheet in collector:
		if sheet.Name == sh_name:
			sheets.append(sheet)

if len(sheets)>1 : OUT = sheets
else: OUT = sheets[0]
# ----------------------------------------

titleBlock = Sheet.TitleBlock(sheet=py_get_sheet_by_name)
schedule_origin_y_coord = CodeBlock { 169.102; }
schedule_row_height = CodeBlock { 4.4588; }

# group: calculating the parameter value
count = List.Count(list=groupByKey.groups@L2)
height_of_the_schedule = CodeBlock(schedRowHeight=schedule_row_height, countOfRows=count) { schedRowHeight*(countOfRows+1); }
parameter_value = CodeBlock(origin=schedule_origin_y_coord, height=height_of_the_schedule) { origin - height; }

# group: 1st frame setter - interior
flatten = List.Flatten(list=titleBlock)
code_block_6 = CodeBlock { "totalsFrame1"; }
setParameterByName = Element.SetParameterByName(element=flatten, parameterName=code_block_6, value=parameter_value)

contains_2 = String.Contains(string=getParameterValueByName_3, searchFor=code_block_4)
filterByBoolMask_4 = List.FilterByBoolMask(list=all_elements_of_category, mask=contains_2)
filterByBoolMask_5 = List.FilterByBoolMask(list=getParameterValueByName_3, mask=contains_2)
groupByKey_2 = List.GroupByKey(list=filterByBoolMask_4.in, keys=filterByBoolMask_5.in)

# group: get this to catalyst
py_get_sheet_by_name_2 = Python(IN[0]=groupByKey_2.uniqueKeys)  # IronPython2; same code as py_get_sheet_by_name

titleBlock_2 = Sheet.TitleBlock(sheet=py_get_sheet_by_name_2)

# group: calculating the parameter value
count_2 = List.Count(list=groupByKey_2.groups@L2)
height_of_the_schedule_2 = CodeBlock(schedRowHeight=schedule_row_height, countOfRows=count_2) { schedRowHeight*(countOfRows+2); }
parameter_value_2 = CodeBlock(origin=schedule_origin_y_coord, height=height_of_the_schedule_2) { origin - height; }

# group: 2nd frame setter -exterior
flatten_2 = List.Flatten(list=titleBlock_2)
code_block_7 = CodeBlock { "totalsFrame2"; }
setParameterByName_2 = Element.SetParameterByName(element=flatten_2, parameterName=code_block_7, value=parameter_value_2)

code_block_8 = CodeBlock { "APARTMÁN "; }
code_block_9 = CodeBlock { "PRENAJ"; }
