# Dynamo graph pbi_schedules_RSN.dyn (Dynamo 2.3.0.5885)

element_types = ElementTypes("ViewSchedule")
all_elements_of_type = ElementsOfType(element_type=element_types)
code_block = CodeBlock { "U:\\1801_Klingerka II\\06_PSP\\03_Projekt\\10_PBI"; }

# group: INPUT
view_name_starts_with = StringInput("PBI skladby")  # graph input
code_block_2 = CodeBlock(path=code_block) { path+"\\skladby\\data"; }

# group: FILTER
code_block_3 = CodeBlock { "View Name"; }
getParameterValueByName = Element.GetParameterValueByName(element=all_elements_of_type, parameterName=code_block_3)
startsWith = String.StartsWith(str=getParameterValueByName, searchFor=view_name_starts_with)
filterByBoolMask = List.FilterByBoolMask(list=all_elements_of_type, mask=startsWith)

name = Element.Name(element=filterByBoolMask.in)
code_block_4 = CodeBlock(FileName=name) { FileName + ".txt"; }
python_script = Python(IN[0]=filterByBoolMask.in, IN[1]=code_block_2, IN[2]=code_block_4)
# ---------- python_script.python (18 lines) ----------
import clr
clr.AddReference("RevitAPI")
from Autodesk.Revit.DB import *

schedule_list = IN[0]
path = IN[1]
filename_list = IN[2]
result_list = []

for index, sched in enumerate(schedule_list):
	schedule = UnwrapElement(sched)
	filename = filename_list[index]
	try:
		export_options = ViewScheduleExportOptions()
		schedule.Export(path, filename, export_options)
		result_list.append("Schedule Exported ")
	except: result_list.append("Failure ")
OUT = result_list
# ----------------------------------------
status = Watch(python_script)
návod = StringInput("Vyexportuje vsetky tabulky zacinajuce danym retazcom do samostatnych txt suborov do urceneho folderu.")  # graph input
py_log = Python()  # unwired: IN[0]
# ---------- py_log.python (37 lines) ----------
# Load the Python Standard and DesignScript Libraries
import sys
import clr
clr.AddReference('ProtoGeometry')
from Autodesk.DesignScript.Geometry import *
clr.AddReference("RevitServices")
import RevitServices
from RevitServices.Persistence import DocumentManager

from datetime import datetime
import getpass

# name of the script for log
log_string = "skladbySchedules_RSN"

doc = DocumentManager.Instance.CurrentDBDocument
filePath = doc.PathName

# getting file name from path
lastBackslash = filePath.rindex("\\")+1
file_name = filePath[lastBackslash:]
user_name = getpass.getuser()
datestamp = str(datetime.now())
# tabulator between data to easy import to excel schedule
separator = "\t"
line = datestamp + separator + log_string + separator + user_name + "\n"

try:
	f = open("L:\\customToolslogs\\dynLogs\\" + file_name +".log", "a")
	f.write(line)
	f.close()
	status = "log has been written"
except:
	status = "something went wrong"

# Assign your output to the OUT variable.
OUT = status
# ----------------------------------------
element_types_2 = ElementTypes("ViewSchedule")
all_elements_of_type_2 = ElementsOfType(element_type=element_types_2)

# group: INPUT
view_name_starts_with_2 = StringInput("PBI_vykaz miestnosti")  # graph input
code_block_5 = CodeBlock(path=code_block) { path+"\\Rooms\\data"; }

# group: FILTER
code_block_6 = CodeBlock { "View Name"; }
getParameterValueByName_2 = Element.GetParameterValueByName(element=all_elements_of_type_2, parameterName=code_block_6)
startsWith_2 = String.StartsWith(str=getParameterValueByName_2, searchFor=view_name_starts_with_2)
filterByBoolMask_2 = List.FilterByBoolMask(list=all_elements_of_type_2, mask=startsWith_2)

name_2 = Element.Name(element=filterByBoolMask_2.in)
code_block_7 = CodeBlock(FileName=name_2) { FileName + ".txt"; }
python_script_2 = Python(IN[0]=filterByBoolMask_2.in, IN[1]=code_block_5, IN[2]=code_block_7)  # same code as python_script
status_2 = Watch(python_script_2)

# group: INPUT
path = StringInput("U:\1801_Klingerka II\06_PSP\03_Projekt\10_PBI\parking\parkovacieMiesta\data")
view_name_starts_with_3 = StringInput("PBI_Výkaz parkovacích miest")  # graph input
code_block_8 = CodeBlock(path=code_block) { path+"\\parking\\parkovacieMiesta\\data"; }

element_types_3 = ElementTypes("ViewSchedule")
all_elements_of_type_3 = ElementsOfType(element_type=element_types_3)

# group: FILTER
code_block_9 = CodeBlock { "View Name"; }
getParameterValueByName_3 = Element.GetParameterValueByName(element=all_elements_of_type_3, parameterName=code_block_9)
startsWith_3 = String.StartsWith(str=getParameterValueByName_3, searchFor=view_name_starts_with_3)
filterByBoolMask_3 = List.FilterByBoolMask(list=all_elements_of_type_3, mask=startsWith_3)

name_3 = Element.Name(element=filterByBoolMask_3.in)
code_block_10 = CodeBlock(FileName=name_3) { FileName + ".txt"; }
python_script_3 = Python(IN[0]=filterByBoolMask_3.in, IN[1]=code_block_8, IN[2]=code_block_10)  # same code as python_script
status_3 = Watch(python_script_3)
