# Dynamo graph CreateViewsByAppartments_p.dyn (Dynamo 2.12.1.8246)
# packages: cata_lyst 0.0.1, Modelical 2022.5.12, Clockwork for Dynamo 2.x 2.4.0, Genius Loci 2022.4.19, archi-lab.net 2023.213.1523

návod = StringInput("""Vytvori seriu Floorplanov pre kazdy Level na ktorom je umiestneny byt. Pre kazdy byt spravi Dependent View tohto floorplanu, ktoreho nazov zmeni podla nazvu bytu v parametri occupancy - hodnota v parametri zacinajuca BYT xxx
vsetkym novovytvorenym floorplanom aplikuje template a nakoniec ich oreze podla boundingboxu vsetkych miestnosti s offsetom""")  # graph input
code_block = CodeBlock { "DuplicateViewsByAppartment"; }
usageLog = Custom[usageLog](scriptName=code_block)  # package cata_lyst; node logs every run of the script in which is used to the hardcoded server location

# group: INPUT
crop_box_offset = IntegerSlider(200, range=0..3000 step 50)  # graph input
appartment_parameter_name = StringInput("Occupancy")
view_template_name = StringInput("passportyMarketing")  # graph input

code_block_2 = CodeBlock { "Rooms"; }
byName = Category.ByName(name=code_block_2)
all_elements_of_category = ElementsOfCategory(Category=byName)

# group: filtering out just rooms from appartments
getParameterValueByName = Element.GetParameterValueByName(element=all_elements_of_category, parameterName=appartment_parameter_name)
level = Custom[Element.Level](element=all_elements_of_category)  # package Clockwork for Dynamo 2.x; Gets an element's level
py_find_and_cut_bytxxxx = Python(IN[0]=getParameterValueByName, IN[1]=level, IN[2]=all_elements_of_category)  # IronPython2
# ---------- py_find_and_cut_bytxxxx.python (30 lines) ----------
# Load the Python Standard and DesignScript Libraries
import sys
import clr
clr.AddReference('ProtoGeometry')
from Autodesk.DesignScript.Geometry import *

# The inputs to this node will be stored as a list in the IN variables.
occ_vals = IN[0] # occupancy values
levels = IN[1]
rooms = IN[2]
index = 3 # for cutting occupancy values
filt_rooms = [] # all rooms in an appartment
filt_occ_vals = [] #occupancy values of first room in an appartment - unique values
filt_levels = [] # just levels with rooms belonging to an appartment
app_occ_vals = [] # occypancy values of rooms in appartments

# Place your code below this line
count = 0
for value in occ_vals:
	#if value[:3] == "BYT":
	if value[:3] == "BYT" or value[:8] == "PRENAJÍM" or value[:6] == "APARTM":
		#cut_value = value[index:]
		if value not in filt_occ_vals:
			filt_occ_vals.append(value)
			filt_levels.append(levels[count])
		filt_rooms.append(rooms[count]) # all rooms in appartments
		app_occ_vals.append(value) # occupancy values of all rooms in appartments
	count += 1
# Assign your output to the OUT variable.
OUT = [filt_occ_vals, filt_levels, filt_rooms, app_occ_vals]
# ----------------------------------------
code_block_3 = CodeBlock(a=py_find_and_cut_bytxxxx)
# ---------- code_block_3.designscript (8 lines) ----------
//occupancy values;
a[0];
//levels
a[1];
//rooms in apparmtents;
a[2];
//occupancy vals of rooms in apparmtents;
a[3];
# ----------------------------------------

# group: group appartment number by Level
groupByKey = List.GroupByKey(list=code_block_3.out0, keys=code_block_3.out1)

# group: cannot sortByKey by Level - bug
string_from_object = FromObject(object=groupByKey.uniqueKeys)
list_sortbykey_levels = List.SortByKey(list=groupByKey.uniqueKeys, keys=string_from_object)
list_sortbykey_appartments = List.SortByKey(list=groupByKey.groups, keys=string_from_object)

# group: creating and renaming Floorplans for each Level
byLevel = FloorPlanView.ByLevel(level=list_sortbykey_levels.sortedList)
code_block_4 = CodeBlock { "View Name"; }
name = Level.Name(level=list_sortbykey_levels.sortedList)
code_block_5 = CodeBlock(a=name) { a+ " MAR"; }
setParameterByName = Element.SetParameterByName(element=byLevel, parameterName=code_block_4, value=code_block_5)

applyViewTemplate = Custom[View.ApplyViewTemplate](views=setParameterByName, tempName=view_template_name)  # package Modelical; This node applies a view template (selected by name) to the selected view.
code_block_6 = CodeBlock { "AsDependent"; }
space_before_suffix = CodeBlock(a=list_sortbykey_appartments.sortedList) { " "+a; }

# group: creating depending views for each appartment
duplicateView = View.DuplicateView(view=applyViewTemplate.views@L2, viewDuplicateOption=code_block_6, suffix=space_before_suffix)

flatten = List.Flatten(list=duplicateView)

# group: group rooms by appartment
groupByKey_2 = List.GroupByKey(list=code_block_3.out2, keys=code_block_3.out3)

sortByKey = List.SortByKey(list=groupByKey_2.groups, keys=groupByKey_2.uniqueKeys)
indexOf = List.IndexOf(list=sortByKey.sortedKeys, element=list_sortbykey_appartments.sortedList)
getItemAtIndex = List.GetItemAtIndex(list=sortByKey.sortedList, index=indexOf@L1)
boundingbox_byunion = Custom[BoundingBox ByUnion](element=getItemAtIndex@L2)  # package Genius Loci; Creates a single bounding box for one or more elements and returns a solid. The optional input Rotation allows to be not aligned with the axis. By Vsevolod Chugreev
byGeometry = BoundingBox.ByGeometry(geom=boundingbox_byunion@L1)

# group: setting crop box
setCropBox = archilab.Revit.Views.Views.SetCropBox(view=flatten, boundingBox=byGeometry)
resizeCropBox = Custom[View.ResizeCropBox](amt=crop_box_offset, view=setCropBox)  # package Clockwork for Dynamo 2.x; Resizes the bounding box of a given Revit element by the specified amount in X, Y and Z direction. May need to be used in conjunction with a Transaction node.
code_block_7 = CodeBlock { false; }
cropBoxVisible = archilab.Revit.Views.Views.CropBoxVisible(view=resizeCropBox.view, visible=code_block_7)  # frozen
