# Dynamo graph DuplicateScheduleByAppartmentV2_p.dyn (Dynamo 2.12.1.8246)
# packages: cata_lyst 0.0.1

# group: INPUT
views = Views("BYT")  # graph input
appartment_parameter_name = StringInput("Occupancy")

code_block = CodeBlock { "Rooms"; }
byName = Category.ByName(name=code_block)
all_elements_of_category = ElementsOfCategory(Category=byName)
getParameterValueByName = Element.GetParameterValueByName(element=all_elements_of_category, parameterName=appartment_parameter_name)
uniqueItems = List.UniqueItems(list=getParameterValueByName)
py_find_bytxxxx = Python(IN[0]=uniqueItems)  # IronPython2
# ---------- py_find_bytxxxx.python (17 lines) ----------
# Load the Python Standard and DesignScript Libraries
import sys
import clr
clr.AddReference('ProtoGeometry')
from Autodesk.DesignScript.Geometry import *

# The inputs to this node will be stored as a list in the IN variables.
strings = IN[0]
index = 3
filt_cut_strings = []

# Place your code below this line
for s in strings:
	if s[:index] == "BYT" or s[:index] == "APA" or s[:6] == "PRENAJ" :
		filt_cut_strings.append(s)
# Assign your output to the OUT variable.
OUT = filt_cut_strings
# ----------------------------------------
duplicateView = View.DuplicateView(view=views, suffix=py_find_bytxxxx)
code_block_2 = CodeBlock { "View Name"; }
setParameterByName = Element.SetParameterByName(element=duplicateView, parameterName=code_block_2, value=py_find_bytxxxx)
clearAllFilters = ScheduleView.ClearAllFilters(scheduleView=setParameterByName)
fields = ScheduleView.Fields(scheduleView=views)
string_from_object = FromObject(object=fields)
code_block_3 = CodeBlock { "Occupancy"; }
indexOf = List.IndexOf(list=string_from_object, element=code_block_3)
code_block_4 = CodeBlock(a=fields, b=indexOf) { a[b]; }
schedule_filter_type = ScheduleFilterType("Equal")
byFieldTypeAndValue = Revit.Schedules.ScheduleFilter.ByFieldTypeAndValue(field=code_block_4, filterType=schedule_filter_type, value=py_find_bytxxxx)
python_script = Python(IN[0]=byFieldTypeAndValue)  # IronPython2
# ---------- python_script.python (15 lines) ----------
# Load the Python Standard and DesignScript Libraries
import sys
import clr
clr.AddReference('ProtoGeometry')
from Autodesk.DesignScript.Geometry import *

# The inputs to this node will be stored as a list in the IN variables.
dataEnteringNode = IN[0]

# Place your code below this line
output = []
for a in dataEnteringNode:
	output.append([a])
# Assign your output to the OUT variable.
OUT = output
# ----------------------------------------
addFilters = ScheduleView.AddFilters(scheduleView=clearAllFilters, scheduleFilters=python_script)
list_create = List.Create(item0=byFieldTypeAndValue)
návod = StringInput("Skopíruje vzorovú tabuľku s filtrami podľa bytov - hodnota v paremtri zacinajuca BYT xxx")  # graph input
code_block_5 = CodeBlock { "DuplicateScheduleByAppartment"; }
usageLog = Custom[usageLog](scriptName=code_block_5)  # package cata_lyst; node logs every run of the script in which is used to the hardcoded server location
py_find_and_cut_bytxxxx = Python(IN[0]=uniqueItems)  # IronPython2
# ---------- py_find_and_cut_bytxxxx.python (23 lines) ----------
# Load the Python Standard and DesignScript Libraries
import sys
import clr
clr.AddReference('ProtoGeometry')
from Autodesk.DesignScript.Geometry import *

# The inputs to this node will be stored as a list in the IN variables.
strings = IN[0]
index = 3 # byt
index_apart = 8 # apartman
index_retail = 23 # retail
filt_cut_strings = []

# Place your code below this line
for s in strings:
	if s[:index] == "BYT":
		filt_cut_strings.append(s[index+1:])
	elif s[:index_apart] == "APARTMÁN":
		filt_cut_strings.append(s[index_apart+1:])
	elif s[:index_retail] == "PRENAJÍMATEĽNÝ PRIESTOR":
		filt_cut_strings.append(s)
# Assign your output to the OUT variable.
OUT = filt_cut_strings
# ----------------------------------------
