# Dynamo graph ExtParapetSirkaSetter.dyn (Dynamo 2.12.1.8246)
# packages: Clockwork for Dynamo 2.x 2.4.0

code_block = CodeBlock { "Windows"; }
byName = Category.ByName(name=code_block)
all_elements_of_category = ElementsOfCategory(Category=byName)
select_model_elements = DSModelElementsSelection()  # 25 picked in the model
rooms = Custom[Window.Rooms](window=select_model_elements)  # package Clockwork for Dynamo 2.x; Gets the rooms that are connected by a given window

# group: filter only placed TO ROOMS
location = Custom[Element.Location+](element=rooms.toRoom)  # package Clockwork for Dynamo 2.x; Returns the location of an element as point, curve or curve loop, along with some booleans to help filtering the results. Unlike the OOTB Element.GetLocation node, it also retunrs sketch lines of sketch-based elements like floor slabs as well as the element's rotation property.

filterByBoolMask = List.FilterByBoolMask(list=select_model_elements, mask=location.hasLocation)
code_block_2 = CodeBlock { "Ext. parapet_šírka"; }
code_block_3 = CodeBlock { 220; }
setParameterByName = Element.SetParameterByName(element=filterByBoolMask.in, parameterName=code_block_2, value=code_block_3)
