# Dynamo graph roomParamCopy_2Occupancy.dyn (Dynamo 2.12.1.8246)

categories = Categories("OST_Rooms")
all_elements_of_category = ElementsOfCategory(Category=categories)
code_block = CodeBlock { "Occupancy"; }
getParameterValueByName = Element.GetParameterValueByName(element=all_elements_of_category, parameterName=code_block)
python_script = Python(IN[0]=getParameterValueByName)  # IronPython2
# ---------- python_script.python (15 lines) ----------
# Load the Python Standard and DesignScript Libraries
import sys
import clr
clr.AddReference('ProtoGeometry')
from Autodesk.DesignScript.Geometry import *

# The inputs to this node will be stored as a list in the IN variables.
data = IN[0]

# Place your code below this line
out_data = []
for i in data:
	out_data.append(i[:-2])
# Assign your output to the OUT variable.
OUT = out_data
# ----------------------------------------
code_block_2 = CodeBlock { "PRENAJÍMATEĽNÝ PRIESTOR"; }
eq = python_script == code_block_2
filterByBoolMask = List.FilterByBoolMask(list=all_elements_of_category, mask=eq)
code_block_3 = CodeBlock { "Occupancy"; }
code_block_4 = CodeBlock { "Č. stav. objektu"; }
getParameterValueByName_2 = Element.GetParameterValueByName(element=filterByBoolMask.in, parameterName=code_block_4)
code_block_5 = CodeBlock { "."; }
code_block_6 = CodeBlock { "Č. poschodia"; }
getParameterValueByName_3 = Element.GetParameterValueByName(element=filterByBoolMask.in, parameterName=code_block_6)
code_block_7 = CodeBlock { "Č. sekcie"; }
getParameterValueByName_4 = Element.GetParameterValueByName(element=filterByBoolMask.in, parameterName=code_block_7)
code_block_8 = CodeBlock { "Č. bytu"; }
getParameterValueByName_5 = Element.GetParameterValueByName(element=filterByBoolMask.in, parameterName=code_block_8)
code_block_9 = CodeBlock(a=getParameterValueByName_2, delimiter=code_block_5, b=getParameterValueByName_3, c=getParameterValueByName_4, d=getParameterValueByName_5) { a+delimiter+b+delimiter+c+delimiter+d; }
code_block_10 = CodeBlock(a=code_block_2, b=code_block_9) { a+" "+b; }
setParameterByName = Element.SetParameterByName(element=filterByBoolMask.in, parameterName=code_block_3, value=code_block_10)
