# Dynamo graph seckia_cisloBytu.dyn (Dynamo 2.12.1.8246)

categories = Categories("OST_Rooms")
all_elements_of_category = ElementsOfCategory(Category=categories)
code_block = CodeBlock { "sekcia_CisloBytu"; }
code_block_2 = CodeBlock { "Č. sekcie"; }
getParameterValueByName = Element.GetParameterValueByName(element=all_elements_of_category, parameterName=code_block_2)
code_block_3 = CodeBlock { "Č. bytu"; }
getParameterValueByName_2 = Element.GetParameterValueByName(element=all_elements_of_category, parameterName=code_block_3)
code_block_4 = CodeBlock(a=getParameterValueByName, b=getParameterValueByName_2) { a+"."+b; }
setParameterByName = Element.SetParameterByName(element=all_elements_of_category, parameterName=code_block, value=code_block_4)
