# Dynamo graph developerAreaPetrzalka.dyn (Dynamo 2.12.1.8246)
# packages: Clockwork for Dynamo 2.x 2.4.0, Genius Loci 2022.4.19, cata_lyst 0.0.1

code_block = CodeBlock { "Doors"; }
byName = Category.ByName(name=code_block)
all_elements_of_category = ElementsOfCategory(Category=byName)
rooms = Custom[Door.Rooms](door=all_elements_of_category)  # package Clockwork for Dynamo 2.x; Gets the rooms that are connected by a given door

# group: reseting values for "fromRoom"s
code_block_2 = CodeBlock { "Rooms"; }
byName_2 = Category.ByName(name=code_block_2)
all_elements_of_category_2 = ElementsOfCategory(Category=byName_2)
code_block_3 = CodeBlock { "Plocha korekcia"; 0; }
setParameterByName = Element.SetParameterByName(element=all_elements_of_category_2, parameterName=code_block_3.out0, value=code_block_3.out1)

passthrough = Custom[Passthrough](passThrough=rooms.fromRoom, waitFor=setParameterByName)  # package Clockwork for Dynamo 2.x; Forces a sequential order of execution. The node wired into the output of the Passthrough node will be executed *after* the node wired into the waitFor input (e.g. important for some Revit operations). The value of the passThrough input will be passed on to the node wired into the output port of the Passthrough node.

# group: filter only placed ROOMS
location = Custom[Element.Location+](element=passthrough)  # package Clockwork for Dynamo 2.x; Returns the location of an element as point, curve or curve loop, along with some booleans to help filtering the results. Unlike the OOTB Element.GetLocation node, it also retunrs sketch lines of sketch-based elements like floor slabs as well as the element's rotation property.
filterByBoolMask = List.FilterByBoolMask(list=passthrough, mask=location.hasLocation)

# group: getting area correction values from doors
filterByBoolMask_2 = List.FilterByBoolMask(list=all_elements_of_category, mask=location.hasLocation)
elementType = Element.ElementType(element=filterByBoolMask_2.in)
code_block_4 = CodeBlock { "Krídlo_šírka"; }
getParameterValueByName = Element.GetParameterValueByName(element=elementType, parameterName=code_block_4)
code_block_5 = CodeBlock(a=getParameterValueByName) { a/1000; }
element_host = Custom[Element Host](element=filterByBoolMask_2.in)  # package Genius Loci; Gets the host of the element. Unlike the OOTB node FamilyInstance.GetHost, it also works for elements hosted by a linked document, wall sweeps, foundations, railings and builing pads. Based on a Clockwork's node
elementType_2 = Element.ElementType(element=element_host)
code_block_6 = CodeBlock { "Width"; }
getParameterValueByName_2 = Element.GetParameterValueByName(element=elementType_2, parameterName=code_block_6)
code_block_7 = CodeBlock(a=getParameterValueByName_2) { a/1000; }
code_block_8 = CodeBlock(a=code_block_5, b=code_block_7) { a*b; }

code_block_9 = CodeBlock { "Windows"; }
byName_3 = Category.ByName(name=code_block_9)
all_elements_of_category_3 = ElementsOfCategory(Category=byName_3)
passthrough_2 = Custom[Passthrough](passThrough=all_elements_of_category_3, waitFor=setParameterByName)

# group: filtering out WINDOWS with zero Sill Height
code_block_10 = CodeBlock { "Sill Height"; }
getParameterValueByName_3 = Element.GetParameterValueByName(element=all_elements_of_category_3, parameterName=code_block_10)
code_block_11 = CodeBlock { 0; }
eq = getParameterValueByName_3 == code_block_11
filterByBoolMask_3 = List.FilterByBoolMask(list=passthrough_2, mask=eq)

rooms_2 = Custom[Window.Rooms](window=filterByBoolMask_3.in)  # package Clockwork for Dynamo 2.x; Gets the rooms that are connected by a given window

# group: filter only placed FROM ROOMS
location_2 = Custom[Element.Location+](element=rooms_2.fromRoom)
filterByBoolMask_4 = List.FilterByBoolMask(list=rooms_2.fromRoom, mask=location_2.hasLocation)

# group: getting area correction values from windows FROM ROOM from interior side
filterByBoolMask_5 = List.FilterByBoolMask(list=filterByBoolMask_3.in, mask=location_2.hasLocation)
elementType_3 = Element.ElementType(element=filterByBoolMask_5.in)
parameters = CodeBlock()
# ---------- parameters.designscript (8 lines) ----------
[
"Width",
"RP pravý_šírka",
"RP ľavý_šírka",
"Int. parapet sirka",
"Rozširovací profil_pravý",
"Rozširovací profil_ľavý"
];
# ----------------------------------------
getParameterValueByName_4 = Element.GetParameterValueByName(element=elementType_3, parameterName=parameters@L1)
parameters_2 = CodeBlock { "Int. parapet sirka"; }
getParameterValueByName_5 = Element.GetParameterValueByName(element=filterByBoolMask_5.in, parameterName=parameters_2)

# group: RP pravy
code_block_12 = CodeBlock(a=getParameterValueByName_4) { a[4]; a[1]; }
python_script = Python(IN[0]=code_block_12.out0, IN[1]=code_block_12.out1)  # IronPython2
# ---------- python_script.python (23 lines) ----------
# Load the Python Standard and DesignScript Libraries
import sys
import clr
clr.AddReference('ProtoGeometry')
from Autodesk.DesignScript.Geometry import *

# The inputs to this node will be stored as a list in the IN variables.
checkbox_states = IN[0]
rp_widths = IN[1] # real parameter values

# Place your code below this line
count = 0
real_widths = []
for width in rp_widths:
	if checkbox_states[count] == 1:
		real_widths.append(width)
	else:
		real_widths.append(0)
	count += 1


# Assign your output to the OUT variable.
OUT = real_widths
# ----------------------------------------

# group: RP lavy
code_block_13 = CodeBlock(a=getParameterValueByName_4) { a[5]; a[2]; }
python_script_2 = Python(IN[0]=code_block_13.out0, IN[1]=code_block_13.out1)  # IronPython2; same code as python_script

# group (continued): getting area correction values from windows FROM ROOM from interior side
code_block_14 = CodeBlock(a=getParameterValueByName_4, rpp=python_script, rpl=python_script_2, b=getParameterValueByName_5) { (a[0]+rpp+rpl)/1000; b/1000; }
code_block_15 = CodeBlock(a=code_block_14.out0, b=code_block_14.out1) { a*b; }

# group: filter only placed TO ROOMS
location_3 = Custom[Element.Location+](element=rooms_2.toRoom)
filterByBoolMask_6 = List.FilterByBoolMask(list=rooms_2.toRoom, mask=location_3.hasLocation)

# group: getting area correction values from windows TO ROOM from exterior side - balconies
filterByBoolMask_7 = List.FilterByBoolMask(list=filterByBoolMask_3.in, mask=location_3.hasLocation)
elementType_4 = Element.ElementType(element=filterByBoolMask_7.in)
parameters_3 = CodeBlock()
# ---------- parameters_3.designscript (6 lines) ----------
[
"Width",
"TI_pravá",
"TI_ľavá",
"Ext. parapet_šírka"
];
# ----------------------------------------
getParameterValueByName_6 = Element.GetParameterValueByName(element=elementType_4, parameterName=parameters_3@L1)
code_block_16 = CodeBlock { "Ext. parapet_šírka"; }
getParameterValueByName_7 = Element.GetParameterValueByName(element=filterByBoolMask_7.in, parameterName=code_block_16)
code_block_17 = CodeBlock(a=getParameterValueByName_6, b=getParameterValueByName_7) { (a[0]-a[1]-a[2])/1000; b/1000; }
code_block_18 = CodeBlock(a=code_block_17.out0, b=code_block_17.out1) { a*b; }

# group: EXCEPTION - area corrections IF Window Comments = rohove okno from exterior side - balconies
code_block_19 = CodeBlock { "Comments"; }
getParameterValueByName_8 = Element.GetParameterValueByName(element=filterByBoolMask_7.in, parameterName=code_block_19)
code_block_20 = CodeBlock { "rohove okno"; }
startsWith = String.StartsWith(string=getParameterValueByName_8, searchFor=code_block_20)
filterByBoolMask_8 = List.FilterByBoolMask(list=filterByBoolMask_7.in, mask=startsWith)
elementType_5 = Element.ElementType(element=filterByBoolMask_8.in)
ext_parapet_width = CodeBlock(a=parameters_3) { a[3]; }
getParameterValueByName_9 = Element.GetParameterValueByName(element=elementType_5, parameterName=ext_parapet_width)
correction_area = CodeBlock(a=getParameterValueByName_9) { -1*(a/1000)*(a/1000)/2; }
filterByBoolMask_9 = List.FilterByBoolMask(list=filterByBoolMask_6.in, mask=startsWith)

# group: EXCEPTION - area corrections IF Window Comments = rohove okno from interior side
code_block_21 = CodeBlock { "Comments"; }
getParameterValueByName_10 = Element.GetParameterValueByName(element=filterByBoolMask_5.in, parameterName=code_block_21)
code_block_22 = CodeBlock { "rohove okno 2"; }
eq_2 = getParameterValueByName_10 == code_block_22
filterByBoolMask_10 = List.FilterByBoolMask(list=filterByBoolMask_5.in, mask=eq_2)
elementType_6 = Element.ElementType(element=filterByBoolMask_10.in)
int_parapet_with = CodeBlock(a=parameters) { a[3]; }
getParameterValueByName_11 = Element.GetParameterValueByName(element=elementType_6, parameterName=int_parapet_with)
rozsirovaci_profil = CodeBlock { 80; }
correction_area_2 = CodeBlock(a=getParameterValueByName_11, RP=rozsirovaci_profil) { (a/1000)*((a+RP)/1000)/2; }
filterByBoolMask_11 = List.FilterByBoolMask(list=filterByBoolMask_4.in, mask=eq_2)

# group: area corrections
join = List.Join(list0=code_block_8, list1=code_block_15, list2=code_block_18, list3=correction_area, list4=correction_area_2)

# group: Rooms
join_2 = List.Join(list0=filterByBoolMask.in, list1=filterByBoolMask_4.in, list2=filterByBoolMask_6.in, list3=filterByBoolMask_9.in, list4=filterByBoolMask_11.in)

py_sum_correction_by_room = Python(IN[0]=join, IN[1]=join_2)  # IronPython2
# ---------- py_sum_correction_by_room.python (46 lines) ----------
# Load the Python Standard and DesignScript Libraries
import sys
import clr
clr.AddReference('ProtoGeometry')
from Autodesk.DesignScript.Geometry import *

clr.AddReference("RevitServices")
clr.AddReference("RevitAPI")
import RevitServices
from RevitServices.Persistence import DocumentManager
from Autodesk.Revit import DB

doc = DocumentManager.Instance.CurrentDBDocument
uiapp = DocumentManager.Instance.CurrentUIApplication
app = uiapp.Application


# The inputs to this node will be stored as a list in the IN variables.
area_corr = IN[0]
rooms = IN[1]

# Place your code below this line
unique_rooms = []
area_corrections = []
count = 0
for room in rooms:
	#try:
		if room not in unique_rooms:
			unique_rooms.append(room)
			area_corrections.append(area_corr[count])
		else:
			index = unique_rooms.index(room)
			# last_area_corr = area_corrections[index]
			# if some records have no value
			try:
				area_corrections[index] += area_corr[count]
			except:
				pass
		count += 1
	#except:
		#pass


# Assign your output to the OUT variable.
OUT = zip(unique_rooms, area_corrections)
#OUT = area_corrections
# ----------------------------------------
transpose = List.Transpose(lists=py_sum_correction_by_room)
code_block_23 = CodeBlock(a=transpose) { a[0]; a[1]; }
code_block_24 = CodeBlock { "Plocha korekcia"; }
setParameterByName_2 = Element.SetParameterByName(element=code_block_23.out0, parameterName=code_block_24, value=code_block_23.out1)
návod = StringInput("""Skript na výpočet developerskej plochy miestností, ktorý dopočítava:
- plochu interieroveho aj exteriérového parapetu okien s nulovym parapetom 
- plochu pod dverným otvorom na celú hrúbku steny  na šírku bez zárubne pripočíta do miestnosti, z ktorej sa dvere otvárajú.

Windows a Doors musia mat priradene urcene parametre
Doors musia mat vo families zapnuty calculation point
Rooms musia mat priradeny parameter "Plocha korekcia"

rohove okna 
rohovym oknam z nulovym parametom je potrebne pridat Comments = rohove okno

ak tvoria obe casti rohoveho okna hranicu interierovej miestnosti (nie loggia) - Comments = rohove okno 2

Postup na kontrolu vystupu:
skopirovanim tabulku s parametrami, tak vlozime parametre aj s nastavenim tabulky
copy template with color scheme
""")  # graph input
code_block_25 = CodeBlock { "developerAreaPetrzalka"; }
usageLog = Custom[usageLog](scriptName=code_block_25)  # package cata_lyst; node logs every run of the script in which is used to the hardcoded server location
