# Dynamo graph sheetCreateTXTptzV5.dyn (Dynamo 2.12.1.8246)
# packages: Rhythm 2022.4.3, cata_lyst 0.0.1

manual = StringInput("""Vytvorí Sheety s číslami a názvami výkresov podľa excelovskej tabuľky.
Na každý Sheet pridá Floor Plan s názvom podľa 3. stĺpca.

V projekte nemôžu byť 2 rovnako nazvané Floor Plany ak jeden z nich chceme automaticky umiestňovať na Sheet.

Formát XLS súboru:
1. stĺpec - Sheet Number
2. stĺpec - Sheet Name
3. Stĺpec - View Name 1
4. Stĺpec - Legenda miestností 
5. Stĺpec - Izbovosť bytu
6. Stĺpec - schema poschodia
7. Stĺpec - Druh_priestoru
(nepovinné)""")  # graph input

# group: INPUT
file_path_for_excel_schedule = Filename("sheetcreate\sheetlist_B1.txt")  # graph input
select_title_block = FamilyTypes("Format_passportyBytovV2:B1")  # graph input
select_view_type_of_1st_view_1 = DoubleSlider(1, range=1..7 step 1)  # "Select View Type of 1st View 1 - FloorPlanView 2 - SectionView 3 - CeilingPlanView 4 - Legend 5 - AxonometricView 6 - AreaPlanView 7 - DraftingView"; graph input
select_view_type_of_3nd_view = DoubleSlider(1, range=1..8 step 1)  # "Select View Type of 3nd View (optional)"; graph input
select_view_type_of_2nd_view = DoubleSlider(8, range=1..8 step 1)  # "Select View Type of 2nd View (optional)"; graph input

fromPath = FileObject(path=file_path_for_excel_schedule)  # "File.FromPath"
readText = FileSystem.ReadText(file=fromPath)

# group: FIX it here
python_script = Python(IN[0]=readText)  # IronPython2
# ---------- python_script.python (16 lines) ----------
# Load the Python Standard and DesignScript Libraries
import sys
import clr
clr.AddReference('ProtoGeometry')
from Autodesk.DesignScript.Geometry import *

# The inputs to this node will be stored as a list in the IN variables.
text = IN[0]
structured = []
# Place your code below this line
t = text.split("\n")
for i in t:
	line = i.split("	")
	structured.append(line)
# Assign your output to the OUT variable.
OUT = structured
# ----------------------------------------

transpose = List.Transpose(lists=python_script)
number = DoubleInput(1)
getItemAtIndex = List.GetItemAtIndex(list=transpose, index=number)
watch = Watch(getItemAtIndex)
number_2 = DoubleInput(0)
getItemAtIndex_2 = List.GetItemAtIndex(list=transpose, index=number_2)
watch_2 = Watch(getItemAtIndex_2)
categories = Categories("OST_Views")
all_elements_of_category = ElementsOfCategory(Category=categories)

# group: list of View Categories
code_block = CodeBlock()
# ---------- code_block.designscript (8 lines) ----------
["Revit.Elements.Views.FloorPlanView",
"Revit.Elements.Views.SectionView",
"Revit.Elements.Views.CeilingPlanView",
"Revit.Elements.Views.Legend",
"Revit.Elements.Views.AxonometricView",
"Revit.Elements.Views.AreaPlanView",
"Revit.Elements.Views.DraftingView",
"Revit.Elements.Views.ScheduleView"];
# ----------------------------------------

# group: Filter - just selected View Category
type = Object.Type(object=all_elements_of_category)
code_block_2 = CodeBlock(list=code_block, x=select_view_type_of_1st_view_1) { list[x-1]; }
eq = type == code_block_2
filterByBoolMask = List.FilterByBoolMask(list=all_elements_of_category, mask=eq)

code_block_3 = CodeBlock { "View Name"; }
getParameterValueByName = Element.GetParameterValueByName(element=filterByBoolMask.in, parameterName=code_block_3)
number_3 = DoubleInput(2)
getItemAtIndex_3 = List.GetItemAtIndex(list=transpose, index=number_3)
watch_3 = Watch(getItemAtIndex_3)

# group: removing nulls
code_block_4 = CodeBlock { 0; }
string_from_object = FromObject(obj=watch_3)
code_block_5 = CodeBlock { "null"; }
allIndicesOf = List.AllIndicesOf(list=string_from_object, item=code_block_5)
firstItem = List.FirstItem(list=allIndicesOf)
slice = List.Slice(list=watch_3, start=code_block_4, end=firstItem)

allIndicesOf_2 = List.AllIndicesOf(list=getParameterValueByName, item=slice)
flatten = List.Flatten(list=allIndicesOf_2)
getItemAtIndex_4 = List.GetItemAtIndex(list=filterByBoolMask.in, index=flatten)
categories_2 = Categories("OST_Views")
all_elements_of_category_2 = ElementsOfCategory(Category=categories_2)

# group: Filter - just selected View Category
type_2 = Object.Type(object=all_elements_of_category_2)
code_block_6 = CodeBlock(list=code_block, x=select_view_type_of_3nd_view) { list[x-1]; }
eq_2 = type_2 == code_block_6
filterByBoolMask_2 = List.FilterByBoolMask(list=all_elements_of_category_2, mask=eq_2)

code_block_7 = CodeBlock { "View Name"; }
getParameterValueByName_2 = Element.GetParameterValueByName(element=filterByBoolMask_2.in, parameterName=code_block_7)
number_4 = DoubleInput(5)
getItemAtIndex_5 = List.GetItemAtIndex(list=transpose, index=number_4)
watch_4 = Watch(getItemAtIndex_5)

# group: removing nulls
code_block_8 = CodeBlock { 0; }
string_from_object_2 = FromObject(object=watch_4)
code_block_9 = CodeBlock { "null"; }
allIndicesOf_3 = List.AllIndicesOf(list=string_from_object_2, item=code_block_9)
firstItem_2 = List.FirstItem(list=allIndicesOf_3)
slice_2 = List.Slice(list=watch_4, start=code_block_8, end=firstItem_2)

allIndicesOf_4 = List.AllIndicesOf(list=getParameterValueByName_2, item=slice_2)
flatten_2 = List.Flatten(list=allIndicesOf_4)
getItemAtIndex_6 = List.GetItemAtIndex(list=filterByBoolMask_2.in, index=flatten_2)

# group: possible list create with 2nd views
list_create = List.Create(item0=getItemAtIndex_4, item1=getItemAtIndex_6)

transpose_2 = List.Transpose(lists=list_create)
code_block_b1 = CodeBlock()
# ---------- code_block_b1.designscript (4 lines) ----------
[
Point.ByCoordinates(2073,786,0),
Point.ByCoordinates(2174,830,0)
];
# ----------------------------------------
byNameNumberTitleBlockViewsAndLocations = Sheet.ByNameNumberTitleBlockViewsAndLocations(sheetName=watch, sheetNumber=watch_2, titleBlockFamilyType=select_title_block, views=transpose_2, locations=code_block_b1)
count = List.Count(list=byNameNumberTitleBlockViewsAndLocations)
code_block_10 = CodeBlock(count=count) { "Bolo vytvorenych " + count + " Sheetov."; }
status = Watch(code_block_10)  # graph output
manual_2 = StringInput("""1 - FloorPlanView
2 - SectionView
3 - CeilingPlanView
4 - Legend
5 - AxonometricView
6 - AreaPlanView
7 - DraftingView""")
C3 = CodeBlock()
# ---------- C3.designscript (4 lines) ----------
[
Point.ByCoordinates(2084,776,0),
Point.ByCoordinates(2170,856,0)
];
# ----------------------------------------
number_5 = DoubleInput(3)
getItemAtIndex_7 = List.GetItemAtIndex(list=transpose, index=number_5)
watch_5 = Watch(getItemAtIndex_7)

# group: FIX THIS
adhoc_return_remover = Python(IN[0]=watch_5)  # IronPython2
# ---------- adhoc_return_remover.python (17 lines) ----------
# Load the Python Standard and DesignScript Libraries
import sys
import clr
clr.AddReference('ProtoGeometry')
from Autodesk.DesignScript.Geometry import *

# The inputs to this node will be stored as a list in the IN variables.
data = IN[0]
output = []
# Place your code below this line
for i in data:
	try:
		output.append(i[:-1])
	except:
		pass
# Assign your output to the OUT variable.
OUT = output
# ----------------------------------------

categories_3 = Categories("OST_Views")
all_elements_of_category_3 = ElementsOfCategory(Category=categories_3)
categories_4 = Categories("OST_Schedules")
all_elements_of_category_4 = ElementsOfCategory(Category=categories_4)
join = List.Join(list0=all_elements_of_category_3, list1=all_elements_of_category_4)

# group: Filter - just selected View Category
type_3 = Object.Type(object=join)
code_block_11 = CodeBlock(list=code_block, x=select_view_type_of_2nd_view) { list[x-1]; }
eq_3 = type_3 == code_block_11
filterByBoolMask_3 = List.FilterByBoolMask(list=join, mask=eq_3)

code_block_12 = CodeBlock { "View Name"; }
getParameterValueByName_3 = Element.GetParameterValueByName(element=filterByBoolMask_3.in, parameterName=code_block_12)

# group: removing nulls
code_block_13 = CodeBlock { 0; }
string_from_object_3 = FromObject(obj=watch_5)
code_block_14 = CodeBlock { "null"; }
allIndicesOf_5 = List.AllIndicesOf(list=string_from_object_3, item=code_block_14)
firstItem_3 = List.FirstItem(list=allIndicesOf_5)
slice_3 = List.Slice(list=watch_5, start=code_block_13, end=firstItem_3)

allIndicesOf_6 = List.AllIndicesOf(list=getParameterValueByName_3, item=slice_3)
flatten_3 = List.Flatten(list=allIndicesOf_6)
getItemAtIndex_8 = List.GetItemAtIndex(list=filterByBoolMask_3.in, index=flatten_3)
schedule_location_on_sheet = CodeBlock { Point.ByCoordinates(2193.85,845,0); }
ʳʰʸᵗʰᵐ_viewport_create = Rhythm.Revit.Elements.Viewport.Create(sheet=byNameNumberTitleBlockViewsAndLocations, view=getItemAtIndex_8, location=schedule_location_on_sheet)
adhoc_return_remover_2 = Python(IN[0]=watch_3)  # IronPython2; same code as adhoc_return_remover
code_block_15 = CodeBlock { "sheetCreateTXT"; }
usageLog = Custom[usageLog](scriptName=code_block_15)  # package cata_lyst; node logs every run of the script in which is used to the hardcoded server location
sheets = Watch(byNameNumberTitleBlockViewsAndLocations)  # graph output
number_6 = DoubleInput(4)
getItemAtIndex_9 = List.GetItemAtIndex(list=transpose, index=number_6)
watch_6 = Watch(getItemAtIndex_9)

# group: FIX THIS
adhoc_return_remover_3 = Python(IN[0]=watch_6)  # IronPython2; same code as adhoc_return_remover

# group: FIX THIS
adhoc_return_remover_4 = Python(IN[0]=watch_4)  # IronPython2; same code as adhoc_return_remover

C1 = CodeBlock()
# ---------- C1.designscript (4 lines) ----------
[
Point.ByCoordinates(2080,776,0),
Point.ByCoordinates(2170,851,0)
];
# ----------------------------------------
number_7 = DoubleInput(6)
getItemAtIndex_10 = List.GetItemAtIndex(list=transpose, index=number_7)
watch_7 = Watch(getItemAtIndex_10)

# group: FIX THIS
adhoc_return_remover_5 = Python(IN[0]=watch_7)  # IronPython2; same code as adhoc_return_remover

# group: Sheet parameters setter
code_block_16 = CodeBlock { "Poschodie"; }
py_poschodie_getter = Python(IN[0]=getItemAtIndex)  # IronPython2
# ---------- py_poschodie_getter.python (15 lines) ----------
# Load the Python Standard and DesignScript Libraries
import sys
import clr
clr.AddReference('ProtoGeometry')
from Autodesk.DesignScript.Geometry import *

# The inputs to this node will be stored as a list in the IN variables.
data = IN[0]
split_strings = []
# Place your code below this line
for i in data:
	split_string = i.split(".")
	split_strings.append(split_string[-2])
# Assign your output to the OUT variable.
OUT = split_strings
# ----------------------------------------
setParameterByName = Element.SetParameterByName(element=sheets, parameterName=code_block_16, value=py_poschodie_getter)
code_block_17 = CodeBlock { "Izbovost"; }
setParameterByName_2 = Element.SetParameterByName(element=sheets, parameterName=code_block_17, value=watch_6)
code_block_18 = CodeBlock { "Druh_priestoru"; }
setParameterByName_3 = Element.SetParameterByName(element=sheets, parameterName=code_block_18, value=adhoc_return_remover_5)
code_block_19 = CodeBlock { "Delenie"; "MAR sheet script"; }
setParameterByName_4 = Element.SetParameterByName(element=sheets, parameterName=code_block_19.out0, value=code_block_19.out1)
