# Dynamo graph AutoMarkPrierazy&OffsetV6.dyn (Dynamo 2.12.1.8246)
# packages: Clockwork for Dynamo 2.x 2.1.2, cata_lyst 0.0.1, Clockwork for Dynamo 2.x 2.4.0, spring nodes 210.1.1

# group: Filter
# note: filtering elements

# group: Error handling
# note: Treating errors as hints to user what to do to avoid the error

code_block = CodeBlock { "Generic Models"; }
byName = Category.ByName(name=code_block)
all_elements_of_category = ElementsOfCategory(Category=byName)

# group: FILTER vykaz kategoria = PRIERAZY
elementType = Element.ElementType(element=all_elements_of_category)
code_block_2 = CodeBlock { "Výkaz kategória"; }
getParameterValueByName = Element.GetParameterValueByName(element=elementType, parameterName=code_block_2)
code_block_3 = CodeBlock { "PRIERAZY"; }
eq = getParameterValueByName == code_block_3
filterByBoolMask = List.FilterByBoolMask(list=all_elements_of_category, mask=eq)

# group: value eraser
code_block_4 = CodeBlock { "HH_od ref 0text"; }
code_block_5 = CodeBlock { ""; }
setParameterByName = Element.SetParameterByName(element=filterByBoolMask.in, parameterName=code_block_4, value=code_block_5)
code_block_6 = CodeBlock { "SH_od ref 0"; }
setParameterByName_2 = Element.SetParameterByName(element=setParameterByName, parameterName=code_block_6, value=code_block_5)
code_block_7 = CodeBlock { "OS_od ref 0"; }
setParameterByName_3 = Element.SetParameterByName(element=setParameterByName_2, parameterName=code_block_7, value=code_block_5)

passthrough = Custom[Passthrough](passThrough=filterByBoolMask.in, waitFor=setParameterByName_3)  # package Clockwork for Dynamo 2.x; Forces a sequential order of execution. The node wired into the output of the Passthrough node will be executed *after* the node wired into the waitFor input (e.g. important for some Revit operations). The value of the passThrough input will be passed on to the node wired into the output port of the Passthrough node.
getFamily = FamilyInstance.GetFamily(familyInstance=passthrough)

# group: remove nulls
isNull = Object.IsNull(object=getFamily)
filterByBoolMask_2 = List.FilterByBoolMask(list=passthrough, mask=isNull)
filterByBoolMask_3 = List.FilterByBoolMask(list=getFamily, mask=isNull)

name = Family.Name(family=filterByBoolMask_3.out)

# group: len stvorec
code_block_8 = CodeBlock { "stena - štvorec"; true; }
contains = String.Contains(string=name, searchFor=code_block_8.out0, ignoreCase=code_block_8.out1)
filterByBoolMask_4 = List.FilterByBoolMask(list=filterByBoolMask_2.out, mask=contains)

code_block_9 = CodeBlock { "Výška"; }
getParameterValueByName_2 = Element.GetParameterValueByName(element=filterByBoolMask_4.in, parameterName=code_block_9)
level = Custom[Element.Level](element=filterByBoolMask_4.in)  # package Clockwork for Dynamo 2.x; Gets an element's level
elevation = Level.Elevation(level=level)
code_block_10 = CodeBlock { "Odsadenie"; }
getParameterValueByName_3 = Element.GetParameterValueByName(element=filterByBoolMask_4.in, parameterName=code_block_10)
code_block_11 = CodeBlock { "Elevation from Level"; }
getParameterValueByName_4 = Element.GetParameterValueByName(element=filterByBoolMask_4.in, parameterName=code_block_11)

# group: SH prierazu
code_block_12 = CodeBlock(levelHeight=elevation, offset=getParameterValueByName_3, elevationFromLevel=getParameterValueByName_4) { levelHeight+offset+elevationFromLevel; }
code_block_13 = CodeBlock { "SH_od ref 0"; }
string_from_object = FromObject(obj=code_block_12)
py_string_cutter = Python(IN[0]=string_from_object)  # IronPython2
# ---------- py_string_cutter.python (15 lines) ----------
# Load the Python Standard and DesignScript Libraries
import sys
import clr
clr.AddReference('ProtoGeometry')
from Autodesk.DesignScript.Geometry import *

# The inputs to this node will be stored as a list in the IN variables.
data = IN[0]
# Place your code below this line
splitdata = []
for i in data:
	split_string = i.split(".")
	splitdata.append(split_string[0])
# Assign your output to the OUT variable.
OUT = splitdata
# ----------------------------------------
setParameterByName_4 = Element.SetParameterByName(element=filterByBoolMask_4.in, parameterName=code_block_13, value=py_string_cutter)

# group: HH prierazu
code_block_14 = CodeBlock { "HH_od ref 0text"; }
code_block_15 = CodeBlock(openingHeight=getParameterValueByName_2, openingSillHeight=code_block_12) { openingHeight+openingSillHeight; }
string_from_object_2 = FromObject(obj=code_block_15)
py_string_cutter_2 = Python(IN[0]=string_from_object_2)  # IronPython2; same code as py_string_cutter
setParameterByName_5 = Element.SetParameterByName(element=filterByBoolMask_4.in, parameterName=code_block_14, value=py_string_cutter_2)

# group: len kruh
code_block_16 = CodeBlock { "stena - kruh"; true; }
contains_2 = String.Contains(string=name, searchFor=code_block_16.out0, ignoreCase=code_block_16.out1)
filterByBoolMask_5 = List.FilterByBoolMask(list=filterByBoolMask_2.out, mask=contains_2)

level_2 = Custom[Element.Level](element=filterByBoolMask_5.in)
elevation_2 = Level.Elevation(level=level_2)
code_block_17 = CodeBlock { "Odsadenie"; }
getParameterValueByName_5 = Element.GetParameterValueByName(element=filterByBoolMask_5.in, parameterName=code_block_17)
code_block_18 = CodeBlock { "Elevation from Level"; }
getParameterValueByName_6 = Element.GetParameterValueByName(element=filterByBoolMask_5.in, parameterName=code_block_18)

# group: SH prierazu
code_block_19 = CodeBlock { "OS_od ref 0"; }
code_block_20 = CodeBlock(levelHeight=elevation_2, offset=getParameterValueByName_5, elevationFromLevel=getParameterValueByName_6) { levelHeight+offset+elevationFromLevel; }
string_from_object_3 = FromObject(obj=code_block_20)
py_string_cutter_3 = Python(IN[0]=string_from_object_3)  # IronPython2; same code as py_string_cutter
setParameterByName_6 = Element.SetParameterByName(element=filterByBoolMask_5.in, parameterName=code_block_19, value=py_string_cutter_3)

# group: INPUT
návod = StringInput("""Skript pre prierazy, ktoré sú vymodelované ako nehostované elementy v kategórii Generic Model

Zapíše výšku spodnej a hornej hrany obdĺžnikových prierazov a výšku osi kruhových prierezov.
Je potrebné mať pridané Shared parametre s názvami:
SH_od ref 0
HH_od ref 0text
OS_od ref 0

cislovanie na kazdom poschodi od 001

format cislovania:
LL.XXX
L = level
X = poradove cislo

Do parametru Typ_Konstrukcie zapise hodnotu z Description prveho elementu, s ktorým je prieraz CUTnutý. Filtruju sa len elementy v kategórii Wall a Floor

Nie je potrebné mať nainštalované žiadne packages.""")  # graph input

# group: OUTPUT
# note: Place output for Dynamo Player
OUTPUT = Watch()  # graph output; unwired: arg0

# group: getting Level
code_block_21 = CodeBlock { "Schedule Level"; }
getParameterValueByName_7 = Element.GetParameterValueByName(element=filterByBoolMask.in, parameterName=code_block_21)

# group: filtering out empty values
code_block_22 = CodeBlock { ""; }
eq_2 = getParameterValueByName_7 == code_block_22
filterByBoolMask_6 = List.FilterByBoolMask(list=filterByBoolMask.in, mask=eq_2)

filterByBoolMask_7 = List.FilterByBoolMask(list=getParameterValueByName_7, mask=eq_2)
name_2 = Level.Name(level=filterByBoolMask_7.out)
sortByKey = List.SortByKey(list=filterByBoolMask_6.out, keys=name_2)
python_script = Python(IN[0]=sortByKey.sortedList, IN[1]=sortByKey.sortedKeys)  # IronPython2
# ---------- python_script.python (30 lines) ----------
# Load the Python Standard and DesignScript Libraries
import sys
import clr
clr.AddReference('ProtoGeometry')
from Autodesk.DesignScript.Geometry import *

# The inputs to this node will be stored as a list in the IN variables.
elements = IN[0]
levelnames = IN[1]

# Place your code below this line
elemLevels = zip(levelnames,elements)
#for element in elements:
lastLevel = ""
#output list of levels
levelList = []
for elemLevel in elemLevels:
	# new level
	if lastLevel != elemLevel[0]:
		#sublist of all list with levels
		levelsubList = []
		levelsubList.append(elemLevel)
		levelList.append(levelsubList)		
		
	# existing level
	if lastLevel == elemLevel[0]:
		levelsubList.append(elemLevel)
	lastLevel = elemLevel[0]
# Assign your output to the OUT variable.
OUT = levelList
# ----------------------------------------
code_block_23 = CodeBlock { 0; }
getItemAtIndex = List.GetItemAtIndex(list=python_script@@L2, index=code_block_23)
py_minus_and_5_treating = Python(IN[0]=getItemAtIndex)  # IronPython2
# ---------- py_minus_and_5_treating.python (24 lines) ----------
# Load the Python Standard and DesignScript Libraries
import sys
import clr
clr.AddReference('ProtoGeometry')
from Autodesk.DesignScript.Geometry import *

# The inputs to this node will be stored as a list in the IN variables.
strings = IN[0]
out_strings = []
# Place your code below this line
for level_list in strings:
	for level in level_list:
		if level[1:3] == ".5" and level[-2:] == "PP":
			#true level name
			level_asign = int(level[0])+1
			level = str(level_asign)+".PP"
		if level[-2:] == "PP":
			level = "-" + level

		#split_string = level.replace("1.PP","-1.PP")
		out_strings.append(level)
	
# Assign your output to the OUT variable.
OUT = out_strings
# ----------------------------------------
py_dot_split = Python(IN[0]=py_minus_and_5_treating)  # IronPython2
# ---------- py_dot_split.python (17 lines) ----------
# Load the Python Standard and DesignScript Libraries
import sys
import clr
clr.AddReference('ProtoGeometry')
from Autodesk.DesignScript.Geometry import *

# The inputs to this node will be stored as a list in the IN variables.
strings = IN[0]
cut_strings = []
# Place your code below this line
for level in strings:
	#for level in level_list:
	split_strings = level.split(".")
	cut_strings.append(split_strings[0])
	
# Assign your output to the OUT variable.
OUT = cut_strings
# ----------------------------------------
code_block_24 = CodeBlock { 1; }
count = List.Count(list=getItemAtIndex@L2)
code_block_25 = CodeBlock(a=count) { a+1; }
code_block_26 = CodeBlock { 3; }
trailingZerosManual = Custom[trailingZerosManual](start=code_block_24, end=code_block_25, numberOfDecimalPlaces=code_block_26)  # package cata_lyst; adds specific number of trailing zeros to sequence of numbers, e. g. for numbering elements
flatten = List.Flatten(list=trailingZerosManual)
code_block_27 = CodeBlock(b=py_dot_split, a=flatten) { "PR_"+b+"_"+a; }

# group: marksetter
code_block_28 = CodeBlock { "Mark"; }
setParameterByName_7 = Element.SetParameterByName(element=sortByKey.sortedList, parameterName=code_block_28, value=code_block_27)

watch = Watch(sortByKey.sortedList)
watch_2 = Watch(sortByKey.sortedKeys)
count_2 = List.Count(list=filterByBoolMask_6.in)
code_block_29 = CodeBlock { -5; 30; 5; }
randomList = Math.RandomList(amount=count_2, value1=code_block_29.out0, value2=code_block_29.out1, seed=code_block_29.out2)
floor = Math.Floor(number=randomList)
code_block_30 = CodeBlock { 500; }
code_block_31 = CodeBlock(a=code_block_30, b=count_2) { a+b; }
code_block_32 = CodeBlock { 3; }
trailingZerosManual_2 = Custom[trailingZerosManual](start=code_block_30, end=code_block_31, numberOfDecimalPlaces=code_block_32)
code_block_33 = CodeBlock(b=floor, a=trailingZerosManual_2) { "PR_"+b+"_"+a; }

# group: marksetter no level
code_block_34 = CodeBlock { "Mark"; }
setParameterByName_8 = Element.SetParameterByName(element=filterByBoolMask_6.in, parameterName=code_block_34, value=code_block_33)

count_3 = List.Count(list=code_block_27)
count_4 = List.Count(list=code_block_33)
code_block_35 = CodeBlock(a=count_3, b=count_4) { a+b; }
ꟿ_element_iscutting = Custom[ꟿ Element.IsCutting]()  # frozen; package spring nodes; Tests if the input element (or elements) is a void cut and if it is cutting any elements. In such cases, the cut elements will be provided.; unwired: element
code_block_36 = CodeBlock(elements=filterByBoolMask.in) { elements; }

# group: el.is cutting?
python_script_2 = Python(IN[0]=code_block_36)  # IronPython2
# ---------- python_script_2.python (44 lines) ----------
import clr

clr.AddReference("RevitServices")
import RevitServices
from RevitServices.Persistence import DocumentManager
doc = DocumentManager.Instance.CurrentDBDocument

clr.AddReference("RevitAPI")
from Autodesk.Revit.DB import *

clr.AddReference("RevitNodes")
import Revit
clr.ImportExtensions(Revit.Elements)

def tolist(obj1):
	if hasattr(obj1,"__iter__"): return obj1
	else: return [obj1]

elements = UnwrapElement(tolist(IN[0]))
out1 = []
cut_el = []
filt_elems = []

cutU = InstanceVoidCutUtils
for i in xrange(len(elements)):
	try:
		if cutU.IsVoidInstanceCuttingElement(elements[i]):
			cut1 = cutU.GetElementsBeingCut(elements[i])
			if cut1.Count != 0:
				cut1 = [doc.GetElement(id).ToDSType(True) for id in cut1]
				out1.append(True)
				cut_el.append(cut1)
				filt_elems.append(elements[i])
			else:
				out1.append(False)
				cut_el.append([])
		else:
			out1.append(False)
			cut_el.append([])
	except:
		out1.append(False)
		cut_el.append([])		

OUT = out1, cut_el, filt_elems
# ----------------------------------------
code_block_37 = CodeBlock(res=python_script_2) { res[0]; res[1]; }

filterByBoolMask_8 = List.FilterByBoolMask(list=code_block_36, mask=code_block_37.out0)
filterByBoolMask_9 = List.FilterByBoolMask(list=code_block_37.out1, mask=code_block_37.out0)

# group: filter just WALLS and FLOORS
firstItem = List.FirstItem(list=filterByBoolMask_9.in@L2)
getCategory = Element.GetCategory(element=firstItem)
string_from_object_4 = FromObject(object=getCategory)
code_block_38 = CodeBlock { "Walls"; "Floors"; }
eq_3 = string_from_object_4 == code_block_38.out0

eq_4 = string_from_object_4 == code_block_38.out1
or_ = eq_4 || eq_3

# group (continued): filter just WALLS and FLOORS
filterByBoolMask_10 = List.FilterByBoolMask(list=filterByBoolMask_8.in, mask=or_)
filterByBoolMask_11 = List.FilterByBoolMask(list=firstItem, mask=or_)

code_block_39 = CodeBlock { "Description"; "Typ_Konstrukcie"; }
elementType_2 = Element.ElementType(element=filterByBoolMask_11.in)

# group: setting - Typ_Konstrukcie parameter
getParameterValueByName_8 = Element.GetParameterValueByName(element=elementType_2, parameterName=code_block_39.out0)
setParameterByName_9 = Element.SetParameterByName(element=filterByBoolMask_10.in, parameterName=code_block_39.out1, value=getParameterValueByName_8)

# group: eraser - Typ_Konstrukcie parameter
code_block_40 = CodeBlock { ""; }
setParameterByName_10 = Element.SetParameterByName(element=filterByBoolMask_10.out, parameterName=code_block_39.out1, value=code_block_40)

code_block_41 = CodeBlock { "AutoMarkPrierazy&Offset"; }
usageLog = Custom[usageLog](scriptName=code_block_41)  # package cata_lyst; node logs every run of the script in which is used to the hardcoded server location
