# Dynamo graph daluxNameGenerator.dyn (Dynamo 2.12.0.5650)

categories = Categories("OST_Sheets")
all_elements_of_category = ElementsOfCategory(Category=categories)
code_block = CodeBlock { "Delenie"; }
getParameterValueByName = Element.GetParameterValueByName(element=all_elements_of_category, parameterName=code_block)
code_block_2 = CodeBlock { "RP"; }
eq = getParameterValueByName == code_block_2
filterByBoolMask = List.FilterByBoolMask(list=all_elements_of_category, mask=eq)
code_block_3 = CodeBlock { "Dalux Name"; }
code_block_4 = CodeBlock { "Stavebný objekt_Ozn."; }
getParameterValueByName_2 = Element.GetParameterValueByName(element=filterByBoolMask.in, parameterName=code_block_4)
code_block_5 = CodeBlock { "Level Investor"; }
getParameterValueByName_3 = Element.GetParameterValueByName(element=filterByBoolMask.in, parameterName=code_block_5)
code_block_6 = CodeBlock { "Typ dokumentu"; }
getParameterValueByName_4 = Element.GetParameterValueByName(element=filterByBoolMask.in, parameterName=code_block_6)
code_block_7 = CodeBlock { "Typ výkresu"; }
getParameterValueByName_5 = Element.GetParameterValueByName(element=filterByBoolMask.in, parameterName=code_block_7)
code_block_8 = CodeBlock { "Sheet Number"; }
getParameterValueByName_6 = Element.GetParameterValueByName(element=filterByBoolMask.in, parameterName=code_block_8)
code_block_9 = CodeBlock { "Sheet Name"; }
getParameterValueByName_7 = Element.GetParameterValueByName(element=filterByBoolMask.in, parameterName=code_block_9)
code_block_10 = CodeBlock(SO=getParameterValueByName_2, poschodie=getParameterValueByName_3, typ_dokumentu=getParameterValueByName_4, typ_vykresu=getParameterValueByName_5, Sheet_number=getParameterValueByName_6, Sheet_name=getParameterValueByName_7) { "SK105_PAN_P3_"+SO+"_ZZZZ_"+poschodie+"_"+typ_dokumentu+"_A_"+typ_vykresu+"_"+Sheet_number+"_"+Sheet_name; }
setParameterByName = Element.SetParameterByName(element=filterByBoolMask.in, parameterName=code_block_3, value=code_block_10)
