# Dynamo graph doorRenumberingCO1sortByZ.dyn (Dynamo 2.12.1.8246)
# packages: cata_lyst 0.0.1

code_block = CodeBlock { "Doors"; }
byName = Category.ByName(name=code_block)
all_elements_of_category = ElementsOfCategory(Category=byName)

# group: INPUT
code_block_2 = CodeBlock { "Mark"; }
greater_equals_than = CodeBlock { 700; }
less_than = CodeBlock { 800; }
start_number = CodeBlock { 700; }

getParameterValueByName = Element.GetParameterValueByName(element=all_elements_of_category, parameterName=code_block_2)
toNumber = String.ToNumber(string=getParameterValueByName)
ge = toNumber >= greater_equals_than
lt = toNumber < less_than
and_ = ge && lt
filterByBoolMask = List.FilterByBoolMask(list=all_elements_of_category, mask=and_)

# group: sorting by Z coordinate
getLocation = Element.GetLocation(element=filterByBoolMask.in)
Z = Point.Z(point=getLocation)
sortByKey = List.SortByKey(list=filterByBoolMask.in, keys=Z)

count = List.Count(list=sortByKey.sortedList)
code_block_3 = CodeBlock(start=start_number, count=count) { start; start + count+1; 3; }
trailingZerosManual = Custom[trailingZerosManual](start=code_block_3.start, end=code_block_3.out1, numberOfDecimalPlaces=code_block_3.out2)  # package cata_lyst; adds specific number of trailing zeros to sequence of numbers, e. g. for numbering elements
setParameterByName = Element.SetParameterByName(element=sortByKey.sortedList, parameterName=code_block_2, value=trailingZerosManual)
code_block_4 = CodeBlock { "doorRenumberingCO1sortbyZ"; }
usageLog = Custom[usageLog](scriptName=code_block_4)  # package cata_lyst; node logs every run of the script in which is used to the hardcoded server location
menene_elementy = Watch(filterByBoolMask.in)  # graph output
