# Dynamo graph openingOrientationChecker.dyn (Dynamo 2.12.1.8246)
# packages: spring nodes 210.1.1

# group: Filter
# note: filtering elements

# group: Error handling
# note: Treating errors as hints to user what to do to avoid the error

# group: INPUT
návod = StringInput("nájde elementy- prierazy, ktore nie su otocene spravne, nie su rovnobezne so stenou ale kolmo na stenu a preto je vykaz rozmerov nespravny")  # graph input

# group: OUTPUT
# note: Place output for Dynamo Player
OUTPUT = Watch()  # graph output; unwired: arg0

ꟿ_element_iscutting = Custom[ꟿ Element.IsCutting]()  # frozen; package spring nodes; Tests if the input element (or elements) is a void cut and if it is cutting any elements. In such cases, the cut elements will be provided.; unwired: element
code_block = CodeBlock { "Generic Models"; }
byName = Category.ByName(name=code_block)
all_elements_of_category = ElementsOfCategory(Category=byName)

# group: FILTER vykaz kategoria = PRIERAZY
elementType = Element.ElementType(element=all_elements_of_category)
code_block_2 = CodeBlock { "Výkaz kategória"; }
getParameterValueByName = Element.GetParameterValueByName(element=elementType, parameterName=code_block_2)
code_block_3 = CodeBlock { "PRIERAZY"; }
eq = getParameterValueByName == code_block_3
filterByBoolMask = List.FilterByBoolMask(list=all_elements_of_category, mask=eq)

# group: el.is cutting?
python_script = Python(IN[0]=filterByBoolMask.in)  # IronPython2
# ---------- python_script.python (44 lines) ----------
import clr

clr.AddReference("RevitServices")
import RevitServices
from RevitServices.Persistence import DocumentManager
doc = DocumentManager.Instance.CurrentDBDocument

clr.AddReference("RevitAPI")
from Autodesk.Revit.DB import *

clr.AddReference("RevitNodes")
import Revit
clr.ImportExtensions(Revit.Elements)

def tolist(obj1):
	if hasattr(obj1,"__iter__"): return obj1
	else: return [obj1]

elements = UnwrapElement(tolist(IN[0]))
out1 = []
cut_el = []
filt_elems = []

cutU = InstanceVoidCutUtils
for i in xrange(len(elements)):
	try:
		if cutU.IsVoidInstanceCuttingElement(elements[i]):
			cut1 = cutU.GetElementsBeingCut(elements[i])
			if cut1.Count != 0:
				cut1 = [doc.GetElement(id).ToDSType(True) for id in cut1]
				out1.append(True)
				cut_el.append(cut1)
				filt_elems.append(elements[i])
			else:
				out1.append(False)
				cut_el.append([])
		else:
			out1.append(False)
			cut_el.append([])
	except:
		out1.append(False)
		cut_el.append([])		

OUT = out1, cut_el, filt_elems
# ----------------------------------------
code_block_4 = CodeBlock(res=python_script) { res[0]; res[1]; }

filterByBoolMask_2 = List.FilterByBoolMask(list=filterByBoolMask.in, mask=code_block_4.out0)
filterByBoolMask_3 = List.FilterByBoolMask(list=code_block_4.out1, mask=code_block_4.out0)

# group: filter just WALLS and openings in walls
firstItem = List.FirstItem(list=filterByBoolMask_3.in@L2)
getCategory = Element.GetCategory(element=firstItem)
string_from_object = FromObject(object=getCategory)
code_block_5 = CodeBlock { "Walls"; }

eq_2 = string_from_object == code_block_5

# group (continued): filter just WALLS and openings in walls
filterByBoolMask_4 = List.FilterByBoolMask(list=filterByBoolMask_2.in, mask=eq_2)
filterByBoolMask_5 = List.FilterByBoolMask(list=firstItem, mask=eq_2)

# group: wall and opening orientation
python_script_2 = Python(IN[0]=filterByBoolMask_5.in)  # IronPython2
# ---------- python_script_2.python (28 lines) ----------
import clr
clr.AddReference('RevitAPI')
from Autodesk.Revit.DB import *

clr.AddReference("RevitNodes")
import Revit
clr.ImportExtensions(Revit.Elements)
clr.ImportExtensions(Revit.GeometryConversion)

def WallOrientation(wall):
	loc = wall.Location
	flipped = False
	if hasattr(loc, "Curve"):
		lcurve = loc.Curve
		if hasattr(wall, "Flipped"): flipped = wall.Flipped
		if str(type(lcurve)) == "Autodesk.Revit.DB.Line":
			if flipped: return wall.Orientation.ToVector().Reverse()
			else: return wall.Orientation.ToVector()
		else:
			direction = (lcurve.GetEndPoint(1) - lcurve.GetEndPoint(0)).Normalize()
			if flipped: return XYZ.BasisZ.CrossProduct(direction).ToVector().Reverse()
			else: return XYZ.BasisZ.CrossProduct(direction).ToVector()
	else: return None

walls = UnwrapElement(IN[0])

if isinstance(IN[0], list): OUT = [WallOrientation(x) for x in walls]
else: OUT = WallOrientation(walls)
# ----------------------------------------
facingOrientation = FamilyInstance.FacingOrientation(familyInstance=filterByBoolMask_4.in)
ZAxis = Vector.ZAxis()
angleAboutAxis = Vector.AngleAboutAxis(vector=python_script_2, otherVector=facingOrientation, rotationAxis=ZAxis)

# group: filtering just 0 and 180 degree vectors as OK
code_block_6 = CodeBlock { 5; }
code_block_7 = CodeBlock(tolerance=code_block_6) { 360-tolerance; }
lt = angleAboutAxis < code_block_7
code_block_8 = CodeBlock(tolerance=code_block_6) { 180+tolerance; }
gt = angleAboutAxis > code_block_8
code_block_9 = CodeBlock(tolerance=code_block_6) { 180-tolerance; }
lt_2 = angleAboutAxis < code_block_9
gt_2 = angleAboutAxis > code_block_6
and_ = lt_2 && gt_2
or_ = gt || and_
and_2 = lt && or_

filterByBoolMask_6 = List.FilterByBoolMask(list=filterByBoolMask_4.in, mask=and_2)
code_block_10 = CodeBlock { "Comments"; }
filterByBoolMask_7 = List.FilterByBoolMask(list=angleAboutAxis, mask=and_2)
string_from_object_2 = FromObject(object=filterByBoolMask_7.in)
setParameterByName = Element.SetParameterByName(element=filterByBoolMask_6.in, parameterName=code_block_10, value=string_from_object_2)
code_block_11 = CodeBlock { ""; }
setParameterByName_2 = Element.SetParameterByName(element=filterByBoolMask_6.out, parameterName=code_block_10, value=code_block_11)  # frozen
