# Dynamo graph prekladyCO1.dyn (Dynamo 2.12.1.8246)
# packages: Clockwork for Dynamo 2.x 2.1.2

# group: INPUT
návod = StringInput("""Vsetkym dveram v projekte v murovanych stenach prida informáciu, že je v nich preklad preklady. Je mozne nastavit vynimku.

Skript je adaptovany len pre projekt CO1""")  # graph input
nedávať_preklad_na_dvere_s_type = StringInput("xxx")  # "Nedávať preklad na dvere s Type Mark:"; graph input
parameter_name = StringInput("Výkaz podkategória")  # graph input
parameter_value = StringInput("MUROVANÉ STENY")  # graph input

code_block = CodeBlock { "Doors"; }
byName = Category.ByName(name=code_block)
all_elements_of_category = ElementsOfCategory(Category=byName)

# group: Filter by Door parameter
type = Custom[Element.Type](element=all_elements_of_category)  # package Clockwork for Dynamo 2.x; Gets the family type of a given element (if applicable). Unlike the OOTB node, it also works for elements in linked models.
code_block_2 = CodeBlock { "Type Mark"; }
parameterByName = Parameter.ParameterByName(element=type, name=code_block_2)
string_from_object = FromObject(obj=parameterByName)
contains = String.Contains(string=string_from_object, searchFor=nedávať_preklad_na_dvere_s_type)
filterByBoolMask = List.FilterByBoolMask(list=all_elements_of_category, mask=contains)

# group: Filter by Wall parameter
host = Custom[Element.Host](element=filterByBoolMask.out)  # package Clockwork for Dynamo 2.x; Gets an element's host. Unlike the OOTB node FamilyInstance.GetHost it not only works for family instances but also for elements like wall sweeps, foundations, railings, builing pads and topo subregions.
type_2 = Custom[Element.Type](element=host)
parameterByName_2 = Parameter.ParameterByName(element=type_2, name=parameter_name)
string_from_object_2 = FromObject(obj=parameterByName_2)
contains_2 = String.Contains(string=string_from_object_2, searchFor=parameter_value)
filterByBoolMask_2 = List.FilterByBoolMask(list=filterByBoolMask.out, mask=contains_2)
filterByBoolMask_3 = List.FilterByBoolMask(list=type_2, mask=contains_2)

code_block_3 = CodeBlock { "Preklad"; }
code_block_4 = CodeBlock { "preklad"; "bez prekladu"; }
setParameterByName = Element.SetParameterByName(element=filterByBoolMask_2.in, parameterName=code_block_3, value=code_block_4.out0)
count = List.Count(list=setParameterByName)
setParameterByName_2 = Element.SetParameterByName(element=filterByBoolMask_2.out, parameterName=code_block_3, value=code_block_4.out1)
count_2 = List.Count(list=setParameterByName_2)

# group: OUTPUT
počet_dverí_ktorým_skript = Watch(count)  # "Počet dverí, ktorým skript nastavil preklad"; graph output
počet_dverí_ktorým_skript_2 = Watch(count_2)  # "Počet dverí, ktorým skript nastavil, že nemajú preklad"; graph output

code_block_5 = CodeBlock { "Wall Width"; }

# group: Door Width
code_block_6 = CodeBlock { "Width"; }
parameterByName_3 = Parameter.ParameterByName(element=filterByBoolMask_3.in, name=code_block_6)
string_from_object_3 = FromObject(object=parameterByName_3)

# group: cut string
code_block_7 = CodeBlock { 0; 8; }
remove = String.Remove(string=string_from_object_3, startIndex=code_block_7.out0, count=code_block_7.out1)

setParameterByName_3 = Element.SetParameterByName(element=filterByBoolMask_2.in, parameterName=code_block_5, value=remove)
