# Dynamo graph spotElevations.dyn (Dynamo 2.12.1.8246)
# packages: Clockwork for Dynamo 2.x 2.4.0

select_model_elements = DSModelElementsSelection()  # 1 picked in the model
geometry = Element.Geometry(element=select_model_elements)
flatten = List.Flatten(list=geometry)
byUnion = Solid.ByUnion(solids=flatten)
code_block = CodeBlock { 0..10000..1000; }
code_block_2 = CodeBlock { 0; }
byCoordinates = Point.ByCoordinates(x=code_block, y=code_block, z=code_block_2, lacing=CrossProduct)
ZAxis = Vector.ZAxis()
code_block_3 = CodeBlock { 50000; }
byStartPointDirectionLength = Line.ByStartPointDirectionLength(startPoint=byCoordinates, direction=ZAxis, length=code_block_3)
intersect = Geometry.Intersect(geometry=byUnion, other=byStartPointDirectionLength, lacing=Longest)
endPoint = Curve.EndPoint(curve=intersect)
flatten_2 = List.Flatten(list=endPoint)
current = Document.Current()
activeView = Document.ActiveView(document=current)
code_block_4 = CodeBlock { 2000; }
byCoordinates_2 = Vector.ByCoordinates(x=code_block_4, y=code_block_4)
byCoordinates_3 = Vector.ByCoordinates(y=code_block_4)
byPoint = Custom[SpotElevation.ByPoint](point=flatten_2, view=activeView, bend=byCoordinates_2, end=byCoordinates_3)  # package Clockwork for Dynamo 2.x; Places a spot elevation at a given point in a given view. May not work in all view types.
byCoordinates_4 = Point.ByCoordinates()
