# Dynamo graph spotElevationsLandscapeCO1.dyn (Dynamo 2.12.1.8246)
# packages: Clockwork for Dynamo 2.x 2.4.0, archi-lab.net 2023.213.1523

# group: filtering out just floors in specific workset
code_block = CodeBlock { "Floors"; }
byName = Category.ByName(name=code_block)
all_elements_of_category = ElementsOfCategory(Category=byName)
code_block_2 = CodeBlock { "Workset"; }
getParameterValueByName = Element.GetParameterValueByName(element=all_elements_of_category, parameterName=code_block_2)
worksets = WorksetUi("LANDSCAPE")
id = archilab.Revit.Elements.Workset.Id(workset=worksets)
eq = getParameterValueByName == id
filterByBoolMask = List.FilterByBoolMask(list=all_elements_of_category, mask=eq)

geometry = Element.Geometry(element=filterByBoolMask.in)
flatten = List.Flatten(list=geometry)
byUnion = Solid.ByUnion(solids=flatten)  # frozen
code_block_3 = CodeBlock { 0..10000..500; }
byCoordinates = Point.ByCoordinates(x=code_block_3, y=code_block_3, lacing=CrossProduct)
ZAxis = Vector.ZAxis()
code_block_4 = CodeBlock { 10000; }
byStartPointDirectionLength = Line.ByStartPointDirectionLength(startPoint=byCoordinates, direction=ZAxis, length=code_block_4)
intersect = Geometry.Intersect(geometry=byUnion, other=byStartPointDirectionLength, lacing=Longest)
endPoint = Curve.EndPoint(curve=intersect)
flatten_2 = List.Flatten(list=endPoint)
current = Document.Current()
activeView = Document.ActiveView(document=current)
code_block_5 = CodeBlock { 2000; }
byCoordinates_2 = Vector.ByCoordinates(x=code_block_5, y=code_block_5)
byCoordinates_3 = Vector.ByCoordinates(y=code_block_5)
byPoint = Custom[SpotElevation.ByPoint](point=flatten_2, view=activeView, bend=byCoordinates_2, end=byCoordinates_3)  # frozen; package Clockwork for Dynamo 2.x; Places a spot elevation at a given point in a given view. May not work in all view types.
byCoordinates_4 = Point.ByCoordinates()
geometry_2 = Custom[Element.Geometry+](element=filterByBoolMask.in)  # package Clockwork for Dynamo 2.x; Returns Dynamo AND native Revit geometry of a given element
