# Dynamo graph deleteAllViewsExcept_p.dyn (Dynamo 2.6.1.8786)
# packages: Clockwork for Dynamo 2.x 2.1.2, spring nodes 203.1.0, cata_lyst 0.0.1

code_block = CodeBlock { null; }
views = Custom[Document.Views](docOrRevitLinkInstance=code_block)  # package Clockwork for Dynamo 2.x; Gets all views in the document - except for 3D view templates (as long as this bug is not fixed: https://github.com/DynamoDS/Dynamo/issues/2970)

# group: INPUT
parameter_name = StringInput("Delenie")  # graph input
parameter_values = StringInput("01_Main floorplans")  # graph input

getParameterValueByName = Element.GetParameterValueByName(element=views, parameterName=parameter_name)
eq = getParameterValueByName == parameter_values
filterByBoolMask = List.FilterByBoolMask(list=views, mask=eq)
boolean = BoolSelector(true)
deleteElements = Custom[Springs.Doc.DeleteElements](element=filterByBoolMask.out, confirm=boolean)  # package spring nodes; Attempts to delete the input list of elements from the active Revit document.The node returns the number of successfully deleted elements and their Ids as a string. Carefully observe the deleted elements count. It may be greater than the input list because hosted elements or tags will be deleted as well. If an element in the list can not be deleted (for example last revision or last view), the whole list will fail to be deleted.
count = List.Count(list=deleteElements.failedIds_str)
počet_ponechaných_views = Watch(count)  # graph output
návod = StringInput("""Vymaže všetky Views (Floorplans, Sections, Details), Schedules, Legends, Sheets, linknuté dwg subory.
Nevymaže views, ktoré majú hodnou vybraného parametra rovnú zvolenej hodnote. 

Skript môže pri väčších projektoch s množstvom views pracovať dlhšie. 
Je potrebné mať nainštalovaný package Springs a Clockwork""")  # graph input
count_2 = List.Count(list=filterByBoolMask.out)
number = DoubleInput(-1)
code_block_2 = CodeBlock(a=count_2, b=number) { a+b; }
počet_vymazaných_views = Watch(code_block_2)  # graph output
počet_vymazaných_elementov = Watch(deleteElements.count)  # graph output
code_block_3 = CodeBlock { "deleteAllViewsExcept"; }
usageLog = Custom[usageLog](scriptName=code_block_3)  # package cata_lyst; node logs every run of the script in which is used to the hardcoded server location
