# Dynamo graph deleteAllViews_po.dyn (Dynamo 2.3.0.5885)
# packages: Clockwork for Dynamo 2.x 2.1.2, spring nodes 203.1.0

code_block = CodeBlock { null; }
views = Custom[Document.Views](docOrRevitLinkInstance=code_block)  # package Clockwork for Dynamo 2.x; Gets all views in the document - except for 3D view templates (as long as this bug is not fixed: https://github.com/DynamoDS/Dynamo/issues/2970)

# group: INPUT
ponechat_views_s_názvom = Views("{3D}")  # graph input

setDifference = List.SetDifference(list1=views, list2=ponechat_views_s_názvom)
boolean = BoolSelector(true)
deleteElements = Custom[Springs.Doc.DeleteElements](element=setDifference, confirm=boolean)  # package spring nodes; Attempts to delete the input list of elements from the active Revit document.The node returns the number of successfully deleted elements and their Ids as a string. Carefully observe the deleted elements count. It may be greater than the input list because hosted elements or tags will be deleted as well. If an element in the list can not be deleted (for example last revision or last view), the whole list will fail to be deleted.
count = List.Count(list=deleteElements.failedIds_str)
počet_ponechaných_views = Watch(count)  # graph output
návod = StringInput("""Vymaže všetky Views (Floorplans, Sections, Details), Schedules, Legends, Sheets, linknuté dwg subory.
Nevymaže 1 vybraný  a práve otvorený view. 

Skript môže pri väčších projektoch s množstvom views pracovať dlhšie. Pre rýchlejšie spracovanie na veľkých modeloch použite CustomTools.
Je potrebné mať nainštalovaný package Springs a Clockwork""")  # graph input
count_2 = List.Count(list=views)
number = DoubleInput(-1)
code_block_2 = CodeBlock(a=count_2, b=number) { a+b; }
počet_vymazaných_views = Watch(code_block_2)  # graph output
počet_vymazaných_elementov = Watch(deleteElements.count)  # graph output
py_log = Python()  # unwired: IN[0]
# ---------- py_log.python (37 lines) ----------
# Load the Python Standard and DesignScript Libraries
import sys
import clr
clr.AddReference('ProtoGeometry')
from Autodesk.DesignScript.Geometry import *
clr.AddReference("RevitServices")
import RevitServices
from RevitServices.Persistence import DocumentManager

from datetime import datetime
import getpass

# name of the script for log
log_string = "deleteAllViews"

doc = DocumentManager.Instance.CurrentDBDocument
filePath = doc.PathName

# getting file name from path
lastBackslash = filePath.rindex("\\")+1
file_name = filePath[lastBackslash:]
user_name = getpass.getuser()
datestamp = str(datetime.now())
# tabulator between data to easy import to excel schedule
separator = "\t"
line = datestamp + separator + log_string + separator + user_name + "\n"

try:
	f = open("L:\\customToolslogs\\dynLogs\\" + file_name +".log", "a")
	f.write(line)
	f.close()
	status = "log has been written"
except:
	status = "something went wrong"

# Assign your output to the OUT variable.
OUT = status
# ----------------------------------------
