# Dynamo graph deleteElementsFromSheets.dyn (Dynamo 2.3.1.11775)
# packages: spring nodes 204.1.0, archi-lab.net 2022.210.2218, cata_lyst 0.0.1

categories = Categories("OST_Sheets")
all_elements_of_category = ElementsOfCategory(Category=categories)

# group: INPUT
filter_parameter = StringInput("Delenie II")  # graph input
parameter_value = StringInput("04_Koncové prvky RP")  # graph input
category_of_deleted_elements = Categories("OST_ScheduleGraphics")  # graph input

getParameterValueByName = Element.GetParameterValueByName(element=all_elements_of_category, parameterName=filter_parameter)
eq = getParameterValueByName == parameter_value
filterByBoolMask = List.FilterByBoolMask(list=all_elements_of_category, mask=eq)
ꟿ_collect_elementsinview = Custom[ꟿ Collect.ElementsInView](view=filterByBoolMask.in, category=category_of_deleted_elements)  # package spring nodes; Selects all elements visible in the input view.
delete = archilab.Revit.Elements.Elements.Delete(element=ꟿ_collect_elementsinview)
count = List.Count(list=delete)
počet_vymazaných_elementov = Watch(count)  # graph output
návod = StringInput("Vymaže z vyfiltrovaných Views a zo Sheetov všetky elementy danej kategórie. Napríklad vymaže všetky Schedules alebo Text Notes")  # graph input
code_block = CodeBlock { "deleteElementsFromSheets"; }
usageLog = Custom[usageLog](scriptName=code_block)  # package cata_lyst; node logs every run of the script in which is used to the hardcoded server location
