# Dynamo graph detailItemLevel.dyn (Dynamo 2.12.1.8246)
# packages: archi-lab.net 2023.213.1523, Genius Loci 2022.4.19, cata_lyst 0.0.1

code_block = CodeBlock { "Detail Items"; }
byName = Category.ByName(name=code_block)
all_elements_of_category = ElementsOfCategory(Category=byName)

# group: INPUT
názov_family_začína_reťazcom = StringInput("DI_Orient")  # graph input

# group: filtering just family instances with certain name
getFamily = FamilyInstance.GetFamily(familyInstance=all_elements_of_category)
name = Family.Name(family=getFamily)
code_block_2 = CodeBlock { 0; }
length = String.Length(string=názov_family_začína_reťazcom)
substring = String.Substring(string=name, startIndex=code_block_2, length=length)
eq = substring == názov_family_začína_reťazcom

filterByBoolMask = List.FilterByBoolMask(list=all_elements_of_category, mask=eq)
code_block_3 = CodeBlock { "Podlažie"; }
ownerView = archilab.Revit.Elements.Elements.OwnerView(element=filterByBoolMask.in)
element_level = Custom[Element Level](element=ownerView)  # package Genius Loci; Gets an element's level. Based on a Clockwork's node
name_2 = Level.Name(level=element_level)
code_block_4 = CodeBlock { "N/A"; }
replaceNull = archilab.Lists.Lists.ReplaceNull(list=name_2, replacement=code_block_4)
setParameterByName = Element.SetParameterByName(element=filterByBoolMask.in, parameterName=code_block_3, value=replaceNull)
návod = StringInput("Do parametru Podlazie zapise nazov Levelu vsetkym Detail Items, ktore su umiestnene na podorysoch")  # graph input
code_block_5 = CodeBlock { "detailItemLevel"; }
usageLog = Custom[usageLog](scriptName=code_block_5)  # package cata_lyst; node logs every run of the script in which is used to the hardcoded server location
