# Dynamo graph disableAnalyticalModel_po.dyn (Dynamo 2.3.0.5885)

code_block = CodeBlock { "Structural Columns"; }
byName = Category.ByName(name=code_block)
all_elements_of_category = ElementsOfCategory(Category=byName)
code_block_2 = CodeBlock { "Floors"; }
byName_2 = Category.ByName(name=code_block_2)
all_elements_of_category_2 = ElementsOfCategory(Category=byName_2)
code_block_3 = CodeBlock { "Walls"; }
byName_3 = Category.ByName(name=code_block_3)
all_elements_of_category_3 = ElementsOfCategory(Category=byName_3)
list_create = List.Create(item0=all_elements_of_category, item1=all_elements_of_category_2, item2=all_elements_of_category_3)
flatten = List.Flatten(list=list_create)
string = StringInput("Enable Analytical Model")
parameterByName = Parameter.ParameterByName(element=flatten, name=string)

# group: removing Null values
code_block_4 = CodeBlock { null; }
eq = parameterByName == code_block_4
filterByBoolMask = List.FilterByBoolMask(list=flatten, mask=eq)
filterByBoolMask_2 = List.FilterByBoolMask(list=parameterByName, mask=eq)

# group: filter only elements with param == 1
value = Parameter.Value(parameter=filterByBoolMask_2.out)
flatten_2 = List.Flatten(list=value)
code_block_5 = CodeBlock { 1; }
eq_2 = flatten_2 == code_block_5
filterByBoolMask_3 = List.FilterByBoolMask(list=filterByBoolMask.out, mask=eq_2)

code_block_6 = CodeBlock { 0; }
setParameterByName = Element.SetParameterByName(element=filterByBoolMask_3.in, parameterName=string, value=code_block_6)
zmenené_elementy = Watch(setParameterByName)  # graph output
návod = StringInput("Vypne Analytical Model všetkým stenám, doskám a stĺpom")  # graph input
py_log = Python()  # unwired: IN[0]
# ---------- py_log.python (40 lines) ----------
# Load the Python Standard and DesignScript Libraries
import sys
import clr
clr.AddReference('ProtoGeometry')
from Autodesk.DesignScript.Geometry import *
clr.AddReference("RevitServices")
import RevitServices
from RevitServices.Persistence import DocumentManager

from datetime import datetime
import getpass

# name of the script for log
log_string = "disableAnalyticalModel"

doc = DocumentManager.Instance.CurrentDBDocument
filePath = doc.PathName

# getting file name from path
try:
	lastBackslash = filePath.rindex("\\")+1
except:
	lastBackslash = filePath.rindex("/")+1
file_name = filePath[lastBackslash:]
user_name = getpass.getuser()
datestamp = str(datetime.now())
# tabulator between data to easy import to excel schedule
separator = "\t"
line = datestamp + separator + log_string + separator + user_name + "\n"

try:
	f = open("L:\\customToolslogs\\dynLogs\\" + file_name +".log", "a")
	f.write(line)
	f.close()
	status = "log has been written"
except:
	status = "something went wrong"

# Assign your output to the OUT variable.
OUT = status
# ----------------------------------------
