# Dynamo graph door_flip_setter_p.dyn (Dynamo 2.3.0.5885)
# packages: archi-lab.net 2020.23.2

code_block = CodeBlock { "Doors"; }
byName = Category.ByName(name=code_block)
all_elements_of_category = ElementsOfCategory(Category=byName)

# group: INPUT
select_phase = RevitPhases()  # nothing selected; graph input
parameter_name = StringInput("Door Swing")  # graph input

door_set_handing = Custom[Door Set Handing](door=all_elements_of_category, phase=select_phase)  # package archi-lab.net; Determines door set handing (whether its a left or right handed door). Input takes doors, and output will split them into two lists (right and left).
watch = Watch(door_set_handing.rightHandedReversed)
návod = StringInput("Všetkým dverám v projekte zapise do parametru urcenom v \"Parameter Name\" značku P resp. L podľa toho či sú ľavé či pravé\n\nJe potrebne doinstalovat Package \"Achi-lab\"")  # graph input
code_block_2 = CodeBlock { "P"; }
setParameterByName = Element.SetParameterByName(element=door_set_handing.rightHanded, parameterName=parameter_name, value=code_block_2)
count = List.Count(list=setParameterByName)
code_block_3 = CodeBlock { "L"; }
setParameterByName_2 = Element.SetParameterByName(element=door_set_handing.leftHanded, parameterName=parameter_name, value=code_block_3)
count_2 = List.Count(list=setParameterByName_2)
code_block_4 = CodeBlock { "L"; }
setParameterByName_3 = Element.SetParameterByName(element=door_set_handing.rightHandedReversed, parameterName=parameter_name, value=code_block_4)
count_3 = List.Count(list=setParameterByName_3)
code_block_5 = CodeBlock { "P"; }
setParameterByName_4 = Element.SetParameterByName(element=door_set_handing.leftHandedReversed, parameterName=parameter_name, value=code_block_5)
count_4 = List.Count(list=setParameterByName_4)
code_block_6 = CodeBlock(a=count, b=count_2, c=count_3, d=count_4) { a+b+c+d; }
počet_upravených_dverí = Watch(code_block_6)  # graph output
py_log = Python()  # unwired: IN[0]
# ---------- py_log.python (40 lines) ----------
# Load the Python Standard and DesignScript Libraries
import sys
import clr
clr.AddReference('ProtoGeometry')
from Autodesk.DesignScript.Geometry import *
clr.AddReference("RevitServices")
import RevitServices
from RevitServices.Persistence import DocumentManager

from datetime import datetime
import getpass

# name of the script for log
log_string = "door_flip_setter"

doc = DocumentManager.Instance.CurrentDBDocument
filePath = doc.PathName

# getting file name from path
try:
	lastBackslash = filePath.rindex("\\")+1
except:
	lastBackslash = filePath.rindex("/")+1
file_name = filePath[lastBackslash:]
user_name = getpass.getuser()
datestamp = str(datetime.now())
# tabulator between data to easy import to excel schedule
separator = "\t"
line = datestamp + separator + log_string + separator + user_name + "\n"

try:
	f = open("L:\\customToolslogs\\dynLogs\\" + file_name +".log", "a")
	f.write(line)
	f.close()
	status = "log has been written"
except:
	status = "something went wrong"

# Assign your output to the OUT variable.
OUT = status
# ----------------------------------------
