# Dynamo graph export all schedules by name_p.dyn (Dynamo 2.3.0.5885)

element_types = ElementTypes("ViewSchedule")
all_elements_of_type = ElementsOfType(element_type=element_types)

# group: INPUT
view_name_starts_with = StringInput("PBI skladby")  # graph input
directory_path = Directory("C:\")  # graph input

# group: FILTER
code_block = CodeBlock { "View Name"; }
getParameterValueByName = Element.GetParameterValueByName(element=all_elements_of_type, parameterName=code_block)
startsWith = String.StartsWith(str=getParameterValueByName, searchFor=view_name_starts_with)
filterByBoolMask = List.FilterByBoolMask(list=all_elements_of_type, mask=startsWith)

name = Element.Name(element=filterByBoolMask.in)
code_block_2 = CodeBlock(FileName=name) { FileName + ".txt"; }
python_script = Python(IN[0]=filterByBoolMask.in, IN[1]=directory_path, IN[2]=code_block_2)
# ---------- python_script.python (18 lines) ----------
import clr
clr.AddReference("RevitAPI")
from Autodesk.Revit.DB import *

schedule_list = IN[0]
path = IN[1]
filename_list = IN[2]
result_list = []

for index, sched in enumerate(schedule_list):
	schedule = UnwrapElement(sched)
	filename = filename_list[index]
	try:
		export_options = ViewScheduleExportOptions()
		schedule.Export(path, filename, export_options)
		result_list.append("Schedule Exported ")
	except: result_list.append("Failure ")
OUT = result_list
# ----------------------------------------
status = Watch(python_script)
watch = Watch(name)
návod = StringInput("Vyexportuje vsetky tabulky zacinajuce danym retazcom do samostatnych txt suborov do urceneho folderu.")  # graph input
py_log = Python()  # unwired: IN[0]
# ---------- py_log.python (37 lines) ----------
# Load the Python Standard and DesignScript Libraries
import sys
import clr
clr.AddReference('ProtoGeometry')
from Autodesk.DesignScript.Geometry import *
clr.AddReference("RevitServices")
import RevitServices
from RevitServices.Persistence import DocumentManager

from datetime import datetime
import getpass

# name of the script for log
log_string = "export all schedules by name"

doc = DocumentManager.Instance.CurrentDBDocument
filePath = doc.PathName

# getting file name from path
lastBackslash = filePath.rindex("\\")+1
file_name = filePath[lastBackslash:]
user_name = getpass.getuser()
datestamp = str(datetime.now())
# tabulator between data to easy import to excel schedule
separator = "\t"
line = datestamp + separator + log_string + separator + user_name + "\n"

try:
	f = open("L:\\customToolslogs\\dynLogs\\" + file_name +".log", "a")
	f.write(line)
	f.close()
	status = "log has been written"
except:
	status = "something went wrong"

# Assign your output to the OUT variable.
OUT = status
# ----------------------------------------
