# Dynamo graph findDWG_p.dyn (Dynamo 2.3.0.5885)
# packages: Clockwork for Dynamo 2.x 2.1.2

# group: INPUT
file_path_of_xls_output = Filename(".\listOfDWGs.xlsx")  # graph input

code_block = CodeBlock { "listOfDWGs"; 0; }
code_block_2 = CodeBlock { "CAD link name"; }
element_types = ElementTypes("ImportInstance")
all_elements_of_type = ElementsOfType(element_type=element_types)
parameters = Element.Parameters(element=all_elements_of_type)
name = Parameter.Name(parameter=parameters)
code_block_3 = CodeBlock { "Shared Site"; }
contains = List.Contains(list=name, item=code_block_3, lacing=Longest)
filterByBoolMask = List.FilterByBoolMask(list=all_elements_of_type, mask=contains)
code_block_4 = CodeBlock { "Name"; }
getParameterValueByName = Element.GetParameterValueByName(element=filterByBoolMask.in, parameterName=code_block_4)
addItemToFront = List.AddItemToFront(item=code_block_2, list=getParameterValueByName)
code_block_5 = CodeBlock { "View Name"; }
ownerView = Custom[Element.OwnerView](element=filterByBoolMask.in)  # package Clockwork for Dynamo 2.x; Gets the owner view of a given Revit element (if possible)
string_from_object = FromObject(obj=ownerView)
addItemToFront_2 = List.AddItemToFront(item=code_block_5, list=string_from_object)
list_create = List.Create(item0=addItemToFront, item1=addItemToFront_2)
transpose = List.Transpose(lists=list_create)
overWrite = BoolSelector(true)  # graph input
exportExcel = Data.ExportExcel(filePath=file_path_of_xls_output, sheetName=code_block.out0, startRow=code_block.out1, startCol=code_block.out1, data=transpose, overWrite=overWrite)
návod = StringInput("Vyhľadá všetky výskyty nalinkovaných DWG. Vyexportuje excelovskú tabuľku s názvom DWG súboru a názvom View, na ktorom je umiestnený jeho Instance. Následne je možné tento View vyhľadať.")  # graph input
py_log = Python()  # unwired: IN[0]
# ---------- py_log.python (37 lines) ----------
# Load the Python Standard and DesignScript Libraries
import sys
import clr
clr.AddReference('ProtoGeometry')
from Autodesk.DesignScript.Geometry import *
clr.AddReference("RevitServices")
import RevitServices
from RevitServices.Persistence import DocumentManager

from datetime import datetime
import getpass

# name of the script for log
log_string = "findDWG"

doc = DocumentManager.Instance.CurrentDBDocument
filePath = doc.PathName

# getting file name from path
lastBackslash = filePath.rindex("\\")+1
file_name = filePath[lastBackslash:]
user_name = getpass.getuser()
datestamp = str(datetime.now())
# tabulator between data to easy import to excel schedule
separator = "\t"
line = datestamp + separator + log_string + separator + user_name + "\n"

try:
	f = open("L:\\customToolslogs\\dynLogs\\" + file_name +".log", "a")
	f.write(line)
	f.close()
	status = "log has been written"
except:
	status = "something went wrong"

# Assign your output to the OUT variable.
OUT = status
# ----------------------------------------
