# Dynamo graph floorOnTopo_p.dyn (Dynamo 2.3.0.5885)
# packages: Clockwork for Dynamo 2.x 2.1.2, spring nodes 203.1.0, archi-lab.net 2020.23.2

# group: INPUT
select_topography = DSModelElementSelection()  # nothing selected; graph input
select_floor_to_match_topography = DSModelElementSelection()  # nothing selected; graph input
offset = DoubleSlider(45, range=0..100 step 5)  # graph input

mesh = Topography.Mesh(topography=select_topography)
code_block = CodeBlock { true; 1; }
toPolySurface = Custom[Springs.Mesh.ToPolySurface](mesh=mesh, mergeAll=code_block.out0, NUMTHREADS=code_block.out1)  # package spring nodes; Converts a Dynamo mesh to a polysurface. By default the node is single threaded, but if you specify a higher number of threads in the `NUMTHREAD` input, the node will run multi-threaded to speed up the conversion. *WARNING* Using multi-threaded code with Dynamo's geometry kernel may crash Revit in some cases.

# group: sketch lines collector
boolean = BoolSelector(true)
elementSketch = Custom[Springs.Collector.ElementSketch](element=select_floor_to_match_topography, fetchModelCurves=boolean)  # package spring nodes; Get the actual sketch lines of a sketch based element (floor, ceiling, modified wall, etc.) . You can optionally fetch the matching model curves, however this might prove comptationally heavy on larger data sets. Does not work with elements from linked files.
curve = CurveElement.Curve(curveElement=elementSketch.model_curves)
endPoint = Curve.EndPoint(curve=curve)
startPoint = Curve.StartPoint(curve=curve)
create = List.Create(item0=endPoint, item1=startPoint)
flatten = List.Flatten(list=create)
uniqueItems = List.UniqueItems(list=flatten)

# group: get max height of topography
faceVertices = Custom[Mesh.FaceVertices](mesh=mesh)  # package Clockwork for Dynamo 2.x; Gets the vertices of each face of a given mesh
X = Point.X(point=faceVertices)

flatten_2 = List.Flatten(list=X)

# group (continued): get max height of topography
maximumItem = List.MaximumItem(list=flatten_2)

# group: vertical lines to intersect
X_2 = Point.X(point=uniqueItems)
Y = Point.Y(point=uniqueItems)
code_block_2 = CodeBlock(maxheight=maximumItem) { maxheight; -1*maxheight; }
byCoordinates = Point.ByCoordinates(x=X_2, y=Y, z=code_block_2.maxheight)
byCoordinates_2 = Point.ByCoordinates(x=X_2, y=Y, z=code_block_2.out1)
byStartPointEndPoint = Line.ByStartPointEndPoint(startPoint=byCoordinates, endPoint=byCoordinates_2)

flatten_3 = List.Flatten(list=byStartPointEndPoint)
intersect = Geometry.Intersect(geometry=toPolySurface, other=flatten_3)
flatten_4 = List.Flatten(list=intersect)
clear_list = Custom[Clear List](input=flatten_4)  # package archi-lab.net; This node will remove all Null and Empty Lists from any list.
points = Topography.Points(topography=select_topography)
join = List.Join(list0=clear_list, list1=points)

# group: floor Z-axis elevation
X_3 = Point.X(point=join)
Y_2 = Point.Y(point=join)
Z = Point.Z(point=join)
code_block_3 = CodeBlock(a=Z, offset=offset) { a+offset; }
byCoordinates_3 = Point.ByCoordinates(x=X_3, y=Y_2, z=code_block_3)

slabShapeByPoints = Custom[Floor.SlabShapeByPoints](points=byCoordinates_3, floor=select_floor_to_match_topography)  # package Clockwork for Dynamo 2.x; Transform a slab shape based on a list of Points
points_of_floor_sketch = Watch(clear_list)
návod = StringInput("""Prispôsobí tvar Floor tvaru Topography. Je možné určiť offset od Topography

Je potrebné mať nainštalovaný package Springs.""")  # graph input
py_log = Python()  # unwired: IN[0]
# ---------- py_log.python (40 lines) ----------
# Load the Python Standard and DesignScript Libraries
import sys
import clr
clr.AddReference('ProtoGeometry')
from Autodesk.DesignScript.Geometry import *
clr.AddReference("RevitServices")
import RevitServices
from RevitServices.Persistence import DocumentManager

from datetime import datetime
import getpass

# name of the script for log
log_string = "floorOnTopo"

doc = DocumentManager.Instance.CurrentDBDocument
filePath = doc.PathName

# getting file name from path
try:
	lastBackslash = filePath.rindex("\\")+1
except:
	lastBackslash = filePath.rindex("/")+1
file_name = filePath[lastBackslash:]
user_name = getpass.getuser()
datestamp = str(datetime.now())
# tabulator between data to easy import to excel schedule
separator = "\t"
line = datestamp + separator + log_string + separator + user_name + "\n"

try:
	f = open("L:\\customToolslogs\\dynLogs\\" + file_name +".log", "a")
	f.write(line)
	f.close()
	status = "log has been written"
except:
	status = "something went wrong"

# Assign your output to the OUT variable.
OUT = status
# ----------------------------------------
