# Dynamo graph floorSplitterManualSlope_p.dyn "floorSplitterV5_p" (Dynamo 2.12.1.8246)
# packages: Clockwork for Dynamo 2.x 2.4.0, cata_lyst 0.0.1, spring nodes 210.1.1

# group: INPUT
delete_original_floor = BoolSelector(false)  # graph input
select_sloped_floor = DSModelElementSelection()  # 1 picked in the model; graph input
swap_slope_arrow_direction = BoolSelector(false)  # graph input
select_slope_arrow = DSModelElementSelection()  # 1 picked in the model; graph input
spád_v_percentách = DoubleSlider(5, range=0..100 step 0.5)  # graph input

code_block = CodeBlock { None; }  # unwired: None
code_block_2 = CodeBlock { true; }
level = Custom[Element.Level](element=select_sloped_floor)  # package Clockwork for Dynamo 2.x; Gets an element's level

# group: slope arrow vector & swap
curve = CurveElement.Curve(curveElement=select_slope_arrow)
endPoint = Curve.EndPoint(curve=curve)
startPoint = Curve.StartPoint(curve=curve)
byTwoPoints = Vector.ByTwoPoints(start=endPoint, end=startPoint)
startPoint_2 = Curve.StartPoint(curve=curve)
endPoint_2 = Curve.EndPoint(curve=curve)
byTwoPoints_2 = Vector.ByTwoPoints(start=startPoint_2, end=endPoint_2)
if_ = RefactoredIf(test=swap_slope_arrow_direction, true=byTwoPoints, false=byTwoPoints_2)

elementType = Element.ElementType(element=select_sloped_floor)

# group: create floors
ꟿ_collect_elementsketch = Custom[ꟿ Collect.ElementSketch](element=select_sloped_floor, fetchModelCurves=code_block_2)  # package spring nodes; Get the actual sketch lines of a sketch based element (floor, ceiling, modified wall, etc.) . You can optionally fetch the matching model curves, however this might prove comptationally heavy on larger data sets. Does not work with elements from linked files.
code_block_3 = CodeBlock { 1; }
flatten = List.Flatten(list=ꟿ_collect_elementsketch.curves, amount=code_block_3)
code_block_4 = CodeBlock(level=level) { level; }
code_block_5 = CodeBlock(a=spád_v_percentách) { a/100; }
code_block_6 = CodeBlock(floor_type=elementType) { floor_type; }
py_sloped_floor_creator = Python(IN[0]=flatten, IN[1]=code_block_4, IN[2]=if_, IN[3]=code_block_5, IN[4]=code_block_6, IN[5]=startPoint_2)  # IronPython2
# ---------- py_sloped_floor_creator.python (38 lines) ----------
import clr #imports the common language runtime to the Iron Python environment
clr.AddReference('RevitAPI') #adds the Revit API library to the CLR
from Autodesk.Revit.DB import Floor, CurveArray #imports the Floor and Curve array modules to the Iron Python environment
clr.AddReference('RevitNodes') #adds the DynamoForRevit library to the CLR
import Revit #imports the Dynamo for Revit module to the Iron Python environment
clr.ImportExtensions(Revit.GeometryConversion) #imports the geometry conversion module to the Iron Python environment
clr.AddReference('RevitServices') #adds the Revit services module to the CLR
import RevitServices #imports the Revit services module to the Iron Python environment
from RevitServices.Persistence import DocumentManager #imports the Revit DocumentManager to the Iron Python Environment
from RevitServices.Transactions import TransactionManager #imports the Revit TransactionManager to the Iron Python environment

clr.AddReference('ProtoGeometry') #addds the geometry library to the CLR
from Autodesk.DesignScript.Geometry import * #imports the dynamo geometry library to the Iron Python environment

doc = DocumentManager.Instance.CurrentDBDocument #sets the doc variable to the current document
outlineLoops = IN[0] #sets the outlineLoop variable to the contents of IN[0] from the Dynamo environment
level = UnwrapElement(IN[1]) #unwraps the contents of IN[1] from the Dynamo environment so it can be used in the Revit API directly and sets the result to the level variable 
slopeVector = IN[2] #converts the contents of IN[2] to the associated Revit content and sets the result to the slopeLine variable 
slope = IN[3] #sets the slope variable to the contents of IN[2] from the Dynamo environment
floorType = UnwrapElement(IN[4]) #unwraps the contents of IN[4] from the Dynamo environment so it can be used int he Revit API directly, and sets the result to the floorType variable
slopeStart = IN[5]


TransactionManager.Instance.EnsureInTransaction(doc) #starts a new transaction so we can modify the document in the doc variable
floors = []
slopeLine = Line.ByStartPointDirectionLength(slopeStart,slopeVector,1000).ToRevitType() #builds a new line 10 unit long line from the average start point on the given vector and converts to a Revit line to use in the floor creation

for loop in outlineLoops:
	ca = CurveArray() #sets a new curve array as an empty CurveArray
	for c in loop: #for each curve int he outlineLoop, perform the offset action below
	   ca.Append(c.ToRevitType()) #converts the curve to the associated Revit type, and appends it to the curve ca variable

	floor = doc.Create.NewSlab(ca, level, slopeLine, slope, True) #creates a new floor in the document stored in the doc variable, using the ca, level, slopeLine, and slope variable, and setting the 'is structural' override to true, setting the result to the floor variable
	floor.FloorType = floorType #sets the floor type to the contents of the floorType variable
	floors.append(floor)
	TransactionManager.Instance.TransactionTaskDone() #closes the Revit transaction

OUT = floors #sends the contents of the floor variable to the Dynamo environment
# ----------------------------------------

code_block_7 = CodeBlock { "Height Offset From Level"; }
getParameterValueByName = Element.GetParameterValueByName(element=select_sloped_floor, parameterName=code_block_7)
setParameterByName = Element.SetParameterByName(element=py_sloped_floor_creator, parameterName=code_block_7, value=getParameterValueByName)
code_block_8 = CodeBlock { "Workset"; }
getParameterValueByName_2 = Element.GetParameterValueByName(element=select_sloped_floor, parameterName=code_block_8)
setParameterByName_2 = Element.SetParameterByName(element=py_sloped_floor_creator, parameterName=code_block_8, value=getParameterValueByName_2)
passthrough = Custom[Passthrough](passThrough=setParameterByName, waitFor=setParameterByName_2)  # package Clockwork for Dynamo 2.x; Forces a sequential order of execution. The node wired into the output of the Passthrough node will be executed *after* the node wired into the waitFor input (e.g. important for some Revit operations). The value of the passThrough input will be passed on to the node wired into the output port of the Passthrough node.

# group: delete original floor
if_2 = RefactoredIf(test=delete_original_floor, true=select_sloped_floor, false=code_block)
passthrough_2 = Custom[Passthrough](passThrough=if_2, waitFor=passthrough)
delete = Element.Delete(element=passthrough_2)

návod = StringInput("""Rozdelí Floors, ktoré sú nakreslené ako multiple sketch do samostatných Instances. 

Obmedzenia:
- Nevytvorí Floors s otvormi, či definované so Splines v ich Boundary

Je potrebné mať nainštalované packages...""")  # graph input
code_block_9 = CodeBlock { "floorSplitter_p"; }
usageLog = Custom[usageLog](scriptName=code_block_9)  # package cata_lyst; node logs every run of the script in which is used to the hardcoded server location
py_sloped_floor_creator_2 = Python(IN[0]=flatten, IN[1]=code_block_4, IN[2]=if_, IN[3]=code_block_5, IN[4]=code_block_6, IN[5]=startPoint_2)  # IronPython2; frozen
# ---------- py_sloped_floor_creator_2.python (59 lines) ----------
import clr #imports the common language runtime to the Iron Python environment
clr.AddReference('RevitAPI') #adds the Revit API library to the CLR
from Autodesk.Revit.DB import Floor, CurveArray #imports the Floor and Curve array modules to the Iron Python environment
clr.AddReference('RevitNodes') #adds the DynamoForRevit library to the CLR
import Revit #imports the Dynamo for Revit module to the Iron Python environment
clr.ImportExtensions(Revit.GeometryConversion) #imports the geometry conversion module to the Iron Python environment
clr.AddReference('RevitServices') #adds the Revit services module to the CLR
import RevitServices #imports the Revit services module to the Iron Python environment
from RevitServices.Persistence import DocumentManager #imports the Revit DocumentManager to the Iron Python Environment
from RevitServices.Transactions import TransactionManager #imports the Revit TransactionManager to the Iron Python environment

clr.AddReference('ProtoGeometry') #addds the geometry library to the CLR
from Autodesk.DesignScript.Geometry import * #imports the dynamo geometry library to the Iron Python environment

doc = DocumentManager.Instance.CurrentDBDocument #sets the doc variable to the current document
outlineLoops = IN[0] #sets the outlineLoop variable to the contents of IN[0] from the Dynamo environment
level = UnwrapElement(IN[1]) #unwraps the contents of IN[1] from the Dynamo environment so it can be used in the Revit API directly and sets the result to the level variable 
slopeVector = IN[2] #converts the contents of IN[2] to the associated Revit content and sets the result to the slopeLine variable 
slope = IN[3] #sets the slope variable to the contents of IN[2] from the Dynamo environment
floorType = UnwrapElement(IN[4]) #unwraps the contents of IN[4] from the Dynamo environment so it can be used int he Revit API directly, and sets the result to the floorType variable
slopeStart = IN[5]


TransactionManager.Instance.EnsureInTransaction(doc) #starts a new transaction so we can modify the document in the doc variable
floors = []
slopeLine = Line.ByStartPointDirectionLength(slopeStart,slopeVector,1000).ToRevitType() #builds a new line 10 unit long line from the average start point on the given vector and converts to a Revit line to use in the floor creation

for loop in outlineLoops:
	#sp = loop[0].Startpoint
	#x = sp.X
	#y = sp.Y
	#z = sp.Z
	
	ca = CurveArray() #sets a new curve array as an empty CurveArray
	#x = [] #creates an empty list as the x variable
	#y = [] #creates an empty list as the y variable
	#z = [] #creates an empty list as the z variable
	#slopeLine = loop[0]

	for c in loop: #for each curve int he outlineLoop, perform the offset action below
	   ca.Append(c.ToRevitType()) #converts the curve to the associated Revit type, and appends it to the curve ca variable
	   #sp = c.StartPoint #gets the start point of each curve
	   #x.append(sp.X) #appends the start point's X value to the x variable
	   #y.append(sp.Y) #appends the start point's Y value to the y vairable
	   #z.append(sp.Z) #appends the start point's Z value to the z vairable
	#x = sum(x)/len(x) #sets the x variable to the average of the start point values
	#y = sum(y)/len(y) #sets the y variable to the average of the start point values
	#z = sum(z)/len(z) #sets the z variable to the average of the start point values
	#x = min(x)
	#y = min(y)
	#z = min(z)
	#slopeLine = Line.ByStartPointDirectionLength(Point.ByCoordinates(x,y,z),slopeVector,1000).ToRevitType() #builds a new line 10 unit long line from the average start point on the given vector and converts to a Revit line to use in the floor creation
	
	floor = doc.Create.NewSlab(ca, level, slopeLine, slope, False) #creates a new floor in the document stored in the doc variable, using the ca, level, slopeLine, and slope variable, and setting the 'is structural' override to true, setting the result to the floor variable
	floor.FloorType = floorType #sets the floor type to the contents of the floorType variable
	floors.append(floor)
	TransactionManager.Instance.TransactionTaskDone() #closes the Revit transaction

OUT = floors #sends the contents of the floor variable to the Dynamo environment
# ----------------------------------------
