# Dynamo graph floorSplitter_autoSlope2023.dyn "floorSplitter_autoSlope2023v2" (Dynamo 2.13.1.3887)
# packages: Clockwork for Dynamo 2.x 2.4.0, cata_lyst 0.0.1, spring nodes 210.1.1

# group: INPUT
delete_original_floor = BoolSelector(true)  # graph input
select_sloped_floor = DSModelElementSelection()  # 1 picked in the model; graph input
swap_slope_arrow_direction = BoolSelector(false)  # graph input
select_slope_arrow_alebo_podobná = DSModelElementSelection()  # "Select Slope Arrow (alebo podobná čiara)"; 1 picked in the model; graph input

code_block = CodeBlock { None; }  # unwired: None
code_block_2 = CodeBlock { true; }
level = Custom[Element.Level](element=select_sloped_floor)  # package Clockwork for Dynamo 2.x; Gets an element's level

# group: slope arrow vector & swap
curve = CurveElement.Curve(curveElement=select_slope_arrow_alebo_podobná)
endPoint = Curve.EndPoint(curve=curve)
startPoint = Curve.StartPoint(curve=curve)
byTwoPoints = Vector.ByTwoPoints(start=endPoint, end=startPoint)
startPoint_2 = Curve.StartPoint(curve=curve)
endPoint_2 = Curve.EndPoint(curve=curve)
byTwoPoints_2 = Vector.ByTwoPoints(start=startPoint_2, end=endPoint_2)
if_ = RefactoredIf(test=swap_slope_arrow_direction, true=byTwoPoints, false=byTwoPoints_2)

# group: getting slope of the floor
faces = Element.Faces(element=select_sloped_floor)
code_block_3 = CodeBlock { 0.5; }
normalAtParameter = Surface.NormalAtParameter(surface=faces, u=code_block_3, v=code_block_3)
Z = Vector.Z(vector=normalAtParameter)
code_block_4 = CodeBlock { 0; }
gt = Z > code_block_4
filterByBoolMask = List.FilterByBoolMask(list=normalAtParameter, mask=gt)
filterByBoolMask_2 = List.FilterByBoolMask(list=faces, mask=gt)
area = Surface.Area(surface=filterByBoolMask_2.in)
maximumItem = List.MaximumItem(list=area)
indexOf = List.IndexOf(list=area, element=maximumItem)
getItemAtIndex = List.GetItemAtIndex(list=filterByBoolMask.in, index=indexOf)
code_block_5 = CodeBlock { 0; 1; }
byCoordinates = Vector.ByCoordinates(x=code_block_5.out0, y=code_block_5.out0, z=code_block_5.out1)
angleWithVector = Vector.AngleWithVector(vector=getItemAtIndex, otherVector=byCoordinates)
slope_in_degrees_to_slope_in = CodeBlock(angle=angleWithVector) { Math.Tan(angle)*100; }  # "slope in degrees to slope in pecpercentage"

elementType = Element.ElementType(element=select_sloped_floor)

# group: create floors
ꟿ_collect_elementsketch = Custom[ꟿ Collect.ElementSketch](element=select_sloped_floor, fetchModelCurves=code_block_2)  # package spring nodes; Get the actual sketch lines of a sketch based element (floor, ceiling, modified wall, etc.) . You can optionally fetch the matching model curves, however this might prove comptationally heavy on larger data sets. Does not work with elements from linked files.
code_block_6 = CodeBlock { 1; }
flatten = List.Flatten(list=ꟿ_collect_elementsketch.curves, amount=code_block_6)
code_block_7 = CodeBlock(level=level) { level; }
code_block_8 = CodeBlock(a=slope_in_degrees_to_slope_in) { a/100; }
code_block_9 = CodeBlock(floor_type=elementType) { floor_type; }
py_sloped_floor_creator = Python(IN[0]=flatten, IN[1]=code_block_7, IN[2]=if_, IN[3]=code_block_8, IN[4]=code_block_9, IN[5]=startPoint_2)  # IronPython2
# ---------- py_sloped_floor_creator.python (45 lines) ----------
import clr #imports the common language runtime to the Iron Python environment
clr.AddReference('RevitAPI') #adds the Revit API library to the CLR
from Autodesk.Revit.DB import Floor, CurveArray #imports the Floor and Curve array modules to the Iron Python environment
from Autodesk.Revit import DB
clr.AddReference('RevitNodes') #adds the DynamoForRevit library to the CLR
import Revit #imports the Dynamo for Revit module to the Iron Python environment
clr.ImportExtensions(Revit.GeometryConversion) #imports the geometry conversion module to the Iron Python environment
clr.AddReference('RevitServices') #adds the Revit services module to the CLR
import RevitServices #imports the Revit services module to the Iron Python environment
from RevitServices.Persistence import DocumentManager #imports the Revit DocumentManager to the Iron Python Environment
from RevitServices.Transactions import TransactionManager #imports the Revit TransactionManager to the Iron Python environment

clr.AddReference('ProtoGeometry') #addds the geometry library to the CLR
from Autodesk.DesignScript.Geometry import * #imports the dynamo geometry library to the Iron Python environment

doc = DocumentManager.Instance.CurrentDBDocument #sets the doc variable to the current document
outlineLoops = IN[0]
level = UnwrapElement(IN[1]) 
slopeVector = IN[2] # the direction of the slope 
slope = IN[3] #slope of the floor
floorType = UnwrapElement(IN[4])
slopeStart = IN[5] #start of the slope arrow line


TransactionManager.Instance.EnsureInTransaction(doc) 
floors = []
slopeLine = Line.ByStartPointDirectionLength(slopeStart,slopeVector,1000).ToRevitType() #slope arrow 1m long

total_curves = []
for loop in outlineLoops: #for each closed loop
	curveLoops = []
	for curve in loop: #for each curve in the loop
		# curve_subloops = []
	    curveLoops.append(curve.ToRevitType())
	profile = DB.CurveLoop.Create(curveLoops)
	total_curves.append(profile)

	# Autodesk.Revit.DB.Floor.create(Document, IList(CurveLoop), ElementId, ElementId, Boolean, Line, Double)
	floor = DB.Floor.Create(doc, [profile], floorType.Id, level.Id, True, slopeLine, slope)
	
	floor.FloorType = floorType #sets the floor type
	floors.append(floor)
TransactionManager.Instance.TransactionTaskDone() #closes the Revit transaction

OUT = floors #sends the contents of the floor variable to the Dynamo environment
# ----------------------------------------
py_filterelementcollector = Python()  # IronPython2
# ---------- py_filterelementcollector.python (24 lines) ----------
# Load the Python Standard and DesignScript Libraries
import sys
import clr
clr.AddReference('ProtoGeometry')
from Autodesk.DesignScript.Geometry import *

clr.AddReference("RevitServices")
clr.AddReference("RevitAPI")
import RevitServices
from RevitServices.Persistence import DocumentManager
from Autodesk.Revit import DB

doc = DocumentManager.Instance.CurrentDBDocument
uiapp = DocumentManager.Instance.CurrentUIApplication
app = uiapp.Application

rooms = DB.FilteredElementCollector(doc).OfCategory(DB.BuiltInCategory.OST_Rooms).WhereElementIsNotElementType().ToElements()
areas = []
for room in rooms:
	area = room.LookupParameter("Area").AsDouble()
	areas.append(area*0.3048*0.3048)

# Assign your output to the OUT variable.
OUT = areas
# ----------------------------------------

code_block_10 = CodeBlock { "Height Offset From Level"; }
getParameterValueByName = Element.GetParameterValueByName(element=select_sloped_floor, parameterName=code_block_10)
setParameterByName = Element.SetParameterByName(element=py_sloped_floor_creator, parameterName=code_block_10, value=getParameterValueByName)
code_block_11 = CodeBlock { "Workset"; }
getParameterValueByName_2 = Element.GetParameterValueByName(element=select_sloped_floor, parameterName=code_block_11)
setParameterByName_2 = Element.SetParameterByName(element=py_sloped_floor_creator, parameterName=code_block_11, value=getParameterValueByName_2)
passthrough = Custom[Passthrough](passThrough=setParameterByName, waitFor=setParameterByName_2)  # package Clockwork for Dynamo 2.x; Forces a sequential order of execution. The node wired into the output of the Passthrough node will be executed *after* the node wired into the waitFor input (e.g. important for some Revit operations). The value of the passThrough input will be passed on to the node wired into the output port of the Passthrough node.

# group: delete original floor
if_2 = RefactoredIf(test=delete_original_floor, true=select_sloped_floor, false=code_block)
passthrough_2 = Custom[Passthrough](passThrough=if_2, waitFor=passthrough)
delete = Element.Delete(element=passthrough_2)

návod = StringInput("""Rozdelí Floors, ktoré sú nakreslené ako multiple sketch do samostatných Instances. 

Ako Slope Arrow, može byť použitá aj čiara  vedená rovnobežne so spádom dosky, ktorá má aspoň jeden z koncových bodov na začiatku spádovania.

Obmedzenia:
- Nevytvorí Floors s otvormi, či definované so Splines v ich Boundary

Je potrebné mať nainštalované packages...""")  # graph input
code_block_12 = CodeBlock { "floorSplitter_Sloped_p"; }
usageLog = Custom[usageLog](scriptName=code_block_12)  # package cata_lyst; node logs every run of the script in which is used to the hardcoded server location
