# Dynamo graph floorSplitter_noSlope_p.dyn "floorSplitterA_p" (Dynamo 2.12.1.8246)
# packages: Clockwork for Dynamo 2.x 2.4.0, cata_lyst 0.0.1, spring nodes 210.1.1

# group: INPUT
delete_original_floor = BoolSelector(false)  # graph input
select_model_element = DSModelElementSelection()  # 1 picked in the model; graph input

code_block = CodeBlock { None; }  # unwired: None
elementType = Element.ElementType(element=select_model_element)
level = Custom[Element.Level](element=select_model_element)  # package Clockwork for Dynamo 2.x; Gets an element's level

# group: create floors
ꟿ_collect_elementsketch = Custom[ꟿ Collect.ElementSketch](element=select_model_element)  # package spring nodes; Get the actual sketch lines of a sketch based element (floor, ceiling, modified wall, etc.) . You can optionally fetch the matching model curves, however this might prove comptationally heavy on larger data sets. Does not work with elements from linked files.
code_block_2 = CodeBlock(level=level) { level; }
byOutlineTypeAndLevel = Floor.ByOutlineTypeAndLevel(outline=ꟿ_collect_elementsketch.curves, floorType=elementType, level=code_block_2)

code_block_3 = CodeBlock { "Height Offset From Level"; }
getParameterValueByName = Element.GetParameterValueByName(element=select_model_element, parameterName=code_block_3)
setParameterByName = Element.SetParameterByName(element=byOutlineTypeAndLevel, parameterName=code_block_3, value=getParameterValueByName)
code_block_4 = CodeBlock { "Workset"; }
getParameterValueByName_2 = Element.GetParameterValueByName(parameterName=code_block_4)  # unwired: element
setParameterByName_2 = Element.SetParameterByName(element=byOutlineTypeAndLevel, parameterName=code_block_4, value=getParameterValueByName_2)
passthrough = Custom[Passthrough](passThrough=setParameterByName, waitFor=setParameterByName_2)  # package Clockwork for Dynamo 2.x; Forces a sequential order of execution. The node wired into the output of the Passthrough node will be executed *after* the node wired into the waitFor input (e.g. important for some Revit operations). The value of the passThrough input will be passed on to the node wired into the output port of the Passthrough node.

# group: delete original floor
if_ = RefactoredIf(test=delete_original_floor, true=select_model_element, false=code_block)
passthrough_2 = Custom[Passthrough](passThrough=if_, waitFor=passthrough)
delete = Element.Delete(element=passthrough_2)

návod = StringInput("""Rozdelí Floors, ktoré sú nakreslené ako multiple sketch do samostatných Instances. 

Obmedzenia:
- Spádované Floors vie rozdeliť len bez spádu.
- Nevytvorí Floors s otvormi, či definované so Splines v ich Boundary

Je potrebné mať nainštalované packages...""")  # graph input
code_block_5 = CodeBlock { "floorSplitter_NoSlope_p"; }
usageLog = Custom[usageLog](scriptName=code_block_5)  # package cata_lyst; node logs every run of the script in which is used to the hardcoded server location
