# Dynamo graph floorSplitter_p.dyn "floorSplitter" (Dynamo 2.12.1.8246)
# packages: Clockwork for Dynamo 2.x 2.4.0, Genius Loci 2022.4.19, cata_lyst 0.0.1

# group: INPUT
select_model_element = DSModelElementSelection()  # nothing selected; graph input
delete_original_floor = BoolSelector(true)  # graph input

# group: get just the top faces
faces = Element.Faces(element=select_model_element)
code_block = CodeBlock { 0.5; }
pointAtParameter = Surface.PointAtParameter(surface=faces, u=code_block, v=code_block)
Z = Point.Z(point=pointAtParameter)
normalAtPoint = Surface.NormalAtPoint(surface=faces, point=pointAtParameter)
Z_2 = Vector.Z(vector=normalAtPoint)
code_block_2 = CodeBlock { 2; }
round = Math.Round(number=Z_2, digits=code_block_2)
code_block_3 = CodeBlock { 0; }
gt = round > code_block_3
filterByBoolMask = List.FilterByBoolMask(list=faces, mask=gt)

# group: Display geometry
explode = Geometry.Explode(geometry=filterByBoolMask.in)

level = Custom[Element.Level](element=select_model_element)  # package Clockwork for Dynamo 2.x; Gets an element's level
elementType = Element.ElementType(element=select_model_element)
code_block_4 = CodeBlock(floor_type=elementType) { floor_type; }

# group: create floors
perimeterCurves = Surface.PerimeterCurves(surface=filterByBoolMask.in)
byJoinedCurves = PolyCurve.ByJoinedCurves(curves=perimeterCurves)
code_block_5 = CodeBlock(level=level) { level; }

# group: moving outlines up
code_block_6 = CodeBlock { 2000; }
byCoordinates = Vector.ByCoordinates(z=code_block_6)
translate = Geometry.Translate(geometry=byJoinedCurves, direction=byCoordinates)

# group: projecting outlines to XY plane
code_block_7 = CodeBlock { -5000; }
byCoordinates_2 = Vector.ByCoordinates(z=code_block_7)
extrude = Curve.Extrude(curve=translate, direction=byCoordinates_2)
plane_bylevel = Custom[Plane ByLevel](level=code_block_5)  # package Genius Loci; Constructs a Plane from a level.
intersect = Geometry.Intersect(geometry=extrude, other=plane_bylevel)
byJoinedCurves_2 = PolyCurve.ByJoinedCurves(curves=intersect)

# group: trying to make sloped floor - WIP
select_model_element_2 = DSModelElementSelection()  # 1 picked in the model
code_block_8 = CodeBlock { 2; }
py_filterelementcollector = Python(IN[1]=code_block_5, IN[2]=select_model_element_2, IN[3]=code_block_8)  # IronPython2; frozen; unwired: IN[0]
# ---------- py_filterelementcollector.python (35 lines) ----------
# Load the Python Standard and DesignScript Libraries
import sys
import clr
clr.AddReference('ProtoGeometry')
from Autodesk.DesignScript.Geometry import *

clr.AddReference("RevitServices")
clr.AddReference("RevitAPI")
import RevitServices
from RevitServices.Persistence import DocumentManager
from Autodesk.Revit import DB
from Autodesk.Revit.Creation import Document

doc = DocumentManager.Instance.CurrentDBDocument
uiapp = DocumentManager.Instance.CurrentUIApplication
app = uiapp.Application

rooms = DB.FilteredElementCollector(doc).OfCategory(DB.BuiltInCategory.OST_Rooms).WhereElementIsNotElementType().ToElements()

profiles = IN[0]
level = IN[1]
slopedArrow = IN[2]
slope = IN[3]


areas = []
for profile in profiles:
	curve_array = DB.CurveArray()
	for curve in profile:
		curve_array.Append(curve)
		
	newFloor = doc.Create.NewSlab(curve_array, level, slopedArrow, slope, True)

# Assign your output to the OUT variable.
OUT = areas
# ----------------------------------------
boolean = BoolSelector(true)
boolean_2 = BoolSelector(true)
python_script = Python(IN[0]=intersect, IN[1]=code_block_5, IN[2]=select_model_element_2, IN[3]=code_block_8, IN[4]=boolean, IN[5]=code_block_4, IN[6]=boolean_2)  # IronPython2; frozen
# ---------- python_script.python (94 lines) ----------
# Copyright(c) 2019, Konrad K Sobon
# @arch_laboratory, http://archi-lab.net

import clr
clr.AddReference('ProtoGeometry')
from Autodesk.DesignScript.Geometry import *

# Import Element wrapper extension methods
clr.AddReference("RevitNodes")
import Revit
clr.ImportExtensions(Revit.Elements)

# Import geometry conversion extension methods
clr.ImportExtensions(Revit.GeometryConversion)

# Import DocumentManager and TransactionManager
clr.AddReference("RevitServices")
import RevitServices
from RevitServices.Persistence import DocumentManager
from RevitServices.Transactions import TransactionManager
doc = DocumentManager.Instance.CurrentDBDocument

# Import RevitAPI
clr.AddReference("RevitAPI")
import Autodesk
from Autodesk.Revit.DB import *

import System
from System import Array
from System.Collections.Generic import *

import sys
pyt_path = r'C:\Program Files (x86)\IronPython 2.7\Lib'
sys.path.append(pyt_path)

#The inputs to this node will be stored as a list in the IN variable.
dataEnteringNode = IN

def ProcessList(_func, _list):
    return map( lambda x: ProcessList(_func, x) if type(x)==list else _func(x), _list )

def ProfileToCrvArray(profile):
	crvArr = CurveArray()
	#for crv in profile.Curves():
	for crv in profile:
		startPt = crv.PointAtParameter(0).ToXyz()
		endPt = crv.PointAtParameter(1).ToXyz()
		rvtLine = Line.CreateBound(startPt, endPt)
		crvArr.Append(rvtLine)
	return crvArr

def LineToRvtLine(crv):
	startPt = crv.PointAtParameter(0).ToXyz()
	endPt = crv.PointAtParameter(1).ToXyz()
	rvtLine = Line.CreateBound(startPt, endPt)
	return rvtLine
	
def CreateRamp(profile, level, slopedArrow, slope, isStr):
	crvArray = ProfileToCrvArray(profile)
	slopeLine = LineToRvtLine(slopedArrow)
	newFloor = doc.Create.NewSlab(crvArray, level, slopeLine, slope, isStr)	
	return newFloor

profiles = IN[0]
level = UnwrapElement(IN[1])
slopeLines = IN[2]
slopes = IN[3]
isStructural = IN[4]
floorType = UnwrapElement(IN[5])
RunIt = IN[6]

if RunIt:
	try:
		errorReport = None
		TransactionManager.Instance.EnsureInTransaction(doc)
		
		output = []
		#for i, j, k in zip(profiles, slopeLines, slopes):
		newFloor = CreateRamp(profiles, level, slopeLines, slopes, isStructural)
		if newFloor != None:
			newFloor.FloorType = floorType
		output.append(newFloor)

		TransactionManager.Instance.TransactionTaskDone()
	except:
		import traceback
		errorReport = traceback.format_exc()
else:
	errorReport = "Please set RunIt to True."

if errorReport == None:
	OUT = output
else:
	OUT = errorReport
# ----------------------------------------

code_block_9 = CodeBlock { None; }  # unwired: None

# group (continued): create floors
byOutlineTypeAndLevel = Floor.ByOutlineTypeAndLevel(outline=intersect, floorType=code_block_4, level=code_block_5)

code_block_10 = CodeBlock { "Height Offset From Level"; }
getParameterValueByName = Element.GetParameterValueByName(element=select_model_element, parameterName=code_block_10)
setParameterByName = Element.SetParameterByName(element=byOutlineTypeAndLevel, parameterName=code_block_10, value=getParameterValueByName)

# group: delete original floor
if_ = RefactoredIf(test=delete_original_floor, true=select_model_element, false=code_block_9)
passthrough = Custom[Passthrough](passThrough=if_, waitFor=setParameterByName)  # package Clockwork for Dynamo 2.x; Forces a sequential order of execution. The node wired into the output of the Passthrough node will be executed *after* the node wired into the waitFor input (e.g. important for some Revit operations). The value of the passThrough input will be passed on to the node wired into the output port of the Passthrough node.
delete = Element.Delete(element=passthrough)

návod = StringInput("""Rozdelí Floors, ktoré sú nakreslené ako multiple sketch do samostatných Instances. 

Obmedzenia:
- Spádované Floors vie rozdeliť len bez spádu.
- Nevytvorí Floors s otvormi, či definované so Splines v ich Boundary

Je potrebné mať nainštalované packages...""")  # graph input
code_block_11 = CodeBlock { "floorSplitter_p"; }
usageLog = Custom[usageLog](scriptName=code_block_11)  # package cata_lyst; node logs every run of the script in which is used to the hardcoded server location
