# Dynamo graph getParameterGUID.dyn (Dynamo 2.12.1.8246)
# packages: cata_lyst 0.0.1

python_script = Python()  # IronPython2; unwired: IN[0]
# ---------- python_script.python (18 lines) ----------
import clr
clr.AddReference('RevitAPI')
from Autodesk.Revit.DB import FilteredElementCollector, SharedParameterElement

clr.AddReference('RevitServices')
from RevitServices.Persistence import DocumentManager

doc = DocumentManager.Instance.CurrentDBDocument
spe = FilteredElementCollector(doc).OfClass(SharedParameterElement)

guid = []
pName = []

for s in spe:
	guid.append(s.GuidValue)
	pName.append(s.Name)

OUT = pName, guid
# ----------------------------------------

# group: INPUT
shared_parameter_name = StringInput("sirka")  # graph input

indexOf = List.IndexOf(list=python_script@L2, element=shared_parameter_name)
firstItem = List.FirstItem(list=indexOf)
getItemAtIndex = List.GetItemAtIndex(list=python_script@L2, index=firstItem)

# group: OUTPUT
output = Watch(getItemAtIndex)  # graph output

návod = StringInput("""Získa GUID Shared parametru s danym menom.
Vhodné na pridanie identického parametru do nových súborov alebo pridanie parametru novým elementom, ktoré ich nemajú v RFA súbore.""")  # graph input
code_block = CodeBlock { "getParameterGUID"; }
usageLog = Custom[usageLog](scriptName=code_block)  # package cata_lyst; node logs every run of the script in which is used to the hardcoded server location
