# Dynamo graph grids_2D_extents_po.dyn (Dynamo 2.3.0.5885)
# packages: spring nodes 203.1.0

activeView = Custom[Springs.Doc.ActiveView]()  # package spring nodes; Selects the current document's active view. Supports more view types than the built-in option. Will be depreciated once the bult in node works with all plan types.
návod = StringInput("""zmení extents všetkých Grids v aktívnom View z defaultného 3D na 2D.Skript je potrebné spúšťať keď sú views neorezané (uncropped).

Je potrebné doinštalovať package Springs""")  # graph input

# group: INPUT
categories = Categories("OST_Grids")

all_elements_of_category = ElementsOfCategory(Category=categories)
code_block = CodeBlock { refresh:bool = true; }
python_script = Python(IN[0]=code_block)
# ---------- python_script.python (14 lines) ----------
#Copyright(c) 2016, Dimitar Venkov
# @5devene, dimitar.ven@gmail.com

import clr

clr.AddReference("RevitServices")
import RevitServices
from RevitServices.Persistence import DocumentManager
doc = DocumentManager.Instance.CurrentDBDocument
clr.AddReference("RevitNodes")
import Revit
clr.ImportExtensions(Revit.Elements)

OUT = doc.ActiveView.ToDSType(True)
# ----------------------------------------
python_script_2 = Python(IN[0]=all_elements_of_category, IN[1]=python_script)
# ---------- python_script_2.python (29 lines) ----------
import clr
clr.AddReference('RevitAPI')
from Autodesk.Revit.DB import *
import Autodesk


clr.AddReference("RevitServices")
import RevitServices
from RevitServices.Persistence import DocumentManager
from RevitServices.Transactions import TransactionManager

doc = DocumentManager.Instance.CurrentDBDocument
uiapp = DocumentManager.Instance.CurrentUIApplication
app = uiapp.Application

a = UnwrapElement(IN[0])
v = UnwrapElement(IN[1])
try:
    TransactionManager.Instance.EnsureInTransaction(doc)
    for i in a:
#       i.SetDatumExtentType(DatumEnds.End0,v, DatumExtentType.Model)
        i.SetDatumExtentType(DatumEnds.End0,v, DatumExtentType.ViewSpecific)
#       i.SetDatumExtentType(DatumEnds.End1,v, DatumExtentType.Model)
        i.SetDatumExtentType(DatumEnds.End1,v, DatumExtentType.ViewSpecific)
    TransactionManager.Instance.TransactionTaskDone()
except:
    OUT[1] = "message"

OUT = v
# ----------------------------------------
watch = Watch(python_script_2)
py_log = Python()  # unwired: IN[0]
# ---------- py_log.python (37 lines) ----------
# Load the Python Standard and DesignScript Libraries
import sys
import clr
clr.AddReference('ProtoGeometry')
from Autodesk.DesignScript.Geometry import *
clr.AddReference("RevitServices")
import RevitServices
from RevitServices.Persistence import DocumentManager

from datetime import datetime
import getpass

# name of the script for log
log_string = "grids 2D extents"

doc = DocumentManager.Instance.CurrentDBDocument
filePath = doc.PathName

# getting file name from path
lastBackslash = filePath.rindex("\\")+1
file_name = filePath[lastBackslash:]
user_name = getpass.getuser()
datestamp = str(datetime.now())
# tabulator between data to easy import to excel schedule
separator = "\t"
line = datestamp + separator + log_string + separator + user_name + "\n"

try:
	f = open("L:\\customToolslogs\\dynLogs\\" + file_name +".log", "a")
	f.write(line)
	f.close()
	status = "log has been written"
except:
	status = "something went wrong"

# Assign your output to the OUT variable.
OUT = status
# ----------------------------------------
