# Dynamo graph heightToParameter_po.dyn (Dynamo 2.3.0.5885)

code_block = CodeBlock { "Site"; }
byName = Category.ByName(name=code_block)
all_elements_of_category = ElementsOfCategory(Category=byName)
getLocation = Element.GetLocation(element=all_elements_of_category)
Z = Point.Z(point=getLocation)

# group: getting +0,000 height
surveyPoint = Coordinates.SurveyPoint()
Z_2 = Point.Z(point=surveyPoint)
basePoint = Coordinates.BasePoint()
Z_3 = Point.Z(point=basePoint)
code_block_2 = CodeBlock(a=Z_2, b=Z_3) { a-b; }
py_round_abs = Python(IN[0]=code_block_2)
# ---------- py_round_abs.python (13 lines) ----------
# Enable Python support and load DesignScript library
import clr
clr.AddReference('ProtoGeometry')
from Autodesk.DesignScript.Geometry import *

# The inputs to this node will be stored as a list in the IN variables.
data = IN

# Place your code below this line
data = round(data[0],0)
data = abs(data)
# Assign your output to the OUT variable.
OUT = data
# ----------------------------------------

code_block_3 = CodeBlock(a=Z, projectZero=py_round_abs) { (a+projectZero); }
round = Math.Round(number=code_block_3)
vyska = Watch(round)  # graph output
code_block_4 = CodeBlock { "nadmorska vyska"; }
setParameterByName = Element.SetParameterByName(element=all_elements_of_category, parameterName=code_block_4, value=round)
návod = StringInput("Do Shared parametru \"nadmorska vyska\" všetkých elementov v Category Site zapíše vzdialenosť od Survey pointu. Nadmorská výška sa dá nasledovne vykázať v tabuľke.")  # graph input
py_log = Python()  # unwired: IN[0]
# ---------- py_log.python (40 lines) ----------
# Load the Python Standard and DesignScript Libraries
import sys
import clr
clr.AddReference('ProtoGeometry')
from Autodesk.DesignScript.Geometry import *
clr.AddReference("RevitServices")
import RevitServices
from RevitServices.Persistence import DocumentManager

from datetime import datetime
import getpass

# name of the script for log
log_string = "heightToParameter"

doc = DocumentManager.Instance.CurrentDBDocument
filePath = doc.PathName

# getting file name from path
try:
	lastBackslash = filePath.rindex("\\")+1
except:
	lastBackslash = filePath.rindex("/")+1
file_name = filePath[lastBackslash:]
user_name = getpass.getuser()
datestamp = str(datetime.now())
# tabulator between data to easy import to excel schedule
separator = "\t"
line = datestamp + separator + log_string + separator + user_name + "\n"

try:
	f = open("L:\\customToolslogs\\dynLogs\\" + file_name +".log", "a")
	f.write(line)
	f.close()
	status = "log has been written"
except:
	status = "something went wrong"

# Assign your output to the OUT variable.
OUT = status
# ----------------------------------------
