# Dynamo graph indexZeleneStrecha.dyn (Dynamo 2.0.1.5055)

categories = Categories(index=438)
all_elements_of_category = ElementsOfCategory(Category=categories)
filter_planting_by_parameter = CodeBlock { "topographyMeter"; }

# group: Filter Type Comments
elementType = Element.ElementType(element=all_elements_of_category)
code_block = CodeBlock { "Type Comments"; }
getParameterValueByName = Element.GetParameterValueByName(element=elementType, parameterName=code_block)
eq = getParameterValueByName == filter_planting_by_parameter
filterByBoolMask = List.FilterByBoolMask(list=all_elements_of_category, mask=eq)

# group: Filter without PD CO2
code_block_2 = CodeBlock { "SO-stavebny objekt"; }
getParameterValueByName_2 = Element.GetParameterValueByName(element=filterByBoolMask.in, parameterName=code_block_2)
filter_floors_by_stavebny_objekt = CodeBlock { "SOCO2002"; }
eq_2 = getParameterValueByName_2 == filter_floors_by_stavebny_objekt
filterByBoolMask_2 = List.FilterByBoolMask(list=filterByBoolMask.in, mask=eq_2)

# group: Filter without chodniky
code_block_3 = CodeBlock { "druh povrchu"; }
getParameterValueByName_3 = Element.GetParameterValueByName(element=filterByBoolMask_2.out, parameterName=code_block_3)
filter_floors_by_stavebny_objekt_2 = CodeBlock { "chodnik"; }
eq_3 = getParameterValueByName_3 == filter_floors_by_stavebny_objekt_2
filterByBoolMask_3 = List.FilterByBoolMask(list=filterByBoolMask_2.out, mask=eq_3)

filter_floors_by_stavebny_objekt_3 = CodeBlock { "hlbka substratu"; }
getParameterValueByName_4 = Element.GetParameterValueByName(element=filterByBoolMask_3.out, parameterName=filter_floors_by_stavebny_objekt_3)
toNumber = String.ToNumber(str=getParameterValueByName_4)

# group: removing nulls
code_block_4 = CodeBlock { null; }
eq_4 = toNumber == code_block_4
filterByBoolMask_4 = List.FilterByBoolMask(list=filterByBoolMask_3.out, mask=eq_4)
filterByBoolMask_5 = List.FilterByBoolMask(list=toNumber, mask=eq_4)

# group: >=500 and <1000
code_block_5 = CodeBlock { 900; }
lt = filterByBoolMask_5.out < code_block_5
code_block_6 = CodeBlock { 500; }
ge = filterByBoolMask_5.out >= code_block_6
and_ = lt && ge
filterByBoolMask_6 = List.FilterByBoolMask(list=filterByBoolMask_4.out, mask=and_)

code_block_7 = CodeBlock { "Comments"; }

# group: asign parameter
code_block_8 = CodeBlock { "0.3"; }
setParameterByName = Element.SetParameterByName(element=filterByBoolMask_6.in, parameterName=code_block_7, value=code_block_8)

# group: >=2000
code_block_9 = CodeBlock { 1750; }
ge_2 = filterByBoolMask_5.out >= code_block_9
filterByBoolMask_7 = List.FilterByBoolMask(list=filterByBoolMask_4.out, mask=ge_2)

# group: >=1000
filterByBoolMask_8 = List.FilterByBoolMask(list=filterByBoolMask_5.out, mask=ge_2)
code_block_10 = CodeBlock { 850; }
ge_3 = filterByBoolMask_8.out >= code_block_10
filterByBoolMask_9 = List.FilterByBoolMask(list=filterByBoolMask_7.out, mask=ge_3)

# group: asign parameter
code_block_11 = CodeBlock { "0.5"; }
setParameterByName_2 = Element.SetParameterByName(element=filterByBoolMask_9.in, parameterName=code_block_7, value=code_block_11)

# group: asign parameter
code_block_12 = CodeBlock { "0.9"; }
setParameterByName_3 = Element.SetParameterByName(element=filterByBoolMask_7.in, parameterName=code_block_7, value=code_block_12)

# group: index 1900
count = List.Count(list=filterByBoolMask_7.in)
code_block_13 = CodeBlock(count=count) { count*0.9; }
watch = Watch(code_block_13)

# group: index 900
count_2 = List.Count(list=filterByBoolMask_9.in)
code_block_14 = CodeBlock(count=count_2) { count*0.5; }
watch_2 = Watch(code_block_14)

# group: index 500
count_3 = List.Count(list=filterByBoolMask_6.in)
code_block_15 = CodeBlock(count=count_3) { count*0.3; }
watch_3 = Watch(code_block_15)

code_block_16 = CodeBlock(a=watch, b=watch_2, c=watch_3) { a+b+c; }
zapocitatelna_plocha = Watch(code_block_16)
code_block_17 = CodeBlock { 2719.8+2180+1149.9; }
cielova_zapocitatelna_plocha = Watch(code_block_17)
návod = StringInput("""Po rozmiestnení Site elementu Topographymeter  v rovnomernom rastri napr. 1x1m a hostovaní na Topography zapíše každému Site elementu do parametru "hlbka substratu" hrubku substratu na zelenej streche.

Site elementy umiestnene na chodnikoch je potrebne vyfiltrovat cez Shared parameter "Druh povrchu" == chodnik

Vyskam je nasledne priradeny koeficient a spocitana je cela zapocitatelna plocha zelene na zelenej streche""")
