# Dynamo graph levels excel.dyn (Dynamo 0.8.1.1942)

file_path = Filename("C:\Users\davidv\Documents\dyn\Dynamo\levels.xlsx")
fromPath = FileObject(file_path)  # "File.FromPath"
string = StringInput("Sheet")
boolean = BoolSelector(false)
readFromFile = Excel.ReadFromFile(file=fromPath, sheetName=string, readAsStrings=boolean)
watch = Watch(readFromFile)
transpose = List.Transpose(readFromFile)
number = DoubleInput(0)
getItemAtIndex = List.GetItemAtIndex(list=transpose, index=number)
watch_2 = Watch(getItemAtIndex)
number_2 = DoubleInput(1)
getItemAtIndex_2 = List.GetItemAtIndex(list=transpose, index=number_2)
watch_3 = Watch(getItemAtIndex_2)
byElevationAndName = Level.ByElevationAndName(watch_2, watch_3)
byLevel = FloorPlanView.ByLevel(byElevationAndName)
