# Dynamo graph line2prefa_length&rotation_p.dyn "lineLength2prefaLength" (Dynamo 2.3.0.5885)

# group: INPUT
prefa = DSModelElementSelection()  # 1 picked in the model; graph input
parameter_name = StringInput("dlzka prvku")  # graph input
line = DSModelElementSelection()  # 1 picked in the model; graph input

code_block = CodeBlock { "Length"; }
getParameterValueByName = Element.GetParameterValueByName(element=line, parameterName=code_block)
round = Math.Round(number=getParameterValueByName)
setParameterByName = Element.SetParameterByName(element=prefa, parameterName=parameter_name, value=round)
curve = CurveElement.Curve(curveElement=line)

# group: arc points
startPoint = Curve.StartPoint(curve=curve)
endPoint = Curve.EndPoint(curve=curve)
centerPoint = Arc.CenterPoint(arc=curve)

# group: getting radius
byStartPointEndPoint = Line.ByStartPointEndPoint(startPoint=endPoint, endPoint=centerPoint)
length = Curve.Length(curve=byStartPointEndPoint)

# group: getting arc angle
byTwoPoints = Vector.ByTwoPoints(start=endPoint, end=centerPoint)
XAxis = Vector.XAxis()
ZAxis = Vector.ZAxis()
angleAboutAxis = Vector.AngleAboutAxis(vector=byTwoPoints, otherVector=XAxis, rotationAxis=ZAxis)
byTwoPoints_2 = Vector.ByTwoPoints(start=startPoint, end=centerPoint)
angleAboutAxis_2 = Vector.AngleAboutAxis(vector=byTwoPoints_2, otherVector=XAxis, rotationAxis=ZAxis)
code_block_2 = CodeBlock(b=angleAboutAxis, a=angleAboutAxis_2) { b-a; }

# group: calculatung correction vector by arc curvature
code_block_3 = CodeBlock(radius=length) { 0; -radius/1000; }
byCoordinates = Point.ByCoordinates(x=code_block_3.out0, y=code_block_3.out0, z=code_block_3.out0)
code_block_4 = CodeBlock(angle=code_block_2) { 0; -angle; }
byCenterPointRadiusAngle = Arc.ByCenterPointRadiusAngle(center=byCoordinates, radius=code_block_3.out1, startAngle=code_block_4.out0, endAngle=code_block_4.out1)
startPoint_2 = Curve.StartPoint(curve=byCenterPointRadiusAngle)
endPoint_2 = Curve.EndPoint(curve=byCenterPointRadiusAngle)
byTwoPoints_3 = Vector.ByTwoPoints(start=startPoint_2, end=endPoint_2)
XAxis_2 = Vector.XAxis()
ZAxis_2 = Vector.ZAxis()
angleAboutAxis_3 = Vector.AngleAboutAxis(vector=byTwoPoints_3, otherVector=XAxis_2, rotationAxis=ZAxis_2)

# group: place instance and rotate by two points vector
byTwoPoints_4 = Vector.ByTwoPoints(start=startPoint, end=endPoint)
XAxis_3 = Vector.XAxis()
ZAxis_3 = Vector.ZAxis()
angleAboutAxis_4 = Vector.AngleAboutAxis(vector=byTwoPoints_4, otherVector=XAxis_3, rotationAxis=ZAxis_3)
code_block_5 = CodeBlock(b=angleAboutAxis_4, a=angleAboutAxis_3) { b-a-90; }
setRotation = FamilyInstance.SetRotation(familyInstance=prefa, degree=code_block_5)

návod = StringInput("Pootočí prefabrikát v tvare krivky podľa vybranej čiary a nastaví jej dĺžku podľa dĺžky čiary.")  # graph input
