# Dynamo graph loadFamilies.dyn (Dynamo 2.3.1.11775)
# packages: Clockwork for Dynamo 2.x 2.3.0

návod = StringInput("Naloaduje families do projektu")
code_block = CodeBlock()
# ---------- code_block.designscript (8 lines) ----------
[
"C:\\Users\\1P\\Desktop\\workFamilies\\krik.rfa",
"C:\\Users\\1P\\Desktop\\workFamilies\\kvetinac.rfa",
"C:\\Users\\1P\\Desktop\\workFamilies\\kolajnice I.rfa",
"C:\\Users\\1P\\Desktop\\workFamilies\\kolajnice IaU.rfa",
"C:\\Users\\1P\\Desktop\\workFamilies\\kolajnice.rfa",
"C:\\Users\\1P\\Desktop\\workFamilies\\kontajner 1100l.rfa"
];
# ----------------------------------------
loadFamily = Custom[Document.LoadFamily](path=code_block)  # package Clockwork for Dynamo 2.x; A very crude implementation of family loading. Will *not* reload an already loaded family of the same name.
countTrue = List.CountTrue(list=loadFamily.success)
success = Watch(countTrue)
countFalse = List.CountFalse(list=loadFamily.success)
errors = Watch(countFalse)
