# Dynamo graph materialAndLinePatternPurge_po.dyn (Dynamo 2.3.0.5885)

code_block = CodeBlock { "Materials"; }
byName = Category.ByName(name=code_block)
all_elements_of_category = ElementsOfCategory(Category=byName)
name = Element.Name(element=all_elements_of_category)
count = List.Count(list=name)
watch = Watch(name)
code_block_2 = CodeBlock { "Render"; "false"; }
contains = String.Contains(str=name, searchFor=code_block_2.out0, ignoreCase=code_block_2.out1)
filterByBoolMask = List.FilterByBoolMask(list=all_elements_of_category, mask=contains)
materiály_na_vymazanie = List.Count(list=filterByBoolMask.in)
count_2 = List.Count(list=filterByBoolMask.out)
python_script = Python(IN[0]=filterByBoolMask.in)
# ---------- python_script.python (44 lines) ----------
import clr
clr.AddReference('ProtoGeometry')
from Autodesk.DesignScript.Geometry import *

# Import DocumentManager and TransactionManager
clr.AddReference("RevitServices")
import RevitServices
from RevitServices.Persistence import DocumentManager
from RevitServices.Transactions import TransactionManager

# Import RevitAPI
clr.AddReference("RevitAPI")
import Autodesk
from Autodesk.Revit.DB import *

doc = DocumentManager.Instance.CurrentDBDocument
uiapp = DocumentManager.Instance.CurrentUIApplication
app = uiapp.Application

from System.Collections.Generic import *

#The inputs to this node will be stored as a list in the IN variable.
dataEnteringNode = IN

#unwrap all elements to use with API
elements = []
for i in IN[0]:
	elements.append(UnwrapElement(i))

idsToDelete = List[Autodesk.Revit.DB.ElementId]()
for i in elements:
	idsToDelete.Add(i.Id)

# "Start" the transaction
TransactionManager.Instance.EnsureInTransaction(doc)

doc.Delete(idsToDelete)

# "End" the transaction
TransactionManager.Instance.TransactionTaskDone()

message = "Z revitového modelu bolo úspešne vymazaných " + str(idsToDelete.Count) + " materiálov."

OUT='patterns.'.join('{:^35}'.format(s) for s in message.split('patterns.'))
# ----------------------------------------
status = Watch(python_script)  # graph output
návod = StringInput("Vyčistí nepotrebné čiary a materiály z DWG importov")  # graph input
element_types = ElementTypes("LinePatternElement")
all_elements_of_type = ElementsOfType(element_type=element_types)
name_2 = Element.Name(element=all_elements_of_type)
watch_2 = Watch(name_2)
code_block_3 = CodeBlock { "IMPORT"; "false"; }
contains_2 = String.Contains(str=name_2, searchFor=code_block_3.out0, ignoreCase=code_block_3.out1)
filterByBoolMask_2 = List.FilterByBoolMask(list=all_elements_of_type, mask=contains_2)
count_3 = List.Count(list=filterByBoolMask_2.out)
ciary_na_vymazanie = List.Count(list=filterByBoolMask_2.in)
count_4 = List.Count(list=name_2)
python_script_2 = Python(IN[0]=filterByBoolMask_2.in)
# ---------- python_script_2.python (51 lines) ----------
#Copyright(c) 2014, Konrad Sobon
# @arch_laboratory, http://archi-lab.net

import clr
clr.AddReference('ProtoGeometry')
from Autodesk.DesignScript.Geometry import *

# Import DocumentManager and TransactionManager
clr.AddReference("RevitServices")
import RevitServices
from RevitServices.Persistence import DocumentManager
from RevitServices.Transactions import TransactionManager

# Import RevitAPI
clr.AddReference("RevitAPI")
import Autodesk
from Autodesk.Revit.DB import *

doc = DocumentManager.Instance.CurrentDBDocument
uiapp = DocumentManager.Instance.CurrentUIApplication
app = uiapp.Application

from System.Collections.Generic import *

#The inputs to this node will be stored as a list in the IN variable.
dataEnteringNode = IN

#unwrap all elements to use with API
elements = []
for i in IN[0]:
	elements.append(UnwrapElement(i))

idsToDelete = List[Autodesk.Revit.DB.ElementId]()
for i in elements:
	idsToDelete.Add(i.Id)

# "Start" the transaction
TransactionManager.Instance.EnsureInTransaction(doc)

doc.Delete(idsToDelete)

# "End" the transaction
TransactionManager.Instance.TransactionTaskDone()

#message = "You have successfully deleted " + str(idsToDelete.Count) + " imported line patterns from Revit model."
message = "Z revitového modelu bolo úspešne vymazaných " + str(idsToDelete.Count) + " importovaných line patterns."
#OUT = 'n'.join('{:^35}'.format(s) for s in message.split('n'))
#OUT='elements'.join('{:^35}'.format(s) for s in message.split('elements'))
#OUT='elements'.join(message.split('elements'))
#OUT='model.'.join('{:^35}'.format(s) for s in message.split('model.'))
OUT='patterns.'.join('{:^35}'.format(s) for s in message.split('patterns.'))
# ----------------------------------------
status_2 = Watch(python_script_2)  # graph output
py_log = Python()  # unwired: IN[0]
# ---------- py_log.python (37 lines) ----------
# Load the Python Standard and DesignScript Libraries
import sys
import clr
clr.AddReference('ProtoGeometry')
from Autodesk.DesignScript.Geometry import *
clr.AddReference("RevitServices")
import RevitServices
from RevitServices.Persistence import DocumentManager

from datetime import datetime
import getpass

# name of the script for log
log_string = "materialAndLinePatternPurge_po.dyn"

doc = DocumentManager.Instance.CurrentDBDocument
filePath = doc.PathName

# getting file name from path
lastBackslash = filePath.rindex("\\")+1
file_name = filePath[lastBackslash:]
user_name = getpass.getuser()
datestamp = str(datetime.now())
# tabulator between data to easy import to excel schedule
separator = "\t"
line = datestamp + separator + log_string + separator + user_name + "\n"

try:
	f = open("L:\\customToolslogs\\dynLogs\\" + file_name +".log", "a")
	f.write(line)
	f.close()
	status = "log has been written"
except:
	status = "something went wrong"

# Assign your output to the OUT variable.
OUT = status
# ----------------------------------------
