# Dynamo graph maxWallHeight_p.dyn (Dynamo 2.12.1.8246)
# packages: spring nodes 210.1.1, archi-lab.net 2023.213.1523, cata_lyst 0.0.1

code_block = CodeBlock { "Walls"; }
byName = Category.ByName(name=code_block)
all_elements_of_category = ElementsOfCategory(Category=byName)

# group: for walls - direct boundingbox
ꟿ_wall_iscurtainwall = Custom[ꟿ Wall.IsCurtainWall](wall=all_elements_of_category)  # frozen; package spring nodes; Returns true if the wall is a curtain wall.
filterByBoolMask = List.FilterByBoolMask(list=all_elements_of_category, mask=ꟿ_wall_iscurtainwall)
geometry = Element.Geometry(element=filterByBoolMask.out)
flatten = List.Flatten(list=geometry)
byGeometry = BoundingBox.ByGeometry(geom=flatten@L1)
toCuboid = BoundingBox.ToCuboid(boundingBox=byGeometry)
code_block_2 = CodeBlock { "Comments"; }
maxPoint = BoundingBox.MaxPoint(boundingBox=byGeometry)
Z = Point.Z(point=maxPoint)
minPoint = BoundingBox.MinPoint(boundingBox=byGeometry)
Z_2 = Point.Z(point=minPoint)
code_block_3 = CodeBlock(a=Z, b=Z_2) { a-b; }
code_block_4 = CodeBlock { 0; }
ꟿ_number_tostring = Custom[ꟿ Number.ToString](num=code_block_3, digits=code_block_4)  # package spring nodes; Converts the input number(s) to string. You can optionally limit the number of digits.
setParameterByName = Element.SetParameterByName(element=filterByBoolMask.out, parameterName=code_block_2, value=ꟿ_number_tostring)

# group: INPUT
názov_parametru_text = StringInput("Comments")  # graph input

getFaces = archilab.Revit.Elements.Walls.GetFaces(wall=all_elements_of_category)
byGeometry_2 = BoundingBox.ByGeometry(geom=getFaces.Faces)
maxPoint_2 = BoundingBox.MaxPoint(boundingBox=byGeometry_2)
Z_3 = Point.Z(point=maxPoint_2)
minPoint_2 = BoundingBox.MinPoint(boundingBox=byGeometry_2)
Z_4 = Point.Z(point=minPoint_2)
code_block_5 = CodeBlock(a=Z_3, b=Z_4) { a-b; }
number2integerString = Custom[Number2integerString](num=code_block_5)  # package cata_lyst; Converts number to string with no decimal numbers
setParameterByName_2 = Element.SetParameterByName(element=all_elements_of_category, parameterName=názov_parametru_text, value=number2integerString)
toCuboid_2 = BoundingBox.ToCuboid(boundingBox=byGeometry_2)
návod = StringInput("Zápis maximálnej výšky stien do zvoleného parametru")  # graph input
code_block_6 = CodeBlock { "maxWallHeight"; }
usageLog = Custom[usageLog](scriptName=code_block_6)  # package cata_lyst; node logs every run of the script in which is used to the hardcoded server location
