# Dynamo graph numberingWalls_p.dyn (Dynamo 2.3.0.5885)

# group: INPUT
select_model_elements = DSModelElementsSelection()  # 12 picked in the model; graph input
parameter_name = StringInput("Mark")  # graph input
prefix = StringInput("C")  # graph input
starting_number = DoubleInput(1)  # graph input

getLocation = Element.GetLocation(element=select_model_elements)
startPoint = Curve.StartPoint(curve=getLocation)
X = Point.X(point=startPoint)
code_block = CodeBlock { "Mark"; }
Y = Point.Y(point=startPoint)
sort = List.Sort(list=Y)
reverse = List.Reverse(list=sort)
indexOf = List.IndexOf(list=Y, element=reverse)
getItemAtIndex = List.GetItemAtIndex(list=select_model_elements, index=indexOf)
count = List.Count(list=getItemAtIndex)
code_block_2 = CodeBlock(start=starting_number, x=count) { start..(start+x); }

# group: 0 navyse pri dvojcifernych cislach
code_block_3 = CodeBlock { 100.000; }
lt = code_block_2 < code_block_3
number = DoubleInput(0)
code_block_4 = CodeBlock { ""; }
if_ = If(test=lt, true=number, false=code_block_4)

# group: 0 navyse pri jednocifernych cislach
number_2 = DoubleInput(10)
lt_2 = code_block_2 < number_2
number_3 = DoubleInput(0)
code_block_5 = CodeBlock { ""; }
if_2 = If(test=lt_2, true=number_3, false=code_block_5)

string_from_object = FromObject(obj=code_block_2)
code_block_6 = CodeBlock(x=prefix, ba=if_, c=if_2, d=string_from_object) { x+ba+c+d; }
setParameterByName = Element.SetParameterByName(element=getItemAtIndex, parameterName=parameter_name, value=code_block_6)
Z = Point.Z(point=startPoint)
návod = StringInput("""Prečísluje Steny na základe ich polohy. Po poradí zoradí elementy podľa ich X-ovej súradnice a prečísluje ich podľa formátu:
"pddd"
p - prefix
d - digit (číslo)

(napr. OML001, OML002...)""")  # graph input
py_log = Python()  # unwired: IN[0]
# ---------- py_log.python (40 lines) ----------
# Load the Python Standard and DesignScript Libraries
import sys
import clr
clr.AddReference('ProtoGeometry')
from Autodesk.DesignScript.Geometry import *
clr.AddReference("RevitServices")
import RevitServices
from RevitServices.Persistence import DocumentManager

from datetime import datetime
import getpass

# name of the script for log
log_string = "numberingWalls"

doc = DocumentManager.Instance.CurrentDBDocument
filePath = doc.PathName

# getting file name from path
try:
	lastBackslash = filePath.rindex("\\")+1
except:
	lastBackslash = filePath.rindex("/")+1
file_name = filePath[lastBackslash:]
user_name = getpass.getuser()
datestamp = str(datetime.now())
# tabulator between data to easy import to excel schedule
separator = "\t"
line = datestamp + separator + log_string + separator + user_name + "\n"

try:
	f = open("L:\\customToolslogs\\dynLogs\\" + file_name +".log", "a")
	f.write(line)
	f.close()
	status = "log has been written"
except:
	status = "something went wrong"

# Assign your output to the OUT variable.
OUT = status
# ----------------------------------------
