# Dynamo graph obrys dosky.dyn (Dynamo 2.0.1.5055)

# group: INPUT
views = Views(index=0)  # graph input
# note: vytvori obrys vodorovnej dosky Detail Lines do zvoleneho podorysu. Obrys vytvori na zaklade prieniku so zvolenou rovinou.
levels = Levels(index=0)  # graph input
offset_roviny_rezu_pod_doskou = CodeBlock { 200; }

categories = Categories(index=206)  # graph input
all_elements_of_category = ElementsOfCategory(Category=categories)
geometry = Element.Geometry(element=all_elements_of_category)
XY = Plane.XY()
elevation = Level.Elevation(level=levels)
code_block = CodeBlock(a=elevation, b=offset_roviny_rezu_pod_doskou) { a-b; }
offset = Plane.Offset(plane=XY, dist=code_block)
intersect = Geometry.Intersect(geometry=geometry, other=offset)
flatten = List.Flatten(list=intersect)
perimeterCurves = Surface.PerimeterCurves(surface=flatten)
byCurve = DetailCurve.ByCurve(view=views, curve=perimeterCurves)
