# Dynamo graph parameter query_p - Copy.dyn "parameter query_p" (Dynamo 2.3.0.5885)
# packages: Clockwork for Dynamo 2.x 2.1.2

návod = StringInput("Zobrazí vsetky hodnoty daneho parametru vybranych elementov. Za hodnotou parametru zobrazi jej pocetnost.")  # graph input
select_model_elements = DSModelElementsSelection()  # 19 picked in the model; graph input
parameter_name = StringInput("Comments")  # graph input
getParameterValueByName = Element.GetParameterValueByName(element=select_model_elements, parameterName=parameter_name)
countOccurences = Custom[List.CountOccurences](seq=getParameterValueByName)  # package Clockwork for Dynamo 2.x; Counts the number of occurences of each unique element in a given list
sortByKey = List.SortByKey(list=countOccurences.uniqueElements, keys=countOccurences.count)
code_block = CodeBlock(a=sortByKey.sorted_list, b=sortByKey.sorted_keys) { a+" - "+b+"x"; }
reverse = List.Reverse(list=code_block)
parameter_values_with_occurences = Watch(reverse)  # graph output
py_log = Python()  # unwired: IN[0]
# ---------- py_log.python (37 lines) ----------
# Load the Python Standard and DesignScript Libraries
import sys
import clr
clr.AddReference('ProtoGeometry')
from Autodesk.DesignScript.Geometry import *
clr.AddReference("RevitServices")
import RevitServices
from RevitServices.Persistence import DocumentManager

from datetime import datetime
import getpass

# name of the script for log
log_string = "parameter query"

doc = DocumentManager.Instance.CurrentDBDocument
filePath = doc.PathName

# getting file name from path
lastBackslash = filePath.rindex("\\")+1
file_name = filePath[lastBackslash:]
user_name = getpass.getuser()
datestamp = str(datetime.now())
# tabulator between data to easy import to excel schedule
separator = "\t"
line = datestamp + separator + log_string + separator + user_name + "\n"

try:
	f = open("L:\\customToolslogs\\dynLogs\\" + file_name +".log", "a")
	f.write(line)
	f.close()
	status = "log has been written"
except:
	status = "something went wrong"

# Assign your output to the OUT variable.
OUT = status
# ----------------------------------------
