# Dynamo graph parameter query_p.dyn (Dynamo 1.3.2.2480)

návod = StringInput("Zobrazí vsetky hodnoty daneho parametru vybranych elementov. Za hodnotou parametru zobrazi jej pocetnost.")
select_model_elements = DSModelElementsSelection()  # 21 picked in the model
parameter_name = StringInput("Comments")
getParameterValueByName = Element.GetParameterValueByName(element=select_model_elements, parameterName=parameter_name)
countOccurences = Custom[List.CountOccurences](seq=getParameterValueByName)  # Counts the number of occurences of each unique element in a given list
sortByKey = List.SortByKey(list=countOccurences.uniqueElements, keys=countOccurences.count)
code_block = CodeBlock(a=sortByKey.sorted_list, b=sortByKey.sorted_keys) { a+" - "+b+"x"; }
reverse = List.Reverse(code_block)
parameter_values_with_occurences = Watch(reverse)
