# Dynamo graph parking space count by room_p.dyn (Dynamo 2.3.0.5885)
# packages: Clockwork for Dynamo 2.x 2.1.2

# group: INPUT
select_model_element_room = DSModelElementSelection()  # nothing selected; graph input
# note: Spocita parkovacie miesta vo vybranej miestnosti a zapise ho do shared parametru.
room_parameter_tag = StringInput("Comments")  # graph input
categories = Categories("OST_Parking")

boundingBox = Geometry.BoundingBox(geometry=select_model_element_room)
all_elements_of_category = ElementsOfCategory(Category=categories)
location = Custom[Element.Location](element=all_elements_of_category)  # package Clockwork for Dynamo 2.x; Returns the location of an element as an XYZ (or if it's line-based the start and end point of the line), along with some booleans to help filtering the results. Use this for some element types (e.g. walls or lines) that do not work with the built-in Get Family Instance Location node.
contains = BoundingBox.Contains(boundingBox=boundingBox, point=location.points)
countTrue = List.CountTrue(list=contains)
string_from_object = FromObject(obj=countTrue)
setParameterByName = Element.SetParameterByName(element=select_model_element_room, parameterName=room_parameter_tag, value=string_from_object)
watch = Watch(countTrue)
návod = StringInput("Spocita parkovacie miesta vo vybranej miestnosti a zapise ho do vybraneho parametru miestnosti.")  # graph input
py_log = Python()  # unwired: IN[0]
# ---------- py_log.python (37 lines) ----------
# Load the Python Standard and DesignScript Libraries
import sys
import clr
clr.AddReference('ProtoGeometry')
from Autodesk.DesignScript.Geometry import *
clr.AddReference("RevitServices")
import RevitServices
from RevitServices.Persistence import DocumentManager

from datetime import datetime
import getpass

# name of the script for log
log_string = "parking space count by room"

doc = DocumentManager.Instance.CurrentDBDocument
filePath = doc.PathName

# getting file name from path
lastBackslash = filePath.rindex("\\")+1
file_name = filePath[lastBackslash:]
user_name = getpass.getuser()
datestamp = str(datetime.now())
# tabulator between data to easy import to excel schedule
separator = "\t"
line = datestamp + separator + log_string + separator + user_name + "\n"

try:
	f = open("L:\\customToolslogs\\dynLogs\\" + file_name +".log", "a")
	f.write(line)
	f.close()
	status = "log has been written"
except:
	status = "something went wrong"

# Assign your output to the OUT variable.
OUT = status
# ----------------------------------------
