# Dynamo graph parking space renumbering spline prefix filter_2023_p.dyn (Dynamo 2.16.1.2727)
# packages: cata_lyst 0.0.1

# group: INPUT
categories = Categories("OST_Parking")
filter_by_type_parameter_name = CodeBlock { "Type Comments"; }
type_comments_filter_1 = StringInput("motorka")  # graph input
type_comments_filter_2 = StringInput("miesto pre skladanie boxov")  # graph input
vyber_model_line = DSModelElementSelection()  # 1 picked in the model; graph input
code_block = CodeBlock { 1000; }
name_of_pm_parameter = StringInput("Mark")  # graph input
prefix = StringInput("2.")  # graph input
číslovať_od = DoubleInput(1)  # graph input

all_elements_of_category = ElementsOfCategory(Category=categories)

# group: filter by parameter
elementType = Element.ElementType(element=all_elements_of_category)
getParameterValueByName = Element.GetParameterValueByName(element=elementType, parameterName=filter_by_type_parameter_name)
eq = getParameterValueByName == type_comments_filter_1
eq_2 = getParameterValueByName == type_comments_filter_2
xor = Math.Xor(bool=eq, otherBool=eq_2)
filterByBoolMask = List.FilterByBoolMask(list=all_elements_of_category, mask=xor)

geometry = Element.Geometry(element=filterByBoolMask.out)
byGeometry = BoundingBox.ByGeometry(geom=geometry)
# note: chyba v tomto node, znamena ze ciara nie je nakreslena ako MODEL LINE
curve = CurveElement.Curve(curveElement=vyber_model_line)
# note: chyba v tomto node znamena ze ciara je prilis dlha
pointsAtChordLengthFromPoint = Curve.PointsAtChordLengthFromPoint(curve=curve, chordLength=code_block)
contains = BoundingBox.Contains(boundingBox=byGeometry, point=pointsAtChordLengthFromPoint, lacing=CrossProduct)
code_block_2 = CodeBlock { true; }
indexOf = List.IndexOf(list=contains, element=code_block_2, lacing=Longest)
sortByKey = List.SortByKey(list=filterByBoolMask.out, keys=indexOf)

# group: not index of
code_block_3 = CodeBlock { -1; }
eq_3 = sortByKey.sortedKeys == code_block_3
filterByBoolMask_2 = List.FilterByBoolMask(list=sortByKey.sortedList, mask=eq_3)
count = List.Count(list=filterByBoolMask_2.out)

code_block_4 = CodeBlock(start=číslovať_od) { start; }
code_block_5 = CodeBlock(start=code_block_4, count=count) { start + count; }
code_block_6 = CodeBlock { 3; }
trailingZerosManual = Custom[trailingZerosManual](start=code_block_4, end=code_block_5, numberOfDecimalPlaces=code_block_6)  # package cata_lyst; adds specific number of trailing zeros to sequence of numbers, e. g. for numbering elements
string_from_object = FromObject(obj=trailingZerosManual)
code_block_7 = CodeBlock(x=prefix, d=string_from_object) { x+d; }
setParameterByName = Element.SetParameterByName(element=filterByBoolMask_2.out, parameterName=name_of_pm_parameter, value=code_block_7)
count_2 = List.Count(list=setParameterByName)
code_block_8 = CodeBlock(b=count_2) { "Bolo prečíslovaných "+b+" PM"; }
status = Watch(code_block_8)  # graph output
návod = StringInput("""Precisluje parkovacie miesta podla nakreslenej ciary. Preskočí miesta s určenou hodnotou v type comments.
format > pnnn (p = prefix; n = number)
	Do vsetkych precislovanych parkovacich miest je potrebne vlozit rovnaky textovy parameter napr. "cislo parkovacieho miesta"a vlozit nested anotation family, ktora tento parameter v parkovacom mieste ukazuje.
	Nasledne sa nakresli ciara (najlepsie spline), ktora pretina tieto parkovacie miesta. Ciary je dobre robit v samostatnej Subcategory napr. "Renumbering parking" aby sa dali lahko vsetky naraz vypnut/zapnut pre nasledne opatovne precislovanie. Ciara musi byt kreslena ako Model Line alebo convertovana z Detail Line.
	Model Line musi byt nakreslena vo Workplane, ktora pretina precislovane parkovacie miesto, cize typicky v rovine podlahy. Pri velmi dlhej ciare sa moze vyskytnut chyba, vtedy rozdelte ciaru na viacere elementy.
	Prikaz moze pracovat dlhsie.""")  # graph input
code_block_9 = CodeBlock { "parking space renumbering spline prefix filter"; }
usageLog = Custom[usageLog](scriptName=code_block_9)  # package cata_lyst; node logs every run of the script in which is used to the hardcoded server location
