# Dynamo graph parking space renumbering spline prefix filter_p.dyn (Dynamo 2.3.0.5885)

# group: INPUT
vyber_model_line = DSModelElementSelection()  # 1 picked in the model; graph input
categories = Categories("OST_Parking")
filter_by_type_parameter_name = CodeBlock { "Type Comments"; }
type_comments_filter_1 = StringInput("motorka")  # graph input
type_comments_filter_2 = StringInput("miesto pre skladanie boxov")  # graph input
code_block = CodeBlock { 1000; }
name_of_pm_parameter = StringInput("Cislo_parkovacieho_miesta")  # graph input
prefix = StringInput("2.")  # graph input

# group: Error handling
categories_2 = Categories("OST_Lines")
getCategory = Element.GetCategory(element=vyber_model_line)

string_from_object = FromObject(obj=categories_2)
string_from_object_2 = FromObject(obj=getCategory)
eq = string_from_object == string_from_object_2

# group (continued): Error handling
code_block_2 = CodeBlock(a=string_from_object_2) { "OK"; a+" nie je správny druh objektu. Vyber Model line."; }
if_ = If(test=eq, true=code_block_2.out0, false=code_block_2.out1)

all_elements_of_category = ElementsOfCategory(Category=categories)

# group: filter by parameter
elementType = Element.ElementType(element=all_elements_of_category)
getParameterValueByName = Element.GetParameterValueByName(element=elementType, parameterName=filter_by_type_parameter_name)
eq_2 = getParameterValueByName == type_comments_filter_1
eq_3 = getParameterValueByName == type_comments_filter_2
xor = Math.Xor(a=eq_2, b=eq_3)
filterByBoolMask = List.FilterByBoolMask(list=all_elements_of_category, mask=xor)

geometry = Element.Geometry(element=filterByBoolMask.out)
byGeometry = BoundingBox.ByGeometry(geom=geometry)
# note: chyba v tomto node, znamena ze ciara nie je nakreslena ako MODEL LINE
curve = CurveElement.Curve(curveElement=vyber_model_line)
# note: chyba v tomto node znamena ze ciara je prilis dlha
pointsAtChordLengthFromPoint = Curve.PointsAtChordLengthFromPoint(curve=curve, chordLength=code_block)
splitByPoints = Curve.SplitByPoints(curve=curve, points=pointsAtChordLengthFromPoint)
endPoint = Curve.EndPoint(curve=splitByPoints)
contains = BoundingBox.Contains(boundingBox=byGeometry, point=endPoint, lacing=CrossProduct)
code_block_3 = CodeBlock { true; }
indexOf = List.IndexOf(list=contains, element=code_block_3, lacing=Longest)
sortByKey = List.SortByKey(list=filterByBoolMask.out, keys=indexOf)

# group: not index of
code_block_4 = CodeBlock { -1; }
eq_4 = sortByKey.sorted_keys == code_block_4
filterByBoolMask_2 = List.FilterByBoolMask(list=sortByKey.sorted_list, mask=eq_4)
count = List.Count(list=filterByBoolMask_2.out)

číslovať_od = DoubleInput(1)  # graph input
number = DoubleInput(1)
sequence = Sequence(start=číslovať_od, amount=count, step=number, lacing=Longest)

# group: 0 navyse pri jednocifernych cislach
number_2 = DoubleInput(10)
lt = sequence < number_2
number_3 = DoubleInput(0)
code_block_5 = CodeBlock { ""; }
if_2 = If(test=lt, true=number_3, false=code_block_5)

# group: 0 navyse pri dvojcifernych cislach
number_4 = DoubleInput(100)
lt_2 = sequence < number_4
number_5 = DoubleInput(0)
code_block_6 = CodeBlock { ""; }
if_3 = If(test=lt_2, true=number_5, false=code_block_6)

string_from_object_3 = FromObject(obj=sequence)
code_block_7 = CodeBlock(x=prefix, c=if_2, y=if_3, d=string_from_object_3) { x+c+y+d; }
setParameterByName = Element.SetParameterByName(element=filterByBoolMask_2.out, parameterName=name_of_pm_parameter, value=code_block_7)
count_2 = List.Count(list=setParameterByName)
code_block_8 = CodeBlock(a=if_, b=count_2) { "Validation: "+a+", Bolo prečíslovaných "+b+" PM"; }
status = Watch(code_block_8)  # graph output
návod = StringInput("""Precisluje parkovacie miesta podla nakreslenej ciary. Preskočí miesta s určenou hodnotou v type comments.
format > pnnn (p = prefix; n = number)
	Do vsetkych precislovanych parkovacich miest je potrebne vlozit rovnaky textovy parameter napr. "cislo parkovacieho miesta"a vlozit nested anotation family, ktora tento parameter v parkovacom mieste ukazuje.
	Nasledne sa nakresli ciara (najlepsie spline), ktora pretina tieto parkovacie miesta. Ciary je dobre robit v samostatnej Subcategory napr. "Renumbering parking" aby sa dali lahko vsetky naraz vypnut/zapnut pre nasledne opatovne precislovanie. Ciara musi byt kreslena ako Model Line alebo convertovana z Detail Line.
	Model Line musi byt nakreslena vo Workplane, ktora pretina precislovane parkovacie miesto, cize typicky v rovine podlahy. Pri velmi dlhej ciare sa moze vyskytnut chyba, vtedy rozdelte ciaru na viacere elementy.
	Prikaz moze pracovat dlhsie.""")  # graph input
py_log = Python()  # unwired: IN[0]
# ---------- py_log.python (37 lines) ----------
# Load the Python Standard and DesignScript Libraries
import sys
import clr
clr.AddReference('ProtoGeometry')
from Autodesk.DesignScript.Geometry import *
clr.AddReference("RevitServices")
import RevitServices
from RevitServices.Persistence import DocumentManager

from datetime import datetime
import getpass

# name of the script for log
log_string = "parking space renumbering spline prefix"

doc = DocumentManager.Instance.CurrentDBDocument
filePath = doc.PathName

# getting file name from path
lastBackslash = filePath.rindex("\\")+1
file_name = filePath[lastBackslash:]
user_name = getpass.getuser()
datestamp = str(datetime.now())
# tabulator between data to easy import to excel schedule
separator = "\t"
line = datestamp + separator + log_string + separator + user_name + "\n"

try:
	f = open("L:\\customToolslogs\\dynLogs\\" + file_name +".log", "a")
	f.write(line)
	f.close()
	status = "log has been written"
except:
	status = "something went wrong"

# Assign your output to the OUT variable.
OUT = status
# ----------------------------------------
