# Dynamo graph parking space renumbering spline prefix filter_p_(nepridava 0).dyn (Dynamo 2.0.1.5055)

# group: INPUT
categories = Categories(index=326)
filter_by_type_parameter_name = CodeBlock { "Type Comments"; }
type_comments_filter_1 = StringInput("motorka")  # graph input
type_comments_filter_2 = StringInput("miesto pre skladanie boxov")  # graph input
start_number_napr_1 = DoubleInput(1)  # graph input
vyber_model_line = DSModelElementSelection()  # nothing selected; graph input
code_block = CodeBlock { 1000; }
name_of_pm_parameter = StringInput("Cislo_parkovacieho_miesta")  # graph input
prefix = StringInput("")  # graph input

all_elements_of_category = ElementsOfCategory(Category=categories)
watch = Watch(all_elements_of_category)

# group: filter by parameter
type = FamilyInstance.Type(familyInstance=watch)
getParameterValueByName = Element.GetParameterValueByName(element=type, parameterName=filter_by_type_parameter_name)
eq = getParameterValueByName == type_comments_filter_1
eq_2 = getParameterValueByName == type_comments_filter_2
xor = Math.Xor(a=eq, b=eq_2)
filterByBoolMask = List.FilterByBoolMask(list=watch, mask=xor)

filterByBoolMask_2 = List.FilterByBoolMask(list=filterByBoolMask.out)  # unwired: mask
watch_2 = Watch(filterByBoolMask_2.in)
# note: chyba v tomto node, znamena ze ciara nie je nakreslena ako MODEL LINE
curve = CurveElement.Curve(curveElement=vyber_model_line)
# note: chyba v tomto node znamena ze ciara je prilis dlha
pointsAtChordLengthFromPoint = Curve.PointsAtChordLengthFromPoint(curve=curve, chordLength=code_block)
splitByPoints = Curve.SplitByPoints(curve=curve, points=pointsAtChordLengthFromPoint)
endPoint = Curve.EndPoint(curve=splitByPoints)
boundingBox = Geometry.BoundingBox(geometry=filterByBoolMask.out)
contains = BoundingBox.Contains(boundingBox=boundingBox)  # unwired: point
map = List.Map(list=endPoint, f_x=contains)
map_2 = List.Map(list=map, f_x=filterByBoolMask_2.in)
flatten = List.Flatten(list=map_2)
uniqueItems = List.UniqueItems(list=flatten)
watch_3 = Watch(uniqueItems)
count = List.Count(list=watch_3)
number = DoubleInput(1)
sequence = Sequence(start=start_number_napr_1, amount=count, step=number, lacing=Longest)

# group: 0 navyse pri jednocifernych cislach
number_2 = DoubleInput(10)
lt = sequence < number_2
number_3 = DoubleInput(0)
code_block_2 = CodeBlock { ""; }
if_ = If(test=lt, true=number_3, false=code_block_2)

# group: 0 navyse pri dvojcifernych cislach
code_block_3 = CodeBlock { 100.000; }
lt_2 = sequence < code_block_3
number_4 = DoubleInput(0)
code_block_4 = CodeBlock { ""; }
if_2 = If(test=lt_2, true=number_4, false=code_block_4)

# group: Error handling
categories_2 = Categories(index=253)
isOfCategory = Custom[Element.IsOfCategory](element=vyber_model_line, category=categories_2)  # Checks whether an element is of a specified category
getCategory = Element.GetCategory(element=vyber_model_line)
watch_4 = Watch(getCategory)
code_block_5 = CodeBlock(a=watch_4) { "OK"; a+" nie je správny druh objektu. Vyber Model line."; }
if_3 = If(test=isOfCategory, true=code_block_5.out0, false=code_block_5.out1)

string_from_object = FromObject(obj=sequence)
code_block_6 = CodeBlock(x=prefix, d=string_from_object) { x+d; }
setParameterByName = Element.SetParameterByName(element=watch_3, parameterName=name_of_pm_parameter, value=code_block_6)
count_2 = List.Count(list=setParameterByName)
code_block_7 = CodeBlock(a=if_3, b=count_2) { "Validation: "+a+", Bolo prečíslovaných "+b+" PM"; }
status = Watch(code_block_7)
návod = StringInput("""Precisluje parkovacie miesta podla nakreslenej ciary. Preskočí miesta s určenou hodnotou v type comments.
format > pnnn (p = prefix; n = number)
	Do vsetkych precislovanych parkovacich miest je potrebne vlozit rovnaky textovy parameter napr. "cislo parkovacieho miesta"a vlozit nested anotation family, ktora tento parameter v parkovacom mieste ukazuje.
	Nasledne sa nakresli ciara (najlepsie spline), ktora pretina tieto parkovacie miesta. Ciary je dobre robit v samostatnej Subcategory napr. "Renumbering parking" aby sa dali lahko vsetky naraz vypnut/zapnut pre nasledne opatovne precislovanie. Ciara musi byt kreslena ako Model Line alebo convertovana z Detail Line.
	Model Line musi byt nakreslena vo Workplane, ktora pretina precislovane parkovacie miesto, cize typicky v rovine podlahy. Pri velmi dlhej ciare sa moze vyskytnut chyba, vtedy rozdelte ciaru na viacere elementy.
	Prikaz moze pracovat dlhsie.""")  # graph input
