# Dynamo graph parking space renumbering spline prefix filter_p_nedoplna_0.dyn (Dynamo 1.3.4.6666)

# group: INPUT
categories = Categories("Parking")
filter_by_type_parameter_name = CodeBlock { "Type Comments"; }
type_comments_filter_1 = StringInput("motorka")
type_comments_filter_2 = StringInput("miesto pre skladanie boxov")
start_number_napr_1 = DoubleInput("")
vyber_model_line = DSModelElementSelection()
code_block = CodeBlock { 1000; }
name_of_pm_parameter = StringInput("Cislo_parkovacieho_miesta")
prefix = StringInput("")

all_elements_of_category = ElementsOfCategory(categories)
watch = Watch(all_elements_of_category)

# group: filter by parameter
type = FamilyInstance.Type(watch)
getParameterValueByName = Element.GetParameterValueByName(element=type, parameterName=filter_by_type_parameter_name)
eq = getParameterValueByName == type_comments_filter_1
eq_2 = getParameterValueByName == type_comments_filter_2
xor = Logic.Xor(eq, eq_2)
filterByBoolMask = List.FilterByBoolMask(list=watch, mask=xor)

filterByBoolMask_2 = List.FilterByBoolMask(list=filterByBoolMask.out)  # unwired: mask
watch_2 = Watch(filterByBoolMask_2.in)
# note: chyba v tomto node, znamena ze ciara nie je nakreslena ako MODEL LINE
curve = CurveElement.Curve(vyber_model_line)
# note: chyba v tomto node znamena ze ciara je prilis dlha
pointsAtChordLengthFromPoint = Curve.PointsAtChordLengthFromPoint(curve, arg2=code_block)
splitByPoints = Curve.SplitByPoints(curve=curve, points=pointsAtChordLengthFromPoint)
endPoint = Curve.EndPoint(splitByPoints)
boundingBox = Geometry.BoundingBox(filterByBoolMask.out)
contains = BoundingBox.Contains(boundingBox)  # unwired: arg1
map = List.Map(list=endPoint, f_x=contains)
map_2 = List.Map(list=map, f_x=filterByBoolMask_2.in)
flatten = Flatten(map_2)
uniqueItems = List.UniqueItems(flatten)
watch_3 = Watch(uniqueItems)
count = Count(watch_3)
number = DoubleInput(1)
sequence = Sequence(start=start_number_napr_1, amount=count, step=number, lacing=Longest)
string_from_object = FromObject(sequence)

# group: 0 navyse pri jednocifernych cislach
number_2 = DoubleInput(10)
lt = sequence < number_2
number_3 = DoubleInput(0)
code_block_2 = CodeBlock { ""; }
if_ = If(test=lt, true=number_3, false=code_block_2)

# group: 0 navyse pri dvojcifernych cislach
number_4 = DoubleInput(100)
lt_2 = sequence < number_4
number_5 = DoubleInput(0)
code_block_3 = CodeBlock { ""; }
if_2 = If(test=lt_2, true=number_5, false=code_block_3)

# group: Error handling
categories_2 = Categories("Lines")
isOfCategory = Custom[Element.IsOfCategory](element=vyber_model_line, category=categories_2)  # Checks whether an element is of a specified category
getCategory = Element.GetCategory(vyber_model_line)
watch_4 = Watch(getCategory)
code_block_4 = CodeBlock(a=watch_4) { "OK"; a+" nie je správny druh objektu. Vyber Model line."; }
if_3 = If(test=isOfCategory, true=code_block_4.out0, false=code_block_4.out1)

code_block_5 = CodeBlock(x=prefix, c=start_number_napr_1) { x+c+y+d; }  # unwired: y, d
setParameterByName = Element.SetParameterByName(element=watch_3, parameterName=name_of_pm_parameter, value=code_block_5)
count_2 = Count(setParameterByName)
code_block_6 = CodeBlock(a=if_3, b=count_2) { "Validation: "+a+", Bolo prečíslovaných "+b+" PM"; }
status = Watch(code_block_6)
návod = StringInput("""Precisluje parkovacie miesta podla nakreslenej ciary. Preskočí miesta s určenou hodnotou v type comments.
format > pnnn (p = prefix; n = number)
 Do vsetkych precislovanych parkovacich miest je potrebne vlozit rovnaky textovy parameter napr. "cislo parkovacieho miesta"a vlozit nested anotation family, ktora tento parameter v parkovacom mieste ukazuje.
 Nasledne sa nakresli ciara (najlepsie spline), ktora pretina tieto parkovacie miesta. Ciary je dobre robit v samostatnej Subcategory napr. "Renumbering parking" aby sa dali lahko vsetky naraz vypnut/zapnut pre nasledne opatovne precislovanie. Ciara musi byt kreslena ako Model Line alebo convertovana z Detail Line.
 Model Line musi byt nakreslena vo Workplane, ktora pretina precislovane parkovacie miesto, cize typicky v rovine podlahy. Pri velmi dlhej ciare sa moze vyskytnut chyba, vtedy rozdelte ciaru na viacere elementy.
 Prikaz moze pracovat dlhsie.""")
