# Dynamo graph parking space renumbering spline_phase_filter_p.dyn (Dynamo 1.3.1.1736)

# group: INPUT
categories = Categories("Parking")
select_model_line = DSModelElementSelection()  # 1 picked in the model
code_block = CodeBlock { 1000; }
name_of_parameter = StringInput("Cislo_parkovacieho_miesta")
start_number_napr_1 = DoubleInput(1)

all_elements_of_category = ElementsOfCategory(categories)
watch = Watch(all_elements_of_category)
select_phase = RevitPhases("EIA - kolaudacia")

# group: Phase filter
phases = Custom[Element.Phases](element=all_elements_of_category)  # Gets the created and demolished phases of an element
id = Element.Id(phases.Created)
id_2 = Element.Id(select_phase)
eq = id == id_2

filterByBoolMask = List.FilterByBoolMask(list=watch, mask=eq)
filterByBoolMask_2 = List.FilterByBoolMask(list=filterByBoolMask.in)  # unwired: mask
watch_2 = Watch(filterByBoolMask_2.in)
návod = StringInput("""Jednoduché precislovanie parkovacich miest vyhovujucich filtru podla nakreslenej ciary (len cislo). Precisluje vsetky miesta vytvorene v danej faze (Phase)

Do vsetkych precislovanych parkovacich miest je potrebne vlozit rovnaky textovy parameter napr. "cislo parkovacieho miesta"a vlozit nested anotation family, ktora tento parameter v parkovacom mieste ukazuje.

Nasledne sa nakresli ciara (najlepsie spline), ktora pretina tieto parkovacie miesta. Ciary je dobre robit v samostatnej Subcategory napr. "Renumbering parking" aby sa dali lahko vsetky naraz vypnut/zapnut pre nasledne opatovne precislovanie. Ciara musi byt kreslena ako Model Line alebo convertovana z Detail Line.

Model Line musi byt nakreslena vo Workplane, ktora pretina precislovane parkovacie miesto, cize typicky v rovine podlahy. Pri velmi dlhej ciare sa moze vyskytnut chyba, vtedy rozdelte ciaru na viacere elementy.

Prikaz moze pracovat dlhsie, nepustajte ho v automatickom mode, ale len v manualnom.""")

# group: Error handling
categories_2 = Categories("Lines")
isOfCategory = Custom[Element.IsOfCategory](element=select_model_line, category=categories_2)  # Checks whether an element is of a specified category
getCategory = Element.GetCategory(select_model_line)
code_block_2 = CodeBlock(a=getCategory) { "OK"; a+" nie je správny druh objektu. Vyber Model line."; }
if_ = If(test=isOfCategory, true=code_block_2.out0, false=code_block_2.out1)

# note: chyba v tomto node, znamena ze ciara nie je nakreslena ako MODEL LINE
curve = CurveElement.Curve(select_model_line)
# note: chyba v tomto node znamena ze ciara je prilis dlha
pointsAtChordLengthFromPoint = Curve.PointsAtChordLengthFromPoint(curve, arg2=code_block)
splitByPoints = Curve.SplitByPoints(curve=curve, points=pointsAtChordLengthFromPoint)
endPoint = Curve.EndPoint(splitByPoints)
boundingBox = Geometry.BoundingBox(filterByBoolMask.in)
contains = BoundingBox.Contains(boundingBox)  # unwired: arg1
map = List.Map(list=endPoint, f_x=contains)
map_2 = List.Map(list=map, f_x=filterByBoolMask_2.in)
flatten = Flatten(map_2)
uniqueItems = List.UniqueItems(flatten)
watch_3 = Watch(uniqueItems)
count = Count(watch_3)
number = DoubleInput(1)
sequence = Sequence(start=start_number_napr_1, amount=count, step=number, lacing=Longest)
string_from_object = FromObject(sequence)
setParameterByName = Element.SetParameterByName(element=watch_3, parameterName=name_of_parameter, value=string_from_object)
count_2 = Count(setParameterByName)
code_block_3 = CodeBlock(a=if_, b=count_2) { "Validation: "+a+", Bolo prečíslovaných "+b+" PM"; }
status = Watch(code_block_3)
