# Dynamo graph placeViewOnSheet_p.dyn (Dynamo 2.3.0.5885)
# packages: Clockwork for Dynamo 2.x 2.1.2

návod = StringInput("umiestni aktívny View na vybraný Sheet. Je potrebné vybrať Rozpisku Sheetu.")  # graph input
current = Document.Current()
activeView = Document.ActiveView(document=current)
select_title_block_of_sheet = DSModelElementSelection()  # 1 picked in the model; graph input
ownerView = Custom[Element.OwnerView](element=select_title_block_of_sheet)  # package Clockwork for Dynamo 2.x; Gets the owner view of a given Revit element (if possible)
placement_x_axis = DoubleSlider(0, range=-3..3 step 0.001)  # graph input
placement_y_axis = DoubleSlider(0, range=0..5 step 0.001)  # graph input
byCoordinates = Point.ByCoordinates(x=placement_x_axis, y=placement_y_axis)
place_legend_on_sheets_py = Python(IN[0]=activeView, IN[1]=ownerView, IN[2]=byCoordinates)
# ---------- place_legend_on_sheets_py.python (39 lines) ----------
import clr
# import Document Manager
clr.AddReference("RevitServices")
import RevitServices 
from RevitServices.Persistence import DocumentManager
from RevitServices.Transactions import TransactionManager
doc = DocumentManager.Instance.CurrentDBDocument
uidoc = DocumentManager.Instance.CurrentUIDocument
clr.AddReference("RevitNodes")
import Revit
clr.ImportExtensions(Revit.Elements)
clr.ImportExtensions(Revit.GeometryConversion)
clr.AddReference("RevitAPI")
from Autodesk.Revit.DB import *

dataEnteringNode = IN

legend = UnwrapElement(IN[0])
sheet = IN[1]
loc = XYZ(IN[2].X, IN[2].Y, IN[2].Z)
viewports = []
failed = []

selectedSheet = UnwrapElement(sheet)
canAddToSht = Viewport.CanAddViewToSheet(doc, selectedSheet.Id, legend.Id)
if canAddToSht:
	try:		
		TransactionManager.Instance.EnsureInTransaction(doc)	
		viewport = Viewport.Create(doc, selectedSheet.Id, legend.Id, loc)	
		TransactionManager.Instance.TransactionTaskDone()
		viewports.Add([viewport,selectedSheet])
	except:
		failed.Add(["Failed",selectedSheet])
else:
	failed.Add(["Failed",selectedSheet])
		
OUT = [viewports, failed]
	
#For more information refer to RBG Wiki or email me (ctrl + click link): daniel.woodcock@robertbird.com
# ----------------------------------------
succeded = CodeBlock(a=place_legend_on_sheets_py) { a[0]; }
countFalse = List.CountFalse(list=succeded)
počet_umiestnených_views = Watch(countFalse)  # graph output
failed = CodeBlock(a=place_legend_on_sheets_py) { a[1]; }
countFalse_2 = List.CountFalse(list=failed)
počet_neumiestnených_views = Watch(countFalse_2)  # graph output
py_log = Python()  # unwired: IN[0]
# ---------- py_log.python (37 lines) ----------
# Load the Python Standard and DesignScript Libraries
import sys
import clr
clr.AddReference('ProtoGeometry')
from Autodesk.DesignScript.Geometry import *
clr.AddReference("RevitServices")
import RevitServices
from RevitServices.Persistence import DocumentManager

from datetime import datetime
import getpass

# name of the script for log
log_string = "placeViewOnSheet"

doc = DocumentManager.Instance.CurrentDBDocument
filePath = doc.PathName

# getting file name from path
lastBackslash = filePath.rindex("\\")+1
file_name = filePath[lastBackslash:]
user_name = getpass.getuser()
datestamp = str(datetime.now())
# tabulator between data to easy import to excel schedule
separator = "\t"
line = datestamp + separator + log_string + separator + user_name + "\n"

try:
	f = open("L:\\customToolslogs\\dynLogs\\" + file_name +".log", "a")
	f.write(line)
	f.close()
	status = "log has been written"
except:
	status = "something went wrong"

# Assign your output to the OUT variable.
OUT = status
# ----------------------------------------
