# Dynamo graph plantingRandomRotate_p.dyn (Dynamo 2.3.0.5885)

# group: INPUT
categories = Categories("OST_Planting")  # graph input
filter_by_parameter = StringInput("Comments")  # graph input
filter_parameter_value = StringInput("")  # graph input

all_elements_of_category = ElementsOfCategory(Category=categories)

# group: filter by parameter value
getParameterValueByName = Element.GetParameterValueByName(element=all_elements_of_category, parameterName=filter_by_parameter)
eq = getParameterValueByName == filter_parameter_value
filterByBoolMask = List.FilterByBoolMask(list=all_elements_of_category, mask=eq)

watch = Watch(filterByBoolMask.in)

# group: random angle
count = List.Count(list=filterByBoolMask.in)
randomList = Math.RandomList(amount=count)
code_block = CodeBlock(a=randomList) { a*360; }

setRotation = FamilyInstance.SetRotation(familyInstance=filterByBoolMask.in, degree=code_block)

# group: status
count_2 = List.Count(list=setRotation)
code_block_2 = CodeBlock(a=count_2) { a+" elementov bolo pootočených o náhodne zvolený uhol"; }
status = Watch(code_block_2)

návod = StringInput("Náhodne pootočí všetky Elementy vyhovujúce filtru, napr. stromy.")  # graph input
py_log = Python()  # unwired: IN[0]
# ---------- py_log.python (37 lines) ----------
# Load the Python Standard and DesignScript Libraries
import sys
import clr
clr.AddReference('ProtoGeometry')
from Autodesk.DesignScript.Geometry import *
clr.AddReference("RevitServices")
import RevitServices
from RevitServices.Persistence import DocumentManager

from datetime import datetime
import getpass

# name of the script for log
log_string = "plantingRandomRotate"

doc = DocumentManager.Instance.CurrentDBDocument
filePath = doc.PathName

# getting file name from path
lastBackslash = filePath.rindex("\\")+1
file_name = filePath[lastBackslash:]
user_name = getpass.getuser()
datestamp = str(datetime.now())
# tabulator between data to easy import to excel schedule
separator = "\t"
line = datestamp + separator + log_string + separator + user_name + "\n"

try:
	f = open("L:\\customToolslogs\\dynLogs\\" + file_name +".log", "a")
	f.write(line)
	f.close()
	status = "log has been written"
except:
	status = "something went wrong"

# Assign your output to the OUT variable.
OUT = status
# ----------------------------------------
