# Dynamo graph pocetFormatov&dimensions_po.dyn (Dynamo 2.3.0.5885)

# group: Gets Titleblocks
code_block = CodeBlock { "Title Blocks"; }
byName = Category.ByName(name=code_block)
all_elements_of_category = ElementsOfCategory(Category=byName)

# group: Gets Sheets
py_clockwork_element_ownerview = Python(IN[0]=all_elements_of_category)
# ---------- py_clockwork_element_ownerview.python (16 lines) ----------
import clr
clr.AddReference('RevitAPI')
from Autodesk.Revit.DB import *

clr.AddReference("RevitNodes")
import Revit
clr.ImportExtensions(Revit.Elements)

def GetOwnerView(item):
	if hasattr(item, "OwnerViewId"): return item.Document.GetElement(item.OwnerViewId)
	else: return None

items = UnwrapElement(IN[0])

if isinstance(IN[0], list): OUT = [GetOwnerView(x) for x in items]
else: OUT = GetOwnerView(items)
# ----------------------------------------

code_block_2 = CodeBlock { "Pocet formatov num"; "Rozmer vykresu"; }

# group: parameter getter
code_block_3 = CodeBlock { "Sheet Width"; }
getParameterValueByName = Element.GetParameterValueByName(element=all_elements_of_category, parameterName=code_block_3)
code_block_4 = CodeBlock { "Sheet Height"; }
getParameterValueByName_2 = Element.GetParameterValueByName(element=all_elements_of_category, parameterName=code_block_4)

# group: calculates pocet formatov
python_script = Python(IN[0]=getParameterValueByName, IN[1]=getParameterValueByName_2)
# ---------- python_script.python (20 lines) ----------
# Enable Python support and load DesignScript library
import clr
import math
clr.AddReference('ProtoGeometry')
from Autodesk.DesignScript.Geometry import *

# The inputs to this node will be stored as a list in the IN variables.

sirka = IN[0]
vyska = IN[1]

# Place your code below this line
y=0
formaty=[]
for s in sirka:
	pocetFormatov = math.ceil(s/211)*math.ceil(vyska[y]/298)
	formaty.append(pocetFormatov)
	y+=1
# Assign your output to the OUT variable.
OUT = formaty
# ----------------------------------------

setParameterByName = Element.SetParameterByName(element=py_clockwork_element_ownerview, parameterName=code_block_2.out0, value=python_script)
návod = StringInput("""Každému Sheetu v projekte zapíše hodnotu "Pocet formatov" z Titleblocku, ktorý je vložený na Sheete do číselného Shared parametru "Pocet formatov num".

Do textového parametru "Rozmer vykresu" zapíše rozmer výkresu vo formáte "sirka x vyska".

V revite je potom v Sheet liste možné spočítať všetky formáty časti alebo celej dokumentácie.""")  # graph input

# group: convert num2strings in format: width x height
python_script_2 = Python(IN[0]=getParameterValueByName_2, IN[1]=getParameterValueByName)
# ---------- python_script_2.python (32 lines) ----------
# Enable Python support and load DesignScript library
import clr
clr.AddReference('ProtoGeometry')
from Autodesk.DesignScript.Geometry import *

# The inputs to this node will be stored as a list in the IN variables.
heights = IN[0]
widths = IN[1]

# Place your code below this line

stringHeights=[]
stringWidths=[]

def stringMaker(inputList,outputList):
	for i in inputList:
		i=int(round(i))
		strings=str(i)
		outputList.append(strings)

stringMaker(heights,stringHeights)
stringMaker(widths,stringWidths)

outlist=[]
y=0
for i in stringHeights:
	outlist.append(stringWidths[y]+"x"+i)
	y+=1

# Assign your output to the OUT variable.
# OUT = stringHeights
OUT = outlist
# ----------------------------------------

setParameterByName_2 = Element.SetParameterByName(element=py_clockwork_element_ownerview, parameterName=code_block_2.out1, value=python_script_2)
py_log = Python()  # unwired: IN[0]
# ---------- py_log.python (37 lines) ----------
# Load the Python Standard and DesignScript Libraries
import sys
import clr
clr.AddReference('ProtoGeometry')
from Autodesk.DesignScript.Geometry import *
clr.AddReference("RevitServices")
import RevitServices
from RevitServices.Persistence import DocumentManager

from datetime import datetime
import getpass

# name of the script for log
log_string = "pocetFormatov&dimensions"

doc = DocumentManager.Instance.CurrentDBDocument
filePath = doc.PathName

# getting file name from path
lastBackslash = filePath.rindex("\\")+1
file_name = filePath[lastBackslash:]
user_name = getpass.getuser()
datestamp = str(datetime.now())
# tabulator between data to easy import to excel schedule
separator = "\t"
line = datestamp + separator + log_string + separator + user_name + "\n"

try:
	f = open("L:\\customToolslogs\\dynLogs\\" + file_name +".log", "a")
	f.write(line)
	f.close()
	status = "log has been written"
except:
	status = "something went wrong"

# Assign your output to the OUT variable.
OUT = status
# ----------------------------------------
