# Dynamo graph pocetFormatov_po.dyn (Dynamo 2.3.0.5885)

# group: Gets Titleblocks
code_block = CodeBlock { "Title Blocks"; }
byName = Category.ByName(name=code_block)
all_elements_of_category = ElementsOfCategory(Category=byName)

py_clockwork_element_ownerview = Python(IN[0]=all_elements_of_category)
# ---------- py_clockwork_element_ownerview.python (16 lines) ----------
import clr
clr.AddReference('RevitAPI')
from Autodesk.Revit.DB import *

clr.AddReference("RevitNodes")
import Revit
clr.ImportExtensions(Revit.Elements)

def GetOwnerView(item):
	if hasattr(item, "OwnerViewId"): return item.Document.GetElement(item.OwnerViewId)
	else: return None

items = UnwrapElement(IN[0])

if isinstance(IN[0], list): OUT = [GetOwnerView(x) for x in items]
else: OUT = GetOwnerView(items)
# ----------------------------------------
code_block_2 = CodeBlock { "Pocet formatov num"; }
elementType = Element.ElementType(element=all_elements_of_category)
code_block_3 = CodeBlock { "Pocet formatov"; }
getParameterValueByName = Element.GetParameterValueByName(element=elementType, parameterName=code_block_3)
setParameterByName = Element.SetParameterByName(element=py_clockwork_element_ownerview, parameterName=code_block_2, value=getParameterValueByName)
návod = StringInput("""Každému Sheetu v projekte zapíše hodnotu "Pocet formatov" z Titleblocku, ktorý je vložený na Sheete do číselného Shared parametru "Pocet formatov num".

V revite je potom v Sheet liste možné spočítať všetky formáty časti alebo celej dokumentácie.""")  # graph input
py_log = Python()  # unwired: IN[0]
# ---------- py_log.python (37 lines) ----------
# Load the Python Standard and DesignScript Libraries
import sys
import clr
clr.AddReference('ProtoGeometry')
from Autodesk.DesignScript.Geometry import *
clr.AddReference("RevitServices")
import RevitServices
from RevitServices.Persistence import DocumentManager

from datetime import datetime
import getpass

# name of the script for log
log_string = "pocetFormatov"

doc = DocumentManager.Instance.CurrentDBDocument
filePath = doc.PathName

# getting file name from path
lastBackslash = filePath.rindex("\\")+1
file_name = filePath[lastBackslash:]
user_name = getpass.getuser()
datestamp = str(datetime.now())
# tabulator between data to easy import to excel schedule
separator = "\t"
line = datestamp + separator + log_string + separator + user_name + "\n"

try:
	f = open("L:\\customToolslogs\\dynLogs\\" + file_name +".log", "a")
	f.write(line)
	f.close()
	status = "log has been written"
except:
	status = "something went wrong"

# Assign your output to the OUT variable.
OUT = status
# ----------------------------------------
