# Dynamo graph prefaGapSetter_p.dyn "prefaGapSetter" (Dynamo 2.3.0.5885)

# group: INPUT
select_model_elements = DSModelElementsSelection()  # nothing selected; graph input
parameter_name = StringInput("dlzka prvku")  # graph input
rozdiel = DoubleSlider(10, range=0..100 step 10)  # graph input

getParameterValueByName = Element.GetParameterValueByName(element=select_model_elements, parameterName=parameter_name)
code_block = CodeBlock(length=getParameterValueByName, diff=rozdiel) { length - diff; }
setParameterByName = Element.SetParameterByName(element=select_model_elements, parameterName=parameter_name, value=code_block)
návod = StringInput("Prefabrikátom vymodelovaným tesne vedľa seba skráti ich dĺžku tak, aby medzi nimi vznikli medzery želanej šírky")  # graph input
