# Dynamo graph prierazyAutomaticDepth_p.dyn (Dynamo 1.3.1.1736)

návod = StringInput("""Vsetkym Generic Models vyhovujucim filtru nastavi hodnotu parametra Depth podla hrubky steny, ktora je host prierazu.
Funguje len na objekty, ktore maju urcenu hodnotu daneho parametra.
Napr. Automaticky nastavi Depth vsetkym prierazom ak sa Mark=1. Ostatne necha neupravene.""")
category = Categories("GenericModel")
all_elements_of_category = ElementsOfCategory(category)

# group: INPUT
parameter_name = StringInput("Mark")
parameter_value = StringInput("1")

getParameterValueByName = Element.GetParameterValueByName(element=all_elements_of_category, parameterName=parameter_name)
eq = getParameterValueByName == parameter_value
filterByBoolMask = List.FilterByBoolMask(list=all_elements_of_category, mask=eq)
parameter_name_2 = StringInput("Depth")
getParameterValueByName_2 = Element.GetParameterValueByName(element=filterByBoolMask.in, parameterName=parameter_name_2)
host = Custom[Element.Host](element=filterByBoolMask.in)  # Gets an element's host
type = Custom[Element.Type](element=host)  # Gets the family type of a given element (if applicable).
code_block = CodeBlock { "Width"; }
getParameterValueByName_3 = Element.GetParameterValueByName(element=type, parameterName=code_block)
setParameterByName = Element.SetParameterByName(element=filterByBoolMask.in, parameterName=parameter_name_2, value=getParameterValueByName_3)
watch = Watch(setParameterByName)
