# Dynamo graph prierazyCircularDucts_FromLink.dyn (Dynamo 2.12.1.8246)
# packages: Clockwork for Dynamo 2.x 2.1.2, spring nodes 203.1.0, cata_lyst 0.0.1, Rhythm 2022.4.3

# group: INPUT
select_wall = DSModelElementSelection()  # 1 picked in the model; graph input
select_from_link_ducts_window = SelectElementsInLink()  # "Select from Link Ducts (Window selection + Click Finish)"; 3 picked in the model; graph input
o_koľko_má_byť_väčší_otvor_na = DoubleSlider(50, range=0..200 step 10)  # "o koľko má byť väčší otvor na každú stranu"; graph input
rozmer_otvorov_zaokrúliť_na = DoubleSlider(10, range=1..100 step 10)  # graph input
kód_profesie = StringInput("VZ")  # graph input

# group: Opening Family Type
code_block = CodeBlock { "Prieraz_KRUH_stena"; }
byName = FamilyType.ByName(name=code_block)
family_prierazu = FamilyTypes()  # nothing selected

geometry = Element.Geometry(element=select_wall)

# group: category filter
getCategory = Element.GetCategory(element=select_from_link_ducts_window.Elements)
name = Category.Name(category=getCategory)
code_block_2 = CodeBlock { "Ducts"; }
eq = name == code_block_2
filterByBoolMask = List.FilterByBoolMask(list=select_from_link_ducts_window.Elements, mask=eq)

location = Custom[Element.Location+](element=filterByBoolMask.in)  # package Clockwork for Dynamo 2.x; Returns the location of an element as point, curve or curve loop, along with some booleans to help filtering the results. Unlike the OOTB Element.GetLocation node, it also retunrs sketch lines of sketch-based elements like floor slabs as well as the element's rotation property.

# group: transform geometry from the link
byOrigin = CoordinateSystem.ByOrigin()
transform = Geometry.Transform(geometry=location.curves, fromCoordinateSystem=byOrigin, contextCoordinateSystem=select_from_link_ducts_window.transform)

intersect = Geometry.Intersect(geometry=geometry, other=transform, lacing=CrossProduct)
flatten = List.Flatten(list=intersect)
endPoint = Curve.EndPoint(curve=flatten)
byPoints = Custom[Springs.HostedInstance.ByPoints](host=select_wall, type=byName, point=endPoint)  # package spring nodes; Creates hosted family instances(doors/windows) at the specified points. You can feed either a single family type or a unique type for each instance.
code_block_3 = CodeBlock { "Priemer"; }

# group: Calculates opening width
code_block_4 = CodeBlock { "Diameter"; }
getParameterValueByName = Element.GetParameterValueByName(element=filterByBoolMask.in, parameterName=code_block_4)
code_block_5 = CodeBlock(parameter=getParameterValueByName, offset=o_koľko_má_byť_väčší_otvor_na) { parameter + 2* offset; }
round = Math.Round(number=code_block_5)
ceiling = Custom[Rounding.Ceiling+](dbl=round, precision=rozmer_otvorov_zaokrúliť_na)  # package Clockwork for Dynamo 2.x; Rounds a number *up* to a specified precision

# group: set opening size
setParameterByName = Element.SetParameterByName(element=byPoints, parameterName=code_block_3, value=ceiling)

návod = StringInput("""Vo vybranej stene vytvorí automaticky prierazy pre vybrané VZT potrubia kruhového prierezu - Duct. V projekte musí byť naloadovaná family s názvom "Prieraz_KRUH_stena"  a pridaný Shared Parameter "Profesia".

Trasy profesií musia byť loadnuté ako link.

POZOR:
Ak script nefunguje, je potrebné loadnuť všetky Linky. Ak nefunguje ani tak, je potrebné otvoriť všetky Worksety - Je to Revit Bug.

Je potrebné mať nainštalované packages Clockwork, Springs a Rhythm""")  # graph input

# group: PROFESIA
parameter_name = StringInput("Profesia")

# group: setter - profesia
setParameterByName_2 = Element.SetParameterByName(element=byPoints, parameterName=parameter_name, value=kód_profesie)

parameter_name_2 = StringInput("Fire_Rating")
elementType = Element.ElementType(element=select_wall)
code_block_6 = CodeBlock { "Fire Rating"; }
getParameterValueByName_2 = Element.GetParameterValueByName(element=elementType, parameterName=code_block_6)

# group: setter - Fire Rating
setParameterByName_3 = Element.SetParameterByName(element=byPoints, parameterName=parameter_name_2, value=getParameterValueByName_2)

code_block_7 = CodeBlock { "prierazyCircularDucts_FromLink"; }
usageLog = Custom[usageLog](scriptName=code_block_7)  # package cata_lyst; node logs every run of the script in which is used to the hardcoded server location
parameter_name_3 = StringInput("hrubka Poziarnej upchavky")

# group: setter - upchavka
setParameterByName_4 = Element.SetParameterByName(element=byPoints, parameterName=parameter_name_3, value=o_koľko_má_byť_väčší_otvor_na)

code_block_8 = CodeBlock { "Workset"; }
getParameterValueByName_3 = Element.GetParameterValueByName(element=select_wall, parameterName=code_block_8)

# group: setter - Workset
setParameterByName_5 = Element.SetParameterByName(element=byPoints, parameterName=code_block_8, value=getParameterValueByName_3)
