# Dynamo graph prierazyPipes_FromLink.dyn (Dynamo 2.12.1.8246)
# packages: Clockwork for Dynamo 2.x 2.1.2, spring nodes 203.1.0, cata_lyst 0.0.1, Rhythm 2022.4.3

# group: Opening Family Type
family_prierazu = FamilyTypes()  # nothing selected
code_block = CodeBlock { "Prieraz_KRUH_stena"; }
byName = FamilyType.ByName(name=code_block)

návod = StringInput("""Vo vybranej stene vytvorí automaticky prierazy pre vybrané potrubia v kategórii Pipes kruhového prierezu. V projekte musí byť naloadovaná family s názvom "Prieraz_KRUH_stena" a pridaný Shared Parameter "Profesia".

Trasy profesií musia byť loadnuté ako link.

POZOR:
Ak script nefunguje, je potrebné loadnuť všetky Linky. Ak nefunguje ani tak, je potrebné otvoriť všetky Worksety - Je to Revit Bug.

Je potrebné mať nainštalované packages Clockwork, Springs a Rhythm""")  # graph input

# group: INPUT
select_wall = DSModelElementSelection()  # 1 picked in the model; graph input
select_elements_from_link_click = SelectElementsInLink()  # "Select Elements from Link - Click Finish"; 7 picked in the model; graph input
o_koľko_má_byť_väčší_otvor_na = DoubleSlider(50, range=0..200 step 10)  # "o koľko má byť väčší otvor na každú stranu"; graph input
rozmer_otvorov_zaokrúliť_na = DoubleSlider(10, range=1..100 step 10)  # graph input
kód_profesie = StringInput("ZT")  # graph input

geometry = Element.Geometry(element=select_wall)

# group: category filter
getCategory = Element.GetCategory(element=select_elements_from_link_click.Elements)
name = Category.Name(category=getCategory)
code_block_2 = CodeBlock { "Pipes"; }
eq = name == code_block_2
filterByBoolMask = List.FilterByBoolMask(list=select_elements_from_link_click.Elements, mask=eq)

location = Custom[Element.Location+](element=filterByBoolMask.in)  # package Clockwork for Dynamo 2.x; Returns the location of an element as point, curve or curve loop, along with some booleans to help filtering the results. Unlike the OOTB Element.GetLocation node, it also retunrs sketch lines of sketch-based elements like floor slabs as well as the element's rotation property.

# group: transform geometry from the link
byOrigin = CoordinateSystem.ByOrigin()
transform = Geometry.Transform(geometry=location.curves, fromCoordinateSystem=byOrigin, contextCoordinateSystem=select_elements_from_link_click.transform)

intersect = Geometry.Intersect(geometry=geometry, other=transform, lacing=CrossProduct)
flatten = List.Flatten(list=intersect)
endPoint = Curve.EndPoint(curve=flatten)
byPoints = Custom[Springs.HostedInstance.ByPoints](host=select_wall, type=byName, point=endPoint)  # package spring nodes; Creates hosted family instances(doors/windows) at the specified points. You can feed either a single family type or a unique type for each instance.

# group: Calculates opening size
code_block_3 = CodeBlock { "Diameter"; }
getParameterValueByName = Element.GetParameterValueByName(element=filterByBoolMask.in, parameterName=code_block_3)
code_block_4 = CodeBlock(a=o_koľko_má_byť_väčší_otvor_na) { a*2; }
code_block_5 = CodeBlock { "Insulation Thickness"; }
getParameterValueByName_2 = Element.GetParameterValueByName(element=filterByBoolMask.in, parameterName=code_block_5)
code_block_6 = CodeBlock(diameter=getParameterValueByName, offset=code_block_4, insulation=getParameterValueByName_2) { diameter + offset + 2*insulation; }

round = Math.Round(number=code_block_6)

# group (continued): Calculates opening size
ceiling = Custom[Rounding.Ceiling+](dbl=round, precision=rozmer_otvorov_zaokrúliť_na)  # package Clockwork for Dynamo 2.x; Rounds a number *up* to a specified precision

# group: set opening size
code_block_7 = CodeBlock { "Priemer"; }
setParameterByName = Element.SetParameterByName(element=byPoints, parameterName=code_block_7, value=ceiling)

# group: PROFESIA
parameter_name = StringInput("Profesia")

# group: setter - profesia
setParameterByName_2 = Element.SetParameterByName(element=setParameterByName, parameterName=parameter_name, value=kód_profesie)

parameter_name_2 = StringInput("hrubka Poziarnej upchavky")

# group: setter - upchavka
setParameterByName_3 = Element.SetParameterByName(element=setParameterByName, parameterName=parameter_name_2, value=o_koľko_má_byť_väčší_otvor_na)

code_block_8 = CodeBlock { "prierazyPipes_FromLink"; }
usageLog = Custom[usageLog](scriptName=code_block_8)  # package cata_lyst; node logs every run of the script in which is used to the hardcoded server location
code_block_9 = CodeBlock { "Workset"; }
getParameterValueByName_3 = Element.GetParameterValueByName(element=select_wall, parameterName=code_block_9)

# group: setter - Workset
setParameterByName_4 = Element.SetParameterByName(element=byPoints, parameterName=code_block_9, value=getParameterValueByName_3)

parameter_name_3 = StringInput("Fire_Rating")
elementType = Element.ElementType(element=select_wall)
code_block_10 = CodeBlock { "Fire Rating"; }
getParameterValueByName_4 = Element.GetParameterValueByName(element=elementType, parameterName=code_block_10)

# group: setter - Fire Rating
setParameterByName_5 = Element.SetParameterByName(element=byPoints, parameterName=parameter_name_3, value=getParameterValueByName_4)
