# Dynamo graph prierazyRectDucts&cableTrays_FromLink.dyn (Dynamo 2.12.1.8246)
# packages: Clockwork for Dynamo 2.x 2.1.2, spring nodes 203.1.0, cata_lyst 0.0.1, Rhythm 2022.4.3

# group: INPUT
select_wall = DSModelElementSelection()  # 1 picked in the model; graph input
select_ducts_cable_trays_window = SelectElementsInLink()  # "Select Ducts & Cable Trays (Window selection + Click Finish)"; 3 picked in the model; graph input
o_koľko_má_byť_väčší_otvor_na = DoubleSlider(50, range=0..200 step 10)  # "o koľko má byť väčší otvor na každú stranu"; graph input
rozmer_otvorov_zaokrúliť_na = DoubleSlider(1, range=1..100 step 10)  # graph input
kód_profesie = StringInput("VZ")  # graph input

# group: Opening Family Type
code_block = CodeBlock { "Prieraz-stena-RECT_hosted"; }
byName = FamilyType.ByName(name=code_block)
family_prierazu = FamilyTypes()  # nothing selected

geometry = Element.Geometry(element=select_wall)

# group: category filter
getCategory = Element.GetCategory(element=select_ducts_cable_trays_window.Elements)
name = Category.Name(category=getCategory)
code_block_2 = CodeBlock { "Cable Trays"; }
eq = name == code_block_2
code_block_3 = CodeBlock { "Ducts"; }
eq_2 = name == code_block_3
xor = Math.Xor(bool=eq, otherBool=eq_2)
filterByBoolMask = List.FilterByBoolMask(list=select_ducts_cable_trays_window.Elements, mask=xor)

location = Custom[Element.Location+](element=filterByBoolMask.in)  # package Clockwork for Dynamo 2.x; Returns the location of an element as point, curve or curve loop, along with some booleans to help filtering the results. Unlike the OOTB Element.GetLocation node, it also retunrs sketch lines of sketch-based elements like floor slabs as well as the element's rotation property.

# group: transform geometry from the link
byOrigin = CoordinateSystem.ByOrigin()
transform = Geometry.Transform(geometry=location.curves, fromCoordinateSystem=byOrigin, contextCoordinateSystem=select_ducts_cable_trays_window.transform)

intersect = Geometry.Intersect(geometry=geometry, other=transform, lacing=CrossProduct)
flatten = List.Flatten(list=intersect)
endPoint = Curve.EndPoint(curve=flatten)
code_block_4 = CodeBlock(a=o_koľko_má_byť_väčší_otvor_na) { a*2; }

# group: Calculates opening height
code_block_5 = CodeBlock { "Height"; }
getParameterValueByName = Element.GetParameterValueByName(element=filterByBoolMask.in, parameterName=code_block_5)
code_block_6 = CodeBlock(parameter=getParameterValueByName, offset=code_block_4) { parameter + offset; }
round = Math.Round(number=code_block_6)
ceiling = Custom[Rounding.Ceiling+](dbl=round, precision=rozmer_otvorov_zaokrúliť_na)  # package Clockwork for Dynamo 2.x; Rounds a number *up* to a specified precision

# group: lowering basepoint because of origin on bottom edge
X = Point.X(point=endPoint)
Y = Point.Y(point=endPoint)
Z = Point.Z(point=endPoint)
code_block_7 = CodeBlock(z=Z, height=ceiling) { z-height/2; }
byCoordinates = Point.ByCoordinates(x=X, y=Y, z=code_block_7)

byPoints = Custom[Springs.HostedInstance.ByPoints](host=select_wall, type=byName, point=byCoordinates)  # package spring nodes; Creates hosted family instances(doors/windows) at the specified points. You can feed either a single family type or a unique type for each instance.

# group: Calculates opening width
code_block_8 = CodeBlock { "Width"; }
getParameterValueByName_2 = Element.GetParameterValueByName(element=filterByBoolMask.in, parameterName=code_block_8)
code_block_9 = CodeBlock(parameter=getParameterValueByName_2, offset=code_block_4) { parameter + offset; }
round_2 = Math.Round(number=code_block_9)
ceiling_2 = Custom[Rounding.Ceiling+](dbl=round_2, precision=rozmer_otvorov_zaokrúliť_na)

# group: set opening width
setParameterByName = Element.SetParameterByName(element=byPoints, parameterName=code_block_8, value=ceiling_2)

# group: set opening heigth
setParameterByName_2 = Element.SetParameterByName(element=byPoints, parameterName=code_block_5, value=ceiling)

# group: PROFESIA
parameter_name = StringInput("Profesia")

# group: setter - profesia
setParameterByName_3 = Element.SetParameterByName(element=byPoints, parameterName=parameter_name, value=kód_profesie)

návod = StringInput("""Vo vybranej stene vytvorí automaticky prierazy pre vybrané VZT potrubia obdĺžnikového prierezu - Duct alebo káblové žľaby - Cable Trays. V projekte musí byť naloadovaná family s názvom "Prieraz-stena-RECT_hosted" a pridaný Shared Parameter "Profesia".

Trasy profesií musia byť loadnuté ako link.

POZOR:
Ak script nefunguje, je potrebné loadnuť všetky Linky. Ak nefunguje ani tak, je potrebné otvoriť všetky Worksety - Je to Revit Bug.

Je potrebné mať nainštalované packages Clockwork, Springs a Rhythm""")  # graph input
watch = Watch(filterByBoolMask.in)
code_block_10 = CodeBlock { "prierazyRectDucts&cableTrays_FromLink"; }
usageLog = Custom[usageLog](scriptName=code_block_10)  # package cata_lyst; node logs every run of the script in which is used to the hardcoded server location
parameter_name_2 = StringInput("hrubka Poziarnej upchavky")

# group: setter - upchavka
setParameterByName_4 = Element.SetParameterByName(element=byPoints, parameterName=parameter_name_2, value=o_koľko_má_byť_väčší_otvor_na)

code_block_11 = CodeBlock { "Workset"; }
getParameterValueByName_3 = Element.GetParameterValueByName(element=select_wall, parameterName=code_block_11)

# group: setter - Workset
setParameterByName_5 = Element.SetParameterByName(element=byPoints, parameterName=code_block_11, value=getParameterValueByName_3)

parameter_name_3 = StringInput("Fire_Rating")
elementType = Element.ElementType(element=select_wall)
code_block_12 = CodeBlock { "Fire Rating"; }
getParameterValueByName_4 = Element.GetParameterValueByName(element=elementType, parameterName=code_block_12)

# group: setter - Fire Rating
setParameterByName_6 = Element.SetParameterByName(element=byPoints, parameterName=parameter_name_3, value=getParameterValueByName_4)
