# Dynamo graph prierazyWindowsLevel_po.dyn "prierazyWindowsLevelV2" (Dynamo 2.0.1.5055)

# group: Selector
categories = Categories(index=603)
all_elements_of_category = ElementsOfCategory(Category=categories)

# group: Filter by Type Comments
elementType = Element.ElementType(element=all_elements_of_category)
code_block = CodeBlock { "Type Comments"; }
getParameterValueByName = Element.GetParameterValueByName(element=elementType, parameterName=code_block)
type_comments_filter = StringInput("stavebne upravy")
eq = getParameterValueByName == type_comments_filter
filterByBoolMask = List.FilterByBoolMask(list=all_elements_of_category, mask=eq)

# group: Ref od 0 Setter
parameter_name_pre_výšku_od_0 = StringInput("ref od 0")  # "Parameter Name pre výšku od ±0.000"
code_block_2 = CodeBlock { "Level"; }
getParameterValueByName_2 = Element.GetParameterValueByName(element=filterByBoolMask.in, parameterName=code_block_2)
elevation = Level.Elevation(level=getParameterValueByName_2)
setParameterByName = Element.SetParameterByName(element=filterByBoolMask.in, parameterName=parameter_name_pre_výšku_od_0, value=elevation)

návod = StringInput("""Do parametru "ref od 0" zapíše výšku levelu, na ktorom je daná stavebná úprava a do parametru "Poschodie" napíše číslo v názve Levelu, na ktorom je prieraz umiestnený.
Pre spustenie klikni na ikonku PLAY.

(Pracuje len s prierazmi s Type Comments == stavebne upravy)""")  # graph input
manual = StringInput("""Do parametru "ref od 0" zapíše výšku levelu, na ktorom je daná stavebná úprava.
Funguje len pre families v category = "Window" a s type comments = "stavebne upravy". Funguje na hostovane aj nehostovane prierazy. 
Pre spustenie klikni na ikonku PLAY.""")
parameter_of_level_number = StringInput("Poschodie")

# group: Level parameter Setter
name = Level.Name(level=getParameterValueByName_2)
code_block_3 = CodeBlock { 0; }
code_block_4 = CodeBlock { "."; }
indexOf = String.IndexOf(str=name, searchFor=code_block_4)
substring = String.Substring(str=name, startIndex=code_block_3, length=indexOf)
setParameterByName_2 = Element.SetParameterByName(element=filterByBoolMask.in, parameterName=parameter_of_level_number, value=substring)
