# Dynamo graph prierazy_vyska_2param_p.dyn (Dynamo 1.3.2.2480)

categories = Categories("GenericModel")
all_elements_of_category = ElementsOfCategory(categories)

# group: INPUT
type_comments_filter = StringInput("stavebne upravy")
parameter_name_pre_výšku_od = StringInput("SHprierazu_Level")  # "Parameter Name pre výšku od podlahy"
parameter_name_pre_výšku_od_0 = StringInput("SHprierazu_0")  # "Parameter Name pre výšku od ±0.000"

# group: Filter by Type Comments
type = FamilyInstance.Type(all_elements_of_category)
code_block = CodeBlock { "Type Comments"; }
getParameterValueByName = Element.GetParameterValueByName(element=type, parameterName=code_block)
eq = getParameterValueByName == type_comments_filter
filterByBoolMask = List.FilterByBoolMask(list=all_elements_of_category, mask=eq)

# group: elevation from floor
code_block_2 = CodeBlock { "Elevation"; }
getParameterValueByName_2 = Element.GetParameterValueByName(element=filterByBoolMask.in, parameterName=code_block_2)

watch = Watch(getParameterValueByName_2)
round = Math.Round(getParameterValueByName_2)

# group (continued): elevation from floor
py_number_to_string_from_springs = Python(IN[0]=round)  # unwired: IN[1]
# ---------- py_number_to_string_from_springs.python (23 lines) ----------
# Copyright(c) 2017, Dimitar Venkov
# @5devene, dimitar.ven@gmail.com
# www.badmonkeys.net

def tolist(x):
	if hasattr(x,'__iter__'): return x
	else : return [x]

def output(x):
	if len(x) == 1: return x[0]
	else : return x

def n2s(n, digits=IN[1]):
	if digits is not None:
		n = round(n, digits)
	s1 = str(n)
	if s1[-2:] == ".0":
		s1 = s1[:-2]
	return s1

nums = tolist(IN[0])

OUT = output(map(n2s, nums) )
# ----------------------------------------
code_block_3 = CodeBlock(a=py_number_to_string_from_springs) { "S.H. od podlahy = "+a; }
setParameterByName = Element.SetParameterByName(element=filterByBoolMask.in, parameterName=parameter_name_pre_výšku_od, value=code_block_3)

# group: elevation from 0,000
code_block_4 = CodeBlock { "Level"; }
getParameterValueByName_3 = Element.GetParameterValueByName(element=filterByBoolMask.in, parameterName=code_block_4)
elevation = Level.Elevation(getParameterValueByName_3)
code_block_5 = CodeBlock(a=elevation, b=round) { a+b; }
py_number_to_string_from_springs_2 = Python(IN[0]=code_block_5)  # unwired: IN[1]; same code as py_number_to_string_from_springs
code_block_6 = CodeBlock(a=py_number_to_string_from_springs_2) { "S.H.= "+a; }
setParameterByName_2 = Element.SetParameterByName(element=filterByBoolMask.in, parameterName=parameter_name_pre_výšku_od_0, value=code_block_6)

návod = StringInput("""Do 2 druhov zvolených parametrov zapíše výšky spodných hrán prierazov (Generic Models, ktorých parameter Type Comments vyhovuje filtru).

Jeden parameter zobrazuje hodnotu od ±0.000 a druhý od príslušného levelu.""")

# group: Symbolic lines in Floorplan visibility
code_block_7 = CodeBlock { 1200; }
le = getParameterValueByName_2 <= code_block_7
filterByBoolMask_2 = List.FilterByBoolMask(list=filterByBoolMask.in, mask=le)
code_block_8 = CodeBlock { "vyska symbolu v podoryse"; }
code_block_9 = CodeBlock { 1200; 100; }
setParameterByName_3 = Element.SetParameterByName(element=filterByBoolMask_2.out, parameterName=code_block_8, value=code_block_9.out1)
setParameterByName_4 = Element.SetParameterByName(element=filterByBoolMask_2.in, parameterName=code_block_8, value=code_block_9.out0)
