# Dynamo graph purgeBeforePublish.dyn (Dynamo 2.12.1.8246)
# packages: Clockwork for Dynamo 2.x 2.1.2, cata_lyst 0.0.1, Genius Loci 2021.11.10, Clockwork for Dynamo 2.x 2.4.0, archi-lab.net 2023.213.1523

návod = StringInput("""Vymaže všetky Worksety, ktoré nie sú v zozname.

Vymaže všetky Views (Floorplans, Sections, Details), Schedules, Legends, Sheets.

Nevymaže views, ktoré majú hodnou vybraného parametra rovnú zvolenej hodnote. 

Nakoniec spustí Deep Purge.

Skript môže pri väčších projektoch s množstvom views pracovať dlhšie. 
Je potrebné mať nainštalovaný package Springs a Clockwork""")  # graph input
code_block = CodeBlock { "purgeBeforePublish"; }
usageLog = Custom[usageLog](scriptName=code_block)  # package cata_lyst; node logs every run of the script in which is used to the hardcoded server location

# group: Purge unused
code_block_2 = CodeBlock { t1 = true; }
current = Document.Current()

code_block_3 = CodeBlock { null; }
views = Custom[Document.Views](docOrRevitLinkInstance=code_block_3)  # package Clockwork for Dynamo 2.x; Gets all views in the document - except for 3D view templates (as long as this bug is not fixed: https://github.com/DynamoDS/Dynamo/issues/2970)

# group: INPUT
parameter_name = StringInput("Delenie 2")  # graph input
parameter_value_1 = StringInput("SLEPÁKY M50")  # graph input
parameter_value_2 = StringInput("WORK")  # graph input
worksets_to_stay = CodeBlock()
# ---------- worksets_to_stay.designscript (11 lines) ----------
[
"(LINK)_FASADA",
"3DtextRoomData",
"ARCHITEKTURA",
"GRC DELENIE",
"OSI A LEVELY",
"PILOTY",
"STATIKA",
"TEREN NOVY",
"TESNIACE STENY"
];
# ----------------------------------------

getParameterValueByName = Element.GetParameterValueByName(element=views, parameterName=parameter_name)
eq = getParameterValueByName == parameter_value_1
eq_2 = getParameterValueByName == parameter_value_2
or_ = eq || eq_2
filterByBoolMask = List.FilterByBoolMask(list=views, mask=or_)
list_create = List.Create(item0=filterByBoolMask.out)
flatten = List.Flatten(list=list_create)
isViewTemplate = Custom[View.IsViewTemplate+](view=flatten)  # package Clockwork for Dynamo 2.x; Checks if a given view is a view template. Unlike the OOTB node it works for all view types.
filterByBoolMask_2 = List.FilterByBoolMask(list=flatten, mask=isViewTemplate)
delete = Element.Delete(element=filterByBoolMask_2.out)
getAll = archilab.Revit.Elements.Workset.GetAll()
py_is_wsname_in_the_list = Python(IN[0]=getAll, IN[1]=worksets_to_stay)  # IronPython2
# ---------- py_is_wsname_in_the_list.python (19 lines) ----------
# Load the Python Standard and DesignScript Libraries
import sys
import clr
clr.AddReference('ProtoGeometry')
from Autodesk.DesignScript.Geometry import *

# The inputs to this node will be stored as a list in the IN variables.
worksets = IN[0]
names = IN[1]
# Place your code below this line
filtered = []

for ws in worksets:
	wsname = ws.Name
	if wsname not in names:
		filtered.append(ws.Id)

# Assign your output to the OUT variable.
OUT = filtered
# ----------------------------------------
py_delete_worksets = Python(IN[0]=py_is_wsname_in_the_list)  # IronPython2
# ---------- py_delete_worksets.python (32 lines) ----------
#Alban de Chasteigner 2021
#twitter : @geniusloci_bim
#geniusloci.bim@gmail.com
#https://github.com/albandechasteigner/GeniusLociForDynamo

import clr
clr.AddReference("RevitServices")
import RevitServices
from RevitServices.Persistence import DocumentManager
from RevitServices.Transactions import TransactionManager
doc = DocumentManager.Instance.CurrentDBDocument
# Import RevitAPI
clr.AddReference("RevitAPI")
import Autodesk
from Autodesk.Revit.DB import *

ids = IN[0] if isinstance(IN[0],list) else [IN[0]]
names = []

deleteWorksetSettings = DeleteWorksetSettings()

TransactionManager.Instance.EnsureInTransaction(doc)
for worksetId in ids :
	if WorksetTable.CanDeleteWorkset(doc,WorksetId(worksetId),deleteWorksetSettings):
		WorksetTable.DeleteWorkset(doc,WorksetId(worksetId),deleteWorksetSettings)
		names.append(doc.GetWorksetTable().GetWorkset(WorksetId(worksetId)).Name)
	else:
		names.append("The workset is not editable by the current user or is owned by other user")
TransactionManager.Instance.TransactionTaskDone()

if isinstance(IN[0], list): OUT = names
else: OUT = names[0]
# ----------------------------------------
passthrough = Custom[Passthrough](passThrough=delete, waitFor=py_delete_worksets)  # package Clockwork for Dynamo 2.x; Forces a sequential order of execution. The node wired into the output of the Passthrough node will be executed *after* the node wired into the waitFor input (e.g. important for some Revit operations). The value of the passThrough input will be passed on to the node wired into the output port of the Passthrough node.
passthrough_2 = Custom[Passthrough](passThrough=current, waitFor=passthrough)

# group (continued): Purge unused
purge_unused = Custom[Purge Unused](RunIt=code_block_2, Deeply=code_block_2, document=passthrough_2)  # package Genius Loci; Purge the document completely including materials an assets using the API. The optional input "deeply" allows to purge unused view templates, unused view filters, imported line Patterns from DWG and "Imports in Families" Object Styles. Can be used with documents open in the background. Works only in Revit 2017 and later.

# group: get ws names
name = archilab.Revit.Elements.Workset.Name(workset=getAll)

code_block_4 = CodeBlock()
# ---------- code_block_4.designscript (10 lines) ----------
[
  "ARCHITEKTURA",
  "OSY A LEVELY",
  "STATIKA",
  "ZARIADOVACIE - STAFAZ",
  "LINKY",
  "PROFESIE",
  "POMOCNE",
  "3DtextRoomData"
];
# ----------------------------------------
