# Dynamo graph purgeNotUsedColorFillEntries_po.dyn "purgeNotUsedColorFillEntries" (Dynamo 2.12.1.8246)
# packages: Genius Loci 2022.4.19, cata_lyst 0.0.1

current = Document.Current()
activeView = Document.ActiveView(document=current)
categories = Categories("OST_Rooms")
view_get_colorfill_scheme = Custom[View Get ColorFill Scheme](view=activeView, category=categories)  # package Genius Loci; Works only in Revit 2022 and later. Returns the color fill scheme element applied to the view.
get_colorfill_scheme_properties = Custom[Get ColorFill Scheme Properties](colorFillScheme=view_get_colorfill_scheme)  # package Genius Loci; Works only in Revit 2022 and later. Gets the category, values, colors and fill patterns of the given Color Scheme.
filterByBoolMask = List.FilterByBoolMask(list=get_colorfill_scheme_properties.Entries, mask=get_colorfill_scheme_properties.IsInUse)
colorfill_scheme_removeentry = Custom[ColorFill Scheme RemoveEntry](colorFillScheme=view_get_colorfill_scheme, entry=filterByBoolMask.out)  # package Genius Loci; Works only in Revit 2022 and later. Removes unused entries from the given color scheme.
návod = StringInput("Vymaze Entries, ktoré nie su pouzite v Colorscheme, ktora je aplikovana v aktivnom View")  # graph input
code_block = CodeBlock { "purgeNotUsedColorFillEntries"; }
usageLog = Custom[usageLog](scriptName=code_block)  # package cata_lyst; node logs every run of the script in which is used to the hardcoded server location
