# Dynamo graph removeUndeletableParameter.dyn (Dynamo 2.3.1.11775)
# packages: archi-lab.net 2022.210.2218

element_types = ElementTypes("SharedParameterElement")
all_elements_of_type = ElementsOfType(element_type=element_types)
name = Element.Name(element=all_elements_of_type)

# group: INPUT
parameter_name = StringInput("Profesie")  # graph input

firstIndexOf = List.FirstIndexOf(list=name, item=parameter_name)
getItemAtIndex = List.GetItemAtIndex(list=all_elements_of_type, index=firstIndexOf)
delete = archilab.Revit.Elements.Elements.Delete(element=getItemAtIndex)
návod = StringInput("Vymazanie parametru z projektu ak nie je možné vymazať ho štandardnou cestou")  # graph input
