# Dynamo graph revision cloud comments CLIPBOARD by selection_p.dyn (Dynamo 2.3.0.5885)

# note: Vytvori zoradeny zoznam Commentov vsetkych vybranych Revision Clouds.
# V node REVISION CLOUD SELECTION je potrebne oknom vybrat vsetky revizne oblaciky na danom vykrese. Zoznam vlozi do clipboardu, z ktoreho ho vlozte do textoveho pola v revite (CTRL+V).
# Script bezi podstatne rychlejsie ak nevyberiete cely podorys ale izolujete len Category Revision Cloud
# Je potrebne si doinstalovat Package Clockwork.
návod = StringInput("""Vytvori zoradeny zoznam Commentov vsetkych vybranych Revision Clouds.

V node REVISION CLOUD SELECTION je potrebne oknom vybrat vsetky revizne oblaciky na danom vykrese. Zoznam vlozi do clipboardu, z ktoreho ho vlozte do textoveho pola v revite (CTRL+V).

Script bezi podstatne rychlejsie ak nevyberiete cely podorys ale izolujete len Category Revision Cloud

Je potrebne si doinstalovat Package Clockwork.""")  # graph input

# group: INPUT
písmeno_revízie = StringInput("E")  # graph input
revision_cloud_selection = DSModelElementsSelection()  # 36 picked in the model; graph input

code_block = CodeBlock { "Revision Clouds"; }
getCategory = Element.GetCategory(element=revision_cloud_selection)
string_from_object = FromObject(obj=getCategory)
eq = code_block == string_from_object
filterByBoolMask = List.FilterByBoolMask(list=revision_cloud_selection, mask=eq)
code_block_2 = CodeBlock { "Comments"; }
getParameterValueByName = Element.GetParameterValueByName(element=filterByBoolMask.in, parameterName=code_block_2)
uniqueItems = List.UniqueItems(list=getParameterValueByName)
sort = List.Sort(list=uniqueItems)
count = List.Count(list=sort)
code_block_3 = CodeBlock(a=count) { 1..a; }
pridava_0_jednocifernym_cislam = CodeBlock(a=code_block_3) { a<=9?"0":""; }
string_from_object_2 = FromObject(obj=code_block_3)
code_block_4 = CodeBlock(a=pridava_0_jednocifernym_cislam, b=string_from_object_2) { a+b; }
building_list_of_rc_comments = CodeBlock(revisionLetter=písmeno_revízie, number=code_block_4) { revisionLetter+number; }
code_block_5 = CodeBlock(a=building_list_of_rc_comments, b=sort) { a+" "+b; }

# group: Clipboard
string_from_array = FromArray(arr=code_block_5)
length = String.Length(str=string_from_array)
code_block_6 = CodeBlock(A=length) { 1; A-2; }
substring = String.Substring(str=string_from_array, startIndex=code_block_6.out0, length=code_block_6.out1)
python_script = Python(IN[0]=substring)  # unwired: IN[1]
# ---------- python_script.python (28 lines) ----------
import clr
clr.AddReference('ProtoGeometry')
from Autodesk.DesignScript.Geometry import *

clr.AddReference('System.Windows.Forms')
from System.Windows.Forms import Clipboard

import sys
pyt_path = r'C:\Program Files (x86)\IronPython 2.7\Lib'
sys.path.append(pyt_path)

#The inputs to this node will be stored as a list in the IN variables.
#leaved commented text from original WRITE TO TEXT FILE node
A = IN[0]
#path = IN[1]

anewline = "\n".join(A.split(","))

#testfile = open(path, 'w')
#testfile = open('C:\Users\davidv\Desktop\work families\Dynamo\python\log.txt', 'w')
#testfile.write(bytes(anewline))

try:
	Clipboard.SetText(anewline)
	OUT = "Výstup bol nakopírovaný do schránky"
#	OUT = IN[0]
except:
	OUT = 'Data could not be copied to clipboard'
# ----------------------------------------

status = Watch(python_script)
indexOf = List.IndexOf(list=sort, element=getParameterValueByName)

# group: Pridanie cislovania Commentom RC
code_block_7 = CodeBlock { "Comments"; }
getItemAtIndex = List.GetItemAtIndex(list=code_block_5, index=indexOf)
string_from_object_3 = FromObject(obj=getItemAtIndex)
setParameterByName = Element.SetParameterByName(element=filterByBoolMask.in, parameterName=code_block_7, value=string_from_object_3)

py_log = Python()  # unwired: IN[0]
# ---------- py_log.python (37 lines) ----------
# Load the Python Standard and DesignScript Libraries
import sys
import clr
clr.AddReference('ProtoGeometry')
from Autodesk.DesignScript.Geometry import *
clr.AddReference("RevitServices")
import RevitServices
from RevitServices.Persistence import DocumentManager

from datetime import datetime
import getpass

# name of the script for log
log_string = "revision cloud comments Clipboard by selection"

doc = DocumentManager.Instance.CurrentDBDocument
filePath = doc.PathName

# getting file name from path
lastBackslash = filePath.rindex("\\")+1
file_name = filePath[lastBackslash:]
user_name = getpass.getuser()
datestamp = str(datetime.now())
# tabulator between data to easy import to excel schedule
separator = "\t"
line = datestamp + separator + log_string + separator + user_name + "\n"

try:
	f = open("L:\\customToolslogs\\dynLogs\\" + file_name +".log", "a")
	f.write(line)
	f.close()
	status = "log has been written"
except:
	status = "something went wrong"

# Assign your output to the OUT variable.
OUT = status
# ----------------------------------------
