# Dynamo graph revision cloud comments schedule FILTER_p.dyn (Dynamo 2.3.0.5885)

code_block = CodeBlock { "Revision Clouds"; }
byName = Category.ByName(name=code_block)
all_elements_of_category = ElementsOfCategory(Category=byName)
code_block_2 = CodeBlock { "Revision Description"; }
getParameterValueByName = Element.GetParameterValueByName(element=all_elements_of_category, parameterName=code_block_2)

# group: INPUT
filter_by_revision_description = StringInput("STENY VÝŤAHOVÝCH ŠÁCHT")  # graph input
file_path = Filename("C:\Users\davidv\Documents\rev.xls")  # graph input

eq = getParameterValueByName == filter_by_revision_description
filterByBoolMask = List.FilterByBoolMask(list=all_elements_of_category, mask=eq)
code_block_3 = CodeBlock { "Comments"; }
getParameterValueByName_2 = Element.GetParameterValueByName(element=filterByBoolMask.in, parameterName=code_block_3)
watch = Watch(getParameterValueByName_2)
code_block_4 = CodeBlock { "sheet"; 0; }
id = Element.Id(element=filterByBoolMask.in)
getParameterValueByName_3 = Element.GetParameterValueByName(element=filterByBoolMask.in, parameterName=code_block_2)
create = List.Create(item0=getParameterValueByName_2, item1=id, item2=getParameterValueByName_3)
transpose = List.Transpose(lists=create)
boolean = BoolSelector(true)
exportExcel = Data.ExportExcel(filePath=file_path, sheetName=code_block_4.out0, startRow=code_block_4.out1, startCol=code_block_4.out1, data=transpose, overWrite=boolean)
návod = StringInput("Vytvori zoznam vsetkych Revision Clouds s priradenym Comments vo forme tabulky, ktoru vyexportuje do formatu *.xls aj s ID daneho Revision Cloudu a Revision Description. Filtruje na zaklade Revision Description. V Revite potom Revision cloud najdeme pomocou Manage/Inquiry/Select by ID")  # graph input
py_log = Python()  # unwired: IN[0]
# ---------- py_log.python (37 lines) ----------
# Load the Python Standard and DesignScript Libraries
import sys
import clr
clr.AddReference('ProtoGeometry')
from Autodesk.DesignScript.Geometry import *
clr.AddReference("RevitServices")
import RevitServices
from RevitServices.Persistence import DocumentManager

from datetime import datetime
import getpass

# name of the script for log
log_string = "revision cloud comments schedule FILTER"

doc = DocumentManager.Instance.CurrentDBDocument
filePath = doc.PathName

# getting file name from path
lastBackslash = filePath.rindex("\\")+1
file_name = filePath[lastBackslash:]
user_name = getpass.getuser()
datestamp = str(datetime.now())
# tabulator between data to easy import to excel schedule
separator = "\t"
line = datestamp + separator + log_string + separator + user_name + "\n"

try:
	f = open("L:\\customToolslogs\\dynLogs\\" + file_name +".log", "a")
	f.write(line)
	f.close()
	status = "log has been written"
except:
	status = "something went wrong"

# Assign your output to the OUT variable.
OUT = status
# ----------------------------------------
