# Dynamo graph room data from excel.dyn (Dynamo 2.0.1.5055)

categories = Categories(index=416)
all_elements_of_category = ElementsOfCategory(Category=categories)

# group: input
file_path = Filename("C:\Users\davidv\Desktop\work families\Dynamo\room schedule.xlsx")
name_of_excel_sheet = StringInput("Hárok1")

fromPath = FileObject(path=file_path)  # "File.FromPath"
boolean = BoolSelector(false)
importExcel = Data.ImportExcel(file=fromPath, sheetName=name_of_excel_sheet, readAsStrings=boolean)
transpose = List.Transpose(lists=importExcel)

# group: nazvy miestnosti
code_block = CodeBlock { "Name"; }
code_block_2 = CodeBlock { 1; }
getItemAtIndex = List.GetItemAtIndex(list=transpose, index=code_block_2)

removeNulls = Lists.Manage.RemoveNulls(Data=getItemAtIndex)

# group (continued): nazvy miestnosti
setParameterByName = Element.SetParameterByName(element=all_elements_of_category, parameterName=code_block, value=removeNulls.Cleaned)

# group: podlahy
code_block_3 = CodeBlock { "Floor Finish"; }
code_block_4 = CodeBlock { 2; }
getItemAtIndex_2 = List.GetItemAtIndex(list=transpose, index=code_block_4)

removeNulls_2 = Lists.Manage.RemoveNulls(Data=getItemAtIndex_2)

# group (continued): podlahy
setParameterByName_2 = Element.SetParameterByName(element=all_elements_of_category, parameterName=code_block_3, value=removeNulls_2.Cleaned)

# group: steny
code_block_5 = CodeBlock { "Wall Finish"; }
code_block_6 = CodeBlock { 3; }
getItemAtIndex_3 = List.GetItemAtIndex(list=transpose, index=code_block_6)

removeNulls_3 = Lists.Manage.RemoveNulls(Data=getItemAtIndex_3)

# group (continued): steny
setParameterByName_3 = Element.SetParameterByName(element=all_elements_of_category, parameterName=code_block_5, value=removeNulls_3.Cleaned)

# group: podhlady
code_block_7 = CodeBlock { "Ceiling Finish"; }
code_block_8 = CodeBlock { 4; }
getItemAtIndex_4 = List.GetItemAtIndex(list=transpose, index=code_block_8)

removeNulls_4 = Lists.Manage.RemoveNulls(Data=getItemAtIndex_4)

# group (continued): podhlady
setParameterByName_4 = Element.SetParameterByName(element=all_elements_of_category, parameterName=code_block_7, value=removeNulls_4.Cleaned)

# group: cisla miestnosti
code_block_9 = CodeBlock { "Number"; }
code_block_10 = CodeBlock { 0; }
getItemAtIndex_5 = List.GetItemAtIndex(index=code_block_10)  # unwired: list

# note: Remove Nulls from Lunchbox package
removeNulls_5 = Lists.Manage.RemoveNulls(Data=getItemAtIndex_5)

# group (continued): cisla miestnosti
setParameterByName_5 = Element.SetParameterByName(parameterName=code_block_9, value=removeNulls_5.Cleaned)  # unwired: element

code_block_11 = CodeBlock { "Number"; }
getParameterValueByName = Element.GetParameterValueByName(element=all_elements_of_category, parameterName=code_block_11)
sort = List.Sort(list=getParameterValueByName)
