# Dynamo graph roomNumberIntoParameter.dyn (Dynamo 2.3.0.5885)
# packages: Rhythm 2019.12.4

návod = StringInput("všetkým elementom v miestnosiach zapíše do vybraného parametru Room Number miestnosti, v ktorej sa daný element nachádza.")  # graph input

# group: input
categories = Categories("OST_GenericModel")  # graph input
parameter_name_pre_zápis_room = StringInput("Comments")  # "Parameter Name pre zápis Room Number"; graph input

all_elements_of_category = ElementsOfCategory(Category=categories)
ʳʰʸᵗʰᵐ_familyinstances_room = Rhythm.Revit.Elements.FamilyInstances.Room(instance=all_elements_of_category)
code_block = CodeBlock { "Number"; }
getParameterValueByName = Element.GetParameterValueByName(element=ʳʰʸᵗʰᵐ_familyinstances_room, parameterName=code_block)
setParameterByName = Element.SetParameterByName(element=all_elements_of_category, parameterName=parameter_name_pre_zápis_room, value=getParameterValueByName)
count = List.Count(list=setParameterByName)
code_block_2 = CodeBlock(count=count) { "Room Number bola zapísaná do parametru " + count + " elementov."; }
status = Watch(code_block_2)  # graph output
py_log = Python()  # unwired: IN[0]
# ---------- py_log.python (40 lines) ----------
# Load the Python Standard and DesignScript Libraries
import sys
import clr
clr.AddReference('ProtoGeometry')
from Autodesk.DesignScript.Geometry import *
clr.AddReference("RevitServices")
import RevitServices
from RevitServices.Persistence import DocumentManager

from datetime import datetime
import getpass

# name of the script for log
log_string = "roomNumberIntoParameter"

doc = DocumentManager.Instance.CurrentDBDocument
filePath = doc.PathName

# getting file name from path
try:
	lastBackslash = filePath.rindex("\\")+1
except:
	lastBackslash = filePath.rindex("/")+1
file_name = filePath[lastBackslash:]
user_name = getpass.getuser()
datestamp = str(datetime.now())
# tabulator between data to easy import to excel schedule
separator = "\t"
line = datestamp + separator + log_string + separator + user_name + "\n"

try:
	f = open("L:\\customToolslogs\\dynLogs\\" + file_name +".log", "a")
	f.write(line)
	f.close()
	status = "log has been written"
except:
	status = "something went wrong"

# Assign your output to the OUT variable.
OUT = status
# ----------------------------------------
