# Dynamo graph roomRenumberingSpline_filterByNameV2_p.dyn (Dynamo 2.3.0.5885)

code_block = CodeBlock { "Rooms"; }
byName = Category.ByName(name=code_block)
all_elements_of_category = ElementsOfCategory(Category=byName)

# group: INPUT
rename_only_rooms_with_name_1 = StringInput("Kobka")  # graph input
rename_only_rooms_with_name_2 = StringInput("Sklad garáže")  # graph input
select_model_line = DSModelElementSelection()  # 1 picked in the model; graph input
code_block_2 = CodeBlock { 1000; }
prefix = StringInput("")  # graph input
number_of_level = DoubleInput(5)  # graph input
start_number = DoubleInput(1)  # graph input

code_block_3 = CodeBlock { "Name"; }
getParameterValueByName = Element.GetParameterValueByName(element=all_elements_of_category, parameterName=code_block_3)
eq = rename_only_rooms_with_name_1 == getParameterValueByName
eq_2 = rename_only_rooms_with_name_2 == getParameterValueByName
xor = Math.Xor(a=eq, b=eq_2)
filterByBoolMask = List.FilterByBoolMask(list=all_elements_of_category, mask=xor)
# note: chyba v tomto node, znamena ze ciara nie je nakreslena ako MODEL LINE
curve = CurveElement.Curve(curveElement=select_model_line)
# note: chyba v tomto node znamena ze ciara je prilis dlha
pointsAtChordLengthFromPoint = Curve.PointsAtChordLengthFromPoint(curve=curve, chordLength=code_block_2)
splitByPoints = Curve.SplitByPoints(curve=curve, points=pointsAtChordLengthFromPoint)
endPoint = Curve.EndPoint(curve=splitByPoints)
isInsideRoom = Room.IsInsideRoom(room=filterByBoolMask.in, point=endPoint, lacing=CrossProduct)
transpose = List.Transpose(lists=isInsideRoom)
count = List.Count(list=endPoint)
code_block_4 = CodeBlock(a=count) { 1..a; }
sortByKey = List.SortByKey(list=transpose, keys=code_block_4)
filterByBoolMask_2 = List.FilterByBoolMask(list=filterByBoolMask.in, mask=sortByKey.sorted_list@L2)
flatten = List.Flatten(list=filterByBoolMask_2.in)
uniqueItems = List.UniqueItems(list=flatten)
watch = Watch(uniqueItems)
string = StringInput("Number")
code_block_5 = CodeBlock { "."; }
n2nd_prefix = StringInput("K")  # "2nd Prefix"; graph input
count_2 = List.Count(list=watch)
number = DoubleInput(1)
sequence = Sequence(start=start_number, amount=count_2, step=number, lacing=Longest)

# group: 0 navyse pri jednocifernych cislach
number_2 = DoubleInput(10)
lt = sequence < number_2
number_3 = DoubleInput(0)
code_block_6 = CodeBlock { ""; }
if_ = If(test=lt, true=number_3, false=code_block_6)

string_from_object = FromObject(obj=sequence)
code_block_7 = CodeBlock(x=prefix, a=number_of_level, b=code_block_5, k=n2nd_prefix, c=if_, d=string_from_object) { x+a+b+k+c+d; }
setParameterByName = Element.SetParameterByName(element=watch, parameterName=string, value=code_block_7)
count_3 = List.Count(list=setParameterByName)
počet_prečíslovaných_miestností = Watch(count_3)
návod = StringInput("""Pre kobky, výťahy a šachty
Format precislovania = pl.kmm
p=prefix, l=level, m=cislo miestnosti, k=2nd prefix
napr. = P-2.K56

Precisluje miestnosti podla nakreslenej ciary.
	Najprv je potrebne nakreslit ciaru (najlepsie spline), ktora pretina miestnosti ktore chceme precislovat. Ciary je dobre robit v samostatnej Subcategory napr. "Renumbering rooms" aby sa dali lahko vsetky naraz vypnut/zapnut pre nasledne opatovne precislovanie. Ciara musi byt kreslena ako Model Line alebo konvertovana z Detail Line.
	Model Line musi byt nakreslena vo Workplane, ktora pretina precislovane miestnosti, cize typicky v rovine podlahy. Pri velmi dlhej ciare sa moze vyskytnut chyba, vtedy rozdelte ciaru na viacere elementy.
	Prikaz moze pracovat dlhsie, nepustajte ho v automatickom mode, ale len v manualnom.""")  # graph input
py_log = Python()  # unwired: IN[0]
# ---------- py_log.python (40 lines) ----------
# Load the Python Standard and DesignScript Libraries
import sys
import clr
clr.AddReference('ProtoGeometry')
from Autodesk.DesignScript.Geometry import *
clr.AddReference("RevitServices")
import RevitServices
from RevitServices.Persistence import DocumentManager

from datetime import datetime
import getpass

# name of the script for log
log_string = "RoomRenumberingSpline_filterByNameV2"

doc = DocumentManager.Instance.CurrentDBDocument
filePath = doc.PathName

# getting file name from path
try:
	lastBackslash = filePath.rindex("\\")+1
except:
	lastBackslash = filePath.rindex("/")+1
file_name = filePath[lastBackslash:]
user_name = getpass.getuser()
datestamp = str(datetime.now())
# tabulator between data to easy import to excel schedule
separator = "\t"
line = datestamp + separator + log_string + separator + user_name + "\n"

try:
	f = open("L:\\customToolslogs\\dynLogs\\" + file_name +".log", "a")
	f.write(line)
	f.close()
	status = "log has been written"
except:
	status = "something went wrong"

# Assign your output to the OUT variable.
OUT = status
# ----------------------------------------
