# Dynamo graph roomsOsobyPO.dyn (Dynamo 2.3.0.5885)

# group: Error handling
# note: Funguje pre Room names:
# Kancelária 1
# Kancelária 2
# Kancelária 3-8
# Kancelária 9+
# Zasadačka
# Recepcia

návod = StringInput("Vypočíta počet osôb (s matematických zaokrúhlením) v kancelárii podľa jej druhu (Room Name) a zapíše ich do zvoleného parametru.")  # graph input
code_block = CodeBlock { "Rooms"; }
byName = Category.ByName(name=code_block)
all_elements_of_category = ElementsOfCategory(Category=byName)

# group: Filter
name = Room.Name(room=all_elements_of_category)
# note: filtering elements
code_block_2 = CodeBlock(a=name) { a == "Kancelária 1"; }
filterByBoolMask = List.FilterByBoolMask(list=all_elements_of_category, mask=code_block_2)
code_block_3 = CodeBlock(a=name) { a == "Kancelária 2"; }
filterByBoolMask_2 = List.FilterByBoolMask(list=all_elements_of_category, mask=code_block_3)
code_block_4 = CodeBlock(a=name) { a == "Zasadačka"; }
filterByBoolMask_3 = List.FilterByBoolMask(list=all_elements_of_category, mask=code_block_4)
code_block_5 = CodeBlock(a=name) { a == "Kancelária 3-8"; }
filterByBoolMask_4 = List.FilterByBoolMask(list=all_elements_of_category, mask=code_block_5)
code_block_6 = CodeBlock(a=name) { a == "Kancelária 9+"; }
filterByBoolMask_5 = List.FilterByBoolMask(list=all_elements_of_category, mask=code_block_6)

# group: INPUT
parameter_pre_zápis_hodnôt = StringInput("pocet osob PO")  # graph input

# group: Výpočet počtu osôb z plochy
area = Room.Area(room=filterByBoolMask.in)
code_block_7 = CodeBlock(area=area) { area/10; }
area_2 = Room.Area(room=filterByBoolMask_2.in)
code_block_8 = CodeBlock(area=area_2) { area/7; }
area_3 = Room.Area(room=filterByBoolMask_3.in)
code_block_9 = CodeBlock(area=area_3) { area/1.5; }
area_4 = Room.Area(room=filterByBoolMask_4.in)
code_block_10 = CodeBlock(area=area_4) { area/5; }
area_5 = Room.Area(room=filterByBoolMask_5.in)
code_block_11 = CodeBlock(area=area_5) { area/4; }

round = Math.Round(number=code_block_7)
round_2 = Math.Round(number=code_block_8)
round_3 = Math.Round(number=code_block_9)
round_4 = Math.Round(number=code_block_10)
round_5 = Math.Round(number=code_block_11)

# group: Zmena hodnoty parametra
setParameterByName = Element.SetParameterByName(element=filterByBoolMask.in, parameterName=parameter_pre_zápis_hodnôt, value=round)
setParameterByName_2 = Element.SetParameterByName(element=filterByBoolMask_2.in, parameterName=parameter_pre_zápis_hodnôt, value=round_2)
setParameterByName_3 = Element.SetParameterByName(element=filterByBoolMask_3.in, parameterName=parameter_pre_zápis_hodnôt, value=round_3)
setParameterByName_4 = Element.SetParameterByName(element=filterByBoolMask_4.in, parameterName=parameter_pre_zápis_hodnôt, value=round_4)
setParameterByName_5 = Element.SetParameterByName(element=filterByBoolMask_5.in, parameterName=parameter_pre_zápis_hodnôt, value=round_5)

code_block_12 = CodeBlock(a=name) { a == "Recepcia"; }
filterByBoolMask_6 = List.FilterByBoolMask(list=all_elements_of_category, mask=code_block_12)
area_6 = Room.Area(room=filterByBoolMask_6.in)
code_block_13 = CodeBlock(area=area_6) { area/10; }
round_6 = Math.Round(number=code_block_13)
setParameterByName_6 = Element.SetParameterByName(element=filterByBoolMask_6.in, parameterName=parameter_pre_zápis_hodnôt, value=round_6)
count = List.Count(list=setParameterByName_6)

# group: OUTPUT
count_2 = List.Count(list=setParameterByName)
count_3 = List.Count(list=setParameterByName_2)
count_4 = List.Count(list=setParameterByName_3)
count_5 = List.Count(list=setParameterByName_4)
count_6 = List.Count(list=setParameterByName_5)
code_block_14 = CodeBlock(a=count_2, b=count_3, c=count_4, d=count_5, e=count_6, f=count) { a+b+c+d+e+f; }
code_block_15 = CodeBlock(a=code_block_14) { "Bolo zapísaných "+a+" hodnôt"; }
# note: Place output for Dynamo Player
OUTPUT = Watch(code_block_15)  # graph output

# note: Logovanie pre analytiku
# uprav nazov skriptu
py_log = Python()  # unwired: IN[0]
# ---------- py_log.python (37 lines) ----------
# Load the Python Standard and DesignScript Libraries
import sys
import clr
clr.AddReference('ProtoGeometry')
from Autodesk.DesignScript.Geometry import *
clr.AddReference("RevitServices")
import RevitServices
from RevitServices.Persistence import DocumentManager

from datetime import datetime
import getpass

# name of the script for log
log_string = "roomsOsobyPO"

doc = DocumentManager.Instance.CurrentDBDocument
filePath = doc.PathName

# getting file name from path
lastBackslash = filePath.rindex("\\")+1
file_name = filePath[lastBackslash:]
user_name = getpass.getuser()
datestamp = str(datetime.now())
# tabulator between data to easy import to excel schedule
separator = "\t"
line = datestamp + separator + log_string + separator + user_name + "\n"

try:
	f = open("L:\\customToolslogs\\dynLogs\\" + file_name +".log", "a")
	f.write(line)
	f.close()
	status = "log has been written"
except:
	status = "something went wrong"

# Assign your output to the OUT variable.
OUT = status
# ----------------------------------------
