# Dynamo graph sheetCreateExcel.dyn (Dynamo 2.3.0.5885)

# group: INPUT
file_path_for_excel_schedule = Filename("alpha_versions\sheets\v4\sheetlist_KP_BD D01-D15.xlsx")  # graph input
select_title_block = FamilyTypes("Sheet-Kniha-bytov_KONC. PRVKY_RP:Sheet-Kniha-bytov_KONC. PRVKY_RP")  # graph input

fromPath = FileObject(path=file_path_for_excel_schedule)  # "File.FromPath"
string = StringInput("Sheet")
boolean = BoolSelector(false)
importExcel = Data.ImportExcel(file=fromPath, sheetName=string, readAsStrings=boolean)
watch = Watch(importExcel)
manual = StringInput("""Vytvorí Sheety s číslami a názvami výkresov podľa excelovskej tabuľky.
Na každý Sheet pridá Floor Plan s názvom podľa 3. stĺpca.

V projekte nemôžu byť 2 rovnako nazvané Floor Plany ak jeden z nich chceme automaticky umiestňovať na Sheet.

Formát XLS súboru:
1. stĺpec - Sheet Number
2. stĺpec - Sheet Name
3. Stĺpec - View Name 1
4. Stĺpec - View Name 2 (nepovinné)""")  # graph input
transpose = List.Transpose(lists=importExcel)
number = DoubleInput(1)
getItemAtIndex = List.GetItemAtIndex(list=transpose, index=number)
watch_2 = Watch(getItemAtIndex)
number_2 = DoubleInput(0)
getItemAtIndex_2 = List.GetItemAtIndex(list=transpose, index=number_2)
watch_3 = Watch(getItemAtIndex_2)
categories = Categories("OST_Views")
all_elements_of_category = ElementsOfCategory(Category=categories)

# group: list of View Categories
code_block = CodeBlock()
# ---------- code_block.designscript (7 lines) ----------
["Revit.Elements.Views.FloorPlanView",
"Revit.Elements.Views.SectionView",
"Revit.Elements.Views.CeilingPlanView",
"Revit.Elements.Views.Legend",
"Revit.Elements.Views.AxonometricView",
"Revit.Elements.Views.AreaPlanView",
"Revit.Elements.Views.DraftingView"];
# ----------------------------------------

select_view_type_of_1st_view_1 = DoubleSlider(1, range=1..7 step 1)  # "Select View Type of 1st View 1 - FloorPlanView 2 - SectionView 3 - CeilingPlanView 4 - Legend 5 - AxonometricView 6 - AreaPlanView 7 - DraftingView"; graph input

# group: Filter - just selected View Category
type = Object.Type(obj=all_elements_of_category)
code_block_2 = CodeBlock(list=code_block, x=select_view_type_of_1st_view_1) { list[x-1]; }
eq = type == code_block_2
filterByBoolMask = List.FilterByBoolMask(list=all_elements_of_category, mask=eq)

code_block_3 = CodeBlock { "View Name"; }
getParameterValueByName = Element.GetParameterValueByName(element=filterByBoolMask.in, parameterName=code_block_3)
number_3 = DoubleInput(2)
getItemAtIndex_3 = List.GetItemAtIndex(list=transpose, index=number_3)
watch_4 = Watch(getItemAtIndex_3)

# group: removing nulls
code_block_4 = CodeBlock { 0; }
string_from_object = FromObject(obj=watch_4)
code_block_5 = CodeBlock { "null"; }
allIndicesOf = List.AllIndicesOf(list=string_from_object, item=code_block_5)
firstItem = List.FirstItem(list=allIndicesOf)
slice = List.Slice(list=watch_4, start=code_block_4, end=firstItem)

allIndicesOf_2 = List.AllIndicesOf(list=getParameterValueByName, item=slice)
flatten = List.Flatten(list=allIndicesOf_2)
getItemAtIndex_4 = List.GetItemAtIndex(list=filterByBoolMask.in, index=flatten)
categories_2 = Categories("OST_Views")
all_elements_of_category_2 = ElementsOfCategory(Category=categories_2)
select_view_type_of_2nd_view = DoubleSlider(7, range=1..7 step 1)  # "Select View Type of 2nd View (optional)"; graph input

# group: Filter - just selected View Category
type_2 = Object.Type(obj=all_elements_of_category_2)
code_block_6 = CodeBlock(list=code_block, x=select_view_type_of_2nd_view) { list[x-1]; }
eq_2 = type_2 == code_block_6
filterByBoolMask_2 = List.FilterByBoolMask(list=all_elements_of_category_2, mask=eq_2)

code_block_7 = CodeBlock { "View Name"; }
getParameterValueByName_2 = Element.GetParameterValueByName(element=filterByBoolMask_2.in, parameterName=code_block_7)
number_4 = DoubleInput(3)
getItemAtIndex_5 = List.GetItemAtIndex(list=transpose, index=number_4)
watch_5 = Watch(getItemAtIndex_5)

# group: removing nulls
code_block_8 = CodeBlock { 0; }
string_from_object_2 = FromObject(obj=watch_5)
code_block_9 = CodeBlock { "null"; }
allIndicesOf_3 = List.AllIndicesOf(list=string_from_object_2, item=code_block_9)
firstItem_2 = List.FirstItem(list=allIndicesOf_3)
slice_2 = List.Slice(list=watch_5, start=code_block_8, end=firstItem_2)

allIndicesOf_4 = List.AllIndicesOf(list=getParameterValueByName_2, item=slice_2)
flatten_2 = List.Flatten(list=allIndicesOf_4)
getItemAtIndex_6 = List.GetItemAtIndex(list=filterByBoolMask_2.in, index=flatten_2)
list_create = List.Create(item0=getItemAtIndex_4, item1=getItemAtIndex_6)
transpose_2 = List.Transpose(lists=list_create)
byNameNumberTitleBlockAndViews = Sheet.ByNameNumberTitleBlockAndViews(sheetName=watch_2, sheetNumber=watch_3, titleBlockFamilyType=select_title_block, views=transpose_2)
count = List.Count(list=byNameNumberTitleBlockAndViews)
code_block_10 = CodeBlock(count=count) { "Bolo vytvorenych " + count + " Sheetov."; }
status = Watch(code_block_10)  # graph output
sheets = Watch(byNameNumberTitleBlockAndViews)  # graph output
manual_2 = StringInput("""1 - FloorPlanView
2 - SectionView
3 - CeilingPlanView
4 - Legend
5 - AxonometricView
6 - AreaPlanView
7 - DraftingView""")
py_log = Python()  # unwired: IN[0]
# ---------- py_log.python (37 lines) ----------
# Load the Python Standard and DesignScript Libraries
import sys
import clr
clr.AddReference('ProtoGeometry')
from Autodesk.DesignScript.Geometry import *
clr.AddReference("RevitServices")
import RevitServices
from RevitServices.Persistence import DocumentManager

from datetime import datetime
import getpass

# name of the script for log
log_string = "sheetCreateExcel"

doc = DocumentManager.Instance.CurrentDBDocument
filePath = doc.PathName

# getting file name from path
lastBackslash = filePath.rindex("\\")+1
file_name = filePath[lastBackslash:]
user_name = getpass.getuser()
datestamp = str(datetime.now())
# tabulator between data to easy import to excel schedule
separator = "\t"
line = datestamp + separator + log_string + separator + user_name + "\n"

try:
	f = open("L:\\customToolslogs\\dynLogs\\" + file_name +".log", "a")
	f.write(line)
	f.close()
	status = "log has been written"
except:
	status = "something went wrong"

# Assign your output to the OUT variable.
OUT = status
# ----------------------------------------
