# Dynamo graph showShaftOpenings.dyn (Dynamo 2.12.1.8246)
# packages: spring nodes 210.1.1, cata_lyst 0.0.1

# group: INPUT
categories = Categories("OST_ShaftOpening")

all_elements_of_category = ElementsOfCategory(Category=categories)
code_block = CodeBlock { true; }
ꟿ_collect_elementsketch = Custom[ꟿ Collect.ElementSketch](element=all_elements_of_category, refresh=code_block)  # package spring nodes; Get the actual sketch lines of a sketch based element (floor, ceiling, modified wall, etc.) . You can optionally fetch the matching model curves, however this might prove comptationally heavy on larger data sets. Does not work with elements from linked files.

# group: flatten the curves (Z coord=0)
XY = Plane.XY()
code_block_2 = CodeBlock { Vector.ByCoordinates(0,0,-1); }
project = Curve.Project(curve=ꟿ_collect_elementsketch.curves@L3, baseGeometry=XY, projectionDirection=code_block_2)

# group: getting the params
code_block_3 = CodeBlock { "Base Offset"; }
getParameterValueByName = Element.GetParameterValueByName(element=all_elements_of_category, parameterName=code_block_3)
code_block_4 = CodeBlock { "Base Constraint"; }
getParameterValueByName_2 = Element.GetParameterValueByName(element=all_elements_of_category, parameterName=code_block_4)

elevation = Level.Elevation(level=getParameterValueByName_2)
code_block_5 = CodeBlock(a=getParameterValueByName, b=elevation) { a+b; }
translate = Geometry.Translate(geometry=project, zTranslation=code_block_5)
code_block_6 = CodeBlock { Vector.ByCoordinates(0,0,1); }

# group: setting the height
boundingBox = Element.BoundingBox(element=all_elements_of_category)
maxPoint = BoundingBox.MaxPoint(boundingBox=boundingBox)
code_block_7 = CodeBlock(a=maxPoint) { a.Z; }
minPoint = BoundingBox.MinPoint(boundingBox=boundingBox)
code_block_8 = CodeBlock(a=minPoint) { a.Z; }
bound_box_height = CodeBlock(a=code_block_7, b=code_block_8) { a-b; }

extrude = Curve.Extrude(curve=translate, direction=code_block_6, distance=bound_box_height)

# group: isolate temp in view
current = Document.Current()
activeView = Document.ActiveView(document=current)
isolateCategoriesTemporary = View.IsolateCategoriesTemporary(view=activeView, categories=categories)

návod = StringInput("Dočasne zafarbí Shaft Openings pre ich ľahšie nájdenie a editáciu.")  # graph input
code_block_9 = CodeBlock { "showShaftOpenings"; }
usageLog = Custom[usageLog](scriptName=code_block_9)  # package cata_lyst; node logs every run of the script in which is used to the hardcoded server location
