# Dynamo graph speckleBlocks.dyn (Dynamo 2.12.0.5650)
# packages: SpeckleDynamo2 2.0.0, cata_lyst 0.0.1

# group: Filter
# note: filtering elements

# group: Error handling
# note: Treating errors as hints to user what to do to avoid the error

# group: INPUT
family_types = FamilyTypes("vylevka plech:vylevka plech")
speckle_stream_url = StringInput("https://speckle.xyz/streams/defc24f058")  # graph input
levels = Levels("Level 1")

receive = Receive(stream=speckle_stream_url, Stream={OriginalInput: "https://speckle.xyz/streams/defc24f058", UserId: null, ServerUrl: "https://speckle.xyz", StreamId: "defc24f058", CommitId: null, BranchName: null, ObjectId: null, IsValid: true, Type: 1}, LastCommitId="a9c70f765a", ReceiveEnabled=true, AutoUpdate=true, AutoUpdateEnabled=true)
py_speckle_block_insertion = Python(IN[0]=receive.data)  # "PY speckle block insertion points"; IronPython2
# ---------- py_speckle_block_insertion.python (17 lines) ----------
# Load the Python Standard and DesignScript Libraries
import sys
import clr
clr.AddReference('ProtoGeometry')
from Autodesk.DesignScript.Geometry import *

# The inputs to this node will be stored as a list in the IN variables.
speckle_data = IN[0]

# Place your code below this line
insert_points = []
for dict in speckle_data:
	ip = dict["insertionPoint"]
	insert_points.append(ip)
	
# Assign your output to the OUT variable.
OUT = insert_points
# ----------------------------------------
byPointAndLevel = FamilyInstance.ByPointAndLevel(familyType=family_types, point=py_speckle_block_insertion, level=levels)
py_speckle_block_transforms = Python(IN[0]=receive.data)  # IronPython2
# ---------- py_speckle_block_transforms.python (17 lines) ----------
# Load the Python Standard and DesignScript Libraries
import sys
import clr
clr.AddReference('ProtoGeometry')
from Autodesk.DesignScript.Geometry import *

# The inputs to this node will be stored as a list in the IN variables.
speckle_data = IN[0]

# Place your code below this line
transforms = []
for dict in speckle_data:
	t = dict["transform"]
	transforms.append(t)
	
# Assign your output to the OUT variable.
OUT = transforms
# ----------------------------------------
py_block_rotations = Python(IN[0]=py_speckle_block_transforms)  # IronPython2
# ---------- py_block_rotations.python (37 lines) ----------
import sys
import clr
import math
clr.AddReference('System.Numerics')
from System.Numerics import *

def euler_from_quaternion(x, y, z, w):
    t0 = +2.0 * (w * x + y * z)
    t1 = +1.0 - 2.0 * (x * x + y * y)
    roll_x = math.atan2(t0, t1)
 
    t2 = +2.0 * (w * y - z * x)
    t2 = +1.0 if t2 > +1.0 else t2
    t2 = -1.0 if t2 < -1.0 else t2
    pitch_y = math.asin(t2)
 
    t3 = +2.0 * (w * z + x * y)
    t4 = +1.0 - 2.0 * (y * y + z * z)
    yaw_z = math.atan2(t3, t4)
    
    return roll_x, pitch_y, yaw_z # in radians


#iterate list of transforms
transforms = IN[0]
angles = []

for v in transforms:

	matrix = Matrix4x4(v[0],v[1],v[2],v[3],v[4],v[5],v[6],v[7],v[8],v[9],v[10],v[11],v[12],v[13],v[14],v[15])
	
	decomposed = Matrix4x4.Decompose(matrix)
	rotation = decomposed[2]
	euler = euler_from_quaternion(rotation.X, rotation.Y, rotation.Z, rotation.W)
	angles.append(math.degrees(euler[2]))

OUT = angles
# ----------------------------------------
round = Math.Round(number=py_block_rotations)
setRotation = FamilyInstance.SetRotation(familyInstance=byPointAndLevel, degree=round)
watch = Watch(receive.info)
návod = StringInput("""Umiestni a otočí family instances v Revite podľa Blokov v DWG súbore

V AutoCADe je nutné do Speckle streamu najprv poslať všetky bloky a až potom spustiť tento skript""")  # graph input
code_block = CodeBlock { "Speckle Blocks"; }
usageLog = Custom[usageLog](scriptName=code_block)  # package cata_lyst; node logs every run of the script in which is used to the hardcoded server location

# group: OUTPUT
# note: Place output for Dynamo Player
OUTPUT = Watch()  # graph output; unwired: arg0
