# Dynamo graph speckleSendLineBasedElems.dyn (Dynamo 2.12.0.5650)
# packages: SpeckleDynamo2 2.0.0, Clockwork for Dynamo 2.x 2.3.0, cata_lyst 0.0.1, Genius Loci 2021.11.10

# group: INPUT
category = Categories("OST_Grids")  # graph input
workset_name = StringInput("")  # graph input
speckle_stream = StringInput("https://speckle.xyz/streams/...")  # graph input
message_optional = StringInput("")  # graph input

all_elements_of_category = ElementsOfCategory(Category=category)

# group: Filter by Workset
element_workset = Custom[Element Workset](element=all_elements_of_category)  # package Genius Loci; Returns the workset of the given element.
eq = element_workset.Workset_Name == workset_name
filterByBoolMask = List.FilterByBoolMask(list=all_elements_of_category, mask=eq)

location = Custom[Element.Location+](element=filterByBoolMask.in)  # package Clockwork for Dynamo 2.x; Returns the location of an element as point, curve or curve loop, along with some booleans to help filtering the results. Unlike the OOTB Element.GetLocation node, it also retunrs sketch lines of sketch-based elements like floor slabs as well as the element's rotation property.
watch = Watch(location.curves)
send = Send(data=watch, stream=speckle_stream, message=message_optional, AutoUpdate=true)
návod = StringInput("Pošle do Speckle streamu všetky Line Based elementy (napr. Pipes, Walls, Grids) v danom Worksete ako čiary - pre použitie v AutoCADe")  # graph input
code_block = CodeBlock { "speckleSendLineBasedElems"; }
usageLog = Custom[usageLog](scriptName=code_block)  # package cata_lyst; node logs every run of the script in which is used to the hardcoded server location
