# Dynamo graph spline2segmentedWalls_p.dyn (Dynamo 2.3.0.5885)

návod = StringInput("vytvorí nasegmentované steny alebo Curtain Walls podľa krivky s voliteľnou dĺžkou segmentu")  # graph input

# group: INPUT
select_model_line = DSModelElementSelection()  # 1 picked in the model; graph input
segment_length = DoubleSlider(900, range=200..8000 step 50)  # graph input
levels_start = Levels("lamely pata")  # graph input
levels_end = Levels("Level 1")  # graph input
wall_types = WallTypes("oporne mury 300mm")  # graph input

curve = CurveElement.Curve(curveElement=select_model_line)
pointsAtChordLengthFromPoint = Curve.PointsAtChordLengthFromPoint(curve=curve, chordLength=segment_length)
splitByPoints = Curve.SplitByPoints(curve=curve, points=pointsAtChordLengthFromPoint)
watch = Watch(splitByPoints)
startPoint = Curve.StartPoint(curve=splitByPoints)
endPoint = Curve.EndPoint(curve=splitByPoints)
byStartPointEndPoint = Line.ByStartPointEndPoint(startPoint=startPoint, endPoint=endPoint)
byCurveAndLevels = Wall.ByCurveAndLevels(c=byStartPointEndPoint, startLevel=levels_start, endLevel=levels_end, wallType=wall_types)
py_log = Python()  # unwired: IN[0]
# ---------- py_log.python (37 lines) ----------
# Load the Python Standard and DesignScript Libraries
import sys
import clr
clr.AddReference('ProtoGeometry')
from Autodesk.DesignScript.Geometry import *
clr.AddReference("RevitServices")
import RevitServices
from RevitServices.Persistence import DocumentManager

from datetime import datetime
import getpass

# name of the script for log
log_string = "spline2segmentedWalls"

doc = DocumentManager.Instance.CurrentDBDocument
filePath = doc.PathName

# getting file name from path
lastBackslash = filePath.rindex("\\")+1
file_name = filePath[lastBackslash:]
user_name = getpass.getuser()
datestamp = str(datetime.now())
# tabulator between data to easy import to excel schedule
separator = "\t"
line = datestamp + separator + log_string + separator + user_name + "\n"

try:
	f = open("L:\\customToolslogs\\dynLogs\\" + file_name +".log", "a")
	f.write(line)
	f.close()
	status = "log has been written"
except:
	status = "something went wrong"

# Assign your output to the OUT variable.
OUT = status
# ----------------------------------------
