# Dynamo graph splineArray_p.dyn (Dynamo 2.3.0.5885)

# group: INPUT
vyber_line = DSModelElementSelection()  # 1 picked in the model; graph input
rozostup_elementov = DoubleSlider(1600, range=50..2000 step 50)  # graph input
element = FamilyTypes()  # nothing selected; graph input

curve = CurveElement.Curve(curveElement=vyber_line)
pointsAtChordLengthFromPoint = Curve.PointsAtChordLengthFromPoint(curve=curve, chordLength=rozostup_elementov)
splitByPoints = Curve.SplitByPoints(curve=curve, points=pointsAtChordLengthFromPoint)
endPoint = Curve.EndPoint(curve=splitByPoints)
startPoint = Curve.StartPoint(curve=splitByPoints)
byPoint = FamilyInstance.ByPoint(familyType=element, point=startPoint)
návod = StringInput("Rozmiestni elementy na krivku v rovnomernom nastavitelnom rozostupe")  # graph input
py_log = Python()  # unwired: IN[0]
# ---------- py_log.python (37 lines) ----------
# Load the Python Standard and DesignScript Libraries
import sys
import clr
clr.AddReference('ProtoGeometry')
from Autodesk.DesignScript.Geometry import *
clr.AddReference("RevitServices")
import RevitServices
from RevitServices.Persistence import DocumentManager

from datetime import datetime
import getpass

# name of the script for log
log_string = "splineArray"

doc = DocumentManager.Instance.CurrentDBDocument
filePath = doc.PathName

# getting file name from path
lastBackslash = filePath.rindex("\\")+1
file_name = filePath[lastBackslash:]
user_name = getpass.getuser()
datestamp = str(datetime.now())
# tabulator between data to easy import to excel schedule
separator = "\t"
line = datestamp + separator + log_string + separator + user_name + "\n"

try:
	f = open("L:\\customToolslogs\\dynLogs\\" + file_name +".log", "a")
	f.write(line)
	f.close()
	status = "log has been written"
except:
	status = "something went wrong"

# Assign your output to the OUT variable.
OUT = status
# ----------------------------------------
