# Dynamo graph statika - batch copy parameters_p.dyn (Dynamo 1.3.1.1736)

copy_to_more_elements = DSModelElementsSelection()
code_block = CodeBlock { "Comments"; }
copy_from = DSModelElementSelection()
getParameterValueByName = Element.GetParameterValueByName(element=copy_from, parameterName=code_block)
setParameterByName = Element.SetParameterByName(element=copy_to_more_elements, parameterName=code_block, value=getParameterValueByName)
code_block_2 = CodeBlock { "Stupen vystuzenia"; }
getParameterValueByName_2 = Element.GetParameterValueByName(element=copy_from, parameterName=code_block_2)
setParameterByName_2 = Element.SetParameterByName(element=copy_to_more_elements, parameterName=code_block_2, value=getParameterValueByName_2)
code_block_3 = CodeBlock { "Trieda Betonu"; }
getParameterValueByName_3 = Element.GetParameterValueByName(element=copy_from, parameterName=code_block_3)
setParameterByName_3 = Element.SetParameterByName(element=copy_to_more_elements, parameterName=code_block_3, value=getParameterValueByName_3)
code_block_4 = CodeBlock { "Chloridy"; }
getParameterValueByName_4 = Element.GetParameterValueByName(element=copy_from, parameterName=code_block_4)
setParameterByName_4 = Element.SetParameterByName(element=copy_to_more_elements, parameterName=code_block_4, value=getParameterValueByName_4)
code_block_5 = CodeBlock { "Trieda prostredia"; }
getParameterValueByName_5 = Element.GetParameterValueByName(element=copy_from, parameterName=code_block_5)
setParameterByName_5 = Element.SetParameterByName(element=copy_to_more_elements, parameterName=code_block_5, value=getParameterValueByName_5)
code_block_6 = CodeBlock { "Max. velkost zrna"; }
getParameterValueByName_6 = Element.GetParameterValueByName(element=copy_from, parameterName=code_block_6)
setParameterByName_6 = Element.SetParameterByName(element=copy_to_more_elements, parameterName=code_block_6, value=getParameterValueByName_6)
návod = StringInput("""Skopiruje parametre:
Trieda betonu, Chloridy, Trieda prostrendia, Maximalna velkost zrna, Stupen vystuzenia a Comments z jedneho elementu na ine. je mozne vybrat viareco elementov naraz.""")
