# Dynamo graph subregion2filledRegion_p.dyn (Dynamo 2.12.1.8246)
# packages: spring nodes 203.1.0

# group: INPUT
select_subregion = DSModelElementSelection()  # 1 picked in the model; graph input
select_filled_region_type = FilledRegionTypes()  # nothing selected; graph input

boolean = BoolSelector(true)
elementSketch = Custom[Springs.Collector.ElementSketch](element=select_subregion, fetchModelCurves=boolean)  # package spring nodes; Get the actual sketch lines of a sketch based element (floor, ceiling, modified wall, etc.) . You can optionally fetch the matching model curves, however this might prove comptationally heavy on larger data sets. Does not work with elements from linked files.
flatten = List.Flatten(list=elementSketch.model_curves)
current = Document.Current()
activeView = Document.ActiveView(document=current)
curve = CurveElement.Curve(curveElement=elementSketch.model_curves)
flatten_2 = List.Flatten(list=curve)
byCurves = FilledRegion.ByCurves(view=activeView, boundary=flatten_2, regionType=select_filled_region_type)
návod = StringInput("Skopíruje Sketchlines zo sketch based elementov ako Floor, Subregion, Roof atd a nakresli podla nich Filled region v aktivnom View")  # graph input
py_log = Python()  # IronPython2; unwired: IN[0]
# ---------- py_log.python (40 lines) ----------
# Load the Python Standard and DesignScript Libraries
import sys
import clr
clr.AddReference('ProtoGeometry')
from Autodesk.DesignScript.Geometry import *
clr.AddReference("RevitServices")
import RevitServices
from RevitServices.Persistence import DocumentManager

from datetime import datetime
import getpass

# name of the script for log
log_string = "subregion2filledRegion"

doc = DocumentManager.Instance.CurrentDBDocument
filePath = doc.PathName

# getting file name from path
try:
	lastBackslash = filePath.rindex("\\")+1
except:
	lastBackslash = filePath.rindex("/")+1
file_name = filePath[lastBackslash:]
user_name = getpass.getuser()
datestamp = str(datetime.now())
# tabulator between data to easy import to excel schedule
separator = "\t"
line = datestamp + separator + log_string + separator + user_name + "\n"

try:
	f = open("L:\\customToolslogs\\dynLogs\\" + file_name +".log", "a")
	f.write(line)
	f.close()
	status = "log has been written"
except:
	status = "something went wrong"

# Assign your output to the OUT variable.
OUT = status
# ----------------------------------------
