# Dynamo graph subregion2floorOnTopo_p.dyn (Dynamo 2.12.1.8246)
# packages: Clockwork for Dynamo 2.x 2.1.2, spring nodes 203.1.0, archi-lab.net 2020.23.2, archi-lab.net 2023.213.1523, Clockwork for Dynamo 2.x 2.4.0

# group: INPUT
select_topography = DSModelElementSelection()  # 1 picked in the model; graph input
select_subregion = DSModelElementSelection()  # 1 picked in the model; graph input
floor_type = FloorTypes("Floor 1")  # graph input
level = Levels("1.NP")  # graph input
offset_floor_od_topography = DoubleSlider(50, range=0..100 step 5)  # graph input

# group: floor creation
boolean = BoolSelector(true)
elementSketch = Custom[Springs.Collector.ElementSketch](element=select_subregion, fetchModelCurves=boolean)  # package spring nodes; Get the actual sketch lines of a sketch based element (floor, ceiling, modified wall, etc.) . You can optionally fetch the matching model curves, however this might prove comptationally heavy on larger data sets. Does not work with elements from linked files.
flatten = List.Flatten(list=elementSketch.model_curves)
curve = CurveElement.Curve(curveElement=flatten)
byOutlineTypeAndLevel = Floor.ByOutlineTypeAndLevel(outlineCurves=curve, floorType=floor_type, level=level)
code_block = CodeBlock { "Height Offset From Level"; 8000; }
setParameterByName = Element.SetParameterByName(element=byOutlineTypeAndLevel, parameterName=code_block.out0, value=code_block.out1)

# group: delete the subregion as it creates duplicate points in Topography.Mesh
passThrough = Custom[PassThrough](passThrough=select_subregion, waitFor=setParameterByName)  # package archi-lab.net; Ripped this off from Clockwork. Sorry Andy.
delete = Element.Delete(element=passThrough)

passThrough_2 = Custom[PassThrough](passThrough=select_topography, waitFor=delete)
mesh = Topography.Mesh(topography=passThrough_2)
code_block_2 = CodeBlock { true; 1; }
toPolySurface = Custom[Springs.Mesh.ToPolySurface](mesh=mesh, mergeAll=code_block_2.out0, NUMTHREADS=code_block_2.out1)  # package spring nodes; Converts a Dynamo mesh to a polysurface. By default the node is single threaded, but if you specify a higher number of threads in the `NUMTHREAD` input, the node will run multi-threaded to speed up the conversion. *WARNING* Using multi-threaded code with Dynamo's geometry kernel may crash Revit in some cases.

# group: sketch lines collector
boolean_2 = BoolSelector(true)
elementSketch_2 = Custom[Springs.Collector.ElementSketch](element=setParameterByName, fetchModelCurves=boolean_2)
curve_2 = CurveElement.Curve(curveElement=elementSketch_2.model_curves)
endPoint = Curve.EndPoint(curve=curve_2)
startPoint = Curve.StartPoint(curve=curve_2)
create = List.Create(item0=endPoint, item1=startPoint)
flatten_2 = List.Flatten(list=create)
uniqueItems = List.UniqueItems(list=flatten_2)

# group: get max height of topography
faceVertices = Custom[Mesh.FaceVertices](mesh=mesh)  # package Clockwork for Dynamo 2.x; Gets the vertices of each face of a given mesh
X = Point.X(point=faceVertices)
flatten_3 = List.Flatten(list=X)
maximumItem = List.MaximumItem(list=flatten_3)

# group: vertical lines to intersect
X_2 = Point.X(point=uniqueItems)
Y = Point.Y(point=uniqueItems)
code_block_3 = CodeBlock(maxheight=maximumItem) { maxheight; -1*maxheight; }
byCoordinates = Point.ByCoordinates(x=X_2, y=Y, z=code_block_3.maxheight)
byCoordinates_2 = Point.ByCoordinates(x=X_2, y=Y, z=code_block_3.out1)
byStartPointEndPoint = Line.ByStartPointEndPoint(startPoint=byCoordinates, endPoint=byCoordinates_2)

flatten_4 = List.Flatten(list=byStartPointEndPoint)
intersect = Geometry.Intersect(geometry=toPolySurface, other=flatten_4)
flatten_5 = List.Flatten(list=intersect)
clear_list = Custom[Clear List](input=flatten_5)  # package archi-lab.net; This node will remove all Null and Empty Lists from any list.
points = Topography.Points(topography=passThrough_2)
join = List.Join(list0=clear_list, list1=points)

# group: floor Z-axis elevation
X_3 = Point.X(point=join)
Y_2 = Point.Y(point=join)
Z = Point.Z(point=join)
code_block_4 = CodeBlock(a=Z, offset=offset_floor_od_topography) { a+offset; }
byCoordinates_3 = Point.ByCoordinates(x=X_3, y=Y_2, z=code_block_4)

slabShapeByPoints = Custom[Floor.SlabShapeByPoints](points=byCoordinates_3, floor=setParameterByName)  # package Clockwork for Dynamo 2.x; Transform a slab shape based on a list of Points
points_of_floor_sketch = Watch(clear_list)
návod = StringInput("""Skonvertuje Subregion na Floor, ktorý výškovo upraví podľa Topography

Hranice Subregionu by mali byť len na Topography. Splines pre lepší výsledok rozdeľte príkazom Spline2arcs.

POZOR! vybrany subregion bude vymazaný a znovu vlozeny """)  # graph input
py_log = Python()  # IronPython2; unwired: IN[0]
# ---------- py_log.python (40 lines) ----------
# Load the Python Standard and DesignScript Libraries
import sys
import clr
clr.AddReference('ProtoGeometry')
from Autodesk.DesignScript.Geometry import *
clr.AddReference("RevitServices")
import RevitServices
from RevitServices.Persistence import DocumentManager

from datetime import datetime
import getpass

# name of the script for log
log_string = "subregion2floorOnTopo"

doc = DocumentManager.Instance.CurrentDBDocument
filePath = doc.PathName

# getting file name from path
try:
	lastBackslash = filePath.rindex("\\")+1
except:
	lastBackslash = filePath.rindex("/")+1
file_name = filePath[lastBackslash:]
user_name = getpass.getuser()
datestamp = str(datetime.now())
# tabulator between data to easy import to excel schedule
separator = "\t"
line = datestamp + separator + log_string + separator + user_name + "\n"

try:
	f = open("L:\\customToolslogs\\dynLogs\\" + file_name +".log", "a")
	f.write(line)
	f.close()
	status = "log has been written"
except:
	status = "something went wrong"

# Assign your output to the OUT variable.
OUT = status
# ----------------------------------------

# group: recreate the deleted subregion
code_block_5 = CodeBlock { 0; 2000; }
byCoordinates_4 = Vector.ByCoordinates(x=code_block_5.out0, y=code_block_5.out0, z=code_block_5.out0)
copyByVector = Custom[Element.CopyByVector](element=passThrough, vector=byCoordinates_4)  # package Clockwork for Dynamo 2.x; Copies an element or a list of elements by a given vector.
