# Dynamo graph text change case_p.dyn (Dynamo 2.3.0.5885)

návod = StringInput("Zmeni VELKE PISMENA na male pismena v textovom poli a naopak.\n\tZvlast sa ovlada prve pismeno a zvlast nasledujuce pismena v textovom poli\n\tPre fungovanie treba doinstalovat Package \"Clockwork\"")  # graph input

# group: INPUT
select_text_note = DSModelElementSelection()  # nothing selected; graph input
prve_pismeno_velke = BoolSelector(true)  # graph input
ostatne_pismena_velke = BoolSelector(true)  # graph input

text = TextNote.Text(textNote=select_text_note)

# group: prve pismeno
code_block = CodeBlock { 0; 1; }
substring = String.Substring(str=text, startIndex=code_block.out0, length=code_block.out1)
changeCase = String.ChangeCase(str=substring, upper=prve_pismeno_velke)

# group: ostatne pismena
length = String.Length(str=text)
code_block_2 = CodeBlock(a=length) { 1; a-1; }
substring_2 = String.Substring(str=text, startIndex=code_block_2.out0, length=code_block_2.out1)
changeCase_2 = String.ChangeCase(str=substring_2, upper=ostatne_pismena_velke)

concat = String.Concat(string0=changeCase, string1=changeCase_2)
setText = TextNote.SetText(textNote=select_text_note, value=concat)
py_log = Python()  # unwired: IN[0]
# ---------- py_log.python (40 lines) ----------
# Load the Python Standard and DesignScript Libraries
import sys
import clr
clr.AddReference('ProtoGeometry')
from Autodesk.DesignScript.Geometry import *
clr.AddReference("RevitServices")
import RevitServices
from RevitServices.Persistence import DocumentManager

from datetime import datetime
import getpass

# name of the script for log
log_string = "text change case"

doc = DocumentManager.Instance.CurrentDBDocument
filePath = doc.PathName

# getting file name from path
try:
	lastBackslash = filePath.rindex("\\")+1
except:
	lastBackslash = filePath.rindex("/")+1
file_name = filePath[lastBackslash:]
user_name = getpass.getuser()
datestamp = str(datetime.now())
# tabulator between data to easy import to excel schedule
separator = "\t"
line = datestamp + separator + log_string + separator + user_name + "\n"

try:
	f = open("L:\\customToolslogs\\dynLogs\\" + file_name +".log", "a")
	f.write(line)
	f.close()
	status = "log has been written"
except:
	status = "something went wrong"

# Assign your output to the OUT variable.
OUT = status
# ----------------------------------------
