# Dynamo graph topoByFloorPoints_p.dyn (Dynamo 2.12.1.8246)
# packages: archi-lab.net 2023.213.1523, spring nodes 210.1.1

návod = StringInput("""Prispôsobí tvar Topography tvaru Flooru, ktorá je určená subelementami. Je možné určiť offset od Flooru

Je potrebné mať nainštalovaný package Springs.""")  # graph input

# group: INPUT
select_topography = DSModelElementSelection()  # 1 picked in the model; graph input
select_floor = DSModelElementSelection()  # 1 picked in the model; graph input
offset = DoubleSlider(100, range=0..100 step 5)  # graph input

points = Floor.Points(floor=select_floor)

# group: topo Z-axis elevation
X = Point.X(point=points)
Y = Point.Y(point=points)
Z = Point.Z(point=points)
code_block = CodeBlock(a=Z, offset=offset) { a-offset; }
byCoordinates = Point.ByCoordinates(x=X, y=Y, z=code_block)

points_2 = Topography.Points(topography=select_topography)
ꟿ_collect_elementsketch = Custom[ꟿ Collect.ElementSketch](element=select_floor)  # package spring nodes; Get the actual sketch lines of a sketch based element (floor, ceiling, modified wall, etc.) . You can optionally fetch the matching model curves, however this might prove comptationally heavy on larger data sets. Does not work with elements from linked files.
flatten = List.Flatten(list=ꟿ_collect_elementsketch.curves)
startPoint = Curve.StartPoint(curve=flatten)
code_block_2 = CodeBlock(A=startPoint) { A.X; A.Y; 0; }
code_block_3 = CodeBlock(X=code_block_2.out0, Y=code_block_2.out1, Z=code_block_2.out2) { Point.ByCoordinates(X,Y,Z); }
byPoints = Polygon.ByPoints(points=code_block_3)
code_block_4 = CodeBlock(A=points_2) { A.X; A.Y; 0; }
code_block_5 = CodeBlock(X=code_block_4.out0, Y=code_block_4.out1, Z=code_block_4.out2) { Point.ByCoordinates(X,Y,Z); }
containmentTest = Polygon.ContainmentTest(polygon=byPoints, point=code_block_5)
filterByBoolMask = List.FilterByBoolMask(list=points_2, mask=containmentTest)
join = List.Join(list0=byCoordinates, list1=filterByBoolMask.out)
byPoints_2 = Topography.ByPoints(points=join)
passThrough = Custom[PassThrough](passThrough=select_topography, waitFor=byPoints_2)  # frozen; package archi-lab.net; Ripped this off from Clockwork. Sorry Andy.
delete = Element.Delete(element=passThrough)
faces = Element.Faces(element=select_floor)

# group: get just the top faces
code_block_6 = CodeBlock { 0.5; }
pointAtParameter = Surface.PointAtParameter(surface=faces, u=code_block_6, v=code_block_6)
Z_2 = Point.Z(point=pointAtParameter)
normalAtPoint = Surface.NormalAtPoint(surface=faces, point=pointAtParameter)
Z_3 = Vector.Z(vector=normalAtPoint)
code_block_7 = CodeBlock { 2; }
round = Math.Round(number=Z_3, digits=code_block_7)
code_block_8 = CodeBlock { 0; }
gt = round > code_block_8
filterByBoolMask_2 = List.FilterByBoolMask(list=faces, mask=gt)

# group: Display geometry
explode = Geometry.Explode(geometry=filterByBoolMask_2.in)

flatten_2 = List.Flatten(list=explode@L3)
