# Dynamo graph topographyMeter-LoadLegendObject.dyn (Dynamo 2.3.0.5885)
# packages: archi-lab.net 2020.23.2

code_block = CodeBlock { "Site"; }
byName = Category.ByName(name=code_block)
all_elements_of_category = ElementsOfCategory(Category=byName)
filter_planting_by_parameter = CodeBlock { "topographyMeter"; }

# group: Filter Type Comments
elementType = Element.ElementType(element=all_elements_of_category)
code_block_2 = CodeBlock { "Type Comments"; }
getParameterValueByName = Element.GetParameterValueByName(element=elementType, parameterName=code_block_2)
eq = getParameterValueByName == filter_planting_by_parameter
filterByBoolMask = List.FilterByBoolMask(list=all_elements_of_category, mask=eq)

# group: INPUT
cast_a_b_c = StringInput("B")

# group: Filter objekt
code_block_3 = CodeBlock { "SO-stavebny objekt"; }
getParameterValueByName_2 = Element.GetParameterValueByName(element=filterByBoolMask.in, parameterName=code_block_3)
filter_floors_by_stavebny_objekt = CodeBlock(A=cast_a_b_c) { "SO"+A+"002"; }
eq_2 = getParameterValueByName_2 == filter_floors_by_stavebny_objekt
filterByBoolMask_2 = List.FilterByBoolMask(list=filterByBoolMask.in, mask=eq_2)

code_block_4 = CodeBlock { "hlbka substratu"; }
location = FamilyInstance.Location(familyInstance=filterByBoolMask_2.in)
Z = Point.Z(point=location)
categories = Categories("OST_FlexPipeCurvesCenterLine")
all_elements_of_category_2 = ElementsOfCategory(Category=categories)
filter_floors_by_typ_strechy = CodeBlock(A=cast_a_b_c) { "zelena strecha "+A; }

# group: floor filter
code_block_5 = CodeBlock { "typ strechy"; }
getParameterValueByName_3 = Element.GetParameterValueByName(element=all_elements_of_category_2, parameterName=code_block_5)
eq_3 = getParameterValueByName_3 == filter_floors_by_typ_strechy
filterByBoolMask_3 = List.FilterByBoolMask(list=all_elements_of_category_2, mask=eq_3)

geometry = Element.Geometry(element=filterByBoolMask_3.in)
flatten = List.Flatten(list=geometry)

# group: union for floors overlaping in floorplan
byUnion = Solid.ByUnion(solids=flatten)

X = Point.X(point=location)
Y = Point.Y(point=location)

# group: lines from planting
code_block_6 = CodeBlock(a=Z) { a+2000; }
byCoordinates = Point.ByCoordinates(x=X, y=Y, z=code_block_6)
code_block_7 = CodeBlock(a=Z) { a-5000; }
byCoordinates_2 = Point.ByCoordinates(x=X, y=Y, z=code_block_7)
byStartPointEndPoint = Line.ByStartPointEndPoint(startPoint=byCoordinates, endPoint=byCoordinates_2)

intersect = Geometry.Intersect(geometry=byUnion, other=byStartPointEndPoint, lacing=Longest)
startPoint = Curve.StartPoint(curve=intersect)
Z_2 = Point.Z(point=startPoint)
code_block_8 = CodeBlock(b=Z, a=Z_2) { b-a; }

# group: minimum for multiple intersections
minimumItem = List.MinimumItem(list=code_block_8)

# group: round
code_block_9 = CodeBlock { 5; }
code_block_10 = CodeBlock(a=minimumItem, b=code_block_9) { a/b; }
round = Math.Round(number=code_block_10)
code_block_11 = CodeBlock(a=round, b=code_block_9) { a*b; }

# group: remove comma
string_from_object = FromObject(obj=code_block_11)
code_block_12 = CodeBlock { 0; ","; }
boolean = BoolSelector(true)
indexOf = String.IndexOf(str=string_from_object, searchFor=code_block_12.out1, ignoreCase=boolean)
substring = String.Substring(str=string_from_object, startIndex=code_block_12.out0, length=indexOf)

# group: null to "na terene"
string_from_object_2 = FromObject(obj=substring)
code_block_13 = CodeBlock { "null"; "na rastlom teréne"; }
replace = String.Replace(str=string_from_object_2, searchFor=code_block_13.out0, replaceWith=code_block_13.out1)

setParameterByName = Element.SetParameterByName(element=filterByBoolMask_2.in, parameterName=code_block_4, value=replace)

# group: height lines
byStartPointEndPoint_2 = Line.ByStartPointEndPoint(startPoint=location, endPoint=startPoint)

# group: Area of structural floors
code_block_14 = CodeBlock { "Structural"; }
getParameterValueByName_4 = Element.GetParameterValueByName(element=filterByBoolMask_3.in, parameterName=code_block_14)
code_block_15 = CodeBlock { 1; }
eq_4 = getParameterValueByName_4 == code_block_15
filterByBoolMask_4 = List.FilterByBoolMask(list=filterByBoolMask_3.in, mask=eq_4)
code_block_16 = CodeBlock { "Area"; }
getParameterValueByName_5 = Element.GetParameterValueByName(element=filterByBoolMask_4.in, parameterName=code_block_16)
sum = Math.Sum(values=getParameterValueByName_5)

# group: vykaz substratu
clear_list = Custom[Clear List](input=minimumItem)  # package archi-lab.net; This node will remove all Null and Empty Lists from any list.
average = Math.Average(numbers=clear_list)
priemerna_vyska = Watch(average)
code_block_17 = CodeBlock(average=average, plocha=sum) { average/1000*plocha; }
objem_substratu = Watch(code_block_17)

# group: assign load legend to visual filters in revit
code_block_18 = CodeBlock { "loadLegendGroup"; }
py_assign_loadlegend = Python(IN[0]=code_block_11)
# ---------- py_assign_loadlegend.python (43 lines) ----------
# Enable Python support and load DesignScript library
import clr
clr.AddReference('ProtoGeometry')
from Autodesk.DesignScript.Geometry import *

# The inputs to this node will be stored as a list in the IN variables.
#dataEnteringNode = IN
a = IN[0]
outputList = []
# Place your code below this line
for i in a:
	if i <= 500:
		outputList.append("loadLegend01")
	elif i <= 1000:
		outputList.append("loadLegend02")
	elif i <= 1100:
		outputList.append("loadLegend03")
	elif i <= 1300:
		outputList.append("loadLegend04")
	elif i <= 1500:
		outputList.append("loadLegend05")
	elif i <= 1800:
		outputList.append("loadLegend06")
	elif i <= 2000:
		outputList.append("loadLegend07")
	elif i <= 2300:
		outputList.append("loadLegend08")
	elif i <= 2500:
		outputList.append("loadLegend09")
	elif i <= 2800:
		outputList.append("loadLegend10")
	elif i <= 3000:
		outputList.append("loadLegend11")
	elif i <= 3200:
		outputList.append("loadLegend12")
	elif i <= 3300:
		outputList.append("loadLegend13")
	elif i <= 3700:
		outputList.append("loadLegend14")
	else:
		outputList.append("loadLegend15")
# Assign your output to the OUT variable.
OUT = outputList
# ----------------------------------------
setParameterByName_2 = Element.SetParameterByName(element=filterByBoolMask_2.in, parameterName=code_block_18, value=py_assign_loadlegend)

návod = StringInput("""Po rozmiestnení Site elementu Topographymeter  v rovnomernom rastri napr. 1x1m a hostovaní na Topography zapíše každému Site elementu do parametru "hlbka substratu" hrubku substratu na zelenej streche.

Do parametru loadLegendGroup sa nastaví tag podla ktoreho sa v revite nastavia farebne filtre pre zobrazenie farebnej mapy hrubky substratu resp. zatazeni.

Priemerna hrubka substratu * plocha strechy = objem zeminy,

Je mozne pridat odfiltrovanie chodnikov""")
py_log = Python()  # unwired: IN[0]
# ---------- py_log.python (37 lines) ----------
# Load the Python Standard and DesignScript Libraries
import sys
import clr
clr.AddReference('ProtoGeometry')
from Autodesk.DesignScript.Geometry import *
clr.AddReference("RevitServices")
import RevitServices
from RevitServices.Persistence import DocumentManager

from datetime import datetime
import getpass

# name of the script for log
log_string = "topographyMeter-LoadLegendObject"

doc = DocumentManager.Instance.CurrentDBDocument
filePath = doc.PathName

# getting file name from path
lastBackslash = filePath.rindex("\\")+1
file_name = filePath[lastBackslash:]
user_name = getpass.getuser()
datestamp = str(datetime.now())
# tabulator between data to easy import to excel schedule
separator = "\t"
line = datestamp + separator + log_string + separator + user_name + "\n"

try:
	f = open("L:\\customToolslogs\\dynLogs\\" + file_name +".log", "a")
	f.write(line)
	f.close()
	status = "log has been written"
except:
	status = "something went wrong"

# Assign your output to the OUT variable.
OUT = status
# ----------------------------------------
