# Dynamo graph topographyMeterSetOfPoints_p.dyn (Dynamo 2.3.0.5885)

# group: INPUTS
select_model_elements = DSModelElementsSelection()  # 1 picked in the model; graph input
select_floor = DSModelElementSelection()  # 1 picked in the model; graph input
návod = StringInput("Odmeria hrúbku substrátu medzi Site elementom hostovaným na Topography a oznacenym Floorom")  # graph input

location = FamilyInstance.Location(familyInstance=select_model_elements)
geometry = Element.Geometry(element=select_floor)
flatten = List.Flatten(list=geometry)

# group: union for floors overlaping in floorplan
byUnion = Solid.ByUnion(solids=flatten)

X = Point.X(point=location)
Y = Point.Y(point=location)
Z = Point.Z(point=location)

# group: lines from planting
code_block = CodeBlock(a=Z) { a+2000; }
byCoordinates = Point.ByCoordinates(x=X, y=Y, z=code_block)
code_block_2 = CodeBlock { -2000; }
byCoordinates_2 = Point.ByCoordinates(x=X, y=Y, z=code_block_2)
byStartPointEndPoint = Line.ByStartPointEndPoint(startPoint=byCoordinates, endPoint=byCoordinates_2)

intersect = Geometry.Intersect(geometry=byUnion, other=byStartPointEndPoint, lacing=Longest)
startPoint = Curve.StartPoint(curve=intersect)

# group: height lines
byStartPointEndPoint_2 = Line.ByStartPointEndPoint(startPoint=location, endPoint=startPoint)

code_block_3 = CodeBlock { "hlbka substratu"; 0; }
Z_2 = Point.Z(point=startPoint)
code_block_4 = CodeBlock(b=Z, a=Z_2) { b-a; }

# group: minimum for multiple intersections
minimumItem = List.MinimumItem(list=code_block_4)

# group: round
code_block_5 = CodeBlock { 50; }
code_block_6 = CodeBlock(a=minimumItem, b=code_block_5) { a/b; }
round = Math.Round(number=code_block_6)
code_block_7 = CodeBlock(a=round, b=code_block_5) { a*b; }

# group: remove comma
string_from_object = FromObject(obj=code_block_7)
code_block_8 = CodeBlock { 0; ","; }
boolean = BoolSelector(true)
indexOf = String.IndexOf(str=string_from_object, searchFor=code_block_8.out1, ignoreCase=boolean)
substring = String.Substring(str=string_from_object, startIndex=code_block_8.out0, length=indexOf)

setParameterByName = Element.SetParameterByName(element=select_model_elements, parameterName=code_block_3.out0, value=substring)
py_log = Python()  # unwired: IN[0]
# ---------- py_log.python (37 lines) ----------
# Load the Python Standard and DesignScript Libraries
import sys
import clr
clr.AddReference('ProtoGeometry')
from Autodesk.DesignScript.Geometry import *
clr.AddReference("RevitServices")
import RevitServices
from RevitServices.Persistence import DocumentManager

from datetime import datetime
import getpass

# name of the script for log
log_string = "topographyMeterSetOfPoints"

doc = DocumentManager.Instance.CurrentDBDocument
filePath = doc.PathName

# getting file name from path
lastBackslash = filePath.rindex("\\")+1
file_name = filePath[lastBackslash:]
user_name = getpass.getuser()
datestamp = str(datetime.now())
# tabulator between data to easy import to excel schedule
separator = "\t"
line = datestamp + separator + log_string + separator + user_name + "\n"

try:
	f = open("L:\\customToolslogs\\dynLogs\\" + file_name +".log", "a")
	f.write(line)
	f.close()
	status = "log has been written"
except:
	status = "something went wrong"

# Assign your output to the OUT variable.
OUT = status
# ----------------------------------------
