# Dynamo graph unhideInViews_p.dyn "unhideInViews" (Dynamo 2.12.1.8246)
# packages: archi-lab.net 2023.213.1523, Clockwork for Dynamo 2.x 2.4.0

code_block = CodeBlock { "Views"; }
byName = Category.ByName(name=code_block)
all_elements_of_category = ElementsOfCategory(Category=byName)

# group: INPUT
parameter_name = StringInput("Delenie I")  # graph input
parameter_value = StringInput("02_PSP")  # graph input
by_selection = BoolSelector(false)
categories = Categories("OST_Views")  # graph input
select_model_elements = DSModelElementsSelection()  # 2 picked in the model

getParameterValueByName = Element.GetParameterValueByName(element=all_elements_of_category, parameterName=parameter_name)
eq = getParameterValueByName == parameter_value
filterByBoolMask = List.FilterByBoolMask(list=all_elements_of_category, mask=eq)
all_elements_of_category_2 = ElementsOfCategory(Category=categories)
id = Element.Id(element=select_model_elements)
byID = Custom[Element.ByID](IdOrUniqueId=id)  # package Clockwork for Dynamo 2.x; Gets the Revit element(s) for a list of IDs (or a single ID). Optionally retrieves elements from linked documents as well.
if_ = RefactoredIf(test=by_selection, true=all_elements_of_category_2, false=byID)
unHideElements = archilab.Revit.Views.Views.UnHideElements(view=filterByBoolMask.in, elements=if_)
návod = StringInput("Zruší Hide Elements in View pre celú kategóriu. Zmena sa spravi vo Views, ktoré majú hodnotu parametra podľa filtra")  # graph input
