# Dynamo graph view to PNG_p.dyn (Dynamo 1.3.1.1736)

current = Document.Current()
activeView = Document.ActiveView(current)

# group: INPUT
file_path = Filename("No file selected.")

exportAsImage = View.ExportAsImage(activeView, file_path)
návod = StringInput("vyexportuje aktivny View ako bitmapu vo formate *.png")
