# Dynamo graph voidPanel.dyn (Dynamo 2.3.0.5885)
# packages: cata_lyst 0.0.1, spring nodes 204.1.0

# group: INPUT
file_path = Filename("img\nonuniformGradient.png")
panel_dimension = IntegerSlider(2500, range=100..3000 step 50)
panel_thickness = IntegerSlider(3, range=2..100 step 1)
step = IntegerSlider(35, range=10..100 step 1)
invert = BoolSelector(false)
min_void_diameter = IntegerSlider(10, range=1..30 step 1)

file_from_path = FileObject(path=file_path)
readFromFile = Image.ReadFromFile(file=file_from_path)
watch_image = WatchImageCore(image=readFromFile)

# group: panel outline
code_block = CodeBlock(x=panel_dimension) { Point.ByCoordinates(0,0); Point.ByCoordinates(0,x); Point.ByCoordinates(x,x); Point.ByCoordinates(x,0); }
list_create = List.Create(item0=code_block.out0, item1=code_block.out1, item2=code_block.out2, item3=code_block.out3)
code_block_2 = CodeBlock { true; }
byPoints = PolyCurve.ByPoints(points=list_create, connectLastToFirst=code_block_2)

code_block_3 = CodeBlock(x=panel_thickness) { -x; }
extrudeAsSolid = Curve.ExtrudeAsSolid(curve=byPoints, direction=code_block_3)
code_block_4 = CodeBlock(step=step, max=panel_dimension) { step..max-1..step; }
byCoordinates = Point.ByCoordinates(x=code_block_4, y=code_block_4, lacing=CrossProduct)
code_block_5 = CodeBlock(a=step) { 0; 1; (a/2)*0.85; }
count = List.Count(list=code_block_4)
pixels = Image.Pixels(image=readFromFile, xSamples=count, ySamples=count)
brightness = Color.Brightness(c=pixels)

# group: invert img
code_block_6 = CodeBlock(x=brightness) { 1-x; }
pyIF = Custom[pyIF](boolean=invert, ifFalse=code_block_6, ifTrue=brightness)  # package cata_lyst; proper IF made in python

mapTo = Math.MapTo(rangeMin=code_block_5.out0, rangeMax=code_block_5.out1, inputValue=pyIF, targetRangeMin=code_block_5.out0, targetRangeMax=code_block_5.out2)
round = Math.Round(number=mapTo)
flatten = List.Flatten(list=round)
code_block_7 = CodeBlock(d=min_void_diameter) { d/2; }

# group: min void dimension filter
flatten_2 = List.Flatten(list=byCoordinates)
ge = flatten >= code_block_7
filterByBoolMask = List.FilterByBoolMask(list=flatten_2, mask=ge)
filterByBoolMask_2 = List.FilterByBoolMask(list=flatten, mask=ge)

byCenterPointRadius = Circle.ByCenterPointRadius(centerPoint=filterByBoolMask.in, radius=filterByBoolMask_2.in)
extrudeAsSolid_2 = Curve.ExtrudeAsSolid(curve=byCenterPointRadius, direction=panel_thickness)
byUnion = Solid.ByUnion(solids=extrudeAsSolid_2)
differenceAll = Solid.DifferenceAll(solid=extrudeAsSolid, others=byUnion)

# group: create element in revit
categories = Categories("OST_CurtainWallPanels")
code_block_8 = CodeBlock { "perforatedPanel"; }
ꟿ_directshape_bygeometry = Custom[ꟿ DirectShape.ByGeometry](geometry=differenceAll, category=categories, name=code_block_8)  # package spring nodes; Convert the input geometry to DirectShape element inside the Revit document. It supports solids or surfaces. It is based on an alternative process that uses a SAT import and can produce smooth surfaces. Each created DS will have a unique type. Make sure that each input geometry has a unique name. You can either feed a single category for all geometries or a unique category for each geometry - the node's lacing is set to longest by default. The default category is Generic Models.

elementType = Element.ElementType(element=ꟿ_directshape_bygeometry)
code_block_9 = CodeBlock { "Description"; }

# group: total perforated area
code_block_10 = CodeBlock(r=filterByBoolMask_2.in) { 3.14*r*r/1000000; }
sum = Math.Sum(values=code_block_10)

code_block_11 = CodeBlock { 3; }
round_2 = Math.Round(number=sum, digits=code_block_11)
string_from_object = FromObject(obj=round_2)
setParameterByName = Element.SetParameterByName(element=elementType, parameterName=code_block_9, value=string_from_object)
návod = StringInput("Vytvorí panel ako DirectShape v kategórii Curtain Panel s perforáciou podľa bitmapy a zapíše celkovú plochu perforácie do Type parametru")
py_log = Python()  # unwired: IN[0]
# ---------- py_log.python (40 lines) ----------
# Load the Python Standard and DesignScript Libraries
import sys
import clr
clr.AddReference('ProtoGeometry')
from Autodesk.DesignScript.Geometry import *
clr.AddReference("RevitServices")
import RevitServices
from RevitServices.Persistence import DocumentManager

from datetime import datetime
import getpass

# name of the script for log
log_string = "voidPanel"

doc = DocumentManager.Instance.CurrentDBDocument
filePath = doc.PathName

# getting file name from path
try:
	lastBackslash = filePath.rindex("\\")+1
except:
	lastBackslash = filePath.rindex("/")+1
file_name = filePath[lastBackslash:]
user_name = getpass.getuser()
datestamp = str(datetime.now())
# tabulator between data to easy import to excel schedule
separator = "\t"
line = datestamp + separator + log_string + separator + user_name + "\n"

try:
	f = open("L:\\customToolslogs\\dynLogs\\" + file_name +".log", "a")
	f.write(line)
	f.close()
	status = "log has been written"
except:
	status = "something went wrong"

# Assign your output to the OUT variable.
OUT = status
# ----------------------------------------
