# Dynamo graph voronoiBasic.dyn (Dynamo 2.3.1.11775)
# packages: spring nodes 204.1.0, cata_lyst 0.0.1

# group: INPUT
panel_width = IntegerSlider(1000, range=1000..20000 step 200)
panel_length = IntegerSlider(1200, range=1000..20000 step 200)
frame_thickness = IntegerSlider(30, range=0..500 step 10)
offset_points = DoubleSlider(1.6, range=1..2 step 0.1)
number_of_cells = IntegerSlider(90, range=0..1000 step 1)
wall_thickness = IntegerSlider(10, range=0..500 step 1)
categories = Categories("OST_CurtainWallPanels")
string = StringInput("voronoiBasic 01")

byWidthLength = Rectangle.ByWidthLength(width=panel_width, length=panel_length)
patch = Curve.Patch(curve=byWidthLength)
code_block = CodeBlock(frameThickness=frame_thickness) { frameThickness; }
thicken = Surface.Thicken(surface=patch, thickness=code_block)

# group: offset rectangle
code_block_2 = CodeBlock(a=panel_width, offset=offset_points) { a*offset; }
code_block_3 = CodeBlock(a=panel_length, offset=offset_points) { a*offset; }
byWidthLength_2 = Rectangle.ByWidthLength(width=code_block_2, length=code_block_3)
patch_2 = Curve.Patch(curve=byWidthLength_2)

randomList = Math.RandomList(amount=number_of_cells)
randomList_2 = Math.RandomList(amount=number_of_cells)
pointAtParameter = Surface.PointAtParameter(surface=patch_2, u=randomList, v=randomList_2)
UVParameterAtPoint = Surface.UVParameterAtPoint(surface=patch_2, point=pointAtParameter)
byParametersOnSurface = Tessellation.Voronoi.ByParametersOnSurface(uvs=UVParameterAtPoint, face=patch_2)
code_block_4 = CodeBlock { 500; }
extrude = Curve.Extrude(curve=byParametersOnSurface, distance=code_block_4)
code_block_5 = CodeBlock(a=code_block_4) { -a/2; }
translate = Geometry.Translate(geometry=extrude, zTranslation=code_block_5)
byJoinedSurfaces = PolySurface.ByJoinedSurfaces(surfaces=translate)
split = Geometry.Split(geometry=patch, other=byJoinedSurfaces)
perimeterCurves = Surface.PerimeterCurves(surface=split)
endPoint = Curve.EndPoint(curve=perimeterCurves)
code_block_6 = CodeBlock { true; }
byPoints = PolyCurve.ByPoints(points=endPoint, connectLastToFirst=code_block_6)
code_block_7 = CodeBlock(x=wall_thickness) { -1*x; }
boolean = BoolSelector(false)
offset = PolyCurve.Offset(polyCurve=byPoints, signedDistance=code_block_7, extendCircular=boolean)
removeNullsV2 = Custom[RemoveNullsV2](obj=offset)  # package cata_lyst; remove nulls from list
byPatch = Surface.ByPatch(closedCurve=removeNullsV2)
removeNullsV2_2 = Custom[RemoveNullsV2](obj=byPatch)
thicken_2 = Surface.Thicken(surface=removeNullsV2_2, thickness=code_block)
byUnion = Solid.ByUnion(solids=thicken_2)
differenceAll = Solid.DifferenceAll(solid=thicken, others=byUnion)
code_block_8 = CodeBlock(categoryFromInput=categories) { categoryFromInput; }
ꟿ_directshape_bygeometry = Custom[ꟿ DirectShape.ByGeometry](geometry=differenceAll, category=code_block_8, name=string)  # package spring nodes; Convert the input geometry to DirectShape element inside the Revit document. It supports solids or surfaces. It is based on an alternative process that uses a SAT import and can produce smooth surfaces. Each created DS will have a unique type. Make sure that each input geometry has a unique name. You can either feed a single category for all geometries or a unique category for each geometry - the node's lacing is set to longest by default. The default category is Generic Models.

# group: plocha perforacie
area = Surface.Area(surface=byPatch)
sum = Math.Sum(values=area)
code_block_9 = CodeBlock(area=sum) { area/1000/1000; }

# group: setting parameters
code_block_10 = CodeBlock()
# ---------- code_block_10.designscript (3 lines) ----------
["Comments",
"Width",
"Height"];
# ----------------------------------------
string_from_object = FromObject(obj=code_block_9)
list_create = List.Create(item0=string_from_object, item1=panel_width, item2=panel_length)
setParameterByName = Element.SetParameterByName(element=ꟿ_directshape_bygeometry, parameterName=code_block_10@L1, value=list_create@L1)

area_2 = CodeBlock(width=panel_width, height=panel_length, perforation=code_block_9) { (width*height)/1000/1000-perforation; }
návod = StringInput("""Vygeneruje panel s náhodným Voronoi delením s určenou hustotou podľa - number of cells

pri artefaktoch na okraji panelu zvýšte hodnotu parametru - offset points""")  # graph input
code_block_11 = CodeBlock { "voronoiBasic"; }
usageLog = Custom[usageLog](scriptName=code_block_11)  # package cata_lyst; node logs every run of the script in which is used to the hardcoded server location
