# Dynamo graph voronoiBeams.dyn (Dynamo 2.3.1.11775)
# packages: cata_lyst 0.0.1

# group: INPUTS
overall_construction_dimension = IntegerSlider(16600, range=1000..20000 step 200)
offset_points = DoubleSlider(1.4, range=1..2 step 0.1)
number_of_cells = IntegerSlider(170, range=0..500 step 1)
levels = Levels("Level 1")
family_types = FamilyTypes("UB-Universal Beams:UB254x102x28")

# group: Circle
code_block = CodeBlock(a=overall_construction_dimension) { a/2; }
byCenterPointRadius = Circle.ByCenterPointRadius(radius=code_block)

patch = Curve.Patch(curve=byCenterPointRadius)

# group: offset rectangle
code_block_2 = CodeBlock(a=overall_construction_dimension, offset=offset_points) { a*offset; }
code_block_3 = CodeBlock(a=overall_construction_dimension, offset=offset_points) { a*offset; }
byWidthLength = Rectangle.ByWidthLength(width=code_block_2, length=code_block_3)
patch_2 = Curve.Patch(curve=byWidthLength)

randomList = Math.RandomList(amount=number_of_cells)
randomList_2 = Math.RandomList(amount=number_of_cells)
pointAtParameter = Surface.PointAtParameter(surface=patch_2, u=randomList, v=randomList_2)
UVParameterAtPoint = Surface.UVParameterAtPoint(surface=patch_2, point=pointAtParameter)
byParametersOnSurface = Tessellation.Voronoi.ByParametersOnSurface(uvs=UVParameterAtPoint, face=patch_2)
code_block_4 = CodeBlock { 500; }
extrude = Curve.Extrude(curve=byParametersOnSurface, distance=code_block_4)
code_block_5 = CodeBlock(a=code_block_4) { -a/2; }
translate = Geometry.Translate(geometry=extrude, zTranslation=code_block_5)
byJoinedSurfaces = PolySurface.ByJoinedSurfaces(surfaces=translate)
split = Geometry.Split(geometry=patch, other=byJoinedSurfaces)
perimeterCurves = Surface.PerimeterCurves(surface=split)
flatten = List.Flatten(list=perimeterCurves)

# group: removing duplicate and reversed duplicate curves
startPoint = Curve.StartPoint(curve=flatten)
endPoint = Curve.EndPoint(curve=flatten)
python_script = Python(IN[0]=startPoint, IN[1]=endPoint)
# ---------- python_script.python (24 lines) ----------
# Load the Python Standard and DesignScript Libraries
import sys
import clr
clr.AddReference('ProtoGeometry')
from Autodesk.DesignScript.Geometry import *

# The inputs to this node will be stored as a list in the IN variables.
start_points = IN[0]
end_points = IN[1]

# Place your code below this line
lines = zip(start_points,end_points)
# all lines - reversed and not reversed
all_lines = []
masks = []
for line in lines:
	if line not in all_lines and line[::-1] not in all_lines:
		all_lines.append(line)
		masks.append(True)
	else:
		masks.append(False)

# Assign your output to the OUT variable.
OUT = masks
# ----------------------------------------
filterByBoolMask = List.FilterByBoolMask(list=flatten, mask=python_script)

code_block_6 = CodeBlock(level=levels) { level; }
code_block_7 = CodeBlock(beamType=family_types) { beamType; }
beamByCurve = StructuralFraming.BeamByCurve(curve=filterByBoolMask.in, level=code_block_6, structuralFramingType=code_block_7)
py_disallow_join = Python(IN[0]=beamByCurve)
# ---------- py_disallow_join.python (21 lines) ----------
import clr
clr.AddReference('RevitServices')
import RevitServices
from RevitServices.Persistence import DocumentManager
from RevitServices.Transactions import TransactionManager
clr.AddReference('RevitAPI')
from Autodesk.Revit.DB.Structure import StructuralFramingUtils

doc = DocumentManager.Instance.CurrentDBDocument
st_framings = UnwrapElement(IN[0])
success, failure = [],[]
for st_framing in st_framings:
	try:
		TransactionManager.Instance.EnsureInTransaction(doc)
		StructuralFramingUtils.DisallowJoinAtEnd(st_framing,0)
		StructuralFramingUtils.DisallowJoinAtEnd(st_framing,1)
		TransactionManager.Instance.TransactionTaskDone()
		success.append(st_framing)
	except:
		failure.append("Failure: Element category" +str(st_framing.Category.Name))
OUT = (success,failure)
# ----------------------------------------
points_for_random_nurbs = IntegerSlider(3, range=2..4 step 1)

# group: NURBS
randomList_3 = Math.RandomList(amount=points_for_random_nurbs)
pointAtParameter_2 = Curve.PointAtParameter(curve=byWidthLength, param=randomList_3)
code_block_8 = CodeBlock { 2; }
code_block_9 = CodeBlock { true; }
byControlPoints = NurbsCurve.ByControlPoints(points=pointAtParameter_2, degree=code_block_8, closeCurve=code_block_9)

návod = StringInput("""Vygeneruje Beams s náhodným Voronoi delením s určenou hustotou podľa - number of cells

pri artefaktoch na okraji panelu zvýšte hodnotu parametru - offset points""")  # graph input
code_block_10 = CodeBlock { "voronoiBeams"; }
usageLog = Custom[usageLog](scriptName=code_block_10)  # package cata_lyst; node logs every run of the script in which is used to the hardcoded server location
