# Dynamo graph voronoiRoundUniform.dyn (Dynamo 2.3.1.11775)
# packages: cata_lyst 0.0.1, spring nodes 204.1.0

# group: INPUTS
panel_width = IntegerSlider(1200, range=1000..20000 step 200)
panel_length = IntegerSlider(1200, range=1000..20000 step 200)
offset_points = DoubleSlider(1.4, range=1..2 step 0.1)
number_of_cells = IntegerSlider(9, range=1..50 step 1)
off_axis_movement = DoubleSlider(0.632, range=0..1 step 0.001)
wall_thickness = IntegerSlider(20, range=0..500 step 10)
frame_thickness = IntegerSlider(50, range=0..500 step 10)
categories = Categories("OST_CurtainWallPanels")
family_name = StringInput("voronoiRoundUniform 01")

byWidthLength = Rectangle.ByWidthLength(width=panel_width, length=panel_length)
patch = Curve.Patch(curve=byWidthLength)

# group: offset rectangle
code_block = CodeBlock(a=panel_width, offset=offset_points) { a*offset; }
code_block_2 = CodeBlock(a=panel_length, offset=offset_points) { a*offset; }
byWidthLength_2 = Rectangle.ByWidthLength(width=code_block, length=code_block_2)
patch_2 = Curve.Patch(curve=byWidthLength_2)

code_block_3 = CodeBlock(step=number_of_cells) { 0..1..#step; }
code_block_4 = CodeBlock(a=number_of_cells) { [0,a-1]; }
removeItemAtIndex = List.RemoveItemAtIndex(list=code_block_3, indices=code_block_4)
pointAtParameter = Surface.PointAtParameter(surface=patch_2, u=removeItemAtIndex, v=removeItemAtIndex, lacing=CrossProduct)
flatten = List.Flatten(list=pointAtParameter)
grid_width = CodeBlock(count=panel_length, length=number_of_cells, seed=off_axis_movement) { count/length*seed; }
code_block_5 = CodeBlock(x=grid_width) { -1*x; }
count = List.Count(list=flatten)
ofRepeatedItem = List.OfRepeatedItem(item=code_block_5, amount=count)
random = Math.Random(value1=ofRepeatedItem, value2=grid_width)
random_2 = Math.Random(value1=ofRepeatedItem, value2=grid_width)
translate = Geometry.Translate(geometry=flatten, xTranslation=random, yTranslation=random_2)
UVParameterAtPoint = Surface.UVParameterAtPoint(surface=patch_2, point=translate)
byParametersOnSurface = Tessellation.Voronoi.ByParametersOnSurface(uvs=UVParameterAtPoint, face=patch_2)
code_block_6 = CodeBlock { 500; }
extrude = Curve.Extrude(curve=byParametersOnSurface, distance=code_block_6)
code_block_7 = CodeBlock(a=code_block_6) { -a/2; }
translate_2 = Geometry.Translate(geometry=extrude, zTranslation=code_block_7)
byJoinedSurfaces = PolySurface.ByJoinedSurfaces(surfaces=translate_2)
split = Geometry.Split(geometry=patch, other=byJoinedSurfaces)
perimeterCurves = Surface.PerimeterCurves(surface=split)
# note: get midpoints
getMidpoint = Custom[getMidpoint](curve=perimeterCurves)  # package cata_lyst; gets midpoint of straight curve
code_block_8 = CodeBlock { true; }
byPoints = NurbsCurve.ByPoints(points=getMidpoint, closeCurve=code_block_8)
code_block_9 = CodeBlock(x=wall_thickness) { x; }
ꟿ_closedcurve_offset = Custom[ꟿ ClosedCurve.Offset+](curve=byPoints, distance=code_block_9)  # package spring nodes; Offsets a curve both ways and correctly differenciates the external and internal offset. If an offset goes beyond the curve's bounds, the result will fail and a null value will be appended instead. Also works for convex curves like arcs.
byPatch = Surface.ByPatch(closedCurve=ꟿ_closedcurve_offset.internal_offset)
removeNullsV2 = Custom[RemoveNullsV2](obj=byPatch)  # package cata_lyst; remove nulls from list

# group: plocha perforacie
area = Surface.Area(surface=removeNullsV2)
sum = Math.Sum(values=area)
code_block_10 = CodeBlock(area=sum) { area/1000/1000; }

area_2 = CodeBlock(width=panel_width, height=panel_length, perforation=code_block_10) { (width*height)/1000/1000-perforation; }
code_block_11 = CodeBlock(frameThickness=frame_thickness) { frameThickness; }
thicken = Surface.Thicken(surface=patch, thickness=code_block_11)
thicken_2 = Surface.Thicken(surface=removeNullsV2, thickness=code_block_11)
byUnion = Solid.ByUnion(solids=thicken_2)
differenceAll = Solid.DifferenceAll(solid=thicken, others=byUnion)
code_block_12 = CodeBlock(categoryFromInput=categories) { categoryFromInput; }
ꟿ_directshape_bygeometry = Custom[ꟿ DirectShape.ByGeometry](geometry=differenceAll, category=code_block_12, name=family_name)  # package spring nodes; Convert the input geometry to DirectShape element inside the Revit document. It supports solids or surfaces. It is based on an alternative process that uses a SAT import and can produce smooth surfaces. Each created DS will have a unique type. Make sure that each input geometry has a unique name. You can either feed a single category for all geometries or a unique category for each geometry - the node's lacing is set to longest by default. The default category is Generic Models.

# group: set parameters
code_block_13 = CodeBlock()
# ---------- code_block_13.designscript (3 lines) ----------
["Comments",
"Width",
"Height"];
# ----------------------------------------
string_from_object = FromObject(obj=code_block_10)
list_create = List.Create(item0=string_from_object, item1=panel_width, item2=panel_length)
setParameterByName = Element.SetParameterByName(element=ꟿ_directshape_bygeometry, parameterName=code_block_13@L1, value=list_create@L1)

návod = StringInput("""Vygeneruje panel s náhodným ale normalizovaným Voronoi delením, do ktorého sú vpísané oblé NURBS krivky

hustotu určuje parameter - number of cells

normalizácia sa určuje parametrom - off axis movement

pri artefaktoch na okraji panelu zvýšte hodnotu parametru - offset points""")  # graph input
code_block_14 = CodeBlock { "voronoiRoundUniform"; }
usageLog = Custom[usageLog](scriptName=code_block_14)  # package cata_lyst; node logs every run of the script in which is used to the hardcoded server location
