# Dynamo graph voronoiUniformFillet.dyn (Dynamo 2.3.1.11775)
# packages: cata_lyst 0.0.1, spring nodes 204.1.0

# group: INPUT
panel_width = IntegerSlider(1200, range=1000..20000 step 200)
panel_length = IntegerSlider(1200, range=1000..20000 step 200)
frame_thickness = IntegerSlider(100, range=0..500 step 10)
offset_points = DoubleSlider(1.6, range=1..2 step 0.1)
number_of_cells = IntegerSlider(9, range=1..50 step 1)
off_axis_movement = DoubleSlider(0.451, range=0..1 step 0.001)
wall_thickness = IntegerSlider(20, range=0..500 step 10)
fillet_radius = IntegerSlider(45, range=0..250 step 5)
categories = Categories("OST_CurtainWallPanels")
family_name = StringInput("voronoiUniformFillet 01")

byWidthLength = Rectangle.ByWidthLength(width=panel_width, length=panel_length)
patch = Curve.Patch(curve=byWidthLength)
code_block = CodeBlock(frameThickness=frame_thickness) { frameThickness; }
thicken = Surface.Thicken(surface=patch, thickness=code_block)

# group: offset rectangle
code_block_2 = CodeBlock(a=panel_width, offset=offset_points) { a*offset; }
code_block_3 = CodeBlock(a=panel_length, offset=offset_points) { a*offset; }
byWidthLength_2 = Rectangle.ByWidthLength(width=code_block_2, length=code_block_3)
patch_2 = Curve.Patch(curve=byWidthLength_2)

code_block_4 = CodeBlock(step=number_of_cells) { 0..1..#step; }
code_block_5 = CodeBlock(a=number_of_cells) { [0,a-1]; }
removeItemAtIndex = List.RemoveItemAtIndex(list=code_block_4, indices=code_block_5)
pointAtParameter = Surface.PointAtParameter(surface=patch_2, u=removeItemAtIndex, v=removeItemAtIndex, lacing=CrossProduct)
flatten = List.Flatten(list=pointAtParameter)
grid_width = CodeBlock(length=panel_length, count=number_of_cells, seed=off_axis_movement) { length/count*seed; }
code_block_6 = CodeBlock(x=grid_width) { -1*x; }
count = List.Count(list=flatten)
ofRepeatedItem = List.OfRepeatedItem(item=code_block_6, amount=count)
random = Math.Random(value1=ofRepeatedItem, value2=grid_width)
random_2 = Math.Random(value1=ofRepeatedItem, value2=grid_width)
translate = Geometry.Translate(geometry=flatten, xTranslation=random, yTranslation=random_2)
UVParameterAtPoint = Surface.UVParameterAtPoint(surface=patch_2, point=translate)
byParametersOnSurface = Tessellation.Voronoi.ByParametersOnSurface(uvs=UVParameterAtPoint, face=patch_2)
code_block_7 = CodeBlock { 500; }
extrude = Curve.Extrude(curve=byParametersOnSurface, distance=code_block_7)
code_block_8 = CodeBlock(a=code_block_7) { -a/2; }
translate_2 = Geometry.Translate(geometry=extrude, zTranslation=code_block_8)
byJoinedSurfaces = PolySurface.ByJoinedSurfaces(surfaces=translate_2)
split = Geometry.Split(geometry=patch, other=byJoinedSurfaces)
perimeterCurves = Surface.PerimeterCurves(surface=split)
endPoint = Curve.EndPoint(curve=perimeterCurves)
code_block_9 = CodeBlock { true; }
byPoints = PolyCurve.ByPoints(points=endPoint, connectLastToFirst=code_block_9)
code_block_10 = CodeBlock(x=wall_thickness) { -x; }
offset = Curve.Offset(curve=byPoints, distance=code_block_10)
removeNullsV2 = Custom[RemoveNullsV2](obj=offset)  # package cata_lyst; remove nulls from list
byJoinedCurves = PolyCurve.ByJoinedCurves(curves=removeNullsV2@L1)
code_block_11 = CodeBlock()
# ---------- code_block_11.designscript (2 lines) ----------
[false,
true];
# ----------------------------------------
fillet = PolyCurve.Fillet(polyCurve=byJoinedCurves, radius=fillet_radius, rightSide=code_block_11@L1)
byPatch = Surface.ByPatch(closedCurve=fillet)
# note: niektore polycurves su pravotocive a niektore lavotocive
code_block_12 = CodeBlock(a=byPatch) { a[0]; }
code_block_13 = CodeBlock(a=byPatch) { a[1]; }
intersect = Geometry.Intersect(geometry=code_block_12, other=code_block_13)
removeNullsV2_2 = Custom[RemoveNullsV2](obj=intersect)
thicken_2 = Surface.Thicken(surface=removeNullsV2_2, thickness=code_block)
byUnion = Solid.ByUnion(solids=thicken_2)
differenceAll = Solid.DifferenceAll(solid=thicken, others=byUnion)
code_block_14 = CodeBlock(categoryFromInput=categories) { categoryFromInput; }
code_block_15 = CodeBlock(name=family_name) { name; }
ꟿ_directshape_bygeometry = Custom[ꟿ DirectShape.ByGeometry](geometry=differenceAll, category=code_block_14, name=code_block_15)  # package spring nodes; Convert the input geometry to DirectShape element inside the Revit document. It supports solids or surfaces. It is based on an alternative process that uses a SAT import and can produce smooth surfaces. Each created DS will have a unique type. Make sure that each input geometry has a unique name. You can either feed a single category for all geometries or a unique category for each geometry - the node's lacing is set to longest by default. The default category is Generic Models.

# group: plocha perforacie
area = Surface.Area(surface=intersect@L1)
sum = Math.Sum(values=area)
code_block_16 = CodeBlock(area=sum) { area/1000/1000; }

# group: set parameters
code_block_17 = CodeBlock()
# ---------- code_block_17.designscript (3 lines) ----------
["Comments",
"Width",
"Height"];
# ----------------------------------------
string_from_object = FromObject(obj=code_block_16)
list_create = List.Create(item0=string_from_object, item1=panel_width, item2=panel_length)
setParameterByName = Element.SetParameterByName(element=ꟿ_directshape_bygeometry, parameterName=code_block_17@L1, value=list_create@L1)

area_2 = CodeBlock(width=panel_width, height=panel_length, perforation=code_block_16) { (width*height)/1000/1000-perforation; }
code_block_18 = CodeBlock { "aluminium"; }
byName = Material.ByName(name=code_block_18)
byGeometry = DirectShape.ByGeometry(geometry=differenceAll, category=code_block_14, material=byName, name=code_block_15)  # frozen
návod = StringInput("""Vygeneruje panel s náhodným ale normalizovaným Voronoi delením so zaoblenými rohmi

hustotu určuje parameter - number of cells

normalizácia sa určuje parametrom - off axis movement

pri artefaktoch na okraji panelu zvýšte hodnotu parametru - offset points""")  # graph input
code_block_19 = CodeBlock { "voronoiUniformFillet"; }
usageLog = Custom[usageLog](scriptName=code_block_19)  # package cata_lyst; node logs every run of the script in which is used to the hardcoded server location
