# Dynamo graph wallAllowJoin_p.dyn "wallAllowJoin" (Dynamo 2.0.1.5055)

# group: INPUT
select_model_elements = DSModelElementsSelection()  # nothing selected; graph input

# group: treat list of elements and one element as well
list_create = List.Create(item0=select_model_elements)
flatten = List.Flatten(list=list_create)

py_allow_wall_join = Python(IN[0]=flatten)
# ---------- py_allow_wall_join.python (21 lines) ----------
import clr
clr.AddReference('RevitServices')
import RevitServices
from RevitServices.Persistence import DocumentManager
from RevitServices.Transactions import TransactionManager
clr.AddReference('RevitAPI')
from Autodesk.Revit.DB import WallUtils

doc = DocumentManager.Instance.CurrentDBDocument
Walls = UnwrapElement(IN[0])
success, failure = [],[]
for wall in Walls:
	# try:
		TransactionManager.Instance.EnsureInTransaction(doc)
		WallUtils.AllowWallJoinAtEnd(wall,0)
		WallUtils.AllowWallJoinAtEnd(wall,1)
		TransactionManager.Instance.TransactionTaskDone()
		success.append(wall)
	# except:
	# 	failure.append("Failure: Element category" +str(wall.Category.Name))
OUT = (success,failure)
# ----------------------------------------
návod = StringInput("Všetkým označeným Walls (len system families) nastaví na oboch koncoch Allow wall join")  # graph input
