# Dynamo graph window_flip_checker_p.dyn (Dynamo 2.3.0.5885)
# packages: archi-lab.net 2020.23.2

# group: INPUT
categories = Categories("OST_Windows")
select_phase = RevitPhases()  # nothing selected; graph input
parameter_name = StringInput("Comments")  # graph input

all_elements_of_category = ElementsOfCategory(Category=categories)
door_set_handing = Custom[Door Set Handing](door=all_elements_of_category, phase=select_phase)  # package archi-lab.net; Determines door set handing (whether its a left or right handed door). Input takes doors, and output will split them into two lists (right and left).
code_block = CodeBlock(a=parameter_name) { a; "no"; "reversed"; }
setParameterByName = Element.SetParameterByName(element=door_set_handing.rightHandedReversed, parameterName=code_block.a, value=code_block.out1)
setParameterByName_2 = Element.SetParameterByName(element=door_set_handing.leftHandedReversed, parameterName=code_block.a, value=code_block.out2)
návod = StringInput("Vsetkym oknam v projekte zapise do parametru urcenom v \"Parameter Name\" informaciu o tom ci bolo dane okno flipovane alebo mirrorovane. Okna je mozne filtrovat podla fazy.\n \n\"no\" resp. \"reversed\"\n\nJe potrebne doinstalovat Package \"Achi-lab\"")  # graph input
setParameterByName_3 = Element.SetParameterByName(element=door_set_handing.rightHanded, parameterName=code_block.a, value=code_block.out2)
setParameterByName_4 = Element.SetParameterByName(element=door_set_handing.leftHanded, parameterName=code_block.a, value=code_block.out1)
py_log = Python()  # unwired: IN[0]
# ---------- py_log.python (37 lines) ----------
# Load the Python Standard and DesignScript Libraries
import sys
import clr
clr.AddReference('ProtoGeometry')
from Autodesk.DesignScript.Geometry import *
clr.AddReference("RevitServices")
import RevitServices
from RevitServices.Persistence import DocumentManager

from datetime import datetime
import getpass

# name of the script for log
log_string = "window flip checker"

doc = DocumentManager.Instance.CurrentDBDocument
filePath = doc.PathName

# getting file name from path
lastBackslash = filePath.rindex("\\")+1
file_name = filePath[lastBackslash:]
user_name = getpass.getuser()
datestamp = str(datetime.now())
# tabulator between data to easy import to excel schedule
separator = "\t"
line = datestamp + separator + log_string + separator + user_name + "\n"

try:
	f = open("L:\\customToolslogs\\dynLogs\\" + file_name +".log", "a")
	f.write(line)
	f.close()
	status = "log has been written"
except:
	status = "something went wrong"

# Assign your output to the OUT variable.
OUT = status
# ----------------------------------------
