# Dynamo graph template.dyn (Dynamo 2.3.0.5885)

# group: INPUT
# note: Place inputs for Dynamo Player

# group: Filter
# note: filtering elements

# group: Error handling
# note: Treating errors as hints to user what to do to avoid the error

návod = StringInput("""Návod, ktorý uvidí používateľ v Dynamo Playeri.

Je potrebné mať nainštalované packages...""")  # graph input
# note: python IF statement, pretoze IF node v dyname casto nefunguje ako ma
pyIF = Python()  # unwired: IN[0], IN[1], IN[2]
# ---------- pyIF.python (20 lines) ----------
# Load the Python Standard and DesignScript Libraries
import sys
import clr
clr.AddReference('ProtoGeometry')
from Autodesk.DesignScript.Geometry import *

# The inputs to this node will be stored as a list in the IN variables.
boolean = IN[0]
true = IN[1]
false = IN[2]

# Place your code below this line
if boolean == 1:
	result = true
elif boolean == 0:
	result = false
else:
	result = null
# Assign your output to the OUT variable.
OUT = result
# ----------------------------------------

# group: OUTPUT
# note: Place output for Dynamo Player
OUTPUT = Watch()  # graph output; unwired: arg0

# note: python FilterElementCollector
py_filterelementcollector = Python()
# ---------- py_filterelementcollector.python (24 lines) ----------
# Load the Python Standard and DesignScript Libraries
import sys
import clr
clr.AddReference('ProtoGeometry')
from Autodesk.DesignScript.Geometry import *

clr.AddReference("RevitServices")
clr.AddReference("RevitAPI")
import RevitServices
from RevitServices.Persistence import DocumentManager
from Autodesk.Revit import DB

doc = DocumentManager.Instance.CurrentDBDocument
uiapp = DocumentManager.Instance.CurrentUIApplication
app = uiapp.Application

rooms = DB.FilteredElementCollector(doc).OfCategory(DB.BuiltInCategory.OST_Rooms).WhereElementIsNotElementType().ToElements()
areas = []
for room in rooms:
	area = room.LookupParameter("Area").AsDouble()
	areas.append(area*0.3048*0.3048)

# Assign your output to the OUT variable.
OUT = areas
# ----------------------------------------
# note: Logovanie pre analytiku
# uprav nazov skriptu
py_log = Python()  # unwired: IN[0]
# ---------- py_log.python (37 lines) ----------
# Load the Python Standard and DesignScript Libraries
import sys
import clr
clr.AddReference('ProtoGeometry')
from Autodesk.DesignScript.Geometry import *
clr.AddReference("RevitServices")
import RevitServices
from RevitServices.Persistence import DocumentManager

from datetime import datetime
import getpass

# name of the script for log
log_string = "Nazov scriptu"

doc = DocumentManager.Instance.CurrentDBDocument
filePath = doc.PathName

# getting file name from path
lastBackslash = filePath.rindex("\\")+1
file_name = filePath[lastBackslash:]
user_name = getpass.getuser()
datestamp = str(datetime.now())
# tabulator between data to easy import to excel schedule
separator = "\t"
line = datestamp + separator + log_string + separator + user_name + "\n"

try:
	f = open("L:\\customToolslogs\\dynLogs\\" + file_name +".log", "a")
	f.write(line)
	f.close()
	status = "log has been written"
except:
	status = "something went wrong"

# Assign your output to the OUT variable.
OUT = status
# ----------------------------------------
